# Grasshopper definition INSTALL.gh (Grasshopper 1.0.7)
# plug-ins: Human UI, EleFront, Human, LunchBox, Pufferfish, MetaHopper, Weaverbird, Spectacles.GrasshopperExporter

rhatt = GetRhinoAttributes()  # -> Name, Layer, Color
addelems = AddElements(DoVLChecking=True)  # -> AddedElements, ElementNames
sortbytype = SortObjectsByType()  # -> Points, Curves, Surfaces, Breps, Meshes, TextObjects, HatchObjects, LightObjects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
quads = QuadPanels(UDivisions=10, VDivisions=10)
offsrf = OffsetSurface(Distance=1, BothSides=False, CreateSolid=True)
bake = BakeObject(Bake=False)
wbcatmullclark = WeaverbirdsCatmullClarkSubdivision(Level=1, SmoothNakedEdges=1)
spectacles_viewer = LaunchSpectaclesViewer(URL="http://tt-acm.github.io/Spectacles.WebViewer/", LaunchBoolean=False)
docinfo = DocumentInfo(AutoUpdate=True, Recursive=True)  # -> DocumentName, DocumentFilePath, Components, Params, _3rdPartyAssemblies
lng = ListLength(List=docinfo._3rdPartyAssemblies)
file_path = Panel(docinfo._3rdPartyAssemblies)
panel = Panel(lng)
