# Grasshopper definition N O A H_v.1.0.gh (Grasshopper 1.0.7)
# plug-ins: Human UI, Pufferfish, Human, Spectacles.GrasshopperExporter, LunchBox, Weaverbird, MetaHopper

# ---- group: ui | T | I N F O / ui | F | UI DIMENSIONS
panel = Panel("UI Dimensions (experimental)")
ui_width = Slider(320, range=1..5000)
ui_height = Slider(555, range=1..5000)
number_slider = Slider(12, range=0..100)
panel_2 = Panel("SAVE UI SETTINGS")
panel_3 = Panel("LOAD UI SETTINGS")
create_button = CreateButton(ButtonName=panel_2, ButtonStyle=0)
create_button_2 = CreateButton(ButtonName=panel_3, ButtonStyle=0)
_8_create_slider = CreateSlider(
    Slider=number_slider,
    SnapValue=1,
    ShowBounds=False,
    ShowTicks=False,
    ShowTooltip=False,
    ShowValLabel=True,
    showLabel=True)
_8_create_slider_2 = CreateSlider(Slider=ui_width, SnapValue=1, ShowBounds=False, ShowTicks=False, ShowTooltip=False, ShowValLabel=True, showLabel=True)
_8_create_slider_3 = CreateSlider(Slider=ui_height, SnapValue=1, ShowBounds=False, ShowTicks=False, ShowTooltip=False, ShowValLabel=True, showLabel=True)
_0_create_label = CreateLabel(LabelText=panel, LabelSize=12, Justification=0)
value_listener = ValueListener(Elements=create_button, SomeProperty=True)  # -> Values, Indices
value_listener_2 = ValueListener(Elements=create_button_2, SomeProperty=True)  # -> Values, Indices
value_listener_3 = ValueListener(Elements=_8_create_slider, SomeProperty=True)  # -> Values, Indices
value_listener_4 = ValueListener(Elements=_8_create_slider_2, SomeProperty=True)  # -> Values, Indices
value_listener_5 = ValueListener(Elements=_8_create_slider_3, SomeProperty=True)  # -> Values, Indices
separator = CreateSeparator(Thickness=10, Horizontal=True, Color=RGB(38, 38, 38))
separator_2 = CreateSeparator(Thickness=10, Horizontal=True, Color=RGB(38, 38, 38))
separator_3 = CreateSeparator(Thickness=10, Horizontal=True, Color=RGB(38, 38, 38))
l_buttons = Merge(Data1=create_button, Data2=create_button_2)
stack = CreateStack(
    UIElements=[_0_create_label, _8_create_slider, _8_create_slider_2, _8_create_slider_3, separator, create_button, separator_2, create_button_2, separator_3],
    Horizontal=False)

# ---- group: ui | T | I N F O / ui | F | CREDIT / STACK | CONNECT BUTTONS
number_slider_2 = Slider(1, range=1..100)
panel_4 = Panel("DONATE")
instagram_icon = Data(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)
discord_icon = Data(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)
str2img = DeserializeImageFromString(ImageString=instagram_icon)
str2img_2 = DeserializeImageFromString(ImageString=discord_icon)
create_button_3 = CreateButton(ImagePath=str2img, ButtonStyle=0)
create_button_4 = CreateButton(ImagePath=str2img_2, ButtonStyle=0)
create_button_5 = CreateButton(ButtonName=panel_4, ButtonStyle=0)
separator_4 = CreateSeparator(Thickness=number_slider_2, Horizontal=False, Color=RGB(38, 38, 38))
separator_5 = CreateSeparator(Thickness=number_slider_2, Horizontal=False, Color=RGB(38, 38, 38))
value_listener_6 = ValueListener(Elements=create_button_3, SomeProperty=True)  # -> Values, Indices
value_listener_7 = ValueListener(Elements=create_button_4, SomeProperty=True)  # -> Values, Indices
value_listener_8 = ValueListener(Elements=create_button_5, SomeProperty=True)  # -> Values, Indices
panel_5 = Panel("https://discord.gg/qfKJsxNeTc")
panel_6 = Panel("https://www.instagram.com/nyan_designs/")
panel_7 = Panel("https://ko-fi.com/nyan_designs/")
launch_spectacles_viewer = LaunchSpectaclesViewer(URL=panel_6, LaunchBoolean=value_listener_6.Values)
launch_spectacles_viewer_2 = LaunchSpectaclesViewer(URL=panel_5, LaunchBoolean=value_listener_7.Values)
launch_spectacles_viewer_3 = LaunchSpectaclesViewer(URL=panel_7, LaunchBoolean=value_listener_8.Values)
l_buttons_2 = Entwine(Branch00=create_button_3, Branch01=create_button_4, Branch02=create_button_5, FlattenInputs=True)  # -> flatten(Result)
entwine = Entwine(
    Branch00=create_button_3,
    Branch01=separator_4,
    Branch02=create_button_4,
    Branch03=separator_5,
    Branch04=create_button_5,
    FlattenInputs=True)  # -> flatten(Result)
stack_2 = CreateStack(UIElements=entwine, Horizontal=True)

# ---- group: ui | T | I N F O / Embed IMG
logo = Data(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)
str2img_3 = DeserializeImageFromString(ImageString=logo)

# ---- group: ui | T | I N F O / ui | F | UI DIMENSIONS / F || SAVE
savestates = SaveElementStates(
    Elements=[_8_create_slider_2, _8_create_slider_3],
    SaveState=value_listener.Values,
    StateName="test",
    ClearSavedStates=False)  # -> SavedStates, SavedStateNames
restore = RestoreElementStates(Restore=value_listener_2.Values, SavedStates=savestates.SavedStates, StateNameToRestore=savestates.SavedStateNames)

# ---- group: ui | T | I N F O
# EXPANDER :: INFO
separator_6 = CreateSeparator(Thickness=10, Horizontal=True, Color=RGB(38, 38, 38))

# ---- group: ui | T | I N F O / ui | F | HELP
panel_8 = Panel("REPORT A BUG/ ERROR")
panel_9 = Panel("REQUEST A FUNCTION/ OPTION")
panel_10 = Panel("WATCH TUTORIALS")
panel_11 = Panel("Learn more about PROJECT NOAH")
panel_12 = Panel("Contribute to PROJECT NOAH")
create_button_6 = CreateButton(ButtonName=panel_8, ButtonStyle=0)
create_button_7 = CreateButton(ButtonName=panel_9, ButtonStyle=0)
create_button_8 = CreateButton(ButtonName=panel_10, ButtonStyle=0)
value_listener_9 = ValueListener(Elements=create_button_6, SomeProperty=True)  # -> Values, Indices
value_listener_10 = ValueListener(Elements=create_button_7, SomeProperty=True)  # -> Values, Indices
_0_create_label_2 = CreateLabel(LabelText=panel_11, LabelSize=12, Justification=0)
value_listener_11 = ValueListener(Elements=create_button_8, SomeProperty=True)  # -> Values, Indices
panel_13 = Panel("https://forms.gle/5TqRkwr69nLJu8eR8")
panel_14 = Panel("https://forms.gle/wN1yDLCbTqrAwNY2A")
panel_15 = Panel("https://youtube.com/playlist?list=PLj1G8Umk_dFqLEozwUL3N28zaYcJ1bzAn")
_0_create_label_3 = CreateLabel(LabelText=panel_12, LabelSize=12, Justification=0)
launch_spectacles_viewer_4 = LaunchSpectaclesViewer(URL=panel_13, LaunchBoolean=value_listener_9.Values)
launch_spectacles_viewer_5 = LaunchSpectaclesViewer(URL=panel_14, LaunchBoolean=value_listener_10.Values)
launch_spectacles_viewer_6 = LaunchSpectaclesViewer(URL=panel_15, LaunchBoolean=value_listener_11.Values)
separator_7 = CreateSeparator(Thickness=10, Horizontal=True, Color=RGB(38, 38, 38))
l_buttons_3 = Merge(Data1=create_button_6, Data2=create_button_7, Data3=create_button_8)
stack_3 = CreateStack(
    UIElements=[_0_create_label_3, create_button_6, separator_6, create_button_7, _0_create_label_2, create_button_8, separator_7],
    Horizontal=False)
swatch = ColourSwatch(SwatchColor=RGB(0, 0, 0))
swatch_2 = ColourSwatch(SwatchColor=RGB(222, 199, 27))
adjustelem = AdjustElementAppearance(ElementsToAdjust=[l_buttons_3, l_buttons, l_buttons_2], Foreground=swatch, Background=swatch_2)

# ---- group: ui | T | C O N C E P T U R A L / ui | F | F O R M / ui | C1 | F O R M / STACK | ADDITION
toggle = BooleanToggle(True)
toggle_2 = BooleanToggle(True)
toggle_3 = BooleanToggle(True)
toggle_4 = BooleanToggle(True)
a_height = Slider(10, range=0.001..100)
a_width = Slider(1, range=0.001..10)
panel_16 = Panel("""SINGLE CRV (CLO) | EXTRUSION
DOUBLE CRVS (CLO) | LOFTS
MULTIPLE CRV (CLO) | LOFT
SRF | EXTRUSION
SRF | OFFSET
BREP (CLO)""")
panel_17 = Panel("""NORMAL
LOOSE
TIGHT
STRAIGHT
UNIFORM""")
panel_18 = Panel("""Z+
NORMAL
Z-""")
panel_19 = Panel("""+
-""")
panel_20 = Panel("A. INPUT")
panel_21 = Panel("A. LOFT TYPE")
panel_22 = Panel("A. E. DIRECTION")
panel_23 = Panel("A. O. DIRECTION")
panel_24 = Panel("Additional Geometry Selection")
panel_25 = Panel("CLOSED | SOLID")
panel_26 = Panel("OPEN | OFFSET")
panel_27 = Panel("ADDITION ON")
panel_28 = Panel("ADDITION OFF")
panel_29 = Panel("FLIP NORMAL")
_2_create_pulldown_menu = CreatePulldownMenu(Label=panel_20, ListItems=panel_16, SelectedIndex=0, showLabel=True)
_2_create_pulldown_menu_2 = CreatePulldownMenu(Label=panel_21, ListItems=panel_17, SelectedIndex=0, showLabel=True)
_2_create_pulldown_menu_3 = CreatePulldownMenu(Label=panel_22, ListItems=panel_18, SelectedIndex=0, showLabel=True)
_2_create_pulldown_menu_4 = CreatePulldownMenu(Label=panel_23, ListItems=panel_19, SelectedIndex=1, showLabel=True)
_10_create_slider = CreateSlider(
    Slider=a_height,
    SnapValue=0.001,
    ShowBounds=False,
    ShowTicks=False,
    ShowTooltip=False,
    ShowValLabel=True,
    showLabel=True)
_10_create_slider_2 = CreateSlider(Slider=a_width, SnapValue=0.001, ShowBounds=False, ShowTicks=False, ShowTooltip=False, ShowValLabel=True, showLabel=True)
_1_disaply_toogle = CreateToggle(Default=False, OnLabel=panel_29, OffLabel=panel_29)
_1_disaply_toogle_2 = CreateToggle(Default=False, OnLabel=panel_27, OffLabel=panel_28)
input_index = ValueListener(Elements=_2_create_pulldown_menu, SomeProperty=True)  # -> Values, Indices
input_index_2 = ValueListener(Elements=_2_create_pulldown_menu_2, SomeProperty=True)  # -> Values, Indices
input_index_3 = ValueListener(Elements=_2_create_pulldown_menu_3, SomeProperty=True)  # -> Values, Indices
input_index_4 = ValueListener(Elements=_2_create_pulldown_menu_4, SomeProperty=True)  # -> Values, Indices
value_listener_12 = ValueListener(Elements=_1_disaply_toogle, SomeProperty=True)  # -> Values, Indices
value_listener_13 = ValueListener(Elements=_10_create_slider, SomeProperty=True)  # -> Values, Indices
value_listener_14 = ValueListener(Elements=_10_create_slider_2, SomeProperty=True)  # -> Values, Indices
value_listener_15 = ValueListener(Elements=_1_disaply_toogle_2, SomeProperty=True)  # -> Values, Indices
_0_create_label_4 = CreateLabel(LabelText=panel_24, LabelSize=12, Justification=0)
panel_30 = Panel(input_index.Indices)
filter = StreamFilter(Gate=panel_30, Stream0=toggle, Stream1=toggle_2, Stream2=toggle_3, Stream3=toggle_4, Stream4=toggle_4, Stream5=toggle_4)
_1_disaply_toogle_3 = CreateToggle(Default=filter, OnLabel=panel_25, OffLabel=panel_26)
value_listener_16 = ValueListener(Elements=_1_disaply_toogle_3, SomeProperty=True)  # -> Values, Indices
panel_31 = Panel(input_index_2.Indices)
panel_32 = Panel(input_index_3.Indices)
panel_33 = Panel(input_index_4.Indices)

# ---- group: TOOLTIPS | FORM / STACK | ADD / cluster | ADDITION SWITCH
panel_34 = Panel("ADDITION | Switch to [ADD]/ [UNION] to [PRIMARY] geometry.")
attach_tooltip_to_element = AttachTooltipToElement(ElementsToAttachTo=_1_disaply_toogle_2, TooltipContent=panel_34, ShowDelay=100, Duration=2000)

# ---- group: TOOLTIPS | FORM / STACK | ADD / cluster | INPUT ADDITION
panel_35 = Panel("2 | INPUT | Select type of [ADDITIONAL]/ [UNION] reference [RHINO] geometry [INPUT] for the function.")
attach_tooltip_to_element_2 = AttachTooltipToElement(ElementsToAttachTo=_2_create_pulldown_menu, TooltipContent=panel_35, ShowDelay=100, Duration=3000)

# ---- group: TOOLTIPS | FORM / STACK | ADD / cluster | LOFT TYPE
attach_tooltip_to_element_3 = AttachTooltipToElement(
    ElementsToAttachTo=_2_create_pulldown_menu_2,
    TooltipContent="LOFT TYPE | Type of Loft between curves.",
    ShowDelay=100,
    Duration=2000)

# ---- group: TOOLTIPS | FORM / STACK | ADD / cluster | A. E. DIRECTION
panel_36 = Panel("ADDITIONAL EXTRUSION DIRECTION | Select solid [EXTRUSION DIRECTION] from base.")
attach_tooltip_to_element_4 = AttachTooltipToElement(ElementsToAttachTo=_2_create_pulldown_menu_3, TooltipContent=panel_36, ShowDelay=100, Duration=2000)

# ---- group: TOOLTIPS | FORM / STACK | ADD / cluster | A. O. DIRECTION
panel_37 = Panel("ADDITIONAL OFFSET DIRECTION | Select solid [OFFSET DIRECTION] from base.")
attach_tooltip_to_element_5 = AttachTooltipToElement(ElementsToAttachTo=_2_create_pulldown_menu_4, TooltipContent=panel_37, ShowDelay=100, Duration=2000)

# ---- group: TOOLTIPS | FORM / STACK | ADD / cluster | CLOSED | SOLID
panel_38 = Panel("[SOLID]/ [OFFSET] | Switch between [CAPPED] extrusion solid and [OFFSETED] extrusion solid.")
attach_tooltip_to_element_6 = AttachTooltipToElement(ElementsToAttachTo=_1_disaply_toogle_3, TooltipContent=panel_38, ShowDelay=100, Duration=4000)

# ---- group: TOOLTIPS | FORM / STACK | ADD / cluster | A. FLIP NORMAL
panel_39 = Panel("FLIP NORMAL | Flip the [DIRECTION] of [EXTRUSION] [NORMAL].")
attach_tooltip_to_element_7 = AttachTooltipToElement(ElementsToAttachTo=_1_disaply_toogle, TooltipContent=panel_39, ShowDelay=100, Duration=2000)

# ---- group: TOOLTIPS | FORM / STACK | SUB / cluster | S. O. DIRECTION
panel_40 = Panel("SUBTRACTION OFFSET DIRECTION | Select solid [OFFSET DIRECTION] from base.")
attach_tooltip_to_element_8 = AttachTooltipToElement(ElementsToAttachTo=_2_create_pulldown_menu_4, TooltipContent=panel_40, ShowDelay=100, Duration=2000)

# ---- group: TOOLTIPS | FORM / STACK | ADD / cluster | A. HEIGHT
attach_tooltip_to_element_9 = AttachTooltipToElement(
    ElementsToAttachTo=_10_create_slider,
    TooltipContent="ADDITIONAL HEIGHT | [HEIGHT] of [EXTRUSION].",
    ShowDelay=100,
    Duration=2000)

# ---- group: TOOLTIPS | FORM / STACK | ADD / cluster | A. WIDTH
attach_tooltip_to_element_10 = AttachTooltipToElement(
    ElementsToAttachTo=_10_create_slider_2,
    TooltipContent="ADDITIONAL WIDTH | [WIDTH] of [OFFSET].",
    ShowDelay=100,
    Duration=2000)

# ---- group: ui | T | C O N C E P T U R A L / ui | F | F O R M / ui | C1 | F O R M / STACK | SUBTRACTION
toggle_5 = BooleanToggle(True)
toggle_6 = BooleanToggle(True)
toggle_7 = BooleanToggle(True)
toggle_8 = BooleanToggle(True)
s_height = Slider(10, range=0.001..100)
s_width = Slider(1, range=0.001..10)
panel_41 = Panel("""SINGLE CRV (CLO) | EXTRUSION
DOUBLE CRVS (CLO) | LOFTS
MULTIPLE CRV (CLO) | LOFT
SRF | EXTRUSION
SRF | OFFSET
BREP (CLO)""")
panel_42 = Panel("""NORMAL
LOOSE
TIGHT
STRAIGHT
UNIFORM""")
panel_43 = Panel("""Z+
NORMAL
Z-""")
panel_44 = Panel("""+
-""")
panel_45 = Panel("S. INPUT")
panel_46 = Panel("S. LOFT TYPE")
panel_47 = Panel("S. E. DIRECTION")
panel_48 = Panel("S. O. DIRECTION")
panel_49 = Panel("Subtraction Geometry Selection")
panel_50 = Panel("CLOSED | SOLID")
panel_51 = Panel("OPEN | OFFSET")
panel_52 = Panel("SUBTRACTION ON")
panel_53 = Panel("SUBTRACTION OFF")
panel_54 = Panel("FLIP NORMAL")
_2_create_pulldown_menu_5 = CreatePulldownMenu(Label=panel_45, ListItems=panel_41, SelectedIndex=0, showLabel=True)
_2_create_pulldown_menu_6 = CreatePulldownMenu(Label=panel_46, ListItems=panel_42, SelectedIndex=0, showLabel=True)
_2_create_pulldown_menu_7 = CreatePulldownMenu(Label=panel_47, ListItems=panel_43, SelectedIndex=0, showLabel=True)
_2_create_pulldown_menu_8 = CreatePulldownMenu(Label=panel_48, ListItems=panel_44, SelectedIndex=1, showLabel=True)
_10_create_slider_3 = CreateSlider(
    Slider=s_height,
    SnapValue=0.001,
    ShowBounds=False,
    ShowTicks=False,
    ShowTooltip=False,
    ShowValLabel=True,
    showLabel=True)
_10_create_slider_4 = CreateSlider(Slider=s_width, SnapValue=0.001, ShowBounds=False, ShowTicks=False, ShowTooltip=False, ShowValLabel=True, showLabel=True)
_1_disaply_toogle_4 = CreateToggle(Default=False, OnLabel=panel_54, OffLabel=panel_54)
_1_disaply_toogle_5 = CreateToggle(Default=False, OnLabel=panel_52, OffLabel=panel_53)
input_index_5 = ValueListener(Elements=_2_create_pulldown_menu_5, SomeProperty=True)  # -> Values, Indices
input_index_6 = ValueListener(Elements=_2_create_pulldown_menu_6, SomeProperty=True)  # -> Values, Indices
input_index_7 = ValueListener(Elements=_2_create_pulldown_menu_7, SomeProperty=True)  # -> Values, Indices
input_index_8 = ValueListener(Elements=_2_create_pulldown_menu_8, SomeProperty=True)  # -> Values, Indices
value_listener_17 = ValueListener(Elements=_1_disaply_toogle_4, SomeProperty=True)  # -> Values, Indices
value_listener_18 = ValueListener(Elements=_10_create_slider_3, SomeProperty=True)  # -> Values, Indices
value_listener_19 = ValueListener(Elements=_10_create_slider_4, SomeProperty=True)  # -> Values, Indices
value_listener_20 = ValueListener(Elements=_1_disaply_toogle_5, SomeProperty=True)  # -> Values, Indices
_0_create_label_5 = CreateLabel(LabelText=panel_49, LabelSize=12, Justification=0)
panel_55 = Panel(input_index_5.Indices)
filter_2 = StreamFilter(
    Gate=panel_55,
    Stream0=toggle_5,
    Stream1=toggle_6,
    Stream2=toggle_7,
    Stream3=toggle_8,
    Stream4=toggle_8,
    Stream5=toggle_8)
_1_disaply_toogle_6 = CreateToggle(Default=filter_2, OnLabel=panel_50, OffLabel=panel_51)
value_listener_21 = ValueListener(Elements=_1_disaply_toogle_6, SomeProperty=True)  # -> Values, Indices
panel_56 = Panel(input_index_6.Indices)
panel_57 = Panel(input_index_7.Indices)
panel_58 = Panel(input_index_8.Indices)

# ---- group: TOOLTIPS | FORM / STACK | SUB / cluster | SUBTRACTION SWITCH
panel_59 = Panel("SUBTRACTION | Switch to [SUBTRACT]/ [DIFFERENCE] from [PRIMARY] geometry.")
attach_tooltip_to_element_11 = AttachTooltipToElement(ElementsToAttachTo=_1_disaply_toogle_5, TooltipContent=panel_59, ShowDelay=100, Duration=2000)

# ---- group: TOOLTIPS | FORM / STACK | SUB / cluster | INPUT SUBTRACTION
panel_60 = Panel("2 | INPUT | Select type of [SUBTRACTION]/[DIFFERENCE] reference [RHINO] geometry [INPUT] for the function.")
attach_tooltip_to_element_12 = AttachTooltipToElement(ElementsToAttachTo=_2_create_pulldown_menu_5, TooltipContent=panel_60, ShowDelay=100, Duration=3000)

# ---- group: TOOLTIPS | FORM / STACK | SUB / cluster | LOFT TYPE
attach_tooltip_to_element_13 = AttachTooltipToElement(
    ElementsToAttachTo=_2_create_pulldown_menu_6,
    TooltipContent="LOFT TYPE | Type of Loft between curves.",
    ShowDelay=100,
    Duration=2000)

# ---- group: TOOLTIPS | FORM / STACK | SUB / cluster | S. E. DIRECTION
panel_61 = Panel("SUBTRACTION EXTRUSION DIRECTION | Select solid [EXTRUSION DIRECTION] from base.")
attach_tooltip_to_element_14 = AttachTooltipToElement(ElementsToAttachTo=_2_create_pulldown_menu_7, TooltipContent=panel_61, ShowDelay=100, Duration=2000)

# ---- group: TOOLTIPS | FORM / STACK | SUB / cluster | CLOSED | SOLID
panel_62 = Panel("[SOLID]/ [OFFSET] | Switch between [CAPPED] extrusion solid and [OFFSETED] extrusion solid.")
attach_tooltip_to_element_15 = AttachTooltipToElement(ElementsToAttachTo=_1_disaply_toogle_6, TooltipContent=panel_62, ShowDelay=100, Duration=4000)

# ---- group: TOOLTIPS | FORM / STACK | SUB / cluster | S. FLIP NORMAL
panel_63 = Panel("FLIP NORMAL | Flip the [DIRECTION] of [EXTRUSION] [NORMAL].")
attach_tooltip_to_element_16 = AttachTooltipToElement(ElementsToAttachTo=_1_disaply_toogle_4, TooltipContent=panel_63, ShowDelay=100, Duration=2000)

# ---- group: TOOLTIPS | FORM / STACK | SUB / cluster | S. HEIGHT
attach_tooltip_to_element_17 = AttachTooltipToElement(
    ElementsToAttachTo=_10_create_slider_3,
    TooltipContent="SUBTRACTION HEIGHT | [HEIGHT] of [EXTRUSION].",
    ShowDelay=100,
    Duration=2000)

# ---- group: TOOLTIPS | FORM / STACK | SUB / cluster | S. WIDTH
attach_tooltip_to_element_18 = AttachTooltipToElement(
    ElementsToAttachTo=_10_create_slider_4,
    TooltipContent="SUBTRACTION WIDTH | [WIDTH] of [OFFSET].",
    ShowDelay=100,
    Duration=2000)

# ---- group: ui | T | C O N C E P T U R A L / ui | F | F O R M / ui | C1 | F O R M / STACK | SUB-D
sub_division = Slider(3, range=1..3)
sub_level = Slider(3, range=1..3)
panel_64 = Panel("SUB-D")
_10_create_slider_5 = CreateSlider(
    Slider=sub_division,
    SnapValue=1,
    ShowBounds=False,
    ShowTicks=False,
    ShowTooltip=False,
    ShowValLabel=True,
    showLabel=True)
_10_create_slider_6 = CreateSlider(Slider=sub_level, SnapValue=1, ShowBounds=False, ShowTicks=False, ShowTooltip=False, ShowValLabel=True, showLabel=True)
_1_disaply_toogle_7 = CreateToggle(Default=False, OnLabel=panel_64, OffLabel=panel_64)
value_listener_22 = ValueListener(Elements=_10_create_slider_5, SomeProperty=True)  # -> Values, Indices
value_listener_23 = ValueListener(Elements=_10_create_slider_6, SomeProperty=True)  # -> Values, Indices
value_listener_24 = ValueListener(Elements=_1_disaply_toogle_7, SomeProperty=True)  # -> Values, Indices

# ---- group: TOOLTIPS | FORM / cluster | SUB D
attach_tooltip_to_element_19 = AttachTooltipToElement(ElementsToAttachTo=_1_disaply_toogle_7, TooltipContent="SUB-D (experimental) | ", ShowDelay=100, Duration=2000)

# ---- group: TOOLTIPS | FORM / cluster | SUB DIVISION
attach_tooltip_to_element_20 = AttachTooltipToElement(ElementsToAttachTo=_10_create_slider_5, TooltipContent="SUB DIVISION | ", ShowDelay=100, Duration=2000)

# ---- group: TOOLTIPS | FORM / cluster | SUB LEVEL
attach_tooltip_to_element_21 = AttachTooltipToElement(ElementsToAttachTo=_10_create_slider_6, TooltipContent="SUB LEVEL | ", ShowDelay=100, Duration=2000)

# ---- group: ui | T | C O N C E P T U R A L / ui | F | F O R M / ui | C1 | F O R M / STACK | PRIMARY
toggle_9 = BooleanToggle(True)
toggle_10 = BooleanToggle(True)
toggle_11 = BooleanToggle(True)
toggle_12 = BooleanToggle(False)
weave = Weave(Pattern=value_listener_24.Values, Stream0=0, Stream1=3, NullGaps=False)
height = Slider(10, range=0.001..500)
width = Slider(1, range=0.001..10)
panel_65 = Panel("""SINGLE CRV (CLO) | EXTRUSION
MULTIPLE CRV (CLO) | LOFT
SRF | EXTRUSION
SRF | OFFSET
BREP (CLO)""")
panel_66 = Panel("""Z+
NORMAL
Z-""")
panel_67 = Panel("""+
-""")
panel_68 = Panel("INPUT")
panel_69 = Panel("E. DIRECTION")
panel_70 = Panel("O. DIRECTION")
panel_71 = Panel("Primary Geometry Selection")
panel_72 = Panel("Creation and Boolean")
panel_73 = Panel("CLOSED | SOLID")
panel_74 = Panel("OPEN | OFFSET")
panel_75 = Panel("FLIP NORMAL")
panel_76 = Panel("   SOLVER ON")
panel_77 = Panel("   SOLVER OFF")
_2_create_pulldown_menu_9 = CreatePulldownMenu(Label=panel_68, ListItems=panel_65, SelectedIndex=0, showLabel=True)
_2_create_pulldown_menu_10 = CreatePulldownMenu(Label=panel_69, ListItems=panel_66, SelectedIndex=0, showLabel=True)
_2_create_pulldown_menu_11 = CreatePulldownMenu(Label=panel_70, ListItems=panel_67, SelectedIndex=1, showLabel=True)
_10_create_slider_7 = CreateSlider(Slider=height, SnapValue=0.001, ShowBounds=False, ShowTicks=False, ShowTooltip=False, ShowValLabel=True, showLabel=True)
_10_create_slider_8 = CreateSlider(Slider=width, SnapValue=0.001, ShowBounds=False, ShowTicks=False, ShowTooltip=False, ShowValLabel=True, showLabel=True)
_1_disaply_toogle_8 = CreateToggle(Default=False, OnLabel=panel_75, OffLabel=panel_75)
toggle_13 = CreateToggle(Default=False, OnLabel=panel_76, OffLabel=panel_77)
value_listener_25 = ValueListener(Elements=toggle_13, SomeProperty=True)  # -> Values, Indices
input_index_9 = ValueListener(Elements=_2_create_pulldown_menu_9, SomeProperty=True)  # -> Values, Indices
input_index_10 = ValueListener(Elements=_2_create_pulldown_menu_10, SomeProperty=True)  # -> Values, Indices
input_index_11 = ValueListener(Elements=_2_create_pulldown_menu_11, SomeProperty=True)  # -> Values, Indices
value_listener_26 = ValueListener(Elements=_1_disaply_toogle_8, SomeProperty=True)  # -> Values, Indices
value_listener_27 = ValueListener(Elements=_10_create_slider_7, SomeProperty=True)  # -> Values, Indices
value_listener_28 = ValueListener(Elements=_10_create_slider_8, SomeProperty=True)  # -> Values, Indices
_0_create_label_6 = CreateLabel(LabelText=panel_72, LabelSize=12, Justification=0)
_0_create_label_7 = CreateLabel(LabelText=panel_71, LabelSize=12, Justification=0)
panel_78 = Panel(input_index_9.Indices)
filter_3 = StreamFilter(Gate=panel_78, Stream0=toggle_9, Stream1=toggle_10, Stream2=toggle_11, Stream3=toggle_12, Stream4=toggle_12)
_1_disaply_toogle_9 = CreateToggle(Default=filter_3, OnLabel=panel_73, OffLabel=panel_74)
value_listener_29 = ValueListener(Elements=_1_disaply_toogle_9, SomeProperty=True)  # -> Values, Indices
panel_79 = Panel(input_index_10.Indices)
panel_80 = Panel(input_index_11.Indices)

# ---- group: TOOLTIPS | FORM / STACK | PRI / cluster | SOLVER
# COLUMN 1 ELEMENT
panel_81 = Panel("""1 | SOLVER | FIREST [TURN ON] [SOLVER] to start this function.
and [TURN OFF] afterwards to avoid [CRASH].""")
attach_tooltip_to_element_22 = AttachTooltipToElement(ElementsToAttachTo=toggle_13, TooltipContent=panel_81, ShowDelay=100, Duration=2000)

# ---- group: TOOLTIPS | FORM / STACK | PRI / cluster | INPUT PRIMARY
panel_82 = Panel("2 | INPUT | Select type of [PRIMARY]/ [BASE] reference [RHINO] geometry [INPUT] for the function.")
attach_tooltip_to_element_23 = AttachTooltipToElement(ElementsToAttachTo=_2_create_pulldown_menu_9, TooltipContent=panel_82, ShowDelay=100, Duration=3000)

# ---- group: TOOLTIPS | FORM / STACK | PRI / cluster | E. DIRECTION
panel_83 = Panel("EXTRUSION DIRECTION | Select solid [EXTRUSION DIRECTION] from base.")
attach_tooltip_to_element_24 = AttachTooltipToElement(ElementsToAttachTo=_2_create_pulldown_menu_10, TooltipContent=panel_83, ShowDelay=100, Duration=2000)

# ---- group: TOOLTIPS | FORM / STACK | PRI / cluster | O. DIRECTION
panel_84 = Panel("OFFSET DIRECTION | Select solid [OFFSET DIRECTION] from base.")
attach_tooltip_to_element_25 = AttachTooltipToElement(ElementsToAttachTo=_2_create_pulldown_menu_11, TooltipContent=panel_84, ShowDelay=100, Duration=2000)

# ---- group: TOOLTIPS | FORM / STACK | PRI / cluster | CLOSED | SOLID
panel_85 = Panel("[SOLID]/ [OFFSET] | Switch between [CAPPED] extrusion solid and [OFFSETED] extrusion solid.")
attach_tooltip_to_element_26 = AttachTooltipToElement(ElementsToAttachTo=_1_disaply_toogle_9, TooltipContent=panel_85, ShowDelay=100, Duration=4000)

# ---- group: TOOLTIPS | FORM / STACK | PRI / cluster | FLIP NORMAL
panel_86 = Panel("FLIP NORMAL | Flip the [DIRECTION] of [EXTRUSION] [NORMAL].")
attach_tooltip_to_element_27 = AttachTooltipToElement(ElementsToAttachTo=_1_disaply_toogle_9, TooltipContent=panel_86, ShowDelay=100, Duration=2000)

# ---- group: TOOLTIPS | FORM / STACK | PRI / cluster | HEIGHT
panel_87 = Panel("HEIGHT | [HEIGHT] of [EXTRUSION].")
attach_tooltip_to_element_28 = AttachTooltipToElement(ElementsToAttachTo=_10_create_slider_7, TooltipContent=panel_87, ShowDelay=100, Duration=2000)

# ---- group: TOOLTIPS | FORM / STACK | PRI / cluster | WIDTH
panel_88 = Panel("WIDTH | [WIDTH] of [OFFSET].")
attach_tooltip_to_element_29 = AttachTooltipToElement(ElementsToAttachTo=_10_create_slider_8, TooltipContent=panel_88, ShowDelay=100, Duration=2000)

# ---- group: ui | T | C O N C E P T U R A L / ui | F | F O R M / ui | C1 | F O R M
panel_89 = Panel("""NORMAL
LOOSE
TIGHT
STRAIGHT
UNIFORM""")
panel_90 = Panel("LOFT TYPE")
_2_create_pulldown_menu_12 = CreatePulldownMenu(Label=panel_90, ListItems=panel_89, SelectedIndex=weave, showLabel=True)
input_index_12 = ValueListener(Elements=_2_create_pulldown_menu_12, SomeProperty=True)  # -> Values, Indices
panel_91 = Panel(input_index_12.Indices)

# ---- group: ui | T | C O N C E P T U R A L / ui | F | P A T T E R N / ui | C1 | P A T T E R N / U. COUNT
offset = Slider(1, range=0.001..5)
count = Slider(11, range=1..1000)
u_count = Slider(2, range=2..300)
v_count = Slider(2, range=2..300)
_10_create_slider_9 = CreateSlider(Slider=offset, SnapValue=0.001, ShowBounds=False, ShowTicks=False, ShowTooltip=False, ShowValLabel=True, showLabel=True)
_11_create_slider = CreateSlider(Slider=count, SnapValue=0.01, ShowBounds=False, ShowTicks=False, ShowTooltip=False, ShowValLabel=True, showLabel=True)
_12_create_slider = CreateSlider(Slider=u_count, SnapValue=0.01, ShowBounds=False, ShowTicks=False, ShowTooltip=False, ShowValLabel=True, showLabel=True)
_13_create_slider = CreateSlider(Slider=v_count, SnapValue=0.01, ShowBounds=False, ShowTicks=False, ShowTooltip=False, ShowValLabel=True, showLabel=True)
value_listener_30 = ValueListener(Elements=_10_create_slider_9, SomeProperty=True)  # -> Values, Indices
value_listener_31 = ValueListener(Elements=_11_create_slider, SomeProperty=True)  # -> Values, Indices
value_listener_32 = ValueListener(Elements=_12_create_slider, SomeProperty=True)  # -> Values, Indices
value_listener_33 = ValueListener(Elements=_13_create_slider, SomeProperty=True)  # -> Values, Indices

# ---- group: TOOLTIPS | FORM / STACK | SLIDERS / cluster | OFFSET
panel_92 = Panel("OFFSET | Offset [ACTIVE TARGET] boundary to fit [OBJECT] from [TARGET] egdes.")
attach_tooltip_to_element_30 = AttachTooltipToElement(ElementsToAttachTo=_10_create_slider_9, TooltipContent=panel_92, ShowDelay=100, Duration=2000)

# ---- group: TOOLTIPS | FORM / STACK | SLIDERS / cluster | COUNT
attach_tooltip_to_element_31 = AttachTooltipToElement(
    ElementsToAttachTo=_11_create_slider,
    TooltipContent="COUNT | Population [COUNT] of [OBJECT] on [TARGET].",
    ShowDelay=100,
    Duration=3000)

# ---- group: TOOLTIPS | FORM / STACK | SLIDERS / cluster | U. COUNT
attach_tooltip_to_element_32 = AttachTooltipToElement(
    ElementsToAttachTo=_12_create_slider,
    TooltipContent="U. COUNT | [COUNT] in U direction of [TARGET].",
    ShowDelay=100,
    Duration=2000)

# ---- group: TOOLTIPS | FORM / STACK | SLIDERS / cluster | V. COUNT
attach_tooltip_to_element_33 = AttachTooltipToElement(
    ElementsToAttachTo=_13_create_slider,
    TooltipContent="V. COUNT | [COUNT] in V direction of [TARGET].",
    ShowDelay=100,
    Duration=2000)

# ---- group: ui | T | C O N C E P T U R A L / ui | F | P A T T E R N / ui | C1 | P A T T E R N / STACK | CURTAIN FRAME
angle_snap = Slider(90, range=0..360)
a_seed = Slider(0, range=0..100)
angle_max = Slider(270, range=0..360)
angle_min = Slider(0, range=0..360)
create_slider = CreateSlider(Slider=angle_max, SnapValue=1, ShowBounds=False, ShowTicks=False, ShowTooltip=False, ShowValLabel=True, showLabel=True)
create_slider_2 = CreateSlider(Slider=angle_min, SnapValue=1, ShowBounds=False, ShowTicks=False, ShowTooltip=False, ShowValLabel=True, showLabel=True)
create_slider_3 = CreateSlider(Slider=a_seed, SnapValue=1, ShowBounds=False, ShowTicks=False, ShowTooltip=False, ShowValLabel=True, showLabel=True)
create_slider_4 = CreateSlider(Slider=angle_snap, SnapValue=1, ShowBounds=False, ShowTicks=False, ShowTooltip=False, ShowValLabel=True, showLabel=True)
value_listener_34 = ValueListener(Elements=create_slider, SomeProperty=True)  # -> Values, Indices
value_listener_35 = ValueListener(Elements=create_slider_2, SomeProperty=True)  # -> Values, Indices
value_listener_36 = ValueListener(Elements=create_slider_3, SomeProperty=True)  # -> Values, Indices
value_listener_37 = ValueListener(Elements=create_slider_4, SomeProperty=True)  # -> Values, Indices

# ---- group: TOOLTIPS | FORM / STACK | SLIDERS / cluster | ANGLE MAX
panel_93 = Panel("ANGLE (MAX) | [ANGLE]/ [MAXIMUM ANGLE] of [ROTATION] of [OBJECT].")
attach_tooltip_to_element_34 = AttachTooltipToElement(ElementsToAttachTo=create_slider, TooltipContent=panel_93, ShowDelay=100, Duration=2000)

# ---- group: TOOLTIPS | FORM / STACK | SLIDERS / cluster | ANGLE MIN
attach_tooltip_to_element_35 = AttachTooltipToElement(
    ElementsToAttachTo=create_slider_2,
    TooltipContent="ANGLE (MIN) | [MINIMUM ANGLE] of [ROTATION] of [OBJECT].",
    ShowDelay=100,
    Duration=4000)

# ---- group: TOOLTIPS | FORM / STACK | SLIDERS / cluster | SNAP ANGLE
panel_94 = Panel("SNAP ANGLE | [INCREMENTAL VALUE] of [RANDOMIZED ANGLE] to snap.")
attach_tooltip_to_element_36 = AttachTooltipToElement(ElementsToAttachTo=create_slider_4, TooltipContent=panel_94, ShowDelay=100, Duration=2000)

# ---- group: TOOLTIPS | FORM / STACK | SLIDERS / cluster | SEED
attach_tooltip_to_element_37 = AttachTooltipToElement(
    ElementsToAttachTo=create_slider_3,
    TooltipContent="ANGLE SEED | [ANGLE] [SEED] for [ROTATION] randomization.",
    ShowDelay=100,
    Duration=2000)

# ---- group: ui | T | C O N C E P T U R A L / STACK | CURTAIN FRAME
scale_max = Slider(1, range=0.01..2)
s_seed = Slider(0, range=0..100)
scale_min = Slider(0.5, range=0.01..2)
create_slider_5 = CreateSlider(
    Slider=scale_max,
    SnapValue=0.01,
    ShowBounds=False,
    ShowTicks=False,
    ShowTooltip=False,
    ShowValLabel=True,
    showLabel=True)
create_slider_6 = CreateSlider(
    Slider=scale_min,
    SnapValue=0.01,
    ShowBounds=False,
    ShowTicks=False,
    ShowTooltip=False,
    ShowValLabel=True,
    showLabel=True)
create_slider_7 = CreateSlider(Slider=s_seed, SnapValue=1, ShowBounds=False, ShowTicks=False, ShowTooltip=False, ShowValLabel=True, showLabel=True)
value_listener_38 = ValueListener(Elements=create_slider_5, SomeProperty=True)  # -> Values, Indices
value_listener_39 = ValueListener(Elements=create_slider_6, SomeProperty=True)  # -> Values, Indices
value_listener_40 = ValueListener(Elements=create_slider_7, SomeProperty=True)  # -> Values, Indices

# ---- group: TOOLTIPS | FORM / STACK | SLIDERS / cluster | SCALE MAX
attach_tooltip_to_element_38 = AttachTooltipToElement(
    ElementsToAttachTo=create_slider_5,
    TooltipContent="SCALE (MAX) | [SCALE]/ [MAXIMUM SCALE] of [OBJECT].",
    ShowDelay=100,
    Duration=2000)

# ---- group: TOOLTIPS | FORM / STACK | SLIDERS / cluster | SCALE MIN
attach_tooltip_to_element_39 = AttachTooltipToElement(
    ElementsToAttachTo=create_slider_6,
    TooltipContent="SCALE (MIN) | [SCALE]/ [MINIMUM SCALE] of [OBJECT].",
    ShowDelay=100,
    Duration=2000)

# ---- group: TOOLTIPS | FORM / STACK | SLIDERS / cluster | SCALE SEED
attach_tooltip_to_element_40 = AttachTooltipToElement(
    ElementsToAttachTo=create_slider_7,
    TooltipContent="SCALE SEED | [SCALE] [SEED] for [ROTATION] randomization.",
    ShowDelay=100,
    Duration=2000)

# ---- group: ui | T | C O N C E P T U R A L / ui | F | F O R M / ui | C2 | F O R M
# COLUMN 2 ELEMENT
# BUTTONS & COLOR
colour = ColourPicker(PickedColour=RGB(184, 164, 92))
panel_95 = Panel("SEL PRI")
panel_96 = Panel("BAKE GEO")
create_color_picker = CreateColorPicker(DefaultColor=colour)
create_button_9 = CreateButton(ButtonName=panel_95, ButtonStyle=0)
create_button_10 = CreateButton(ButtonName=panel_96, ButtonStyle=0)
value_listener_41 = ValueListener(Elements=create_color_picker, SomeProperty=True)  # -> Values, Indices
value_listener_42 = ValueListener(Elements=create_button_9, SomeProperty=True)  # -> Values, Indices
value_listener_43 = ValueListener(Elements=create_button_10, SomeProperty=True)  # -> Values, Indices
placeholder = Placeholder()

# ---- group: TOOLTIPS | FORM / cluster | SEL PRI
panel_97 = Panel("3 | SEL GEO | [SELECT] [PRIMARY] reference [RHINO] geometry [INPUT] for the function.")
attach_tooltip_to_element_41 = AttachTooltipToElement(ElementsToAttachTo=create_button_9, TooltipContent=panel_97, ShowDelay=100, Duration=2000)

# ---- group: TOOLTIPS | FORM / cluster | BAKE GEO
panel_98 = Panel("BAKE GEO | [BAKE]/ [CREATE] function [OUTPUT] geometry into rhino selected layer.")
attach_tooltip_to_element_42 = AttachTooltipToElement(ElementsToAttachTo=create_button_10, TooltipContent=panel_98, ShowDelay=100, Duration=2000)

# ---- group: TOOLTIPS | FORM / cluster | COLOR PICKER
panel_99 = Panel("COLOR PICKER | Select [DISPLAY COLOR] of [OUTPUT] geometry.")
attach_tooltip_to_element_43 = AttachTooltipToElement(ElementsToAttachTo=create_color_picker, TooltipContent=panel_99, ShowDelay=100, Duration=2000)

# ---- group: ui | T | C O N C E P T U R A L / ui | F | P A T T E R N / ui | C2 | P A T T E R N
# COLUMN 2 ELEMENT
# BUTTONS & COLOR
colour_2 = ColourPicker(PickedColour=RGB(255, 229, 99))
panel_100 = Panel("SEL OBJ")
panel_101 = Panel("BAKE GEO")
create_color_picker_2 = CreateColorPicker(DefaultColor=colour_2)
create_button_11 = CreateButton(ButtonName=panel_100, ButtonStyle=0)
create_button_12 = CreateButton(ButtonName=panel_101, ButtonStyle=0)
value_listener_44 = ValueListener(Elements=create_button_11, SomeProperty=True)  # -> Values, Indices
value_listener_45 = ValueListener(Elements=create_button_12, SomeProperty=True)  # -> Values, Indices
value_listener_46 = ValueListener(Elements=create_color_picker_2, SomeProperty=True)  # -> Values, Indices
placeholder_2 = Placeholder()
panel_102 = Panel(value_listener_45.Values)

# ---- group: TOOLTIPS | FORM / cluster | SEL OBJ
panel_103 = Panel("4 | SEL OBJ | [SELECT] reference [RHINO] geometry [OBJECT] [INPUT] to [ORIENT] onto [TARGET] geometry.")
attach_tooltip_to_element_44 = AttachTooltipToElement(ElementsToAttachTo=create_button_11, TooltipContent=panel_103, ShowDelay=100, Duration=2000)

# ---- group: TOOLTIPS | FORM / cluster | BAKE GEO
panel_104 = Panel("BAKE GEO | [BAKE]/ [CREATE] function [OUTPUT] geometry into rhino selected layer.")
attach_tooltip_to_element_45 = AttachTooltipToElement(ElementsToAttachTo=create_button_12, TooltipContent=panel_104, ShowDelay=100, Duration=2000)

# ---- group: TOOLTIPS | FORM / cluster | COLOR PICKER
panel_105 = Panel("COLOR PICKER | Select [DISPLAY COLOR] of [OUTPUT] geometry.")
attach_tooltip_to_element_46 = AttachTooltipToElement(ElementsToAttachTo=create_color_picker_2, TooltipContent=panel_105, ShowDelay=100, Duration=2000)

# ---- group: ui | T | C O N C E P T U R A L / ui | F | F O R M
# FORM   E X P A N D E R (human UI)
# COLUMN 1 ELEMENT
panel_106 = Panel("SEL ADD")
panel_107 = Panel("SEL SUB")
panel_108 = Panel("CLEAR GEO")
create_button_13 = CreateButton(ButtonName=panel_106, ButtonStyle=0)
create_button_14 = CreateButton(ButtonName=panel_107, ButtonStyle=0)
create_button_15 = CreateButton(ButtonName=panel_108, ButtonStyle=0)
value_listener_47 = ValueListener(Elements=create_button_13, SomeProperty=True)  # -> Values, Indices
value_listener_48 = ValueListener(Elements=create_button_14, SomeProperty=True)  # -> Values, Indices
value_listener_49 = ValueListener(Elements=create_button_15, SomeProperty=True)  # -> Values, Indices

# ---- group: TOOLTIPS | FORM / cluster | SEL ADD
panel_109 = Panel("3 | SEL GEO | [SELECT] reference [RHINO] geometry [INPUT] to [ADD] to [PRIMARY].")
attach_tooltip_to_element_47 = AttachTooltipToElement(ElementsToAttachTo=create_button_13, TooltipContent=panel_109, ShowDelay=100, Duration=2000)

# ---- group: TOOLTIPS | FORM / cluster | SEL SUB
panel_110 = Panel("3 | SEL GEO | [SELECT] reference [RHINO] geometry [INPUT] to [SUBTRACT] from [PRIMARY].")
attach_tooltip_to_element_48 = AttachTooltipToElement(ElementsToAttachTo=create_button_14, TooltipContent=panel_110, ShowDelay=100, Duration=2000)

# ---- group: TOOLTIPS | FORM / cluster | CLEAR GEO
panel_111 = Panel("CLEAR GEO | [CLEAR]/ [RESET] ALL reference [RHINO] geometry [INPUT] for the function.")
attach_tooltip_to_element_49 = AttachTooltipToElement(ElementsToAttachTo=create_button_15, TooltipContent=panel_111, ShowDelay=100, Duration=2000)

# ---- group: ui | T | C O N C E P T U R A L / ui | F | F O R M / ui | C2 | F O R M / STACK | MAIN COLUMAN 2
panel_112 = Panel("SAVE")
panel_113 = Panel("LOAD")
create_button_16 = CreateButton(ButtonName=panel_112, ButtonStyle=0)
create_button_17 = CreateButton(ButtonName=panel_113, ButtonStyle=0)
value_listener_50 = ValueListener(Elements=create_button_16, SomeProperty=True)  # -> Values, Indices
value_listener_51 = ValueListener(Elements=create_button_17, SomeProperty=True)  # -> Values, Indices

# ---- group: TOOLTIPS | FORM / cluster | SAVE
# COLUMN 2 ELEMENT
panel_114 = Panel("SAVE | [SAVE] the values of the [PARAMETERS] of the function to avoid resetting.")
attach_tooltip_to_element_50 = AttachTooltipToElement(ElementsToAttachTo=create_button_16, TooltipContent=panel_114, ShowDelay=100, Duration=2000)

# ---- group: TOOLTIPS | FORM / cluster | LOAD
panel_115 = Panel("LOAD | [LOAD] the value(s) of the [PARAMETERS] of the functions.")
attach_tooltip_to_element_51 = AttachTooltipToElement(ElementsToAttachTo=create_button_17, TooltipContent=panel_115, ShowDelay=100, Duration=2000)

# ----
panel_116 = Panel("CLEAR GEO")

# ---- group: ui | T | C O N C E P T U R A L / ui | F | P A T T E R N / ui | C2 | P A T T E R N / STACK | MAIN COLUMAN 2
panel_117 = Panel("SAVE")
panel_118 = Panel("LOAD")
create_button_18 = CreateButton(ButtonName=panel_117, ButtonStyle=0)
create_button_19 = CreateButton(ButtonName=panel_118, ButtonStyle=0)
value_listener_52 = ValueListener(Elements=create_button_18, SomeProperty=True)  # -> Values, Indices
value_listener_53 = ValueListener(Elements=create_button_19, SomeProperty=True)  # -> Values, Indices

# ---- group: TOOLTIPS | FORM / cluster | SAVE
# COLUMN 2 ELEMENT
panel_119 = Panel("SAVE | [SAVE] the values of the [PARAMETERS] of the function to avoid resetting.")
attach_tooltip_to_element_52 = AttachTooltipToElement(ElementsToAttachTo=create_button_18, TooltipContent=panel_119, ShowDelay=100, Duration=2000)

# ---- group: TOOLTIPS | FORM / cluster | LOAD
panel_120 = Panel("LOAD | [LOAD] the value(s) of the [PARAMETERS] of the functions.")
attach_tooltip_to_element_53 = AttachTooltipToElement(ElementsToAttachTo=create_button_19, TooltipContent=panel_120, ShowDelay=100, Duration=2000)

# ----
create_button_20 = CreateButton(ButtonName=panel_116, ButtonStyle=0)

# ---- group: TOOLTIPS | FORM / cluster | CLEAR GEO
panel_121 = Panel("CLEAR GEO | [CLEAR]/ [RESET] ALL reference [RHINO] geometry [INPUT] for the function.")
attach_tooltip_to_element_54 = AttachTooltipToElement(ElementsToAttachTo=create_button_20, TooltipContent=panel_121, ShowDelay=100, Duration=2000)

# ----
value_listener_54 = ValueListener(Elements=create_button_20, SomeProperty=True)  # -> Values, Indices

# ---- group: ui | T | C O N C E P T U R A L / ui | F | F O R M / ui | E | F O R M / STACK | COLUMANS
elements = Merge(
    Data1=_0_create_label_6,
    Data2=toggle_13,
    Data3=_0_create_label_7,
    Data4=_2_create_pulldown_menu_9,
    Data5=_2_create_pulldown_menu_12,
    Data6=_2_create_pulldown_menu_10,
    Data7=_2_create_pulldown_menu_11,
    Data8=_1_disaply_toogle_9,
    Data9=_1_disaply_toogle_8,
    Data10=_10_create_slider_7,
    Data11=_10_create_slider_8,
    Data12=_1_disaply_toogle_2,
    Data13=_0_create_label_4,
    Data14=_2_create_pulldown_menu,
    Data15=_2_create_pulldown_menu_2,
    Data16=_2_create_pulldown_menu_3,
    Data17=_2_create_pulldown_menu_4,
    Data18=_1_disaply_toogle_3,
    Data19=_1_disaply_toogle,
    Data20=_10_create_slider,
    Data21=_10_create_slider_2,
    Data22=_1_disaply_toogle_5,
    Data23=_0_create_label_5,
    Data24=_2_create_pulldown_menu_5,
    Data25=_2_create_pulldown_menu_6,
    Data26=_2_create_pulldown_menu_7,
    Data27=_2_create_pulldown_menu_8,
    Data28=_1_disaply_toogle_6,
    Data29=_1_disaply_toogle_4,
    Data30=_10_create_slider_3,
    Data31=_10_create_slider_4,
    Data32=_1_disaply_toogle_7,
    Data33=_10_create_slider_5,
    Data34=_10_create_slider_6)

# ---- group: ui | T | C O N C E P T U R A L / ui | F | F O R M / ui | E | F O R M / STACK | COLUMANS / cluster
column_1_elements_generator = COLUMN1ELEMENTSGENERATOR_4(
    all_c1_elements=elements,
    inputindex=panel_78,
    solidindex=value_listener_29.Values,
    extruindex=panel_79,
    addindex=value_listener_15.Values,
    ainputindex=panel_30,
    asolidindex=value_listener_16.Values,
    aextruindex=panel_32,
    subindex=value_listener_20.Values,
    sinputindex=panel_55,
    ssolidindex=value_listener_21.Values,
    sextruindex=panel_57,
    subdindex=value_listener_24.Values)  # -> column_1_elements, number_of_elements_in_column_1

column_2_elements_generator = COLUMN2ELEMENTSGENERATOR_5(
    addindex=value_listener_15.Values,
    subindex=value_listener_20.Values,
    c1length=column_1_elements_generator.number_of_elements_in_column_1,
    L=[create_button_16, create_button_17, create_button_9, create_button_13, create_button_14, create_button_15, create_button_10, create_color_picker, placeholder])

# ---- group: ui | T | C O N C E P T U R A L / ui | F | F O R M / ui | E | F O R M
# EXPANDER MENU
# Columns
# Human UI Elements
savestates_2 = SaveElementStates(
    Elements=[column_1_elements_generator.column_1_elements, column_2_elements_generator],
    SaveState=value_listener_50.Values,
    StateName="test",
    ClearSavedStates=False)  # -> SavedStates, SavedStateNames
restore_2 = RestoreElementStates(Restore=value_listener_51.Values, SavedStates=savestates_2.SavedStates, StateNameToRestore=savestates_2.SavedStateNames)

# ---- group: Fx | F O R M / fx | SCRIPT | PRIMARY GEOMETRY / fx | INPUT | PRIMARY GEOMETRY
toggle_14 = BooleanToggle(False)  # disabled
toggle_15 = BooleanToggle(True)  # disabled
toggle_16 = BooleanToggle(False)  # disabled
toggle_17 = BooleanToggle(False)  # disabled
boolean_toggle = BooleanToggle(True)  # disabled
filter_4 = StreamFilter(Gate=panel_78, Stream0=toggle_14, Stream1=toggle_15, Stream2=toggle_16, Stream3=toggle_17, Stream4=toggle_17)  # disabled
select_geo = SelectGeo(
    run=value_listener_42.Values,
    allowMultiple=filter_4,
    allowNone=boolean_toggle,
    msg="Pick object(s)",
    clear=value_listener_49.Values)  # -> pickedGeometry; inputs run: Boolean, allowMultiple: Boolean, allowNone: Boolean, msg: String, clear: Boolean; disabled
# ---------- select_geo: C# usings ----------
using System.IO;
using System.Linq;
using System.Data;
using System.Drawing;
using System.Reflection;
using System.Windows.Forms;
using System.Xml;
using System.Xml.Linq;
using System.Runtime.InteropServices;

using Rhino.DocObjects;
using Rhino.Collections;
using GH_IO;
using GH_IO.Serialization;
# ---------- select_geo: C# ----------
    if(run) getNewGeometry(msg, allowMultiple, allowNone);
    pickedGeometry = objIDs;
    if(clear) objIDs.Clear();
# ---------- select_geo: C# additional code ----------
  static List<Guid> objIDs = new List<Guid>();


  void getNewGeometry(string msg, bool allowMultiple, bool allowNone){
    ObjectType filter = ObjectType.AnyObject;

    ObjRef[] rhObjects = new ObjRef[1];


    try{
      Rhino.Commands.Result result = Rhino.Commands.Result.Cancel;
      if(!allowMultiple) {
        ObjRef rhObject;
        result = Rhino.Input.RhinoGet.GetOneObject(msg, allowNone, filter, out rhObject);
        rhObjects[0] = rhObject;

      } else {
        result = Rhino.Input.RhinoGet.GetMultipleObjects(msg, allowNone, filter, out rhObjects);
      }

      if(result == Rhino.Commands.Result.Cancel){

      } else if(result == Rhino.Commands.Result.Success){
        objIDs = rhObjects.Select(o => o.ObjectId).ToList();
        return;
      }
    } catch {

    }
  }
# ---------- end select_geo ----------
objfromgroup = GetObjectsInGroup()
primary_geometry = Geometry(select_geo)  # disabled

# ---- group: fx | SCRIPT | COLOR INDICATOR / F || COLOR INDICATOR (SEL GEO)
lng = ListLength(List=flatten(primary_geometry))
expression = Expression(x=lng, Expression="if (x = 0,0,1)")
expression_2 = Expression(x=lng, Expression="if (x = 0,0,1)")
swatch_3 = ColourSwatch(SwatchColor=RGB(255, 255, 255))
swatch_4 = ColourSwatch(SwatchColor=RGB(0, 0, 0))
swatch_5 = ColourSwatch(SwatchColor=RGBA(255, 255, 255, 0))
swatch_6 = ColourSwatch(SwatchColor=RGB(222, 199, 27))
weave_2 = Weave(Pattern=expression, Stream0=swatch_3, Stream1=swatch_4, NullGaps=False)
weave_3 = Weave(Pattern=expression_2, Stream0=swatch_5, Stream1=swatch_6, NullGaps=False)
adjustelem_2 = AdjustElementAppearance(ElementsToAdjust=create_button_9, Foreground=weave_2, Background=weave_3)

# ---- group: Fx | F O R M / fx | SCRIPT | ADDITIONAL GEOMETRY / fx | INPUT | ADDITION GEOMETRY
toggle_18 = BooleanToggle(True)  # disabled
toggle_19 = BooleanToggle(True)  # disabled
toggle_20 = BooleanToggle(True)  # disabled
toggle_21 = BooleanToggle(True)  # disabled
toggle_22 = BooleanToggle(True)  # disabled
boolean_toggle_2 = BooleanToggle(True)  # disabled
filter_5 = StreamFilter(
    Gate=panel_30,
    Stream0=toggle_18,
    Stream1=toggle_19,
    Stream2=toggle_20,
    Stream3=toggle_21,
    Stream4=toggle_22,
    Stream5=toggle_22)  # disabled
select_geo_2 = SelectGeo(
    run=value_listener_47.Values,
    allowMultiple=filter_5,
    allowNone=boolean_toggle_2,
    msg="Pick object(s)",
    clear=value_listener_49.Values)  # -> pickedGeometry; inputs run: Boolean, allowMultiple: Boolean, allowNone: Boolean, msg: String, clear: Boolean; disabled; same code as select_geo
addition_geometry = Geometry(select_geo_2)  # disabled

# ---- group: fx | SCRIPT | COLOR INDICATOR / F || COLOR INDICATOR (SEL GEO)
lng_2 = ListLength(List=flatten(addition_geometry))
expression_3 = Expression(x=lng_2, Expression="if (x = 0,0,1)")
expression_4 = Expression(x=lng_2, Expression="if (x = 0,0,1)")
swatch_7 = ColourSwatch(SwatchColor=RGB(255, 255, 255))
swatch_8 = ColourSwatch(SwatchColor=RGB(0, 0, 0))
swatch_9 = ColourSwatch(SwatchColor=RGBA(255, 255, 255, 0))
swatch_10 = ColourSwatch(SwatchColor=RGB(222, 199, 27))
weave_4 = Weave(Pattern=expression_3, Stream0=swatch_7, Stream1=swatch_8, NullGaps=False)
weave_5 = Weave(Pattern=expression_4, Stream0=swatch_9, Stream1=swatch_10, NullGaps=False)
adjustelem_3 = AdjustElementAppearance(ElementsToAdjust=create_button_13, Foreground=weave_4, Background=weave_5)

# ---- group: Fx | F O R M / fx | SCRIPT | SUBTRACTION GEOMETRY / fx | INPUT | SUBTRACTION GEOMETRY
toggle_23 = BooleanToggle(True)  # disabled
toggle_24 = BooleanToggle(True)  # disabled
toggle_25 = BooleanToggle(True)  # disabled
toggle_26 = BooleanToggle(True)  # disabled
toggle_27 = BooleanToggle(True)  # disabled
boolean_toggle_3 = BooleanToggle(True)  # disabled
filter_6 = StreamFilter(
    Gate=panel_55,
    Stream0=toggle_23,
    Stream1=toggle_24,
    Stream2=toggle_25,
    Stream3=toggle_26,
    Stream4=toggle_27,
    Stream5=toggle_27)  # disabled
select_geo_3 = SelectGeo(
    run=value_listener_48.Values,
    allowMultiple=filter_6,
    allowNone=boolean_toggle_3,
    msg="Pick object(s)",
    clear=value_listener_49.Values)  # -> pickedGeometry; inputs run: Boolean, allowMultiple: Boolean, allowNone: Boolean, msg: String, clear: Boolean; disabled; same code as select_geo
subtraction_geometry = Geometry(select_geo_3)  # disabled

# ---- group: fx | SCRIPT | COLOR INDICATOR / F || COLOR INDICATOR (CLEAR GEO)
inputgeo_list = Relay([primary_geometry, addition_geometry, subtraction_geometry])
lng_3 = ListLength(List=flatten(inputgeo_list))
expression_5 = Expression(x=lng_3, Expression="if (x = 0,0,1)")
expression_6 = Expression(x=lng_3, Expression="if (x = 0,0,1)")
swatch_11 = ColourSwatch(SwatchColor=RGB(255, 255, 255))
swatch_12 = ColourSwatch(SwatchColor=RGB(0, 0, 0))
swatch_13 = ColourSwatch(SwatchColor=RGBA(255, 255, 255, 0))
swatch_14 = ColourSwatch(SwatchColor=RGB(222, 199, 27))
weave_6 = Weave(Pattern=expression_5, Stream0=swatch_12, Stream1=swatch_11, NullGaps=False)
weave_7 = Weave(Pattern=expression_6, Stream0=swatch_14, Stream1=swatch_13, NullGaps=False)
adjustelem_4 = AdjustElementAppearance(ElementsToAdjust=create_button_15, Foreground=weave_6, Background=weave_7)

# ---- group: fx | SCRIPT | COLOR INDICATOR / F || COLOR INDICATOR (SEL GEO)
lng_4 = ListLength(List=flatten(subtraction_geometry))
expression_7 = Expression(x=lng_4, Expression="if (x = 0,0,1)")
expression_8 = Expression(x=lng_4, Expression="if (x = 0,0,1)")
swatch_15 = ColourSwatch(SwatchColor=RGB(255, 255, 255))
swatch_16 = ColourSwatch(SwatchColor=RGB(0, 0, 0))
swatch_17 = ColourSwatch(SwatchColor=RGBA(255, 255, 255, 0))
swatch_18 = ColourSwatch(SwatchColor=RGB(222, 199, 27))
weave_8 = Weave(Pattern=expression_7, Stream0=swatch_15, Stream1=swatch_16, NullGaps=False)
weave_9 = Weave(Pattern=expression_8, Stream0=swatch_17, Stream1=swatch_18, NullGaps=False)
adjustelem_5 = AdjustElementAppearance(ElementsToAdjust=create_button_14, Foreground=weave_8, Background=weave_9)

# ---- group: Fx | P A T T E R N / fx | INPUT | OBJECT
boolean_toggle_4 = BooleanToggle(True)  # disabled
boolean_toggle_5 = BooleanToggle(True)  # disabled
select_geo_4 = SelectGeo(
    run=value_listener_44.Values,
    allowMultiple=boolean_toggle_4,
    allowNone=boolean_toggle_5,
    msg="Pick object(s)",
    clear=value_listener_54.Values)  # -> pickedGeometry; inputs run: Boolean, allowMultiple: Boolean, allowNone: Boolean, msg: String, clear: Boolean; disabled; same code as select_geo
object_geo = Geometry(select_geo_4)  # disabled
objfromgroup_2 = GetObjectsInGroup()

# ---- group: fx | SCRIPT | COLOR INDICATOR / F || COLOR INDICATOR (SEL GEO)
lng_5 = ListLength(List=flatten(object_geo))
expression_9 = Expression(x=lng_5, Expression="if (x = 0,0,1)")
expression_10 = Expression(x=lng_5, Expression="if (x = 0,0,1)")
swatch_19 = ColourSwatch(SwatchColor=RGB(255, 255, 255))
swatch_20 = ColourSwatch(SwatchColor=RGB(0, 0, 0))
swatch_21 = ColourSwatch(SwatchColor=RGBA(255, 255, 255, 0))
swatch_22 = ColourSwatch(SwatchColor=RGB(222, 199, 27))
weave_10 = Weave(Pattern=expression_9, Stream0=swatch_19, Stream1=swatch_20, NullGaps=False)
weave_11 = Weave(Pattern=expression_10, Stream0=swatch_21, Stream1=swatch_22, NullGaps=False)
adjustelem_6 = AdjustElementAppearance(ElementsToAdjust=create_button_11, Foreground=weave_10, Background=weave_11)

# ---- group: Fx | P A T T E R N / F || SCALE FACTORS / F || ATTRACTOR | REMAP SCALE
objfromgroup_3 = GetObjectsInGroup()

# ---- group: Fx | F O R M / fx | SCRIPT | BOOLEAN OPERATIONS / F || MESH OPERATIONS
objfromgroup_4 = GetObjectsInGroup()

# ---- group: ui | T | A R C H I T E C T U R A L / ui | F | R A I L I N G / ui | C1 | R A I L I N G / Embed IMG
solid = Data(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)
str2img_4 = DeserializeImageFromString(ImageString=solid)

steel = Data(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)
str2img_5 = DeserializeImageFromString(ImageString=steel)

glass = Data(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)
str2img_6 = DeserializeImageFromString(ImageString=glass)

glass_2 = Data(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)
str2img_7 = DeserializeImageFromString(ImageString=glass_2)

cable = Data(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)
str2img_8 = DeserializeImageFromString(ImageString=cable)

# ---- group: DOCUMENT INPUTS / EXPERIMENTAL FX | DECIVE SCREEN SIZE
get_screen_dimensions = GetScreenDimensions()  # -> Width, Height
expression_11 = Expression(x=get_screen_dimensions.Width, Expression="(1.6*x)/10")
_5_5_x_10 = Expression(x=get_screen_dimensions.Height, Expression="(5.1*x)/10")
width_2 = Maximum(A=expression_11, B=value_listener_4.Values)
height_2 = Maximum(A=_5_5_x_10, B=value_listener_5.Values)

# ---- group: ui | T | C O N C E P T U R A L / ui | F | F O R M / ui | E | F O R M / STACK | MAIN EXPANDER / cluster
create_grid = CreateGrid(column_1=column_1_elements_generator.column_1_elements, column_2=column_2_elements_generator, height_of_menu=width_2)  # -> elements, width_of_grid, height_2, row_def_2, columan_def, element_row, element_column, total_list_length

# ---- group: ui | T | C O N C E P T U R A L / ui | F | F O R M / ui | E | F O R M / STACK | MAIN EXPANDER
create_grid_2 = CreateGrid(
    UIElements=create_grid.elements,
    Width=create_grid.width_of_grid,
    Height=create_grid.height_2,
    RowDefinitions=create_grid.row_def_2,
    ColumnDefinitions=create_grid.columan_def,
    ElementRow=create_grid.element_row,
    ElementColumn=create_grid.element_column,
    ElementRowSpan=1,
    ElementColumnSpan=1)
all_expander_elements = Entwine(Branch00=create_grid_2, FlattenInputs=True)  # -> flatten(Result)
stack_4 = CreateStack(UIElements=all_expander_elements, Horizontal=False)

# ---- group: DOCUMENT INPUTS / GH DOCUMENT INFO
docinfo = DocumentInfo(AutoUpdate=True, Recursive=True)  # -> DocumentName, DocumentFilePath, Components, Params, _3rdPartyAssemblies
lng_6 = ListLength(List=docinfo._3rdPartyAssemblies)
file_path = Panel(docinfo._3rdPartyAssemblies)
panel_122 = Panel(lng_6)

# ---- group: UI |
trigger = Trigger(TimerInterval=20, Target=groups)  # disabled
panel_123 = Panel("UI | ")
groups = GetGroups()  # -> Groups, GroupStyles, Nickname, Color
swatch_23 = ColourSwatch(SwatchColor=RGB(124, 118, 146))
find_groups = FindGroups(L=groups.Groups, T=groups.Nickname, relay=panel_123)
setgroup = SetGroupProperties(Group=find_groups, Color=swatch_23)

# ---- group: ui | T |
trigger_2 = Trigger(TimerInterval=20, Target=groups_2)  # disabled
panel_124 = Panel("ui | T | ")
groups_2 = GetGroups()  # -> Groups, GroupStyles, Nickname, Color
swatch_24 = ColourSwatch(SwatchColor=RGB(124, 118, 146))
find_groups_2 = FindGroups(L=groups_2.Groups, T=groups_2.Nickname, relay=panel_124)
setgroup_2 = SetGroupProperties(Group=find_groups_2, Color=swatch_24)

# ---- group: ui | F |
trigger_3 = Trigger(TimerInterval=20, Target=groups_3)  # disabled
panel_125 = Panel("ui | F | ")
groups_3 = GetGroups()  # -> Groups, GroupStyles, Nickname, Color
swatch_25 = ColourSwatch(SwatchColor=RGB(193, 128, 183))
find_groups_3 = FindGroups(L=groups_3.Groups, T=groups_3.Nickname, relay=panel_125)
setgroup_3 = SetGroupProperties(Group=find_groups_3, Color=swatch_25)

# ---- group: ui | C1 |
trigger_4 = Trigger(TimerInterval=20, Target=groups_4)  # disabled
panel_126 = Panel("""ui | C1 | 
ui | C2 | 
ui | E | """)
groups_4 = GetGroups()  # -> Groups, GroupStyles, Nickname, Color
graft = GraftTree(Tree=panel_126, IncludeEmptyLists=True, IncludeNullItems=True)
swatch_26 = ColourSwatch(SwatchColor=RGB(156, 79, 108))
find_groups_4 = FindGroups(L=groups_4.Groups, T=groups_4.Nickname, relay=graft)
setgroup_4 = SetGroupProperties(Group=find_groups_4, Color=swatch_26)

# ---- group: STACK |
trigger_5 = Trigger(TimerInterval=20, Target=groups_5)  # disabled
panel_127 = Panel("STACK | ")
groups_5 = GetGroups()  # -> Groups, GroupStyles, Nickname, Color
graft_2 = GraftTree(Tree=panel_127, IncludeEmptyLists=True, IncludeNullItems=True)
swatch_27 = ColourSwatch(SwatchColor=RGB(220, 106, 108))
find_groups_5 = FindGroups(L=groups_5.Groups, T=groups_5.Nickname, relay=graft_2)
setgroup_5 = SetGroupProperties(Group=find_groups_5, Color=swatch_27)

# ---- group: ui | T | A R C H I T E C T U R A L / ui | F | F L O O R / ui | C1 | F L O O R / STACK | FOUNDATION / Embed IMG
foundation = Data(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)
str2img_9 = DeserializeImageFromString(ImageString=foundation)

# ---- group: ui | T | A R C H I T E C T U R A L / ui | F | R A I L I N G / ui | C1 | R A I L I N G / STACK | DIVISION
s_count = Slider(15, range=1..100)
d_length = Slider(3, range=0..10)
sub_count = Slider(3, range=1..50)
sub_length = Slider(0.5, range=0..5)
_5_create_slider = CreateSlider(Slider=s_count, SnapValue=1, ShowBounds=False, ShowTicks=False, ShowTooltip=False, ShowValLabel=True, showLabel=True)
_6_create_slider = CreateSlider(Slider=d_length, SnapValue=0.01, ShowBounds=False, ShowTicks=False, ShowTooltip=False, ShowValLabel=True, showLabel=True)
_7_create_slider = CreateSlider(Slider=sub_count, SnapValue=1, ShowBounds=False, ShowTicks=False, ShowTooltip=False, ShowValLabel=True, showLabel=True)
_8_create_slider_4 = CreateSlider(
    Slider=sub_length,
    SnapValue=0.1,
    ShowBounds=False,
    ShowTicks=False,
    ShowTooltip=False,
    ShowValLabel=True,
    showLabel=True)
value_listener_55 = ValueListener(Elements=_5_create_slider, SomeProperty=True)  # -> Values, Indices
value_listener_56 = ValueListener(Elements=_6_create_slider, SomeProperty=True)  # -> Values, Indices
value_listener_57 = ValueListener(Elements=_7_create_slider, SomeProperty=True)  # -> Values, Indices
value_listener_58 = ValueListener(Elements=_8_create_slider_4, SomeProperty=True)  # -> Values, Indices

# ---- group: TOOL TIPS | RAILING / cluster | D COUNT
panel_128 = Panel("SEGMENT COUNT | [COUNT] of [SEGMENT] divisions for [RAILING]")
attach_tooltip_to_element_55 = AttachTooltipToElement(ElementsToAttachTo=_5_create_slider, TooltipContent=panel_128, ShowDelay=100, Duration=2000)

# ---- group: TOOL TIPS | RAILING / cluster | D LENGTH
panel_129 = Panel("DIVISION LENGTH | [LENGTH] of divisions for [RAILING]")
attach_tooltip_to_element_56 = AttachTooltipToElement(ElementsToAttachTo=_6_create_slider, TooltipContent=panel_129, ShowDelay=100, Duration=2000)

# ---- group: TOOL TIPS | RAILING / cluster | SUB COUNT
panel_130 = Panel("SUB-DIVISION COUNT |  [COUNT] of sub-divisions for [STEEL] [RAILING].")
attach_tooltip_to_element_57 = AttachTooltipToElement(ElementsToAttachTo=_7_create_slider, TooltipContent=panel_130, ShowDelay=100, Duration=2000)

# ---- group: TOOL TIPS | RAILING / cluster | SUB LENGTH
panel_131 = Panel("SUB DIVISION LENGTH | [LENGTH] of sub-divisions for [STEEL] [RAILING].")
attach_tooltip_to_element_58 = AttachTooltipToElement(ElementsToAttachTo=_8_create_slider_4, TooltipContent=panel_131, ShowDelay=100, Duration=4000)

# ---- group: ui | T | A R C H I T E C T U R A L / ui | F | R A I L I N G / ui | C1 | R A I L I N G / STACK | BASIC VERTICAL ELEMENTS
r_height = Slider(4, range=0.01..10)
t_offset = Slider(0.29, range=0.01..5)
b_offset = Slider(0.5, range=0.01..5)
_9_create_slider = CreateSlider(Slider=r_height, SnapValue=0.01, ShowBounds=False, ShowTicks=False, ShowTooltip=False, ShowValLabel=True, showLabel=True)
_10_create_slider_10 = CreateSlider(Slider=t_offset, SnapValue=0.01, ShowBounds=False, ShowTicks=False, ShowTooltip=False, ShowValLabel=True, showLabel=True)
_11_create_slider_2 = CreateSlider(Slider=b_offset, SnapValue=0.01, ShowBounds=False, ShowTicks=False, ShowTooltip=False, ShowValLabel=True, showLabel=True)
value_listener_59 = ValueListener(Elements=_9_create_slider, SomeProperty=True)  # -> Values, Indices
value_listener_60 = ValueListener(Elements=_10_create_slider_10, SomeProperty=True)  # -> Values, Indices
value_listener_61 = ValueListener(Elements=_11_create_slider_2, SomeProperty=True)  # -> Values, Indices

# ---- group: TOOL TIPS | RAILING / cluster | R HEIGHT
panel_132 = Panel("RAILING HEIGHT | Total [HEIGHT] of [RALINGING].")
attach_tooltip_to_element_59 = AttachTooltipToElement(ElementsToAttachTo=_9_create_slider, TooltipContent=panel_132, ShowDelay=100, Duration=4000)

# ---- group: TOOL TIPS | RAILING / cluster | T. OFFSET
panel_133 = Panel("TOP OFFSET | [OFFSET] distance from [TOP] edge.")
attach_tooltip_to_element_60 = AttachTooltipToElement(ElementsToAttachTo=_10_create_slider_10, TooltipContent=panel_133, ShowDelay=100, Duration=2000)

# ---- group: TOOL TIPS | RAILING / cluster | B. OFFSET
panel_134 = Panel("BOTTOM OFFSET | [OFFSET] distance from [BOTTOM] edge.")
attach_tooltip_to_element_61 = AttachTooltipToElement(ElementsToAttachTo=_11_create_slider_2, TooltipContent=panel_134, ShowDelay=100, Duration=2000)

# ---- group: ui | T | A R C H I T E C T U R A L / ui | F | R A I L I N G / ui | C1 | R A I L I N G / STACK | BASIC HORIZONTAL ELEMENTS
p_width = Slider(0.055, range=0.001..2)
sub_width = Slider(0.04, range=0..2)
h_radius = Slider(0.05, range=0.001..2)
_12_create_slider_2 = CreateSlider(Slider=p_width, SnapValue=0.001, ShowBounds=False, ShowTicks=False, ShowTooltip=False, ShowValLabel=True, showLabel=True)
_13_create_slider_2 = CreateSlider(
    Slider=sub_width,
    SnapValue=0.01,
    ShowBounds=False,
    ShowTicks=False,
    ShowTooltip=False,
    ShowValLabel=True,
    showLabel=True)
_14_create_slider = CreateSlider(
    Slider=h_radius,
    SnapValue=0.001,
    ShowBounds=False,
    ShowTicks=False,
    ShowTooltip=False,
    ShowValLabel=True,
    showLabel=True)
value_listener_62 = ValueListener(Elements=_12_create_slider_2, SomeProperty=True)  # -> Values, Indices
value_listener_63 = ValueListener(Elements=_13_create_slider_2, SomeProperty=True)  # -> Values, Indices
value_listener_64 = ValueListener(Elements=_14_create_slider, SomeProperty=True)  # -> Values, Indices

# ---- group: TOOL TIPS | RAILING / cluster | P. WIDTH
attach_tooltip_to_element_62 = AttachTooltipToElement(
    ElementsToAttachTo=_12_create_slider_2,
    TooltipContent="POST WIDTH | [WIDTH] of individual [POST] of [RAILING].",
    ShowDelay=100,
    Duration=2000)

# ---- group: TOOL TIPS | RAILING / cluster | SUB WIDTH
panel_135 = Panel("SUB WIDTH | [WIDTH] of individual [INTERIOR] [POST] of [RAILING].")
attach_tooltip_to_element_63 = AttachTooltipToElement(ElementsToAttachTo=_13_create_slider_2, TooltipContent=panel_135, ShowDelay=100, Duration=2000)

# ---- group: TOOL TIPS | RAILING / cluster | H. RADIUS
attach_tooltip_to_element_64 = AttachTooltipToElement(
    ElementsToAttachTo=_14_create_slider,
    TooltipContent="HANDLE RADIUS | [RADIUS]/ [WIDTH] of [RAILING] [HANDLE].",
    ShowDelay=100,
    Duration=2000)

# ---- group: ui | T | A R C H I T E C T U R A L / ui | F | R A I L I N G / ui | C1 | R A I L I N G / STACK | CABLE
c_count = Slider(5, range=1..10)
c_radius = Slider(0.015, range=0.001..0.5)
create_slider_8 = CreateSlider(Slider=c_count, SnapValue=1, ShowBounds=False, ShowTicks=False, ShowTooltip=False, ShowValLabel=True, showLabel=True)
create_slider_9 = CreateSlider(
    Slider=c_radius,
    SnapValue=0.001,
    ShowBounds=False,
    ShowTicks=False,
    ShowTooltip=False,
    ShowValLabel=True,
    showLabel=True)
value_listener_65 = ValueListener(Elements=create_slider_8, SomeProperty=True)  # -> Values, Indices
value_listener_66 = ValueListener(Elements=create_slider_9, SomeProperty=True)  # -> Values, Indices

# ---- group: TOOL TIPS | RAILING / cluster | C. COUNT
attach_tooltip_to_element_65 = AttachTooltipToElement(ElementsToAttachTo=create_slider_8, TooltipContent="CABLE COUNT | [COUNT] of [CABLE].", ShowDelay=100, Duration=2000)

# ---- group: TOOL TIPS | RAILING / cluster | C. RADIUS
attach_tooltip_to_element_66 = AttachTooltipToElement(ElementsToAttachTo=create_slider_9, TooltipContent="CABLE RADIUS | [RADIUS] of [CABLE].", ShowDelay=100, Duration=2000)

# ---- group: ui | T | A R C H I T E C T U R A L / ui | F | R A I L I N G / ui | C1 | R A I L I N G / STACK | CLIP
c_width = Slider(0.17, range=0..2)
c_thickness = Slider(0.03, range=0..1)
create_slider_10 = CreateSlider(
    Slider=c_thickness,
    SnapValue=0.01,
    ShowBounds=False,
    ShowTicks=False,
    ShowTooltip=False,
    ShowValLabel=True,
    showLabel=True)
create_slider_11 = CreateSlider(Slider=c_width, SnapValue=0.01, ShowBounds=False, ShowTicks=False, ShowTooltip=False, ShowValLabel=True, showLabel=True)
value_listener_67 = ValueListener(Elements=create_slider_10, SomeProperty=True)  # -> Values, Indices
value_listener_68 = ValueListener(Elements=create_slider_11, SomeProperty=True)  # -> Values, Indices

# ---- group: TOOL TIPS | RAILING / cluster | C. THICKNESS
panel_136 = Panel("""CLIP THICKNESS | [THICKNESS] of [GLASS CLIP] 
CLIP THICKNESS <= POST WIDTH""")
attach_tooltip_to_element_67 = AttachTooltipToElement(ElementsToAttachTo=create_slider_10, TooltipContent=panel_136, ShowDelay=100, Duration=2000)

# ---- group: TOOL TIPS | RAILING / cluster | C. WIDTH
attach_tooltip_to_element_68 = AttachTooltipToElement(
    ElementsToAttachTo=create_slider_11,
    TooltipContent="CLIP WIDTH | [WIDTH] of [GLASS CLIP].",
    ShowDelay=100,
    Duration=2000)

# ---- group: ui | T | A R C H I T E C T U R A L / ui | F | R A I L I N G / ui | C1 | R A I L I N G / STACK | GLASS
g_offset = Slider(0.17, range=0..2)
g_thickness = Slider(0.01, range=0.001..0.2)
create_slider_12 = CreateSlider(Slider=g_offset, SnapValue=0.01, ShowBounds=False, ShowTicks=False, ShowTooltip=False, ShowValLabel=True, showLabel=True)
create_slider_13 = CreateSlider(
    Slider=g_thickness,
    SnapValue=0.0001,
    ShowBounds=False,
    ShowTicks=False,
    ShowTooltip=False,
    ShowValLabel=True,
    showLabel=True)
value_listener_69 = ValueListener(Elements=create_slider_12, SomeProperty=True)  # -> Values, Indices
value_listener_70 = ValueListener(Elements=create_slider_13, SomeProperty=True)  # -> Values, Indices

# ---- group: TOOL TIPS | RAILING / cluster | G. OFFSET
panel_137 = Panel("GLASS OFFSET | [OFFSET] distance of [GLASS] edges from [POST] edges.")
attach_tooltip_to_element_69 = AttachTooltipToElement(ElementsToAttachTo=create_slider_12, TooltipContent=panel_137, ShowDelay=100, Duration=2000)

# ---- group: TOOL TIPS | RAILING / cluster | G. THICIKNESS
attach_tooltip_to_element_70 = AttachTooltipToElement(
    ElementsToAttachTo=create_slider_13,
    TooltipContent="GLASS THICKNESS | [THICKNESS] of [RAILING] [GLASS].",
    ShowDelay=100,
    Duration=2000)

# ---- group: ui | T | A R C H I T E C T U R A L / ui | F | F L O O R / ui | C1 | F L O O R / STACK | FOUNDATION / Embed IMG
waffle = Data(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)
str2img_10 = DeserializeImageFromString(ImageString=waffle)

joist = Data(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)
str2img_11 = DeserializeImageFromString(ImageString=joist)

# ---- group: ui | T | A R C H I T E C T U R A L / ui | F | F L O O R / ui | C1 | F L O O R / STACK | TILE CREATION
u_division = Slider(2, range=2..100)
v_division = Slider(2, range=2..100)
alteration = Slider(0, range=0..100)
gap_width = Slider(0.01, range=0..0.5)
# FRAME CREATION
tolerance = Slider(0.15, range=0..0.5)
panel_138 = Panel("FLIP UV")
_10_create_slider_11 = CreateSlider(Slider=u_division, SnapValue=1, ShowBounds=False, ShowTicks=False, ShowTooltip=False, ShowValLabel=True, showLabel=True)
_11_create_slider_3 = CreateSlider(Slider=v_division, SnapValue=1, ShowBounds=False, ShowTicks=False, ShowTooltip=False, ShowValLabel=True, showLabel=True)
_12_create_slider_3 = CreateSlider(
    Slider=alteration,
    SnapValue=0.01,
    ShowBounds=False,
    ShowTicks=False,
    ShowTooltip=False,
    ShowValLabel=True,
    showLabel=True)
_13_create_slider_3 = CreateSlider(
    Slider=gap_width,
    SnapValue=0.001,
    ShowBounds=False,
    ShowTicks=False,
    ShowTooltip=False,
    ShowValLabel=True,
    showLabel=True)
_13_create_slider_4 = CreateSlider(
    Slider=tolerance,
    SnapValue=0.001,
    ShowBounds=False,
    ShowTicks=False,
    ShowTooltip=False,
    ShowValLabel=True,
    showLabel=True)
_1_disaply_toogle_10 = CreateToggle(Default=False, OnLabel=panel_138, OffLabel=panel_138)
value_listener_71 = ValueListener(Elements=_1_disaply_toogle_10, SomeProperty=True)  # -> Values, Indices
value_listener_72 = ValueListener(Elements=_10_create_slider_11, SomeProperty=True)  # -> Values, Indices
value_listener_73 = ValueListener(Elements=_11_create_slider_3, SomeProperty=True)  # -> Values, Indices
value_listener_74 = ValueListener(Elements=_12_create_slider_3, SomeProperty=True)  # -> Values, Indices
value_listener_75 = ValueListener(Elements=_13_create_slider_3, SomeProperty=True)  # -> Values, Indices
value_listener_76 = ValueListener(Elements=_13_create_slider_4, SomeProperty=True)  # -> Values, Indices

# ---- group: TOOL TIPS | FLOOR / cluster | FLIP UV
panel_139 = Panel("FLIP UV | Flip [Surface UV] of [TILE] pattern. (look up SURFACE MAPPING)")
attach_tooltip_to_element_71 = AttachTooltipToElement(ElementsToAttachTo=_1_disaply_toogle_10, TooltipContent=panel_139, ShowDelay=100, Duration=2000)

# ---- group: TOOL TIPS | FLOOR / cluster | U DIV
panel_140 = Panel("U DIVISION | [TILE] [DIVISION]/ [COUNT] in the surface U direction.")
attach_tooltip_to_element_72 = AttachTooltipToElement(ElementsToAttachTo=_10_create_slider_11, TooltipContent=panel_140, ShowDelay=100, Duration=2000)

# ---- group: TOOL TIPS | FLOOR / cluster | V DIV
panel_141 = Panel("V DIVISION | [TILE] [DIVISION]/ [COUNT] in the surface V direction.")
attach_tooltip_to_element_73 = AttachTooltipToElement(ElementsToAttachTo=_11_create_slider_3, TooltipContent=panel_141, ShowDelay=100, Duration=2000)

# ---- group: TOOL TIPS | FLOOR / cluster | ALTERATION
panel_142 = Panel("ALTERATION | [SEED] for randomization.")
attach_tooltip_to_element_74 = AttachTooltipToElement(ElementsToAttachTo=_12_create_slider_3, TooltipContent=panel_142, ShowDelay=100, Duration=2000)

# ---- group: TOOL TIPS | FLOOR / cluster | GAP WIDTH
panel_143 = Panel("""GAP WIDTH | [WIDTH] and [DEPTH] of gaps between [TILE PANELS].
GAP WIDTH > 0 | SOLID OUTPUT
GAP WIDTH = 0 | SURFACE OUTPUT""")
attach_tooltip_to_element_75 = AttachTooltipToElement(ElementsToAttachTo=_13_create_slider_3, TooltipContent=panel_143, ShowDelay=100, Duration=4000)

# ---- group: TOOL TIPS | FLOOR / cluster | TOLERANCE
panel_144 = Panel("""TOLERANCE | [TOLERANCE] for sorting panels for irregular shaped floor slabs.
If no problem, JUST LEAVE IT.""")
attach_tooltip_to_element_76 = AttachTooltipToElement(ElementsToAttachTo=_13_create_slider_4, TooltipContent=panel_144, ShowDelay=100, Duration=2000)

# ---- group: ui | T | A R C H I T E C T U R A L
# EXPANDER :: A R C H I T E C T U R A L
c_radius_2 = Slider(0.02, range=0.001..0.5)
panel_145 = Panel("""SINGLE CRV (OPEN)
DOUBLE CRV (OPEN)""")

# ---- group: ui | T | A R C H I T E C T U R A L / ui | F | W A L L / ui | C1 | W A L L / STACK | DEFAULT
# COLUMN 1 ELEMENT
panel_146 = Panel("""SINGLE CRV (OPEN)
DOUBLE CRV (OPEN)
BORDER CRV OR SRF
SINGE CRV (CLOSED)
DOUBLE CRV (CLOSED)""")
panel_147 = Panel("""SINGLE CRV (OPEN)
DOUBLE CRV (OPEN)
BORDER CRV OR SRF""")
max_height = Slider(8, range=0.1..30)
width_3 = Slider(0.5, range=0.1..5)
min_height = Slider(4, range=0.1..30)
alliteration = Slider(0, range=0..100)
panel_148 = Panel("""SOLID
BRICK
CURTAIN
CHANNEL GLASS""")
panel_149 = Panel("""UNIFROM
RANDOMIZED""")
panel_150 = Panel("""STICKS
SPIDERS""")
panel_151 = Panel("""         +
         0
         -""")
panel_152 = Panel("INPUT")
panel_153 = Panel(" HEIGHT(S)")
panel_154 = Panel("O. DIRECTION")
panel_155 = Panel("TYPE")
panel_156 = Panel("FRAME")
panel_157 = Panel("1")
panel_158 = Panel("   SOLVER ON")
panel_159 = Panel("   SOLVER OFF")
panel_160 = Panel("Wall Creation")
_3_create_pulldown_menu = CreatePulldownMenu(Label=panel_155, ListItems=panel_148, showLabel=True)
_4_create_pulldown_menu = CreatePulldownMenu(Label=panel_153, ListItems=panel_149, SelectedIndex=0, showLabel=True)
_5_create_pulldown_menu = CreatePulldownMenu(Label=panel_154, ListItems=panel_151, SelectedIndex=panel_157, showLabel=True)
_6_create_pulldown_menu = CreatePulldownMenu(Label=panel_156, ListItems=panel_150, SelectedIndex=0, showLabel=True)
_7_create_slider_2 = CreateSlider(Slider=width_3, SnapValue=0.01, ShowBounds=False, ShowTicks=False, ShowTooltip=False, ShowValLabel=True, showLabel=True)
_8_create_slider_5 = CreateSlider(
    Slider=max_height,
    SnapValue=0.01,
    ShowBounds=False,
    ShowTicks=False,
    ShowTooltip=False,
    ShowValLabel=True,
    showLabel=True)
_9_create_slider_2 = CreateSlider(
    Slider=min_height,
    SnapValue=0.01,
    ShowBounds=False,
    ShowTicks=False,
    ShowTooltip=False,
    ShowValLabel=True,
    showLabel=True)
_10_create_slider_12 = CreateSlider(
    Slider=alliteration,
    SnapValue=1,
    ShowBounds=False,
    ShowTicks=False,
    ShowTooltip=False,
    ShowValLabel=True,
    showLabel=True)
toggle_28 = CreateToggle(Default=False, OnLabel=panel_158, OffLabel=panel_159)
value_listener_77 = ValueListener(Elements=_7_create_slider_2, SomeProperty=True)  # -> Values, Indices
value_listener_78 = ValueListener(Elements=_8_create_slider_5, SomeProperty=True)  # -> Values, Indices
value_listener_79 = ValueListener(Elements=_9_create_slider_2, SomeProperty=True)  # -> Values, Indices
value_listener_80 = ValueListener(Elements=_10_create_slider_12, SomeProperty=True)  # -> Values, Indices
type_index = ValueListener(Elements=_3_create_pulldown_menu, SomeProperty=True)  # -> Values, Indices
value_listener_81 = ValueListener(Elements=_4_create_pulldown_menu, SomeProperty=True)  # -> Values, Indices
value_listener_82 = ValueListener(Elements=_5_create_pulldown_menu, SomeProperty=True)  # -> Values, Indices
value_listener_83 = ValueListener(Elements=_6_create_pulldown_menu, SomeProperty=True)  # -> Values, Indices
value_listener_84 = ValueListener(Elements=toggle_28, SomeProperty=True)  # -> Values, Indices
# W A L L   E X P A N D E R (human UI)
_0_create_label_8 = CreateLabel(LabelText=panel_160, LabelSize=12, Justification=0)
panel_161 = Panel(value_listener_81.Indices)
panel_162 = Panel(value_listener_83.Indices)
panel_163 = Panel(type_index.Indices)
menus = Weave(Pattern=panel_163, Stream0=panel_146, Stream1=panel_147, Stream2=panel_147, Stream3=panel_145, NullGaps=False)
_2_create_pulldown_menu_13 = CreatePulldownMenu(Label=panel_152, ListItems=menus, SelectedIndex=0, showLabel=True)
input_index_13 = ValueListener(Elements=_2_create_pulldown_menu_13, SomeProperty=True)  # -> Values, Indices
panel_164 = Panel(input_index_13.Indices)

# ---- group: TOOL TIPS | WALL / cluster | SOLVER
# COLUMN 1 ELEMENT
panel_165 = Panel("""1 | SOLVER | FIREST [TURN ON] [SOLVER] to start this function.
and [TURN OFF] afterwards to avoid [CRASH].""")
attach_tooltip_to_element_77 = AttachTooltipToElement(ElementsToAttachTo=toggle_28, TooltipContent=panel_165, ShowDelay=100, Duration=2000)

# ---- group: TOOL TIPS | WALL / cluster | INPUT
panel_166 = Panel("2 | INPUT | Select type of reference [RHINO] geometry [INPUT] for the function.")
attach_tooltip_to_element_78 = AttachTooltipToElement(ElementsToAttachTo=_2_create_pulldown_menu_13, TooltipContent=panel_166, ShowDelay=100, Duration=3000)

# ---- group: TOOL TIPS | WALL / cluster | TYPE
panel_167 = Panel("TYPE | Select type of [WALL].")
attach_tooltip_to_element_79 = AttachTooltipToElement(ElementsToAttachTo=_3_create_pulldown_menu, TooltipContent=panel_167, ShowDelay=100, Duration=2000)

# ---- group: TOOL TIPS | WALL / cluster | HEIGHT
panel_168 = Panel("HEIGHT | select [HEIGHT] dimension system for walls.")
attach_tooltip_to_element_80 = AttachTooltipToElement(ElementsToAttachTo=_4_create_pulldown_menu, TooltipContent=panel_168, ShowDelay=100, Duration=2000)

# ---- group: TOOL TIPS | WALL / cluster | O.DIRECTION
panel_169 = Panel("OFFSET DIRECTION | Select the [DIRECTION] of [OFFSET] of the wall(s).")
attach_tooltip_to_element_81 = AttachTooltipToElement(ElementsToAttachTo=_5_create_pulldown_menu, TooltipContent=panel_169, ShowDelay=100, Duration=2000)

# ---- group: TOOL TIPS | WALL / cluster | FRAME
panel_170 = Panel("FRAME | Select [FRAME] type for [CURTAIN WALL].")
attach_tooltip_to_element_82 = AttachTooltipToElement(ElementsToAttachTo=_6_create_pulldown_menu, TooltipContent=panel_170, ShowDelay=100, Duration=2000)

# ---- group: TOOL TIPS | WALL / cluster | ALTERATION
panel_171 = Panel("ALTERATION | [SEED] for randomization.")
attach_tooltip_to_element_83 = AttachTooltipToElement(ElementsToAttachTo=_10_create_slider_12, TooltipContent=panel_171, ShowDelay=100, Duration=2000)

# ---- group: TOOL TIPS | WALL / cluster | WIDTH
panel_172 = Panel("WIDTH | [WIDTH] of walls.")
attach_tooltip_to_element_84 = AttachTooltipToElement(ElementsToAttachTo=_7_create_slider_2, TooltipContent=panel_172, ShowDelay=100, Duration=2000)

# ---- group: TOOL TIPS | WALL / cluster | MAX HEIGHT
panel_173 = Panel("MAX HEIGHT | [MAXIMUM] || [HEIGHT] of walls.")
attach_tooltip_to_element_85 = AttachTooltipToElement(ElementsToAttachTo=_8_create_slider_5, TooltipContent=panel_173, ShowDelay=100, Duration=2000)

# ---- group: TOOL TIPS | WALL / cluster | MIN HEIGHT
panel_174 = Panel("MIN HEIGHT | [MINIMUM] [HEIGHT] of walls.")
attach_tooltip_to_element_86 = AttachTooltipToElement(ElementsToAttachTo=_9_create_slider_2, TooltipContent=panel_174, ShowDelay=100, Duration=2000)

# ---- group: ui | T | A R C H I T E C T U R A L / ui | F | W A L L / ui | C1 | W A L L / STACK | GLASS
s_count_2 = Slider(8, range=1..100)
s_length = Slider(3, range=0..10)
g_thickness_2 = Slider(0.01, range=0.001..0.2)
panel_175 = Panel("""COUNT
LENGTH""")
panel_176 = Panel("DIVISION")
_4_create_pulldown_menu_2 = CreatePulldownMenu(Label=panel_176, ListItems=panel_175, SelectedIndex=0, showLabel=True)
_5_create_slider_2 = CreateSlider(Slider=s_count_2, SnapValue=1, ShowBounds=False, ShowTicks=False, ShowTooltip=False, ShowValLabel=True, showLabel=True)
_6_create_slider_2 = CreateSlider(Slider=s_length, SnapValue=0.01, ShowBounds=False, ShowTicks=False, ShowTooltip=False, ShowValLabel=True, showLabel=True)
create_slider_14 = CreateSlider(
    Slider=g_thickness_2,
    SnapValue=0.001,
    ShowBounds=False,
    ShowTicks=False,
    ShowTooltip=False,
    ShowValLabel=True,
    showLabel=True)
value_listener_85 = ValueListener(Elements=_5_create_slider_2, SomeProperty=True)  # -> Values, Indices
value_listener_86 = ValueListener(Elements=_6_create_slider_2, SomeProperty=True)  # -> Values, Indices
value_listener_87 = ValueListener(Elements=create_slider_14, SomeProperty=True)  # -> Values, Indices
value_listener_88 = ValueListener(Elements=_4_create_pulldown_menu_2, SomeProperty=True)  # -> Values, Indices
panel_177 = Panel(value_listener_88.Indices)

# ---- group: TOOL TIPS | WALL / cluster | DIVISION
panel_178 = Panel("""DIVISION | Vertical [GLASS MULLION] [DIVISION] system for walls.
COUNT | Divide [INPUT] by a fixed [COUNT] of [SEGMENT]s.
LENGTH | Divide [INPUT] by a fixed [LENGTH] of a [SEGMENTS].""")
attach_tooltip_to_element_87 = AttachTooltipToElement(ElementsToAttachTo=_4_create_pulldown_menu_2, TooltipContent=panel_178, ShowDelay=100, Duration=2000)

# ---- group: TOOL TIPS | WALL / cluster | S. COUNT
panel_179 = Panel("SEGMENT COUNT | [COUNT] of [SEGMENT].")
attach_tooltip_to_element_88 = AttachTooltipToElement(ElementsToAttachTo=_5_create_slider_2, TooltipContent=panel_179, ShowDelay=100, Duration=2000)

# ---- group: TOOL TIPS | WALL / cluster | S. LENGTH
attach_tooltip_to_element_89 = AttachTooltipToElement(
    ElementsToAttachTo=_6_create_slider_2,
    TooltipContent="SEGMENT LENGTH | [LENGTH] of [SEGMENT].",
    ShowDelay=100,
    Duration=2000)

# ---- group: ui | T | A R C H I T E C T U R A L / ui | F | F L O O R / ui | C1 | F L O O R / STACK | INPUT BREP
lvl_1_height = Slider(15, range=0.01..50)
lvl_2_height = Slider(10, range=0.01..50)
lvl_count = Slider(2, range=2..100)
_7_create_slider_3 = CreateSlider(
    Slider=lvl_1_height,
    SnapValue=0.01,
    ShowBounds=False,
    ShowTicks=False,
    ShowTooltip=False,
    ShowValLabel=True,
    showLabel=True)
_8_create_slider_6 = CreateSlider(
    Slider=lvl_2_height,
    SnapValue=0.01,
    ShowBounds=False,
    ShowTicks=False,
    ShowTooltip=False,
    ShowValLabel=True,
    showLabel=True)
_8_create_slider_7 = CreateSlider(Slider=lvl_count, SnapValue=1, ShowBounds=False, ShowTicks=False, ShowTooltip=False, ShowValLabel=True, showLabel=True)
value_listener_89 = ValueListener(Elements=_7_create_slider_3, SomeProperty=True)  # -> Values, Indices
value_listener_90 = ValueListener(Elements=_8_create_slider_6, SomeProperty=True)  # -> Values, Indices
value_listener_91 = ValueListener(Elements=_8_create_slider_7, SomeProperty=True)  # -> Values, Indices

# ---- group: TOOL TIPS | FLOOR / cluster | LVL 1 HEIGHT
panel_180 = Panel("LVL 1 HEIGHT | Floor to ceiling height of level 1.")
attach_tooltip_to_element_90 = AttachTooltipToElement(ElementsToAttachTo=_7_create_slider_3, TooltipContent=panel_180, ShowDelay=100, Duration=2000)

# ---- group: TOOL TIPS | FLOOR / cluster | LVL 2+ HEIGHT
panel_181 = Panel("LVL 1 HEIGHT | Floor to ceiling height of level 2 and so on.")
attach_tooltip_to_element_91 = AttachTooltipToElement(ElementsToAttachTo=_8_create_slider_6, TooltipContent=panel_181, ShowDelay=100, Duration=2000)

# ---- group: TOOL TIPS | FLOOR / cluster | LVL COUNT
panel_182 = Panel("LVL COUNT | Number of levels inside the envelope shape.")
attach_tooltip_to_element_92 = AttachTooltipToElement(ElementsToAttachTo=_8_create_slider_7, TooltipContent=panel_182, ShowDelay=100, Duration=2000)

# ---- group: ui | T | A R C H I T E C T U R A L / ui | F | F L O O R / ui | C1 | F L O O R / STACK | BEAM
depth_1 = Slider(0.667, range=0.01..5)
width_1 = Slider(0.666, range=0.01..5)
t_web_1 = Slider(0.024, range=0.01..5)
t_flange_1 = Slider(0.036, range=0.01..5)
depth_2 = Slider(0.667, range=0.01..5)
width_2_2 = Slider(0.666, range=0.01..5)
t_web_2 = Slider(0.024, range=0.01..5)
t_flange_2 = Slider(0.036, range=0.01..5)
panel_183 = Panel("UNIFORM UV SIZES")
create_slider_15 = CreateSlider(Slider=depth_1, SnapValue=0.001, ShowBounds=False, ShowTicks=False, ShowTooltip=False, ShowValLabel=True, showLabel=True)
create_slider_16 = CreateSlider(Slider=width_1, SnapValue=0.001, ShowBounds=False, ShowTicks=False, ShowTooltip=False, ShowValLabel=True, showLabel=True)
create_slider_17 = CreateSlider(Slider=t_web_1, SnapValue=0.001, ShowBounds=False, ShowTicks=False, ShowTooltip=False, ShowValLabel=True, showLabel=True)
create_slider_18 = CreateSlider(
    Slider=t_flange_1,
    SnapValue=0.001,
    ShowBounds=False,
    ShowTicks=False,
    ShowTooltip=False,
    ShowValLabel=True,
    showLabel=True)
create_slider_19 = CreateSlider(Slider=depth_2, SnapValue=0.001, ShowBounds=False, ShowTicks=False, ShowTooltip=False, ShowValLabel=True, showLabel=True)
create_slider_20 = CreateSlider(
    Slider=width_2_2,
    SnapValue=0.001,
    ShowBounds=False,
    ShowTicks=False,
    ShowTooltip=False,
    ShowValLabel=True,
    showLabel=True)
create_slider_21 = CreateSlider(Slider=t_web_2, SnapValue=0.001, ShowBounds=False, ShowTicks=False, ShowTooltip=False, ShowValLabel=True, showLabel=True)
create_slider_22 = CreateSlider(
    Slider=t_flange_2,
    SnapValue=0.001,
    ShowBounds=False,
    ShowTicks=False,
    ShowTooltip=False,
    ShowValLabel=True,
    showLabel=True)
_1_disaply_toogle_11 = CreateToggle(Default=True, OnLabel=panel_183, OffLabel=panel_183)
value_listener_92 = ValueListener(Elements=_1_disaply_toogle_11, SomeProperty=True)  # -> Values, Indices
value_listener_93 = ValueListener(Elements=create_slider_15, SomeProperty=True)  # -> Values, Indices
value_listener_94 = ValueListener(Elements=create_slider_16, SomeProperty=True)  # -> Values, Indices
value_listener_95 = ValueListener(Elements=create_slider_17, SomeProperty=True)  # -> Values, Indices
value_listener_96 = ValueListener(Elements=create_slider_18, SomeProperty=True)  # -> Values, Indices
value_listener_97 = ValueListener(Elements=create_slider_19, SomeProperty=True)  # -> Values, Indices
value_listener_98 = ValueListener(Elements=create_slider_20, SomeProperty=True)  # -> Values, Indices
value_listener_99 = ValueListener(Elements=create_slider_21, SomeProperty=True)  # -> Values, Indices
value_listener_100 = ValueListener(Elements=create_slider_22, SomeProperty=True)  # -> Values, Indices

# ---- group: TOOL TIPS | FLOOR / cluster | DEPTH 1
panel_184 = Panel("DEPTH 1 | [DEPTH] of [JOIST] members in the surface U direction.")
attach_tooltip_to_element_93 = AttachTooltipToElement(ElementsToAttachTo=create_slider_15, TooltipContent=panel_184, ShowDelay=100, Duration=2000)

# ---- group: TOOL TIPS | FLOOR / cluster | WIDTH 1
panel_185 = Panel("WIDTH 1 | [WIDTH] of [JOIST] members in the surface U direction.")
attach_tooltip_to_element_94 = AttachTooltipToElement(ElementsToAttachTo=create_slider_16, TooltipContent=panel_185, ShowDelay=100, Duration=2000)

# ---- group: TOOL TIPS | FLOOR / cluster | T.WEB 1
panel_186 = Panel("WEB THICKNES 1 | [WEB THICKNESS] of [JOIST] members in the surface U direction.")
attach_tooltip_to_element_95 = AttachTooltipToElement(ElementsToAttachTo=create_slider_17, TooltipContent=panel_186, ShowDelay=100, Duration=2000)

# ---- group: TOOL TIPS | FLOOR / cluster | T.FLANGE 1
panel_187 = Panel("FLANGE THICKNES 1 | [FLANGE THICKNESS] of [JOIST] members in the surface U direction.")
attach_tooltip_to_element_96 = AttachTooltipToElement(ElementsToAttachTo=create_slider_18, TooltipContent=panel_187, ShowDelay=100, Duration=2000)

# ---- group: TOOL TIPS | FLOOR / cluster | DEPTH 2
panel_188 = Panel("DEPTH 2 | [DEPTH] of [JOIST] members in the surface V direction.")
attach_tooltip_to_element_97 = AttachTooltipToElement(ElementsToAttachTo=create_slider_19, TooltipContent=panel_188, ShowDelay=100, Duration=2000)

# ---- group: TOOL TIPS | FLOOR / cluster | WIDTH 2
panel_189 = Panel("WIDTH 2 | [WIDTH] of [JOIST] members in the surface V direction.")
attach_tooltip_to_element_98 = AttachTooltipToElement(ElementsToAttachTo=create_slider_20, TooltipContent=panel_189, ShowDelay=100, Duration=2000)

# ---- group: TOOL TIPS | FLOOR / cluster | T.WEB 2
panel_190 = Panel("WEB THICKNES 2 | [WEB THICKNESS] of [JOIST] members in the surface V direction.")
attach_tooltip_to_element_99 = AttachTooltipToElement(ElementsToAttachTo=create_slider_21, TooltipContent=panel_190, ShowDelay=100, Duration=2000)

# ---- group: TOOL TIPS | FLOOR / cluster | T.FLANGE 2
panel_191 = Panel("FLANGE THICKNES 2 | [FLANGE THICKNESS] of [JOIST] members in the surface V direction.")
attach_tooltip_to_element_100 = AttachTooltipToElement(ElementsToAttachTo=create_slider_22, TooltipContent=panel_191, ShowDelay=100, Duration=2000)

# ---- group: ui | T | A R C H I T E C T U R A L / ui | F | F L O O R / ui | C1 | F L O O R / STACK | FRAME DEFAULT
u_division_2 = Slider(2, range=2..50)
v_division_2 = Slider(2, range=2..50)
create_slider_23 = CreateSlider(
    Slider=u_division_2,
    SnapValue=1,
    ShowBounds=False,
    ShowTicks=False,
    ShowTooltip=False,
    ShowValLabel=True,
    showLabel=True)
create_slider_24 = CreateSlider(
    Slider=v_division_2,
    SnapValue=1,
    ShowBounds=False,
    ShowTicks=False,
    ShowTooltip=False,
    ShowValLabel=True,
    showLabel=True)
value_listener_101 = ValueListener(Elements=create_slider_23, SomeProperty=True)  # -> Values, Indices
value_listener_102 = ValueListener(Elements=create_slider_24, SomeProperty=True)  # -> Values, Indices

# ---- group: TOOL TIPS | FLOOR / cluster | U DIV
panel_192 = Panel("U DIVISION | [JOIST] member(s) [COUNT] in the surface U direction.")
attach_tooltip_to_element_101 = AttachTooltipToElement(ElementsToAttachTo=create_slider_23, TooltipContent=panel_192, ShowDelay=100, Duration=2000)

# ---- group: TOOL TIPS | FLOOR / cluster | V DIV
panel_193 = Panel("V DIVISION | [JOIST] member(s) [COUNT] in the surface V direction.")
attach_tooltip_to_element_102 = AttachTooltipToElement(ElementsToAttachTo=create_slider_24, TooltipContent=panel_193, ShowDelay=100, Duration=2000)

# ---- group: ui | T | A R C H I T E C T U R A L / ui | F | F L O O R / ui | C1 | F L O O R / STACK | WAFFLE
fillet_radius = Slider(0.17, range=0..2)
create_slider_25 = CreateSlider(
    Slider=fillet_radius,
    SnapValue=0.01,
    ShowBounds=False,
    ShowTicks=False,
    ShowTooltip=False,
    ShowValLabel=True,
    showLabel=True)
value_listener_103 = ValueListener(Elements=create_slider_25, SomeProperty=True)  # -> Values, Indices

# ---- group: TOOL TIPS | FLOOR / cluster | FILLET RADIUS
panel_194 = Panel("FILLET RADIUS | [FILLET RADIUS] of interior edges of [SUPPORT].")
attach_tooltip_to_element_103 = AttachTooltipToElement(ElementsToAttachTo=create_slider_25, TooltipContent=panel_194, ShowDelay=100, Duration=2000)

# ---- group: ui | T | A R C H I T E C T U R A L / ui | F | W A L L / ui | C1 | W A L L / STACK | BRICK
brick_length = Slider(0.67, range=0.1..5)
brick_width = Slider(0.3, range=0.01..5)
brick_height = Slider(0.18, range=0.01..5)
brick_count = Slider(50, range=1..500)
_10_create_slider_13 = CreateSlider(Slider=brick_count, SnapValue=1, ShowBounds=False, ShowTicks=False, ShowTooltip=False, ShowValLabel=True, showLabel=True)
_11_create_slider_4 = CreateSlider(
    Slider=brick_length,
    SnapValue=0.01,
    ShowBounds=False,
    ShowTicks=False,
    ShowTooltip=False,
    ShowValLabel=True,
    showLabel=True)
_12_create_slider_4 = CreateSlider(
    Slider=brick_width,
    SnapValue=0.01,
    ShowBounds=False,
    ShowTicks=False,
    ShowTooltip=False,
    ShowValLabel=True,
    showLabel=True)
_13_create_slider_5 = CreateSlider(
    Slider=brick_height,
    SnapValue=0.01,
    ShowBounds=False,
    ShowTicks=False,
    ShowTooltip=False,
    ShowValLabel=True,
    showLabel=True)
value_listener_104 = ValueListener(Elements=_10_create_slider_13, SomeProperty=True)  # -> Values, Indices
value_listener_105 = ValueListener(Elements=_11_create_slider_4, SomeProperty=True)  # -> Values, Indices
value_listener_106 = ValueListener(Elements=_12_create_slider_4, SomeProperty=True)  # -> Values, Indices
value_listener_107 = ValueListener(Elements=_13_create_slider_5, SomeProperty=True)  # -> Values, Indices

# ---- group: TOOL TIPS | WALL / cluster | BRICK COUNT
panel_195 = Panel("BRICK COUNT | [BRICK] [COUNT] per level.")
attach_tooltip_to_element_104 = AttachTooltipToElement(ElementsToAttachTo=_10_create_slider_13, TooltipContent=panel_195, ShowDelay=100, Duration=2000)

# ---- group: TOOL TIPS | WALL / cluster | BRICK WIDTH
panel_196 = Panel("BRICK LENGTH | [WIDTH] of individual [BRICK].")
attach_tooltip_to_element_105 = AttachTooltipToElement(ElementsToAttachTo=_12_create_slider_4, TooltipContent=panel_196, ShowDelay=100, Duration=2000)

# ---- group: TOOL TIPS | WALL / cluster | BRICK HEIGHT
panel_197 = Panel("BRICK LENGTH | [HEIGHT] of individual [BRICK].")
attach_tooltip_to_element_106 = AttachTooltipToElement(ElementsToAttachTo=_13_create_slider_5, TooltipContent=panel_197, ShowDelay=100, Duration=4000)

# ---- group: TOOL TIPS | WALL / cluster | BRICK LENGTH
panel_198 = Panel("BRICK LENGTH | [LENGTH] of individual [BRICK].")
attach_tooltip_to_element_107 = AttachTooltipToElement(ElementsToAttachTo=_11_create_slider_4, TooltipContent=panel_198, ShowDelay=100, Duration=2000)

# ---- group: ui | T | A R C H I T E C T U R A L / ui | F | F L O O R / ui | C1 | F L O O R / STACK | DEFAULT
depth = Slider(0.67, range=0.01..5)
panel_199 = Panel("""BORDER CRV OR SRF
DOUBLE CRV (CLOSED)
ENVELOPE BREP (CLOSED)""")
panel_200 = Panel("""NONE
GRID
STAGGERED
RAMDONIZED""")
panel_201 = Panel("""NONE
FOUNDATION
WAFFLE
JOIST""")
panel_202 = Panel("""         +
         0
         -""")
panel_203 = Panel("INPUT")
panel_204 = Panel("TILE")
panel_205 = Panel("SUPPORT")
panel_206 = Panel("DIRECTION")
panel_207 = Panel("1")
# COLUMN 1 ELEMENT
# DROP DOWN MENUS
# BASIC ELEMENTS
panel_208 = Panel("Slab Creation")
panel_209 = Panel("   SOLVER ON")
panel_210 = Panel("   SOLVER OFF")
_2_create_pulldown_menu_14 = CreatePulldownMenu(Label=panel_203, ListItems=panel_199, SelectedIndex=0, showLabel=True)
_3_create_pulldown_menu_2 = CreatePulldownMenu(Label=panel_204, ListItems=panel_200, showLabel=True)
_4_create_pulldown_menu_3 = CreatePulldownMenu(Label=panel_205, ListItems=panel_201, SelectedIndex=0, showLabel=True)
_5_create_pulldown_menu_2 = CreatePulldownMenu(Label=panel_206, ListItems=panel_202, SelectedIndex=panel_207, showLabel=True)
_6_create_slider_3 = CreateSlider(Slider=depth, SnapValue=0.01, ShowBounds=False, ShowTicks=False, ShowTooltip=False, ShowValLabel=True, showLabel=True)
_1_toggle = CreateToggle(Default=False, OnLabel=panel_209, OffLabel=panel_210)
pattern_index = ValueListener(Elements=_3_create_pulldown_menu_2, SomeProperty=True)  # -> Values, Indices
value_listener_108 = ValueListener(Elements=_4_create_pulldown_menu_3, SomeProperty=True)  # -> Values, Indices
value_listener_109 = ValueListener(Elements=_5_create_pulldown_menu_2, SomeProperty=True)  # -> Values, Indices
value_listener_110 = ValueListener(Elements=_6_create_slider_3, SomeProperty=True)  # -> Values, Indices
value_listener_111 = ValueListener(Elements=_1_toggle, SomeProperty=True)  # -> Values, Indices
input_index_14 = ValueListener(Elements=_2_create_pulldown_menu_14, SomeProperty=True)  # -> Values, Indices
_0_create_label_9 = CreateLabel(LabelText=panel_208, LabelSize=12, Justification=0)
panel_211 = Panel(value_listener_111.Values)
panel_212 = Panel(value_listener_108.Indices)
panel_213 = Panel(value_listener_109.Indices)
panel_214 = Panel(input_index_14.Indices)
panel_215 = Panel(pattern_index.Indices)

# ---- group: TOOL TIPS | FLOOR / cluster | SOLVER
# COLUMN 1 ELEMENT
panel_216 = Panel("""1 | SOLVER | FIREST [TURN ON] [SOLVER] to start this function.
and [TURN OFF] afterwards to avoid [CRASH].""")
attach_tooltip_to_element_108 = AttachTooltipToElement(ElementsToAttachTo=_1_toggle, TooltipContent=panel_216, ShowDelay=100, Duration=2000)

# ---- group: TOOL TIPS | FLOOR / cluster | INPUT
panel_217 = Panel("2 | INPUT | Select type of reference [RHINO] geometry [INPUT] for the function.")
attach_tooltip_to_element_109 = AttachTooltipToElement(ElementsToAttachTo=_2_create_pulldown_menu_14, TooltipContent=panel_217, ShowDelay=100, Duration=3000)

# ---- group: TOOL TIPS | FLOOR / cluster | TILE
panel_218 = Panel("TILE | Select type of [TILE] pattern for the floor(s).")
attach_tooltip_to_element_110 = AttachTooltipToElement(ElementsToAttachTo=_3_create_pulldown_menu_2, TooltipContent=panel_218, ShowDelay=100, Duration=2000)

# ---- group: TOOL TIPS | FLOOR / cluster | SUPPORT
panel_219 = Panel("SUPPORT | Select type of [SUPPORT] for the floor(s).")
attach_tooltip_to_element_111 = AttachTooltipToElement(ElementsToAttachTo=_4_create_pulldown_menu_3, TooltipContent=panel_219, ShowDelay=100, Duration=2000)

# ---- group: TOOL TIPS | FLOOR / cluster | DIRECTION
panel_220 = Panel("DIRECTION | Select the [DIRECTION] of [EXTRUSION] of the floors(s).")
attach_tooltip_to_element_112 = AttachTooltipToElement(ElementsToAttachTo=_5_create_pulldown_menu_2, TooltipContent=panel_220, ShowDelay=100, Duration=2000)

# ---- group: TOOL TIPS | FLOOR / cluster | DEPTH
panel_221 = Panel("DEPTH | [DEPTH]/ [THICKNESS] of the floors.")
attach_tooltip_to_element_113 = AttachTooltipToElement(ElementsToAttachTo=_6_create_slider_3, TooltipContent=panel_221, ShowDelay=100, Duration=2000)

# ----
panel_222 = Panel("FLIP NORMAL (-)")

# ---- group: ui | T | A R C H I T E C T U R A L / ui | F | W A L L / ui | C1 | W A L L / STACK | CURTAIN FRAME
u_division_3 = Slider(1, range=1..50)
v_division_3 = Slider(1, range=1..50)
panel_223 = Panel("FLIP NORMAL (+)")
create_slider_26 = CreateSlider(
    Slider=u_division_3,
    SnapValue=1,
    ShowBounds=False,
    ShowTicks=False,
    ShowTooltip=False,
    ShowValLabel=True,
    showLabel=True)
create_slider_27 = CreateSlider(
    Slider=v_division_3,
    SnapValue=1,
    ShowBounds=False,
    ShowTicks=False,
    ShowTooltip=False,
    ShowValLabel=True,
    showLabel=True)
_1_disaply_toogle_12 = CreateToggle(Default=False, OnLabel=panel_223, OffLabel=panel_222)
value_listener_112 = ValueListener(Elements=_1_disaply_toogle_12, SomeProperty=True)  # -> Values, Indices
value_listener_113 = ValueListener(Elements=create_slider_26, SomeProperty=True)  # -> Values, Indices
value_listener_114 = ValueListener(Elements=create_slider_27, SomeProperty=True)  # -> Values, Indices

# ---- group: TOOL TIPS | WALL / cluster | U DIV
panel_224 = Panel("U DIVISION | Panel [DIVISION] in the surface U direction.")
attach_tooltip_to_element_114 = AttachTooltipToElement(ElementsToAttachTo=create_slider_26, TooltipContent=panel_224, ShowDelay=100, Duration=2000)

# ---- group: TOOL TIPS | WALL / cluster | V DIV
panel_225 = Panel("V DIVISION | Panel [DIVISION] in the surface V direction.")
attach_tooltip_to_element_115 = AttachTooltipToElement(ElementsToAttachTo=create_slider_27, TooltipContent=panel_225, ShowDelay=100, Duration=2000)

# ---- group: TOOL TIPS | WALL / cluster | FLIP NORMAL
panel_226 = Panel("FLIP NORMAL | [FLIP] surface [NORMAL] of walls.")
attach_tooltip_to_element_116 = AttachTooltipToElement(ElementsToAttachTo=_1_disaply_toogle_12, TooltipContent=panel_226, ShowDelay=100, Duration=2000)

# ---- group: ui | T | A R C H I T E C T U R A L / ui | F | W A L L / ui | C1 | W A L L / STACK | STICK FRAME / Embed IMG
sticks = Data(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)
str2img_12 = DeserializeImageFromString(ImageString=sticks)

# ---- group: ui | T | A R C H I T E C T U R A L / ui | F | W A L L / ui | C1 | W A L L / STACK | STRINGER ITEMS
s_count_3 = Slider(2, range=1..10)
s_offset = Slider(0, range=0..5)
_11_create_slider_5 = CreateSlider(
    Slider=s_offset,
    SnapValue=0.001,
    ShowBounds=False,
    ShowTicks=False,
    ShowTooltip=False,
    ShowValLabel=True,
    showLabel=True)
_12_create_slider_5 = CreateSlider(Slider=s_count_3, SnapValue=1, ShowBounds=False, ShowTicks=False, ShowTooltip=False, ShowValLabel=True, showLabel=True)
value_listener_115 = ValueListener(Elements=_11_create_slider_5, SomeProperty=True)  # -> Values, Indices
value_listener_116 = ValueListener(Elements=_12_create_slider_5, SomeProperty=True)  # -> Values, Indices

# ---- group: TOOL TIPS | STAIRS / cluster | S. OFFSET
panel_227 = Panel("STRINGER OFFSET | [OFFSET] distance of [STRINGER] from the edge of [STAIR].")
attach_tooltip_to_element_117 = AttachTooltipToElement(ElementsToAttachTo=_11_create_slider_5, TooltipContent=panel_227, ShowDelay=100, Duration=2000)

# ---- group: TOOL TIPS | STAIRS / cluster | S. COUNT
panel_228 = Panel("STRINGER COUNT | Number of [STRINGER].")
attach_tooltip_to_element_118 = AttachTooltipToElement(ElementsToAttachTo=_12_create_slider_5, TooltipContent=panel_228, ShowDelay=100, Duration=2000)

# ---- group: ui | T | A R C H I T E C T U R A L / ui | F | W A L L / ui | C1 | W A L L / STACK | RUN ITEMS
step_count = Slider(15, range=2..100)
step_tread = Slider(0.917, range=0.01..1)
r_thickness = Slider(0.083, range=0.001..0.2)
t_thickness = Slider(0.083, range=0.001..0.2)
s_thickness = Slider(0.25, range=0.001..1)
t_nosing = Slider(0.083, range=0.001..0.2)
_15_create_slider = CreateSlider(Slider=step_count, SnapValue=1, ShowBounds=False, ShowTicks=False, ShowTooltip=False, ShowValLabel=True, showLabel=True)
_16_create_slider = CreateSlider(
    Slider=step_tread,
    SnapValue=0.001,
    ShowBounds=False,
    ShowTicks=False,
    ShowTooltip=False,
    ShowValLabel=True,
    showLabel=True)
_17_create_slider = CreateSlider(
    Slider=t_nosing,
    SnapValue=0.001,
    ShowBounds=False,
    ShowTicks=False,
    ShowTooltip=False,
    ShowValLabel=True,
    showLabel=True)
_17_create_slider_2 = CreateSlider(
    Slider=t_thickness,
    SnapValue=0.001,
    ShowBounds=False,
    ShowTicks=False,
    ShowTooltip=False,
    ShowValLabel=True,
    showLabel=True)
_17_create_slider_3 = CreateSlider(
    Slider=s_thickness,
    SnapValue=0.001,
    ShowBounds=False,
    ShowTicks=False,
    ShowTooltip=False,
    ShowValLabel=True,
    showLabel=True)
value_listener_117 = ValueListener(Elements=_15_create_slider, SomeProperty=True)  # -> Values, Indices
value_listener_118 = ValueListener(Elements=_16_create_slider, SomeProperty=True)  # -> Values, Indices
value_listener_119 = ValueListener(Elements=_17_create_slider, SomeProperty=True)  # -> Values, Indices
value_listener_120 = ValueListener(Elements=_17_create_slider_2, SomeProperty=True)  # -> Values, Indices
value_listener_121 = ValueListener(Elements=_17_create_slider_3, SomeProperty=True)  # -> Values, Indices

# ---- group: TOOL TIPS | STAIRS / cluster | STEP COUNT
panel_229 = Panel("STEP COUNT | Total Number of individual [STEP] of [STAIR].")
attach_tooltip_to_element_119 = AttachTooltipToElement(ElementsToAttachTo=_15_create_slider, TooltipContent=panel_229, ShowDelay=100, Duration=2000)

# ---- group: TOOL TIPS | STAIRS / cluster | STEP TREAD
panel_230 = Panel("STEP TREAD | [LENGTH]/ [RUN] of individual [STEP TREAD] of [STAIR].")
attach_tooltip_to_element_120 = AttachTooltipToElement(ElementsToAttachTo=_16_create_slider, TooltipContent=panel_230, ShowDelay=100, Duration=2000)

# ---- group: TOOL TIPS | STAIRS / cluster | T. NOSING
panel_231 = Panel("TREAD NOSING | [NOSING] distance of individual [TREAD].")
attach_tooltip_to_element_121 = AttachTooltipToElement(ElementsToAttachTo=_17_create_slider, TooltipContent=panel_231, ShowDelay=100, Duration=2000)

# ---- group: TOOL TIPS | STAIRS / cluster | T. THICKNESS
panel_232 = Panel("TREAD THICKNESS | [THICKNESS] of [TREAD].")
attach_tooltip_to_element_122 = AttachTooltipToElement(ElementsToAttachTo=_17_create_slider_2, TooltipContent=panel_232, ShowDelay=100, Duration=2000)

# ---- group: TOOL TIPS | STAIRS / cluster | S. THICKNESS
panel_233 = Panel("STRINGER THICKNESS | [THICKNESS] of [STRINGER].")
attach_tooltip_to_element_123 = AttachTooltipToElement(ElementsToAttachTo=_17_create_slider_3, TooltipContent=panel_233, ShowDelay=100, Duration=2000)

# ---- group: ui | T | A R C H I T E C T U R A L / ui | F | W A L L / ui | C1 | W A L L / STACK | DEFAULT ITEMS
panel_234 = Panel("JOINED CRVS")
panel_235 = Panel("INPUT")
panel_236 = Panel("Pipe Creation (experimental)")
panel_237 = Panel("   SOLVER ON")
panel_238 = Panel("   SOLVER OFF")
_2_create_pulldown_menu_15 = CreatePulldownMenu(Label=panel_235, ListItems=panel_234, SelectedIndex=0, showLabel=True)
_1_toggle_2 = CreateToggle(Default=False, OnLabel=panel_237, OffLabel=panel_238)
value_listener_122 = ValueListener(Elements=_1_toggle_2, SomeProperty=True)  # -> Values, Indices
input_index_15 = ValueListener(Elements=_2_create_pulldown_menu_15, SomeProperty=True)  # -> Values, Indices
# P I P E   E X P A N D E R (human UI)
_0_create_label_10 = CreateLabel(LabelText=panel_236, LabelSize=12, Justification=0)
panel_239 = Panel(input_index_15.Indices)

# ---- group: TOOL TIPS | PIPES / cluster | SOLVER
# COLUMN 1 ELEMENT
panel_240 = Panel("""1 | SOLVER | FIREST [TURN ON] [SOLVER] to start this function.
and [TURN OFF] afterwards to avoid [CRASH].""")
attach_tooltip_to_element_124 = AttachTooltipToElement(ElementsToAttachTo=_1_toggle_2, TooltipContent=panel_240, ShowDelay=100, Duration=2000)

# ---- group: TOOL TIPS | PIPES / cluster | INPUT
panel_241 = Panel("2 | INPUT | Select type of reference [RHINO] geometry [INPUT] for the function.")
attach_tooltip_to_element_125 = AttachTooltipToElement(ElementsToAttachTo=_2_create_pulldown_menu_15, TooltipContent=panel_241, ShowDelay=100, Duration=3000)

# ---- group: ui | T | A R C H I T E C T U R A L / ui | F | W A L L / ui | C1 | W A L L / STACK | SLIDERS
f_radius = Slider(0.5, range=0.01..3)
p_radius = Slider(0.25, range=0.001..1)
p_thickness = Slider(0.01, range=0.001..0.2)
j_thickness = Slider(0.03, range=0.001..0.2)
r_width = Slider(0.05, range=0.001..0.2)
r_thickness_2 = Slider(0.05, range=0.001..0.2)
_16_create_slider_2 = CreateSlider(
    Slider=f_radius,
    SnapValue=0.001,
    ShowBounds=False,
    ShowTicks=False,
    ShowTooltip=False,
    ShowValLabel=True,
    showLabel=True)
_17_create_slider_4 = CreateSlider(
    Slider=p_radius,
    SnapValue=0.001,
    ShowBounds=False,
    ShowTicks=False,
    ShowTooltip=False,
    ShowValLabel=True,
    showLabel=True)
_17_create_slider_5 = CreateSlider(
    Slider=p_thickness,
    SnapValue=0.001,
    ShowBounds=False,
    ShowTicks=False,
    ShowTooltip=False,
    ShowValLabel=True,
    showLabel=True)
_17_create_slider_6 = CreateSlider(
    Slider=j_thickness,
    SnapValue=0.001,
    ShowBounds=False,
    ShowTicks=False,
    ShowTooltip=False,
    ShowValLabel=True,
    showLabel=True)
_17_create_slider_7 = CreateSlider(Slider=r_width, SnapValue=0.001, ShowBounds=False, ShowTicks=False, ShowTooltip=False, ShowValLabel=True, showLabel=True)
_17_create_slider_8 = CreateSlider(
    Slider=r_thickness_2,
    SnapValue=0.001,
    ShowBounds=False,
    ShowTicks=False,
    ShowTooltip=False,
    ShowValLabel=True,
    showLabel=True)
value_listener_123 = ValueListener(Elements=_16_create_slider_2, SomeProperty=True)  # -> Values, Indices
value_listener_124 = ValueListener(Elements=_17_create_slider_4, SomeProperty=True)  # -> Values, Indices
value_listener_125 = ValueListener(Elements=_17_create_slider_5, SomeProperty=True)  # -> Values, Indices
value_listener_126 = ValueListener(Elements=_17_create_slider_6, SomeProperty=True)  # -> Values, Indices
value_listener_127 = ValueListener(Elements=_17_create_slider_7, SomeProperty=True)  # -> Values, Indices
value_listener_128 = ValueListener(Elements=_17_create_slider_8, SomeProperty=True)  # -> Values, Indices

# ---- group: TOOL TIPS | PIPES / cluster | F. RADIUS
panel_242 = Panel("FILLET RADIUS | [FILLET RAIDUS] for sharp corners.")
attach_tooltip_to_element_126 = AttachTooltipToElement(ElementsToAttachTo=_16_create_slider_2, TooltipContent=panel_242, ShowDelay=100, Duration=2000)

# ---- group: TOOL TIPS | PIPES / cluster | P. RADIUS
panel_243 = Panel("PIPE RADIUS | [RADIUS] of [PIPES]. ")
attach_tooltip_to_element_127 = AttachTooltipToElement(ElementsToAttachTo=_17_create_slider_4, TooltipContent=panel_243, ShowDelay=100, Duration=2000)

# ---- group: TOOL TIPS | PIPES / cluster | P. THICKNESS
panel_244 = Panel("PIPE THICKNESS | [THICKNESS] of the straight portions of [PIPE].")
attach_tooltip_to_element_128 = AttachTooltipToElement(ElementsToAttachTo=_17_create_slider_5, TooltipContent=panel_244, ShowDelay=100, Duration=2000)

# ---- group: TOOL TIPS | PIPES / cluster | J. THICKNESS
panel_245 = Panel("""JOINT THICKNESS | [THICKNESS] of the corner [JOINT] portions of [PIPE]. 
[JOINT THICKENSS] is always >= [PIPE THICKNESS].""")
attach_tooltip_to_element_129 = AttachTooltipToElement(ElementsToAttachTo=_17_create_slider_6, TooltipContent=panel_245, ShowDelay=100, Duration=4000)

# ---- group: TOOL TIPS | PIPES / cluster | R WIDTH
panel_246 = Panel("RING WIDTH | [WIDTH] of the [RING] portion of [PIPE].")
attach_tooltip_to_element_130 = AttachTooltipToElement(ElementsToAttachTo=_17_create_slider_7, TooltipContent=panel_246, ShowDelay=100, Duration=2000)

# ---- group: TOOL TIPS | PIPES / cluster | R THICKNESS
panel_247 = Panel("RING THICKNESS | [THICKNESS] of the [RING] portion of the [PIPE]")
attach_tooltip_to_element_131 = AttachTooltipToElement(ElementsToAttachTo=_17_create_slider_8, TooltipContent=panel_247, ShowDelay=100, Duration=2000)

# ---- group: ui | T | A R C H I T E C T U R A L / ui | F | W A L L / ui | C1 | W A L L / STACK | SPIDER FRAME / Embed IMG
spiders = Data(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)
str2img_13 = DeserializeImageFromString(ImageString=spiders)

# ----
img_path = ImgPath(filename=docinfo.DocumentName, filepath=docinfo.DocumentFilePath)

# ---- group: O | GEO |
trigger_6 = Trigger(TimerInterval=20, Target=groups_6)  # disabled
panel_248 = Panel("O | GEO | ")
groups_6 = GetGroups()  # -> Groups, GroupStyles, Nickname, Color
graft_3 = GraftTree(Tree=panel_248, IncludeEmptyLists=True, IncludeNullItems=True)
swatch_28 = ColourSwatch(SwatchColor=RGB(224, 162, 161))
find_groups_6 = FindGroups(L=groups_6.Groups, T=groups_6.Nickname, relay=graft_3)
setgroup_6 = SetGroupProperties(Group=find_groups_6, Color=swatch_28)

# ---- group: Fx |
trigger_7 = Trigger(TimerInterval=20, Target=groups_7)  # disabled
panel_249 = Panel("Fx | ")
groups_7 = GetGroups()  # -> Groups, GroupStyles, Nickname, Color
graft_4 = GraftTree(Tree=panel_249, IncludeEmptyLists=True, IncludeNullItems=True)
swatch_29 = ColourSwatch(SwatchColor=RGB(63, 111, 155))
find_groups_7 = FindGroups(L=groups_7.Groups, T=groups_7.Nickname, relay=graft_4)
setgroup_7 = SetGroupProperties(Group=find_groups_7, Color=swatch_29)

# ---- group: fx | SCRIPT |
trigger_8 = Trigger(TimerInterval=20, Target=groups_8)  # disabled
panel_250 = Panel("fx | SCRIPT | ")
groups_8 = GetGroups()  # -> Groups, GroupStyles, Nickname, Color
graft_5 = GraftTree(Tree=panel_250, IncludeEmptyLists=True, IncludeNullItems=True)
swatch_30 = ColourSwatch(SwatchColor=RGB(134, 218, 243))
find_groups_8 = FindGroups(L=groups_8.Groups, T=groups_8.Nickname, relay=graft_5)
setgroup_8 = SetGroupProperties(Group=find_groups_8, Color=swatch_30)

# ---- group: fx | INPUT |
trigger_9 = Trigger(TimerInterval=20, Target=groups_9)  # disabled
panel_251 = Panel("""fx | INPUT | 
fx | OUTPUT | """)
groups_9 = GetGroups()  # -> Groups, GroupStyles, Nickname, Color
graft_6 = GraftTree(Tree=panel_251, IncludeEmptyLists=True, IncludeNullItems=True)
swatch_31 = ColourSwatch(SwatchColor=RGB(226, 208, 243))
find_groups_9 = FindGroups(L=groups_9.Groups, T=groups_9.Nickname, relay=graft_6)
setgroup_9 = SetGroupProperties(Group=find_groups_9, Color=swatch_31)

# ---- group: F ||
trigger_10 = Trigger(TimerInterval=20, Target=groups_10)  # disabled
panel_252 = Panel("F || ")
groups_10 = GetGroups()  # -> Groups, GroupStyles, Nickname, Color
graft_7 = GraftTree(Tree=panel_252, IncludeEmptyLists=True, IncludeNullItems=True)
swatch_32 = ColourSwatch(SwatchColor=RGB(85, 187, 198))
find_groups_10 = FindGroups(L=groups_10.Groups, T=groups_10.Nickname, relay=graft_7)
setgroup_10 = SetGroupProperties(Group=find_groups_10, Color=swatch_32)

# ----
expression_12 = Expression(x=width_2, Expression="(2.9*x)/3")

# ---- group: ui | T | I N F O / ui | F | CREDIT / STACK | LOGO & CREDITS
panel_253 = Panel("VERSION: 1.0 (BETA)")
panel_254 = Panel("AUTHOR: NYAN LIN MYAT")
panel_255 = Panel("CO-AUTHOR:                      ")
create_image = CreateImage(ImageSource=str2img_3, ImageWidth=expr(".95*x", expression_12), ImageHeight=expr(".65*x", expression_12))
_0_create_label_11 = CreateLabel(LabelText=panel_254, LabelSize=12, Justification=1)
_0_create_label_12 = CreateLabel(LabelText=panel_255, LabelSize=12, Justification=1)
_0_create_label_13 = CreateLabel(LabelText=panel_253, LabelSize=12, Justification=1)
entwine_2 = Entwine(Branch00=_0_create_label_11, Branch01=_0_create_label_12, FlattenInputs=True)  # -> flatten(Result)
stack_5 = CreateStack(UIElements=[entwine_2, _0_create_label_13], Horizontal=False)
entwine_3 = Entwine(Branch00=create_image, Branch01=stack_5, FlattenInputs=True)  # -> flatten(Result)
stack_6 = CreateStack(UIElements=entwine_3, Horizontal=False)

# ---- group: ui | T | I N F O / ui | F | CREDIT
panel_256 = Panel("CONNECT  |  JOIN  |  SUPPORT")
panel_257 = Panel("""This version is strictly for evaluation purposes only.
Redistribution is prohibited.""")
_0_create_label_14 = CreateLabel(LabelText=panel_257, LabelSize=12, Justification=1)
_0_create_label_15 = CreateLabel(LabelText=panel_256, LabelSize=12, Justification=0)
separator_8 = CreateSeparator(Thickness=10, Horizontal=True, Color=RGB(38, 38, 38))
separator_9 = CreateSeparator(Thickness=10, Horizontal=True, Color=RGB(38, 38, 38))
all_elements = Merge(
    Data1=flatten(_0_create_label_14),
    Data2=flatten(separator_8),
    Data3=flatten(stack_6),
    Data4=flatten(separator_9),
    Data5=flatten(_0_create_label_15),
    Data6=flatten(stack_2))
stack_7 = CreateStack(UIElements=all_elements, Horizontal=False)

# ---- group: ui | T | A R C H I T E C T U R A L / ui | F | W A L L / ui | C1 | W A L L / STACK | STICK FRAME
f_width_1 = Slider(0.25, range=0.01..2)
f_width_2 = Slider(0.1, range=0.01..2)
f_thickness_1 = Slider(0.25, range=0.01..2)
f_thickness_1_2 = Slider(0.25, range=0.01..2)
f_thickness_2 = Slider(0.1, range=0.01..2)
f_thickness_2_2 = Slider(0.1, range=0.01..2)
g_thickness_3 = Slider(0.01, range=0.001..0.2)
create_slider_28 = CreateSlider(
    Slider=f_width_1,
    SnapValue=0.01,
    ShowBounds=False,
    ShowTicks=False,
    ShowTooltip=False,
    ShowValLabel=True,
    showLabel=True)
create_slider_29 = CreateSlider(
    Slider=f_width_2,
    SnapValue=0.01,
    ShowBounds=False,
    ShowTicks=False,
    ShowTooltip=False,
    ShowValLabel=True,
    showLabel=True)
create_slider_30 = CreateSlider(
    Slider=f_thickness_1,
    SnapValue=0.01,
    ShowBounds=False,
    ShowTicks=False,
    ShowTooltip=False,
    ShowValLabel=True,
    showLabel=True)
create_slider_31 = CreateSlider(
    Slider=f_thickness_1_2,
    SnapValue=0.01,
    ShowBounds=False,
    ShowTicks=False,
    ShowTooltip=False,
    ShowValLabel=True,
    showLabel=True)
create_slider_32 = CreateSlider(
    Slider=f_thickness_2,
    SnapValue=0.01,
    ShowBounds=False,
    ShowTicks=False,
    ShowTooltip=False,
    ShowValLabel=True,
    showLabel=True)
create_slider_33 = CreateSlider(
    Slider=f_thickness_2_2,
    SnapValue=0.01,
    ShowBounds=False,
    ShowTicks=False,
    ShowTooltip=False,
    ShowValLabel=True,
    showLabel=True)
create_slider_34 = CreateSlider(
    Slider=g_thickness_3,
    SnapValue=0.001,
    ShowBounds=False,
    ShowTicks=False,
    ShowTooltip=False,
    ShowValLabel=True,
    showLabel=True)
create_image_2 = CreateImage(ImageSource=flatten(str2img_12), ImageWidth=expression_12, ImageHeight=expression_12)
value_listener_129 = ValueListener(Elements=create_slider_28, SomeProperty=True)  # -> Values, Indices
value_listener_130 = ValueListener(Elements=create_slider_29, SomeProperty=True)  # -> Values, Indices
value_listener_131 = ValueListener(Elements=create_slider_30, SomeProperty=True)  # -> Values, Indices
value_listener_132 = ValueListener(Elements=create_slider_31, SomeProperty=True)  # -> Values, Indices
value_listener_133 = ValueListener(Elements=create_slider_32, SomeProperty=True)  # -> Values, Indices
value_listener_134 = ValueListener(Elements=create_slider_33, SomeProperty=True)  # -> Values, Indices
value_listener_135 = ValueListener(Elements=create_slider_34, SomeProperty=True)  # -> Values, Indices

# ---- group: TOOL TIPS | WALL / cluster | F. WIDTH 1
panel_258 = Panel("FRAME WIDTH 1 | [WIDTH] of exterior frame.")
attach_tooltip_to_element_132 = AttachTooltipToElement(ElementsToAttachTo=create_slider_28, TooltipContent=panel_258, ShowDelay=100, Duration=2000)

# ---- group: TOOL TIPS | WALL / cluster | FRAME WIDTH 2
panel_259 = Panel("FRAME WIDTH 2 | [WIDTH] of interior [MULLIONS].")
attach_tooltip_to_element_133 = AttachTooltipToElement(ElementsToAttachTo=create_slider_29, TooltipContent=panel_259, ShowDelay=100, Duration=2000)

# ---- group: TOOL TIPS | WALL / cluster | FRAME THICKNESS 1 (-)
panel_260 = Panel("FRAME THICKNESS 1 (-) | [THICKNESS] of exterior frame in [NEGATIVE] [DIRECTION].")
attach_tooltip_to_element_134 = AttachTooltipToElement(ElementsToAttachTo=create_slider_30, TooltipContent=panel_260, ShowDelay=100, Duration=2000)

# ---- group: TOOL TIPS | WALL / cluster | FRAME THICKNESS 1 (+)
panel_261 = Panel("FRAME THICKNESS 1 (+) | [THICKNESS] of exterior frame in [POSITIVE] [DIRECTION].")
attach_tooltip_to_element_135 = AttachTooltipToElement(ElementsToAttachTo=create_slider_31, TooltipContent=panel_261, ShowDelay=100, Duration=2000)

# ---- group: TOOL TIPS | WALL / cluster | FRAME THICKNESS 2 (-)
panel_262 = Panel("FRAME THICKNESS 2 (+) | [THICKNESS] of interior mullions in [NEGATIVE] [DIRECTION].")
attach_tooltip_to_element_136 = AttachTooltipToElement(ElementsToAttachTo=create_slider_32, TooltipContent=panel_262, ShowDelay=100, Duration=2000)

# ---- group: TOOL TIPS | WALL / cluster | FRAME THICKNESS 2 (+)
panel_263 = Panel("FRAME THICKNESS 2 (+) | [THICKNESS] of interior mullions in [POSITIVE] [DIRECTION].")
attach_tooltip_to_element_137 = AttachTooltipToElement(ElementsToAttachTo=create_slider_33, TooltipContent=panel_263, ShowDelay=100, Duration=2000)

# ---- group: TOOL TIPS | WALL / cluster | G. THICKNESS
panel_264 = Panel("GLASS THICKNESS | [THICKNESS] of [GLASS].")
attach_tooltip_to_element_138 = AttachTooltipToElement(ElementsToAttachTo=[create_slider_34, create_slider_14], TooltipContent=panel_264, ShowDelay=100, Duration=2000)

# ---- group: ui | T | A R C H I T E C T U R A L / ui | F | W A L L / ui | C1 | W A L L / STACK | SPIDER FRAME
f_offset = Slider(0.75, range=0.1..3)
f_radius_2 = Slider(0.5, range=0.1..3)
g_gap = Slider(0.008, range=0.001..0.1)
create_slider_35 = CreateSlider(Slider=f_offset, SnapValue=0.01, ShowBounds=False, ShowTicks=False, ShowTooltip=False, ShowValLabel=True, showLabel=True)
create_slider_36 = CreateSlider(
    Slider=c_radius_2,
    SnapValue=0.001,
    ShowBounds=False,
    ShowTicks=False,
    ShowTooltip=False,
    ShowValLabel=True,
    showLabel=True)
create_slider_37 = CreateSlider(
    Slider=f_radius_2,
    SnapValue=0.01,
    ShowBounds=False,
    ShowTicks=False,
    ShowTooltip=False,
    ShowValLabel=True,
    showLabel=True)
create_slider_38 = CreateSlider(Slider=g_gap, SnapValue=0.01, ShowBounds=False, ShowTicks=False, ShowTooltip=False, ShowValLabel=True, showLabel=True)
create_image_3 = CreateImage(ImageSource=flatten(str2img_13), ImageWidth=expression_12, ImageHeight=expression_12)
value_listener_136 = ValueListener(Elements=create_slider_35, SomeProperty=True)  # -> Values, Indices
value_listener_137 = ValueListener(Elements=create_slider_36, SomeProperty=True)  # -> Values, Indices
value_listener_138 = ValueListener(Elements=create_slider_37, SomeProperty=True)  # -> Values, Indices
value_listener_139 = ValueListener(Elements=create_slider_38, SomeProperty=True)  # -> Values, Indices

# ---- group: TOOL TIPS | WALL / cluster | FRAME OFFSET
panel_265 = Panel("FRAME OFFSET | [OFFSET]/ [DEPTH] of [SPIDER] frame.")
attach_tooltip_to_element_139 = AttachTooltipToElement(ElementsToAttachTo=create_slider_35, TooltipContent=panel_265, ShowDelay=100, Duration=2000)

# ---- group: TOOL TIPS | WALL / cluster | FRAME RADIUS
panel_266 = Panel("FRAME RADIUS | [RADIUS]/ [WIDTH] of [SPIDER ARM].")
attach_tooltip_to_element_140 = AttachTooltipToElement(ElementsToAttachTo=create_slider_37, TooltipContent=panel_266, ShowDelay=100, Duration=2000)

# ---- group: TOOL TIPS | WALL / cluster | CABLE RADIUS
panel_267 = Panel("CABLE RADIUS | [RADIUS] of tension cables connecting [SPIDER ARM].")
attach_tooltip_to_element_141 = AttachTooltipToElement(ElementsToAttachTo=create_slider_36, TooltipContent=panel_267, ShowDelay=100, Duration=2000)

# ---- group: TOOL TIPS | WALL / cluster | GLASS GAP
panel_268 = Panel("GLASS GAP | [GAP] between individual [GLASS PANELS].")
attach_tooltip_to_element_142 = AttachTooltipToElement(ElementsToAttachTo=create_slider_38, TooltipContent=panel_268, ShowDelay=100, Duration=2000)

# ---- group: ui | T | A R C H I T E C T U R A L / ui | F | F L O O R / ui | C1 | F L O O R / STACK | FOUNDATION
filter_7 = StreamFilter(Gate=panel_212, Stream1=str2img_9, Stream2=str2img_10, Stream3=str2img_11)
depth_3 = Slider(0.67, range=0.01..5)
width_4 = Slider(0.5, range=0.01..5)
width_2_3 = Slider(0.4, range=0.01..5)
create_slider_39 = CreateSlider(Slider=depth_3, SnapValue=0.01, ShowBounds=False, ShowTicks=False, ShowTooltip=False, ShowValLabel=True, showLabel=True)
create_slider_40 = CreateSlider(Slider=width_4, SnapValue=0.01, ShowBounds=False, ShowTicks=False, ShowTooltip=False, ShowValLabel=True, showLabel=True)
create_slider_41 = CreateSlider(
    Slider=width_2_3,
    SnapValue=0.01,
    ShowBounds=False,
    ShowTicks=False,
    ShowTooltip=False,
    ShowValLabel=True,
    showLabel=True)
create_image_4 = CreateImage(ImageSource=flatten(filter_7), ImageWidth=expr(".95*x", expression_12), ImageHeight=expr(".95*x", expression_12))
value_listener_140 = ValueListener(Elements=create_slider_39, SomeProperty=True)  # -> Values, Indices
value_listener_141 = ValueListener(Elements=create_slider_41, SomeProperty=True)  # -> Values, Indices
value_listener_142 = ValueListener(Elements=create_slider_40, SomeProperty=True)  # -> Values, Indices

# ---- group: TOOL TIPS | FLOOR / cluster | DEPTH
panel_269 = Panel("DEPTH | [DEPTH] of [SUPPORT].")
attach_tooltip_to_element_143 = AttachTooltipToElement(ElementsToAttachTo=create_slider_39, TooltipContent=panel_269, ShowDelay=100, Duration=2000)

# ---- group: TOOL TIPS | FLOOR / cluster | WIDTH
panel_270 = Panel("WIDTH | Main [WIDTH] of [SUPPORT].")
attach_tooltip_to_element_144 = AttachTooltipToElement(ElementsToAttachTo=create_slider_40, TooltipContent=panel_270, ShowDelay=100, Duration=2000)

# ---- group: TOOL TIPS | FLOOR / cluster | WIDTH 2
panel_271 = Panel("""WIDTH 2 | Tapered [WIDTH] of [WAFFLE] [SUPPORT].
WIDTH 2 <= WIDTH 1""")
attach_tooltip_to_element_145 = AttachTooltipToElement(ElementsToAttachTo=create_slider_41, TooltipContent=panel_271, ShowDelay=100, Duration=2000)

# ---- group: cluster
trigger_11 = Trigger(TimerInterval=20, Target=groups_11)  # disabled
panel_272 = Panel("cluster")
groups_11 = GetGroups()  # -> Groups, GroupStyles, Nickname, Color
graft_8 = GraftTree(Tree=panel_272, IncludeEmptyLists=True, IncludeNullItems=True)
swatch_33 = ColourSwatch(SwatchColor=RGB(239, 235, 147))
find_groups_11 = FindGroups(L=groups_11.Groups, T=groups_11.Nickname, relay=graft_8)
setgroup_11 = SetGroupProperties(Group=find_groups_11, Color=swatch_33)

# ---- group: ui | T | A R C H I T E C T U R A L / ui | F | R A I L I N G / ui | C2 | R A I L I N G
# COLUMN 2 ELEMENT
# BUTTONS & COLOR
colour_3 = ColourPicker(PickedColour=RGB(89, 89, 89))
colour_4 = ColourPicker(PickedColour=RGBA(161, 221, 240, 160))
panel_273 = Panel("SEL GEO")
panel_274 = Panel("BAKE GEO")
create_color_picker_3 = CreateColorPicker(DefaultColor=colour_3)
create_color_picker_4 = CreateColorPicker(DefaultColor=colour_4)
create_button_21 = CreateButton(ButtonName=panel_273, ButtonStyle=0)
create_button_22 = CreateButton(ButtonName=panel_274, ButtonStyle=0)
value_listener_143 = ValueListener(Elements=create_button_21, SomeProperty=True)  # -> Values, Indices
value_listener_144 = ValueListener(Elements=create_button_22, SomeProperty=True)  # -> Values, Indices
value_listener_145 = ValueListener(Elements=create_color_picker_3, SomeProperty=True)  # -> Values, Indices
value_listener_146 = ValueListener(Elements=create_color_picker_4, SomeProperty=True)  # -> Values, Indices
placeholder_3 = Placeholder()
panel_275 = Panel(value_listener_144.Values)

# ---- group: TOOL TIPS | RAILING / cluster | SEL GEO
panel_276 = Panel("3 | SEL GEO | [SELECT] reference [RHINO] geometry [INPUT] for the function.")
attach_tooltip_to_element_146 = AttachTooltipToElement(ElementsToAttachTo=create_button_21, TooltipContent=panel_276, ShowDelay=100, Duration=2000)

# ---- group: TOOL TIPS | RAILING / cluster | BAKE GEO
panel_277 = Panel("BAKE GEO | [BAKE]/ [CREATE] function [OUTPUT] geometry into rhino selected layer.")
attach_tooltip_to_element_147 = AttachTooltipToElement(ElementsToAttachTo=create_button_22, TooltipContent=panel_277, ShowDelay=100, Duration=2000)

# ---- group: TOOL TIPS | RAILING / cluster | COLOR PICKER
panel_278 = Panel("COLOR PICKER | Select [DISPLAY COLOR] of [OUTPUT] geometry.")
attach_tooltip_to_element_148 = AttachTooltipToElement(
    ElementsToAttachTo=[create_color_picker_3, create_color_picker_4],
    TooltipContent=panel_278,
    ShowDelay=100,
    Duration=2000)

# ---- group: ui | T | A R C H I T E C T U R A L / ui | F | F L O O R / ui | C2 | W A L L
# COLUMN 2 ELEMENT
# BUTTONS & COLOR
colour_5 = ColourPicker(PickedColour=RGB(133, 133, 133))
panel_279 = Panel("SEL GEO")
panel_280 = Panel("BAKE GEO")
create_color_picker_5 = CreateColorPicker(DefaultColor=colour_5)
create_button_23 = CreateButton(ButtonName=panel_279, ButtonStyle=0)
create_button_24 = CreateButton(ButtonName=panel_280, ButtonStyle=0)
value_listener_147 = ValueListener(Elements=create_button_23, SomeProperty=True)  # -> Values, Indices
value_listener_148 = ValueListener(Elements=create_button_24, SomeProperty=True)  # -> Values, Indices
value_listener_149 = ValueListener(Elements=create_color_picker_5, SomeProperty=True)  # -> Values, Indices
placeholder_4 = Placeholder()
panel_281 = Panel(value_listener_148.Values)

# ---- group: TOOL TIPS | FLOOR / cluster | SEL GEO
panel_282 = Panel("3 | SEL GEO | [SELECT] reference [RHINO] geometry [INPUT] for the function.")
attach_tooltip_to_element_149 = AttachTooltipToElement(ElementsToAttachTo=create_button_23, TooltipContent=panel_282, ShowDelay=100, Duration=2000)

# ---- group: TOOL TIPS | FLOOR / cluster | BAKE GEO
panel_283 = Panel("BAKE GEO | [BAKE]/ [CREATE] function [OUTPUT] geometry into rhino selected layer.")
attach_tooltip_to_element_150 = AttachTooltipToElement(ElementsToAttachTo=create_button_24, TooltipContent=panel_283, ShowDelay=100, Duration=2000)

# ---- group: TOOL TIPS | FLOOR / cluster | COLOR PICKER
panel_284 = Panel("COLOR PICKER | Select [DISPLAY COLOR] of [OUTPUT] geometry.")
attach_tooltip_to_element_151 = AttachTooltipToElement(ElementsToAttachTo=create_color_picker_5, TooltipContent=panel_284, ShowDelay=100, Duration=2000)

# ----
# DOCUMENT ADJUSTMENTS
# UI | = HUMAN UI MAIN
# ui | T | = UI | TAB
# ui | F | = UI | FUNCTION
# ui | c1/c2/E | = UI | ELEMENTS
# 
# 
# Fx | = FUNCTION
# fx | SCRIPT = FUNCTION SCRIPT
# fx | INPUT | = FUNCTION INPUT
# fx | OUTPUT | = FUNCTION OUTPUT
# F || = FUNCTION SCRIPT COMPONENT
# 
# O | GEO | = OUTPUT (GEOMETRY)
number_slider_3 = Slider(2, range=0..10)
wiredisplay = ControlWireDisplay(WireDisplay=number_slider_3, AllObjects_Object=[toggle_12, subsrf, divide_2, offsets_3, edges_4, join_3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])

# ---- group: ui | T | A R C H I T E C T U R A L / ui | F | W A L L / ui | C2 | W A L L
# COLUMN 2 ELEMENT
# BUTTONS & COLOR
colour_6 = ColourPicker(PickedColour=RGB(122, 122, 122))
panel_285 = Panel("SEL GEO")
panel_286 = Panel("BAKE GEO")
create_color_picker_6 = CreateColorPicker(DefaultColor=colour_6)
create_button_25 = CreateButton(ButtonName=panel_285, ButtonStyle=0)
create_button_26 = CreateButton(ButtonName=panel_286, ButtonStyle=0)
value_listener_150 = ValueListener(Elements=create_button_25, SomeProperty=True)  # -> Values, Indices
value_listener_151 = ValueListener(Elements=create_button_26, SomeProperty=True)  # -> Values, Indices
value_listener_152 = ValueListener(Elements=create_color_picker_6, SomeProperty=True)  # -> Values, Indices
placeholder_5 = Placeholder()
panel_287 = Panel(value_listener_151.Values)

# ---- group: TOOL TIPS | STAIRS / cluster | SEL GEO
panel_288 = Panel("3 | SEL GEO | [SELECT] reference [RHINO] geometry [INPUT] for the function.")
attach_tooltip_to_element_152 = AttachTooltipToElement(ElementsToAttachTo=create_button_25, TooltipContent=panel_288, ShowDelay=100, Duration=2000)

# ---- group: TOOL TIPS | STAIRS / cluster | BAKE GEO
panel_289 = Panel("BAKE GEO | [BAKE]/ [CREATE] function [OUTPUT] geometry into rhino selected layer.")
attach_tooltip_to_element_153 = AttachTooltipToElement(ElementsToAttachTo=create_button_26, TooltipContent=panel_289, ShowDelay=100, Duration=2000)

# ---- group: TOOL TIPS | STAIRS / cluster | COLOR PICKER
panel_290 = Panel("COLOR PICKER | Select [DISPLAY COLOR] of [OUTPUT] geometry.")
attach_tooltip_to_element_154 = AttachTooltipToElement(ElementsToAttachTo=create_color_picker_6, TooltipContent=panel_290, ShowDelay=100, Duration=2000)

# ----
panel_291 = Panel("CLEAR GEO")
toggle_29 = BooleanToggle(False)

# ---- group: ui | T | A R C H I T E C T U R A L / ui | F | W A L L / ui | C2 | W A L L
# COLUMN 2 ELEMENT
# BUTTONS & COLOR
colour_7 = ColourPicker(PickedColour=RGB(178, 178, 178))
panel_292 = Panel("SEL GEO")
panel_293 = Panel("BAKE GEO")
create_color_picker_7 = CreateColorPicker(DefaultColor=colour_7)
create_button_27 = CreateButton(ButtonName=panel_292, ButtonStyle=0)
create_button_28 = CreateButton(ButtonName=panel_293, ButtonStyle=0)
value_listener_153 = ValueListener(Elements=create_button_27, SomeProperty=True)  # -> Values, Indices
value_listener_154 = ValueListener(Elements=create_button_28, SomeProperty=True)  # -> Values, Indices
value_listener_155 = ValueListener(Elements=create_color_picker_7, SomeProperty=True)  # -> Values, Indices
placeholder_6 = Placeholder()
panel_294 = Panel(value_listener_154.Values)

# ---- group: TOOL TIPS | PIPES / cluster | SEL GEO
panel_295 = Panel("3 | SEL GEO | [SELECT] reference [RHINO] geometry [INPUT] for the function.")
attach_tooltip_to_element_155 = AttachTooltipToElement(ElementsToAttachTo=create_button_27, TooltipContent=panel_295, ShowDelay=100, Duration=2000)

# ---- group: TOOL TIPS | PIPES / cluster | BAKE GEO
panel_296 = Panel("BAKE GEO | [BAKE]/ [CREATE] function [OUTPUT] geometry into rhino selected layer.")
attach_tooltip_to_element_156 = AttachTooltipToElement(ElementsToAttachTo=create_button_28, TooltipContent=panel_296, ShowDelay=100, Duration=2000)

# ---- group: TOOL TIPS | PIPES / cluster | COLOR PICKER
panel_297 = Panel("COLOR PICKER | Select [DISPLAY COLOR] of [OUTPUT] geometry.")
attach_tooltip_to_element_157 = AttachTooltipToElement(ElementsToAttachTo=create_color_picker_7, TooltipContent=panel_297, ShowDelay=100, Duration=2000)

# ---- group: ui | T | A R C H I T E C T U R A L / ui | F | R A I L I N G / ui | C2 | R A I L I N G / STACK | MAIN COLUMAN 2
panel_298 = Panel("SAVE")
panel_299 = Panel("LOAD")
create_button_29 = CreateButton(ButtonName=panel_298, ButtonStyle=0)
create_button_30 = CreateButton(ButtonName=panel_299, ButtonStyle=0)
value_listener_156 = ValueListener(Elements=create_button_29, SomeProperty=True)  # -> Values, Indices
value_listener_157 = ValueListener(Elements=create_button_30, SomeProperty=True)  # -> Values, Indices

# ---- group: TOOL TIPS | RAILING / cluster | SAVE
# COLUMN 2 ELEMENT
panel_300 = Panel("SAVE | [SAVE] the values of the [PARAMETERS] of the function to avoid resetting.")
attach_tooltip_to_element_158 = AttachTooltipToElement(ElementsToAttachTo=create_button_29, TooltipContent=panel_300, ShowDelay=100, Duration=2000)

# ---- group: TOOL TIPS | RAILING / cluster | LOAD
panel_301 = Panel("LOAD | [LOAD] the value(s) of the [PARAMETERS] of the functions.")
attach_tooltip_to_element_159 = AttachTooltipToElement(ElementsToAttachTo=create_button_30, TooltipContent=panel_301, ShowDelay=100, Duration=2000)

# ----
panel_302 = Panel("CLEAR GEO")
create_button_31 = CreateButton(ButtonName=panel_291, ButtonStyle=0)

# ---- group: TOOL TIPS | RAILING / cluster | CLEAR GEO
panel_303 = Panel("CLEAR GEO | [CLEAR]/ [RESET] reference [RHINO] geometry [INPUT] for the function.")
attach_tooltip_to_element_160 = AttachTooltipToElement(ElementsToAttachTo=create_button_31, TooltipContent=panel_303, ShowDelay=100, Duration=2000)

# ---- group: ui | T | A R C H I T E C T U R A L / ui | F | F L O O R / ui | C2 | W A L L / STACK | MAIN COLUMAN 2
panel_304 = Panel("CLEAR GEO")
panel_305 = Panel("SAVE")
panel_306 = Panel("LOAD")
create_button_32 = CreateButton(ButtonName=panel_305, ButtonStyle=0)
create_button_33 = CreateButton(ButtonName=panel_306, ButtonStyle=0)
create_button_34 = CreateButton(ButtonName=panel_304, ButtonStyle=0)
value_listener_158 = ValueListener(Elements=create_button_32, SomeProperty=True)  # -> Values, Indices
value_listener_159 = ValueListener(Elements=create_button_33, SomeProperty=True)  # -> Values, Indices
value_listener_160 = ValueListener(Elements=create_button_34, SomeProperty=True)  # -> Values, Indices

# ---- group: TOOL TIPS | FLOOR / cluster | SAVE
# COLUMN 2 ELEMENT
panel_307 = Panel("SAVE | [SAVE] the values of the [PARAMETERS] of the function to avoid resetting.")
attach_tooltip_to_element_161 = AttachTooltipToElement(ElementsToAttachTo=create_button_32, TooltipContent=panel_307, ShowDelay=100, Duration=2000)

# ---- group: TOOL TIPS | FLOOR / cluster | LOAD
panel_308 = Panel("LOAD | [LOAD] the value(s) of the [PARAMETERS] of the functions.")
attach_tooltip_to_element_162 = AttachTooltipToElement(ElementsToAttachTo=create_button_33, TooltipContent=panel_308, ShowDelay=100, Duration=2000)

# ---- group: TOOL TIPS | FLOOR / cluster | CLEAR GEO
panel_309 = Panel("CLEAR GEO | [CLEAR]/ [RESET] reference [RHINO] geometry [INPUT] for the function.")
attach_tooltip_to_element_163 = AttachTooltipToElement(ElementsToAttachTo=create_button_34, TooltipContent=panel_309, ShowDelay=100, Duration=2000)

# ----
onoff = EnableDisableObject(
    Enabled=toggle_29,
    AllObjects_Object=[trigger, trigger_2, trigger_3, trigger_4, trigger_5, trigger_11, trigger_8, trigger_7, trigger_9, trigger_10, trigger_6])

# ---- group: ui | T | A R C H I T E C T U R A L / ui | F | W A L L / ui | C2 | W A L L / STACK | MAIN COLUMAN 2
panel_310 = Panel("CLEAR GEO")
panel_311 = Panel("SAVE")
panel_312 = Panel("LOAD")
create_button_35 = CreateButton(ButtonName=panel_311, ButtonStyle=0)
create_button_36 = CreateButton(ButtonName=panel_312, ButtonStyle=0)
create_button_37 = CreateButton(ButtonName=panel_310, ButtonStyle=0)
value_listener_161 = ValueListener(Elements=create_button_35, SomeProperty=True)  # -> Values, Indices
value_listener_162 = ValueListener(Elements=create_button_36, SomeProperty=True)  # -> Values, Indices
value_listener_163 = ValueListener(Elements=create_button_37, SomeProperty=True)  # -> Values, Indices
panel_313 = Panel(value_listener_163.Values)

# ---- group: TOOL TIPS | STAIRS / cluster | SAVE
# COLUMN 2 ELEMENT
panel_314 = Panel("SAVE | [SAVE] the values of the [PARAMETERS] of the function to avoid resetting.")
attach_tooltip_to_element_164 = AttachTooltipToElement(ElementsToAttachTo=create_button_35, TooltipContent=panel_314, ShowDelay=100, Duration=2000)

# ---- group: TOOL TIPS | STAIRS / cluster | LOAD
panel_315 = Panel("LOAD | [LOAD] the value(s) of the [PARAMETERS] of the functions.")
attach_tooltip_to_element_165 = AttachTooltipToElement(ElementsToAttachTo=create_button_36, TooltipContent=panel_315, ShowDelay=100, Duration=2000)

# ---- group: TOOL TIPS | STAIRS / cluster | CLEAR GEO
panel_316 = Panel("CLEAR GEO | [CLEAR]/ [RESET] reference [RHINO] geometry [INPUT] for the function.")
attach_tooltip_to_element_166 = AttachTooltipToElement(ElementsToAttachTo=create_button_37, TooltipContent=panel_316, ShowDelay=100, Duration=2000)

# ---- group: ui | T | A R C H I T E C T U R A L / ui | F | W A L L / ui | C2 | W A L L / STACK | MAIN COLUMAN 2
panel_317 = Panel("CLEAR GEO")
panel_318 = Panel("SAVE")
panel_319 = Panel("LOAD")
create_button_38 = CreateButton(ButtonName=panel_318, ButtonStyle=0)
create_button_39 = CreateButton(ButtonName=panel_319, ButtonStyle=0)
create_button_40 = CreateButton(ButtonName=panel_317, ButtonStyle=0)
value_listener_164 = ValueListener(Elements=create_button_38, SomeProperty=True)  # -> Values, Indices
value_listener_165 = ValueListener(Elements=create_button_39, SomeProperty=True)  # -> Values, Indices
value_listener_166 = ValueListener(Elements=create_button_40, SomeProperty=True)  # -> Values, Indices
panel_320 = Panel(value_listener_166.Values)

# ---- group: TOOL TIPS | PIPES / cluster | SAVE
# COLUMN 2 ELEMENT
panel_321 = Panel("SAVE | [SAVE] the values of the [PARAMETERS] of the function to avoid resetting.")
attach_tooltip_to_element_167 = AttachTooltipToElement(ElementsToAttachTo=create_button_38, TooltipContent=panel_321, ShowDelay=100, Duration=2000)

# ---- group: TOOL TIPS | PIPES / cluster | LOAD
panel_322 = Panel("LOAD | [LOAD] the value(s) of the [PARAMETERS] of the functions.")
attach_tooltip_to_element_168 = AttachTooltipToElement(ElementsToAttachTo=create_button_39, TooltipContent=panel_322, ShowDelay=100, Duration=2000)

# ---- group: TOOL TIPS | PIPES / cluster | CLEAR GEO
panel_323 = Panel("CLEAR GEO | [CLEAR]/ [RESET] reference [RHINO] geometry [INPUT] for the function.")
attach_tooltip_to_element_169 = AttachTooltipToElement(ElementsToAttachTo=create_button_40, TooltipContent=panel_323, ShowDelay=100, Duration=2000)

# ----
create_button_41 = CreateButton(ButtonName=panel_302, ButtonStyle=0)

# ---- group: TOOL TIPS | WALL / cluster | CLEAR GEO
panel_324 = Panel("CLEAR GEO | [CLEAR]/ [RESET] reference [RHINO] geometry [INPUT] for the function.")
attach_tooltip_to_element_170 = AttachTooltipToElement(ElementsToAttachTo=create_button_41, TooltipContent=panel_324, ShowDelay=100, Duration=2000)

# ----
value_listener_167 = ValueListener(Elements=create_button_31, SomeProperty=True)  # -> Values, Indices
value_listener_168 = ValueListener(Elements=create_button_41, SomeProperty=True)  # -> Values, Indices
panel_325 = Panel(value_listener_143.Values)
panel_326 = Panel(value_listener_167.Values)

# ---- group: ui | T | A R C H I T E C T U R A L / ui | F | F L O O R / ui | E | W A L L / STACK | COLUMANS
# EXPANDER MENU
basic_elements = Merge(
    Data1=_0_create_label_9,
    Data2=_1_toggle,
    Data3=_2_create_pulldown_menu_14,
    Data4=_3_create_pulldown_menu_2,
    Data5=_4_create_pulldown_menu_3,
    Data6=_5_create_pulldown_menu_2,
    Data7=_6_create_slider_3,
    Data8=_7_create_slider_3,
    Data9=_8_create_slider_6,
    Data10=_8_create_slider_7,
    Data11=placeholder_4)

# ---- group: ui | T | A R C H I T E C T U R A L / ui | F | W A L L / ui | E | W A L L / STACK | SUB EXPANDER / cluster
elements_2 = Relay([create_image_2, create_image_3, _1_disaply_toogle_12, create_slider_26, create_slider_27, create_slider_28, create_slider_29, create_slider_30, create_slider_31, create_slider_32, create_slider_33, create_slider_34, create_slider_35, create_slider_36, create_slider_37, create_slider_38])
curtain_elements = CURTAINELEMENTS(typeindex=panel_163, frameindex=panel_162, L=elements_2)

# ----
elements_3 = Relay([create_slider_23, create_slider_24, create_image_4, create_slider_39, create_slider_40, create_slider_25, _1_disaply_toogle_11, create_slider_15, create_slider_16, create_slider_17, create_slider_18, create_slider_19, create_slider_20, create_slider_21, placeholder_4, create_slider_22, create_slider_41])

# ---- group: ui | T | A R C H I T E C T U R A L / ui | F | F L O O R / STACK | TILLE CREATION
column_2_elements_generator_2 = COLUMN2ELEMENTSGENERATOR_2(
    patternindex=panel_215,
    L=[_1_disaply_toogle_10, _10_create_slider_11, _11_create_slider_3, _12_create_slider_3, _13_create_slider_3, _13_create_slider_4])
stack_8 = CreateStack(UIElements=column_2_elements_generator_2, Horizontal=False)
tile_expander = CreateExpander(UIElements=stack_8, Header="TILE CREATION", Open=panel_211)
filter_8 = StreamFilter(Gate=panel_215, Stream1=tile_expander, Stream2=tile_expander, Stream3=tile_expander)
setexp = SetExpander(Expander=tile_expander, ExpandedOpen=panel_211)

# ---- group: ui | T | A R C H I T E C T U R A L / ui | F | F L O O R / ui | E | W A L L / STACK | COLUMANS / cluster
# Columns
column_1_elements_generator_2 = COLUMN1ELEMENTSGENERATOR(all_c1_elements=basic_elements, inputindex=panel_214, frameinput=panel_212)  # -> column_1_elements, number_of_elements_in_column_1

column_2_elements_generator_3 = COLUMN2ELEMENTSGENERATOR(
    inputindex=panel_214,
    frameinput=panel_212,
    c1length=column_1_elements_generator_2.number_of_elements_in_column_1,
    L=[create_button_32, create_button_33, create_button_23, create_button_24, create_color_picker_5, placeholder_4, create_button_34])

# ---- group: ui | T | A R C H I T E C T U R A L / ui | F | W A L L / ui | E | W A L L / STACK | COLUMANS
merge = Merge(
    Data1=_0_create_label_10,
    Data2=_1_toggle_2,
    Data3=_2_create_pulldown_menu_15,
    Data4=_16_create_slider_2,
    Data5=_17_create_slider_4,
    Data6=_17_create_slider_5,
    Data7=_17_create_slider_6,
    Data8=_17_create_slider_7,
    Data9=_17_create_slider_8)

# ----
elements_4 = Relay([_10_create_slider_13, _11_create_slider_4, _12_create_slider_4, _13_create_slider_5])

# ---- group: ui | T | A R C H I T E C T U R A L / ui | F | W A L L / ui | E | W A L L / STACK | SUB EXPANDER
panel_327 = Panel("STICK FRAME CREATION")
panel_328 = Panel("SPIDER FRAME CREATION")
weave_12 = Weave(Pattern=panel_177, Stream0=_5_create_slider_2, Stream1=_6_create_slider_2, NullGaps=False)
merge_2 = Merge(Data1=_4_create_pulldown_menu_2, Data2=weave_12, Data3=create_slider_14)
title = Weave(Pattern=panel_162, Stream0=panel_327, Stream1=panel_328, NullGaps=False)
stack_9 = CreateStack(UIElements=elements_4, Horizontal=False)
stack_10 = CreateStack(UIElements=merge_2, Horizontal=False)
brick_expander = CreateExpander(UIElements=stack_9, Header="BRICK CREATION", Open=True)
sticks_expander = CreateExpander(UIElements=curtain_elements, Header=title, Open=False)
glass_expander = CreateExpander(UIElements=stack_10, Header="CHANNEL GLASS CREATION", Open=False)
expander_index = CSharpScript(typeIndex=panel_163)  # -> out, i; inputs typeIndex: Int32
# ---------- expander_index: C# ----------
    index.Clear();

    if (typeIndex == 0)
    {
      index.Add(0);
    }

    if (typeIndex == 1)
    {
      index.Add(1);
    }

    if (typeIndex == 2)
    {
      index.Add(2);
    }

    if (typeIndex == 3)
    {
      index.Add(3);
    }
    
    
    //FIANL RESULTANT DATA
    i = index;
# ---------- expander_index: C# additional code ----------
  //Declare Value
  List<int> index = new List<int>();
# ---------- end expander_index ----------
sub_expanders = StreamFilter(Gate=expander_index.i, Stream1=brick_expander, Stream2=sticks_expander, Stream3=glass_expander)
setexp_2 = SetExpander(Expander=[brick_expander, sticks_expander, glass_expander], ExpandedOpen=value_listener_84.Values)

# ---- group: UI | MAIN WINDOW / COVER IMAGE
banner_img = Data(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)
str2img_14 = DeserializeImageFromString(ImageString=banner_img)
create_image_5 = CreateImage(ImageSource=str2img_14, ImageWidth=width_2, ImageHeight=expr("0.75*x", height_2))
adjust_element_positioning = AdjustElementPositioning(ElementsToAdjust=create_image_5, AbsolutePositioning=False, HorizontalAlignment=1, VerticalAlignment=3)

# ---- group: ui | T | A R C H I T E C T U R A L / ui | F | F L O O R / STACK | FRAME SUPPORT CREATION / cluster
frame_elements = FRAMEELEMENTS(uvindex=value_listener_92.Values, frameindex=panel_212, L=elements_3)

# ---- group: ui | T | A R C H I T E C T U R A L / ui | F | F L O O R / STACK | FRAME SUPPORT CREATION
panel_329 = Panel("FOUNDATION CREATION")
panel_330 = Panel("WAFFLE CREATION")
panel_331 = Panel("JOIST CREATION")
title_2 = Weave(Pattern=panel_212, Stream0=panel_329, Stream1=panel_329, Stream2=panel_330, Stream3=panel_331, NullGaps=False)
sticks_expander_2 = CreateExpander(UIElements=frame_elements, Header=title_2, Open=panel_211)
filter_9 = StreamFilter(Gate=panel_212, Stream1=sticks_expander_2, Stream2=sticks_expander_2, Stream3=sticks_expander_2)
setexp_3 = SetExpander(Expander=sticks_expander_2, ExpandedOpen=panel_211)

# ---- group: UI | MAIN WINDOW / cluster | 2 buttons / STACK | 2 BUTTONS / Embed IMG
power = Data(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)
str2img_15 = DeserializeImageFromString(ImageString=power)

# ---- group: ui | T | A R C H I T E C T U R A L / ui | F | W A L L / ui | E | W A L L / STACK | COLUMANS / cluster
column_1_elements_generator_3 = COLUMN1ELEMENTSGENERATOR_6(all_c1_elements=merge, inputindex=panel_239)  # -> column_1_elements, number_of_elements_in_column_1

column_2_elements_generator_4 = COLUMN2ELEMENTSGENERATOR_4(
    c1length=column_1_elements_generator_3.number_of_elements_in_column_1,
    L=[create_button_38, create_button_39, create_button_27, create_button_28, create_color_picker_7, placeholder_6, create_button_40])

# ---- group: ui | T | A R C H I T E C T U R A L / ui | F | F L O O R / ui | E | W A L L / STACK | MAIN EXPANDER / cluster
# Human UI Elements
create_grid_3 = CreateGrid(column_1=column_1_elements_generator_2.column_1_elements, column_2=column_2_elements_generator_3, height_of_menu=width_2)  # -> elements, width_of_grid, height_2, row_def_2, columan_def, element_row, element_column, total_list_length

# ---- group: UI | MAIN WINDOW / cluster | 2 buttons / STACK | 2 BUTTONS
panel_332 = Panel("""EWW INCH
FEET
EWW METER""")
panel_333 = Panel("UNITS  ")
panel_334 = Panel(" ")
number_slider_4 = Slider(20, range=1..50)
pulldown = CreatePulldownMenu(Label=panel_333, ListItems=panel_332, SelectedIndex=1, showLabel=True)
button = CreateButton(ButtonName=panel_334, ImagePath=str2img_15, ButtonStyle=0)
values = ValueListener(Elements=pulldown, SomeProperty=True)  # -> Values, Indices
values_2 = ValueListener(Elements=button, SomeProperty=True)  # -> Values, Indices
poweroff = CSharpScript(close=values_2.Values)  # inputs close: Boolean
# ---------- poweroff: C# ----------
    if(close)
    {
      Grasshopper.Instances.DocumentEditor.ScriptAccess_CloseAllDocuments();
    }
    else{}
# ---------- end poweroff ----------
adjustelem_7 = AdjustElementAppearance(ElementsToAdjust=pulldown, FontSize=number_slider_4)

# ---- group: ui | T | A R C H I T E C T U R A L / ui | F | R A I L I N G / C. WIDTH
units = UNITS_26(relay=values.Indices)  # -> W, W_2
selobj = GetSelectedObjects(AllObjects_Object=c_thickness)  # -> ComponentObjects, ParamObjects, OtherObjects
set_slider = SetSliderProperties(Slider=selobj.ParamObjects, Value=units.W, Range=units.W_2, Type=0)

# ---- group: ui | T | A R C H I T E C T U R A L / ui | F | R A I L I N G / C. DEPTH
units_2 = UNITS_27(relay=values.Indices)  # -> W, W_2
selobj_2 = GetSelectedObjects(AllObjects_Object=c_width)  # -> ComponentObjects, ParamObjects, OtherObjects
set_slider_2 = SetSliderProperties(Slider=selobj_2.ParamObjects, Value=units_2.W, Range=units_2.W_2, Type=0)

# ---- group: ui | T | A R C H I T E C T U R A L / ui | F | R A I L I N G / G. OFFSET
units_3 = UNITS_27(relay=values.Indices)  # -> W, W_2
selobj_3 = GetSelectedObjects(AllObjects_Object=g_offset)  # -> ComponentObjects, ParamObjects, OtherObjects
set_slider_3 = SetSliderProperties(Slider=selobj_3.ParamObjects, Value=units_3.W, Range=units_3.W_2, Type=0)

# ---- group: ui | T | A R C H I T E C T U R A L / ui | F | R A I L I N G / G.THICKNESS
units_4 = UNITS_10(relay=values.Indices)  # -> W, W_2
selobj_4 = GetSelectedObjects(AllObjects_Object=g_thickness)  # -> ComponentObjects, ParamObjects, OtherObjects
set_slider_4 = SetSliderProperties(Slider=selobj_4.ParamObjects, Value=units_4.W, Range=units_4.W_2, Type=0)

# ---- group: ui | T | A R C H I T E C T U R A L / ui | F | R A I L I N G / S. LENGTH
units_5 = UNITS_17(relay=values.Indices)  # -> W, W_2
selobj_5 = GetSelectedObjects(AllObjects_Object=d_length)  # -> ComponentObjects, ParamObjects, OtherObjects
set_slider_5 = SetSliderProperties(Slider=selobj_5.ParamObjects, Value=units_5.W, Range=units_5.W_2, Type=0)

# ---- group: ui | T | A R C H I T E C T U R A L / ui | F | R A I L I N G / SUB.LENGTH
units_6 = UNITS_18(relay=values.Indices)  # -> W, W_2
selobj_6 = GetSelectedObjects(AllObjects_Object=sub_length)  # -> ComponentObjects, ParamObjects, OtherObjects
set_slider_6 = SetSliderProperties(Slider=selobj_6.ParamObjects, Value=units_6.W, Range=units_6.W_2, Type=0)

# ---- group: ui | T | A R C H I T E C T U R A L / ui | F | R A I L I N G / R. HEIGHT
units_7 = UNITS_19(relay=values.Indices)  # -> W, W_2
selobj_7 = GetSelectedObjects(AllObjects_Object=r_height)  # -> ComponentObjects, ParamObjects, OtherObjects
set_slider_7 = SetSliderProperties(Slider=selobj_7.ParamObjects, Value=units_7.W, Range=units_7.W_2, Type=0)

# ---- group: ui | T | A R C H I T E C T U R A L / ui | F | R A I L I N G / T. OFFSET
units_8 = UNITS_20(relay=values.Indices)  # -> W, W_2
selobj_8 = GetSelectedObjects(AllObjects_Object=t_offset)  # -> ComponentObjects, ParamObjects, OtherObjects
set_slider_8 = SetSliderProperties(Slider=selobj_8.ParamObjects, Value=units_8.W, Range=units_8.W_2, Type=0)

# ---- group: ui | T | A R C H I T E C T U R A L / ui | F | R A I L I N G / B. OFFSET
units_9 = UNITS_21(relay=values.Indices)  # -> W, W_2
selobj_9 = GetSelectedObjects(AllObjects_Object=b_offset)  # -> ComponentObjects, ParamObjects, OtherObjects
set_slider_9 = SetSliderProperties(Slider=selobj_9.ParamObjects, Value=units_9.W, Range=units_9.W_2, Type=0)

# ---- group: ui | T | A R C H I T E C T U R A L / ui | F | R A I L I N G / R. WIDTH/ RADIUS
units_10 = UNITS_22(relay=values.Indices)  # -> W, W_2
selobj_10 = GetSelectedObjects(AllObjects_Object=p_width)  # -> ComponentObjects, ParamObjects, OtherObjects
set_slider_10 = SetSliderProperties(Slider=selobj_10.ParamObjects, Value=units_10.W, Range=units_10.W_2, Type=0)

# ---- group: ui | T | A R C H I T E C T U R A L / ui | F | R A I L I N G / SUB. WIDTH
units_11 = UNITS_23(relay=values.Indices)  # -> W, W_2
selobj_11 = GetSelectedObjects(AllObjects_Object=sub_width)  # -> ComponentObjects, ParamObjects, OtherObjects
set_slider_11 = SetSliderProperties(Slider=selobj_11.ParamObjects, Value=units_11.W, Range=units_11.W_2, Type=0)

# ---- group: ui | T | A R C H I T E C T U R A L / ui | F | R A I L I N G / H. RADIUS
units_12 = UNITS_24(relay=values.Indices)  # -> W, W_2
selobj_12 = GetSelectedObjects(AllObjects_Object=h_radius)  # -> ComponentObjects, ParamObjects, OtherObjects
set_slider_12 = SetSliderProperties(Slider=selobj_12.ParamObjects, Value=units_12.W, Range=units_12.W_2, Type=0)

# ---- group: ui | T | A R C H I T E C T U R A L / ui | F | R A I L I N G / C. RADIUS
units_13 = UNITS_25(relay=values.Indices)  # -> W, W_2
selobj_13 = GetSelectedObjects(AllObjects_Object=c_radius)  # -> ComponentObjects, ParamObjects, OtherObjects
set_slider_13 = SetSliderProperties(Slider=selobj_13.ParamObjects, Value=units_13.W, Range=units_13.W_2, Type=0)

# ---- group: ui | T | A R C H I T E C T U R A L / BRICK WIDTH
units_14 = UNITS_5(relay=values.Indices)  # -> W, W_2
selobj_14 = GetSelectedObjects(AllObjects_Object=brick_width)  # -> ComponentObjects, ParamObjects, OtherObjects
set_slider_14 = SetSliderProperties(Slider=selobj_14.ParamObjects, Value=units_14.W, Range=units_14.W_2, Type=0)

# ---- group: ui | T | A R C H I T E C T U R A L / BRICK LENGTH
units_15 = UNITS_4(relay=values.Indices)  # -> W, W_2
selobj_15 = GetSelectedObjects(AllObjects_Object=brick_length)  # -> ComponentObjects, ParamObjects, OtherObjects
set_slider_15 = SetSliderProperties(Slider=selobj_15.ParamObjects, Value=units_15.W, Range=units_15.W_2, Type=0)

# ---- group: ui | T | A R C H I T E C T U R A L / MAXHEIGHT
selobj_16 = GetSelectedObjects(AllObjects_Object=max_height)  # -> ComponentObjects, ParamObjects, OtherObjects
units_16 = UNITS_3(relay=values.Indices)  # -> W, W_2
set_slider_16 = SetSliderProperties(Slider=selobj_16.ParamObjects, Value=units_16.W, Range=units_16.W_2, Type=0)

# ---- group: ui | T | A R C H I T E C T U R A L / F.THICKNESS 2 (+)
units_17 = UNITS_8(relay=values.Indices)  # -> W, W_2
selobj_17 = GetSelectedObjects(AllObjects_Object=f_thickness_2)  # -> ComponentObjects, ParamObjects, OtherObjects
set_slider_17 = SetSliderProperties(Slider=selobj_17.ParamObjects, Value=units_17.W, Range=units_17.W_2, Type=0)

# ---- group: ui | T | A R C H I T E C T U R A L / F.OFFSET
units_18 = UNITS_11(relay=values.Indices)  # -> W, W_2
selobj_18 = GetSelectedObjects(AllObjects_Object=f_offset)  # -> ComponentObjects, ParamObjects, OtherObjects
set_slider_18 = SetSliderProperties(Slider=selobj_18.ParamObjects, Value=units_18.W, Range=units_18.W_2, Type=0)

# ---- group: ui | T | A R C H I T E C T U R A L / BRICK HEIGHT
units_19 = UNITS_6(relay=values.Indices)  # -> W, W_2
selobj_19 = GetSelectedObjects(AllObjects_Object=brick_height)  # -> ComponentObjects, ParamObjects, OtherObjects
set_slider_19 = SetSliderProperties(Slider=selobj_19.ParamObjects, Value=units_19.W, Range=units_19.W_2, Type=0)

# ---- group: ui | T | A R C H I T E C T U R A L / F.WIDTH 2
units_20 = UNITS_8(relay=values.Indices)  # -> W, W_2
selobj_20 = GetSelectedObjects(AllObjects_Object=f_width_2)  # -> ComponentObjects, ParamObjects, OtherObjects
set_slider_20 = SetSliderProperties(Slider=selobj_20.ParamObjects, Value=units_20.W, Range=units_20.W_2, Type=0)

# ---- group: ui | T | A R C H I T E C T U R A L / G.THICKNESS
units_21 = UNITS_10(relay=values.Indices)  # -> W, W_2
selobj_21 = GetSelectedObjects(AllObjects_Object=g_thickness_3)  # -> ComponentObjects, ParamObjects, OtherObjects
set_slider_21 = SetSliderProperties(Slider=selobj_21.ParamObjects, Value=units_21.W, Range=units_21.W_2, Type=0)

# ---- group: ui | T | A R C H I T E C T U R A L / F.RADIUS
units_22 = UNITS_13(relay=values.Indices)  # -> W, W_2
selobj_22 = GetSelectedObjects(AllObjects_Object=f_radius_2)  # -> ComponentObjects, ParamObjects, OtherObjects
set_slider_22 = SetSliderProperties(Slider=selobj_22.ParamObjects, Value=units_22.W, Range=units_22.W_2, Type=0)

# ---- group: ui | T | A R C H I T E C T U R A L / C.RADIUS
units_23 = UNITS_12(relay=values.Indices)  # -> W, W_2
selobj_23 = GetSelectedObjects(AllObjects_Object=c_radius_2)  # -> ComponentObjects, ParamObjects, OtherObjects
set_slider_23 = SetSliderProperties(Slider=selobj_23.ParamObjects, Value=units_23.W, Range=units_23.W_2, Type=0)

# ---- group: ui | T | A R C H I T E C T U R A L / F.WIDTH 1
units_24 = UNITS_7(relay=values.Indices)  # -> W, W_2
selobj_24 = GetSelectedObjects(AllObjects_Object=f_width_1)  # -> ComponentObjects, ParamObjects, OtherObjects
set_slider_24 = SetSliderProperties(Slider=selobj_24.ParamObjects, Value=units_24.W, Range=units_24.W_2, Type=0)

# ---- group: ui | T | A R C H I T E C T U R A L / F.THICKNESS (+)
units_25 = UNITS_9(relay=values.Indices)  # -> W, W_2
selobj_25 = GetSelectedObjects(AllObjects_Object=f_thickness_1_2)  # -> ComponentObjects, ParamObjects, OtherObjects
set_slider_25 = SetSliderProperties(Slider=selobj_25.ParamObjects, Value=units_25.W, Range=units_25.W_2, Type=0)

# ---- group: ui | T | A R C H I T E C T U R A L / WIDTH
# UNITS
selobj_26 = GetSelectedObjects(AllObjects_Object=width_3)  # -> ComponentObjects, ParamObjects, OtherObjects
units_26 = UNITS(relay=values.Indices)  # -> W, W_2
set_slider_26 = SetSliderProperties(Slider=selobj_26.ParamObjects, Value=units_26.W, Range=units_26.W_2, Type=0)

# ---- group: ui | T | A R C H I T E C T U R A L / F.THICKNESS (-)
units_27 = UNITS_9(relay=values.Indices)  # -> W, W_2
selobj_27 = GetSelectedObjects(AllObjects_Object=f_thickness_1)  # -> ComponentObjects, ParamObjects, OtherObjects
set_slider_27 = SetSliderProperties(Slider=selobj_27.ParamObjects, Value=units_27.W, Range=units_27.W_2, Type=0)

# ---- group: ui | T | A R C H I T E C T U R A L / F.THICKNESS 2 (-)
units_28 = UNITS_8(relay=values.Indices)  # -> W, W_2
selobj_28 = GetSelectedObjects(AllObjects_Object=f_thickness_2_2)  # -> ComponentObjects, ParamObjects, OtherObjects
set_slider_28 = SetSliderProperties(Slider=selobj_28.ParamObjects, Value=units_28.W, Range=units_28.W_2, Type=0)

# ---- group: ui | T | A R C H I T E C T U R A L / G.GAP
units_29 = UNITS_14(relay=values.Indices)  # -> W, W_2
selobj_29 = GetSelectedObjects(AllObjects_Object=g_gap)  # -> ComponentObjects, ParamObjects, OtherObjects
set_slider_29 = SetSliderProperties(Slider=selobj_29.ParamObjects, Value=units_29.W, Range=units_29.W_2, Type=0)

# ---- group: ui | T | A R C H I T E C T U R A L / MINEHIGHT
units_30 = UNITS_2(relay=values.Indices)  # -> W, W_2
selobj_30 = GetSelectedObjects(AllObjects_Object=min_height)  # -> ComponentObjects, ParamObjects, OtherObjects
set_slider_30 = SetSliderProperties(Slider=selobj_30.ParamObjects, Value=units_30.W, Range=units_30.W_2, Type=0)

# ---- group: ui | T | A R C H I T E C T U R A L / ui | F | W A L L / STEP HEIGHT
units_31 = UNITS_37(relay=values.Indices)  # -> W, W_2
selobj_31 = GetSelectedObjects(AllObjects_Object=step_height)  # -> ComponentObjects, ParamObjects, OtherObjects
set_slider_31 = SetSliderProperties(Slider=selobj_31.ParamObjects, Value=units_31.W, Range=units_31.W_2, Type=0)

# ---- group: ui | T | A R C H I T E C T U R A L / ui | F | W A L L / TOTAL HEIGHT
units_32 = UNITS_28(relay=values.Indices)  # -> W, W_2
selobj_32 = GetSelectedObjects(AllObjects_Object=total_height)  # -> ComponentObjects, ParamObjects, OtherObjects
set_slider_32 = SetSliderProperties(Slider=selobj_32.ParamObjects, Value=units_32.W, Range=units_32.W_2, Type=0)

# ---- group: ui | T | A R C H I T E C T U R A L / ui | F | W A L L / WIDTH
units_33 = UNITS_19(relay=values.Indices)  # -> W, W_2
selobj_33 = GetSelectedObjects(AllObjects_Object=width_11)  # -> ComponentObjects, ParamObjects, OtherObjects
set_slider_33 = SetSliderProperties(Slider=selobj_33.ParamObjects, Value=units_33.W, Range=units_33.W_2, Type=0)

# ---- group: ui | T | A R C H I T E C T U R A L / ui | F | W A L L / S. OFFSET
units_34 = UNITS_36(relay=values.Indices)  # -> W, W_2
selobj_34 = GetSelectedObjects(AllObjects_Object=s_offset)  # -> ComponentObjects, ParamObjects, OtherObjects
set_slider_34 = SetSliderProperties(Slider=selobj_34.ParamObjects, Value=units_34.W, Range=units_34.W_2, Type=0)

# ---- group: ui | T | A R C H I T E C T U R A L / ui | F | W A L L / STEP TREAD
units_35 = UNITS_38(relay=values.Indices)  # -> W, W_2
selobj_35 = GetSelectedObjects(AllObjects_Object=step_tread)  # -> ComponentObjects, ParamObjects, OtherObjects
set_slider_35 = SetSliderProperties(Slider=selobj_35.ParamObjects, Value=units_35.W, Range=units_35.W_2, Type=0)

# ---- group: ui | T | A R C H I T E C T U R A L / ui | F | W A L L / T. NOSING
units_36 = UNITS_39(relay=values.Indices)  # -> W, W_2
selobj_36 = GetSelectedObjects(AllObjects_Object=t_nosing)  # -> ComponentObjects, ParamObjects, OtherObjects
set_slider_36 = SetSliderProperties(Slider=selobj_36.ParamObjects, Value=units_36.W, Range=units_36.W_2, Type=0)

# ---- group: ui | T | A R C H I T E C T U R A L / ui | F | W A L L / R.THICKNESS
units_37 = UNITS_39(relay=values.Indices)  # -> W, W_2
selobj_37 = GetSelectedObjects(AllObjects_Object=r_thickness)  # -> ComponentObjects, ParamObjects, OtherObjects
set_slider_37 = SetSliderProperties(Slider=selobj_37.ParamObjects, Value=units_37.W, Range=units_37.W_2, Type=0)

# ---- group: ui | T | A R C H I T E C T U R A L / ui | F | W A L L / T.THICKNESS
units_38 = UNITS_39(relay=values.Indices)  # -> W, W_2
selobj_38 = GetSelectedObjects(AllObjects_Object=t_thickness)  # -> ComponentObjects, ParamObjects, OtherObjects
set_slider_38 = SetSliderProperties(Slider=selobj_38.ParamObjects, Value=units_38.W, Range=units_38.W_2, Type=0)

# ---- group: ui | T | A R C H I T E C T U R A L / ui | F | W A L L / S.THICKNESS
units_39 = UNITS_40(relay=values.Indices)  # -> W, W_2
selobj_39 = GetSelectedObjects(AllObjects_Object=s_thickness)  # -> ComponentObjects, ParamObjects, OtherObjects
set_slider_39 = SetSliderProperties(Slider=selobj_39.ParamObjects, Value=units_39.W, Range=units_39.W_2, Type=0)

# ---- group: ui | T | A R C H I T E C T U R A L / ui | F | F L O O R / DEPTH
units_40 = UNITS_15(relay=values.Indices)  # -> W, W_2
selobj_40 = GetSelectedObjects(AllObjects_Object=depth)  # -> ComponentObjects, ParamObjects, OtherObjects
set_slider_40 = SetSliderProperties(Slider=selobj_40.ParamObjects, Value=units_40.W, Range=units_40.W_2, Type=0)

# ---- group: ui | T | A R C H I T E C T U R A L / ui | F | F L O O R / LVL 1 HEIGHT
units_41 = UNITS_16(relay=values.Indices)  # -> W, W_2
selobj_41 = GetSelectedObjects(AllObjects_Object=lvl_1_height)  # -> ComponentObjects, ParamObjects, OtherObjects
set_slider_41 = SetSliderProperties(Slider=selobj_41.ParamObjects, Value=units_41.W, Range=units_41.W_2, Type=0)

# ---- group: ui | T | A R C H I T E C T U R A L / ui | F | F L O O R / LVL 2+ HEIGHT
units_42 = UNITS_28(relay=values.Indices)  # -> W, W_2
selobj_42 = GetSelectedObjects(AllObjects_Object=lvl_2_height)  # -> ComponentObjects, ParamObjects, OtherObjects
set_slider_42 = SetSliderProperties(Slider=selobj_42.ParamObjects, Value=units_42.W, Range=units_42.W_2, Type=0)

# ---- group: ui | T | A R C H I T E C T U R A L / ui | F | F L O O R / GAP WIDTH
units_43 = UNITS_29(relay=values.Indices)  # -> W, W_2
selobj_43 = GetSelectedObjects(AllObjects_Object=gap_width)  # -> ComponentObjects, ParamObjects, OtherObjects
set_slider_43 = SetSliderProperties(Slider=selobj_43.ParamObjects, Value=units_43.W, Range=units_43.W_2, Type=0)

# ---- group: ui | T | A R C H I T E C T U R A L / ui | F | F L O O R / TOLERANCE
units_44 = UNITS_30(relay=values.Indices)  # -> W, W_2
selobj_44 = GetSelectedObjects(AllObjects_Object=tolerance)  # -> ComponentObjects, ParamObjects, OtherObjects
set_slider_44 = SetSliderProperties(Slider=selobj_44.ParamObjects, Value=units_44.W, Range=units_44.W_2, Type=0)

# ---- group: ui | T | A R C H I T E C T U R A L / ui | F | F L O O R / DEPTH
units_45 = UNITS_31(relay=values.Indices)  # -> W, W_2
selobj_45 = GetSelectedObjects(AllObjects_Object=depth_3)  # -> ComponentObjects, ParamObjects, OtherObjects
set_slider_45 = SetSliderProperties(Slider=selobj_45.ParamObjects, Value=units_45.W, Range=units_45.W_2, Type=0)

# ---- group: ui | T | A R C H I T E C T U R A L / ui | F | F L O O R / WIDTH
units_46 = UNITS_21(relay=values.Indices)  # -> W, W_2
selobj_46 = GetSelectedObjects(AllObjects_Object=width_4)  # -> ComponentObjects, ParamObjects, OtherObjects
set_slider_46 = SetSliderProperties(Slider=selobj_46.ParamObjects, Value=units_46.W, Range=units_46.W_2, Type=0)

# ---- group: ui | T | A R C H I T E C T U R A L / ui | F | F L O O R / FILLET RADIUS
units_47 = UNITS_27(relay=values.Indices)  # -> W, W_2
selobj_47 = GetSelectedObjects(AllObjects_Object=[fillet_radius, g_offset])  # -> ComponentObjects, ParamObjects, OtherObjects
set_slider_47 = SetSliderProperties(Slider=selobj_47.ParamObjects, Value=units_47.W, Range=units_47.W_2, Type=0)

# ---- group: ui | T | A R C H I T E C T U R A L / ui | F | F L O O R / DEPTH 1
units_48 = UNITS_32(relay=values.Indices)  # -> W, W_2
selobj_48 = GetSelectedObjects(AllObjects_Object=depth_1)  # -> ComponentObjects, ParamObjects, OtherObjects
set_slider_48 = SetSliderProperties(Slider=selobj_48.ParamObjects, Value=units_48.W, Range=units_48.W_2, Type=0)

# ---- group: ui | T | A R C H I T E C T U R A L / ui | F | F L O O R / WIDTH 1
units_49 = UNITS_33(relay=values.Indices)  # -> W, W_2
selobj_49 = GetSelectedObjects(AllObjects_Object=width_1)  # -> ComponentObjects, ParamObjects, OtherObjects
set_slider_49 = SetSliderProperties(Slider=selobj_49.ParamObjects, Value=units_49.W, Range=units_49.W_2, Type=0)

# ---- group: ui | T | A R C H I T E C T U R A L / ui | F | F L O O R / T. WEB 1
units_50 = UNITS_34(relay=values.Indices)  # -> W, W_2
selobj_50 = GetSelectedObjects(AllObjects_Object=t_web_1)  # -> ComponentObjects, ParamObjects, OtherObjects
set_slider_50 = SetSliderProperties(Slider=selobj_50.ParamObjects, Value=units_50.W, Range=units_50.W_2, Type=0)

# ---- group: ui | T | A R C H I T E C T U R A L / ui | F | F L O O R / T. FLANGE 1
units_51 = UNITS_35(relay=values.Indices)  # -> W, W_2
selobj_51 = GetSelectedObjects(AllObjects_Object=[t_flange_1, t_web_1])  # -> ComponentObjects, ParamObjects, OtherObjects
set_slider_51 = SetSliderProperties(Slider=selobj_51.ParamObjects, Value=units_51.W, Range=units_51.W_2, Type=0)

# ---- group: ui | T | A R C H I T E C T U R A L / ui | F | F L O O R / DEPTH 2
units_52 = UNITS_32(relay=values.Indices)  # -> W, W_2
selobj_52 = GetSelectedObjects(AllObjects_Object=[depth_2, depth_1])  # -> ComponentObjects, ParamObjects, OtherObjects
set_slider_52 = SetSliderProperties(Slider=selobj_52.ParamObjects, Value=units_52.W, Range=units_52.W_2, Type=0)

# ---- group: ui | T | A R C H I T E C T U R A L / ui | F | F L O O R / WIDTH 2
units_53 = UNITS_33(relay=values.Indices)  # -> W, W_2
selobj_53 = GetSelectedObjects(AllObjects_Object=[width_2_2, width_1])  # -> ComponentObjects, ParamObjects, OtherObjects
set_slider_53 = SetSliderProperties(Slider=selobj_53.ParamObjects, Value=units_53.W, Range=units_53.W_2, Type=0)

# ---- group: ui | T | A R C H I T E C T U R A L / ui | F | F L O O R / T. WEB 2
units_54 = UNITS_34(relay=values.Indices)  # -> W, W_2
selobj_54 = GetSelectedObjects(AllObjects_Object=[t_web_2, t_web_1])  # -> ComponentObjects, ParamObjects, OtherObjects
set_slider_54 = SetSliderProperties(Slider=selobj_54.ParamObjects, Value=units_54.W, Range=units_54.W_2, Type=0)

# ---- group: ui | T | A R C H I T E C T U R A L / ui | F | F L O O R / T. FLANGE 2
units_55 = UNITS_35(relay=values.Indices)  # -> W, W_2
selobj_55 = GetSelectedObjects(AllObjects_Object=[t_flange_2, t_flange_1])  # -> ComponentObjects, ParamObjects, OtherObjects
set_slider_55 = SetSliderProperties(Slider=selobj_55.ParamObjects, Value=units_55.W, Range=units_55.W_2, Type=0)

# ---- group: ui | T | A R C H I T E C T U R A L / ui | F | W A L L / F. RADIUS
units_56 = UNITS_41(relay=values.Indices)  # -> W, W_2
# COLUMN 1 ELEMENT
selobj_56 = GetSelectedObjects(AllObjects_Object=f_radius)  # -> ComponentObjects, ParamObjects, OtherObjects
set_slider_56 = SetSliderProperties(Slider=selobj_56.ParamObjects, Value=units_56.W, Range=units_56.W_2, Type=0)

# ---- group: ui | T | A R C H I T E C T U R A L / ui | F | W A L L / P. RADIUS
units_57 = UNITS_40(relay=values.Indices)  # -> W, W_2
selobj_57 = GetSelectedObjects(AllObjects_Object=p_radius)  # -> ComponentObjects, ParamObjects, OtherObjects
set_slider_57 = SetSliderProperties(Slider=selobj_57.ParamObjects, Value=units_57.W, Range=units_57.W_2, Type=0)

# ---- group: ui | T | A R C H I T E C T U R A L / ui | F | W A L L / P.THICKNESS
units_58 = UNITS_10(relay=values.Indices)  # -> W, W_2
selobj_58 = GetSelectedObjects(AllObjects_Object=p_thickness)  # -> ComponentObjects, ParamObjects, OtherObjects
set_slider_58 = SetSliderProperties(Slider=selobj_58.ParamObjects, Value=units_58.W, Range=units_58.W_2, Type=0)

# ---- group: ui | T | A R C H I T E C T U R A L / ui | F | W A L L / J.THICKNESS
units_59 = UNITS_42(relay=values.Indices)  # -> W, W_2
selobj_59 = GetSelectedObjects(AllObjects_Object=j_thickness)  # -> ComponentObjects, ParamObjects, OtherObjects
set_slider_59 = SetSliderProperties(Slider=selobj_59.ParamObjects, Value=units_59.W, Range=units_59.W_2, Type=0)

# ---- group: ui | T | A R C H I T E C T U R A L / ui | F | W A L L / R. WIDTH
units_60 = UNITS_43(relay=values.Indices)  # -> W, W_2
selobj_60 = GetSelectedObjects(AllObjects_Object=r_width)  # -> ComponentObjects, ParamObjects, OtherObjects
set_slider_60 = SetSliderProperties(Slider=selobj_60.ParamObjects, Value=units_60.W, Range=units_60.W_2, Type=0)

# ---- group: ui | T | A R C H I T E C T U R A L / ui | F | W A L L / R. THICKNESS
units_61 = UNITS_43(relay=values.Indices)  # -> W, W_2
selobj_61 = GetSelectedObjects(AllObjects_Object=r_thickness_2)  # -> ComponentObjects, ParamObjects, OtherObjects
set_slider_61 = SetSliderProperties(Slider=selobj_61.ParamObjects, Value=units_61.W, Range=units_61.W_2, Type=0)

# ---- group: ui | T | A R C H I T E C T U R A L / ui | F | R A I L I N G
# R A I L I N G   E X P A N D E R (human UI)
relay = Relay([_5_create_slider, _6_create_slider, _7_create_slider, _8_create_slider_4, _9_create_slider, _10_create_slider_10, _11_create_slider_2, _12_create_slider_2, _13_create_slider_2, _14_create_slider, create_slider_8, create_slider_9, create_slider_10, create_slider_11, create_slider_12, create_slider_13])

# ---- group: ui | T | A R C H I T E C T U R A L / ui | F | F L O O R / ui | E | W A L L / STACK | MAIN EXPANDER
create_grid_4 = CreateGrid(
    UIElements=create_grid_3.elements,
    Width=create_grid_3.width_of_grid,
    Height=create_grid_3.height_2,
    RowDefinitions=create_grid_3.row_def_2,
    ColumnDefinitions=create_grid_3.columan_def,
    ElementRow=create_grid_3.element_row,
    ElementColumn=create_grid_3.element_column,
    ElementRowSpan=1,
    ElementColumnSpan=1)
all_expander_elements_2 = Entwine(Branch00=create_grid_4, Branch01=filter_8, Branch02=filter_9, FlattenInputs=True)  # -> flatten(Result)
stack_11 = CreateStack(UIElements=all_expander_elements_2, Horizontal=False)

# ---- group: ui | T | A R C H I T E C T U R A L / ui | F | W A L L / ui | E | W A L L / STACK | MAIN EXPANDER / cluster
create_grid_5 = CreateGrid(column_1=column_1_elements_generator_3.column_1_elements, column_2=column_2_elements_generator_4, height_of_menu=width_2)  # -> elements, width_of_grid, height_2, row_def_2, columan_def, element_row, element_column, total_list_length

# ---- group: ui | T | A R C H I T E C T U R A L / ui | F | F L O O R
# F L O O R   E X P A N D E R (human UI)
savestates_3 = SaveElementStates(
    Elements=[column_1_elements_generator_2.column_1_elements, column_2_elements_generator_3, elements_3],
    SaveState=value_listener_158.Values,
    StateName="test",
    ClearSavedStates=False,
    stateSetChunk_State0_stateName="test",
    stateSetChunk_State0_stateItem0_ElementIndex=0,
    stateSetChunk_State0_stateItem0_ElementValue="Slab Creation",
    stateSetChunk_State0_stateItem0_ElementValueType="System.String",
    stateSetChunk_State0_stateItem1_ElementIndex=0,
    stateSetChunk_State0_stateItem1_ElementValue="True",
    stateSetChunk_State0_stateItem1_ElementValueType="System.Boolean",
    stateSetChunk_State0_stateItem2_ElementIndex=0,
    stateSetChunk_State0_stateItem2_ElementValue="BORDER CRV OR SRF",
    stateSetChunk_State0_stateItem2_ElementValueType="System.String",
    stateSetChunk_State0_stateItem3_ElementIndex=0,
    stateSetChunk_State0_stateItem3_ElementValue="NONE",
    stateSetChunk_State0_stateItem3_ElementValueType="System.String",
    stateSetChunk_State0_stateItem4_ElementIndex=0,
    stateSetChunk_State0_stateItem4_ElementValue="WAFFLE",
    stateSetChunk_State0_stateItem4_ElementValueType="System.String",
    stateSetChunk_State0_stateItem5_ElementIndex=0,
    stateSetChunk_State0_stateItem5_ElementValue="         0",
    stateSetChunk_State0_stateItem5_ElementValueType="System.String",
    stateSetChunk_State0_stateItem6_ElementIndex=0,
    stateSetChunk_State0_stateItem6_ElementValue="0.67",
    stateSetChunk_State0_stateItem6_ElementValueType="System.Double",
    stateSetChunk_State0_stateItem7_ElementIndex=0,
    stateSetChunk_State0_stateItem7_ElementValue="True",
    stateSetChunk_State0_stateItem7_ElementValueType="System.Boolean",
    stateSetChunk_State0_stateItem8_ElementIndex=0,
    stateSetChunk_State0_stateItem8_ElementValue="False",
    stateSetChunk_State0_stateItem8_ElementValueType="System.Boolean",
    stateSetChunk_State0_stateItem9_ElementIndex=0,
    stateSetChunk_State0_stateItem9_ElementValue="False",
    stateSetChunk_State0_stateItem9_ElementValueType="System.Boolean",
    stateSetChunk_State0_stateItem10_ElementIndex=0,
    stateSetChunk_State0_stateItem10_ElementValue="False",
    stateSetChunk_State0_stateItem10_ElementValueType="System.Boolean",
    stateSetChunk_State0_stateItem11_ElementIndex=0,
    stateSetChunk_State0_stateItem11_ElementValue="False",
    stateSetChunk_State0_stateItem11_ElementValueType="System.Boolean",
    stateSetChunk_State0_stateItem12_ElementIndex=0,
    stateSetChunk_State0_stateItem12_ElementValue="Color [A=255, R=133, G=133, B=133]",
    stateSetChunk_State0_stateItem12_ElementValueType="System.Drawing.Color")  # -> SavedStates, SavedStateNames
restore_3 = RestoreElementStates(Restore=value_listener_159.Values, SavedStates=savestates_3.SavedStates, StateNameToRestore=savestates_3.SavedStateNames)

# ---- group: ui | T | A R C H I T E C T U R A L / ui | F | W A L L / ui | E | W A L L / STACK | MAIN EXPANDER
create_grid_6 = CreateGrid(
    UIElements=create_grid_5.elements,
    Width=create_grid_5.width_of_grid,
    Height=create_grid_5.height_2,
    RowDefinitions=create_grid_5.row_def_2,
    ColumnDefinitions=create_grid_5.columan_def,
    ElementRow=create_grid_5.element_row,
    ElementColumn=create_grid_5.element_column,
    ElementRowSpan=1,
    ElementColumnSpan=1)
all_expander_elements_3 = Entwine(Branch00=create_grid_6, FlattenInputs=True)  # -> flatten(Result)
stack_12 = CreateStack(UIElements=all_expander_elements_3, Horizontal=False)

# ---- group: ui | T | A R C H I T E C T U R A L / ui | F | W A L L / ui | E | W A L L
# EXPANDER MENU
# Columns
# Human UI Elements
savestates_4 = SaveElementStates(
    Elements=[column_1_elements_generator_3.column_1_elements, column_2_elements_generator_4],
    SaveState=value_listener_164.Values,
    StateName="test",
    ClearSavedStates=False)  # -> SavedStates, SavedStateNames
restore_4 = RestoreElementStates(Restore=value_listener_165.Values, SavedStates=savestates_4.SavedStates, StateNameToRestore=savestates_4.SavedStateNames)

# ---- group: UI | MAIN WINDOW / cluster | 2 buttons
merge_3 = Merge(Data1=pulldown, Data2=button)
stack_13 = CreateStack(UIElements=merge_3, Horizontal=True)

# ---- group: Fx | P I P E / fx | INPUT | P I P E
boolean_toggle_6 = BooleanToggle(True)  # disabled
boolean_toggle_7 = BooleanToggle(True)  # disabled
select_geo_5 = SelectGeo(
    run=value_listener_153.Values,
    allowMultiple=boolean_toggle_6,
    allowNone=boolean_toggle_7,
    msg="Pick object(s)",
    clear=panel_320)  # -> pickedGeometry; inputs run: Boolean, allowMultiple: Boolean, allowNone: Boolean, msg: String, clear: Boolean; disabled; same code as select_geo
objfromgroup_5 = GetObjectsInGroup()
onoff_2 = EnableDisableObject(Enabled=value_listener_122.Values, AllObjects_Object=select_geo_5)
crv = Curve(select_geo_5)  # disabled

# ---- group: fx | SCRIPT | COLOR INDICATOR / F || COLOR INDICATOR (SEL GEO)
lng_7 = ListLength(List=flatten(crv))
expression_13 = Expression(x=lng_7, Expression="if (x = 0,0,1)")
expression_14 = Expression(x=lng_7, Expression="if (x = 0,0,1)")
swatch_34 = ColourSwatch(SwatchColor=RGB(255, 255, 255))
swatch_35 = ColourSwatch(SwatchColor=RGB(0, 0, 0))
swatch_36 = ColourSwatch(SwatchColor=RGBA(255, 255, 255, 0))
swatch_37 = ColourSwatch(SwatchColor=RGB(222, 199, 27))
weave_13 = Weave(Pattern=expression_13, Stream0=swatch_34, Stream1=swatch_35, NullGaps=False)
weave_14 = Weave(Pattern=expression_14, Stream0=swatch_36, Stream1=swatch_37, NullGaps=False)
adjustelem_8 = AdjustElementAppearance(ElementsToAdjust=create_button_27, Foreground=weave_13, Background=weave_14)

# ---- group: fx | SCRIPT | COLOR INDICATOR / F || COLOR INDICATOR (CLEAR GEO)
expression_15 = Expression(x=lng_7, Expression="if (x = 0,0,1)")
expression_16 = Expression(x=lng_7, Expression="if (x = 0,0,1)")
swatch_38 = ColourSwatch(SwatchColor=RGB(255, 255, 255))
swatch_39 = ColourSwatch(SwatchColor=RGB(0, 0, 0))
swatch_40 = ColourSwatch(SwatchColor=RGBA(255, 255, 255, 0))
swatch_41 = ColourSwatch(SwatchColor=RGB(222, 199, 27))
weave_15 = Weave(Pattern=expression_15, Stream0=swatch_39, Stream1=swatch_38, NullGaps=False)
weave_16 = Weave(Pattern=expression_16, Stream0=swatch_41, Stream1=swatch_40, NullGaps=False)
adjustelem_9 = AdjustElementAppearance(ElementsToAdjust=create_button_40, Foreground=weave_15, Background=weave_16)

# ---- group: Fx | S T A I R / fx | INPUT | S T A I R
boolean_toggle_8 = BooleanToggle(True)  # disabled
boolean_toggle_9 = BooleanToggle(True)  # disabled
select_geo_6 = SelectGeo(
    run=value_listener_150.Values,
    allowMultiple=boolean_toggle_8,
    allowNone=boolean_toggle_9,
    msg="Pick object(s)",
    clear=panel_313)  # -> pickedGeometry; inputs run: Boolean, allowMultiple: Boolean, allowNone: Boolean, msg: String, clear: Boolean; disabled; same code as select_geo
objfromgroup_6 = GetObjectsInGroup()
geo = Geometry(select_geo_6)  # disabled

# ---- group: fx | SCRIPT | COLOR INDICATOR / F || COLOR INDICATOR (SEL GEO)
lng_8 = ListLength(List=flatten(geo))
expression_17 = Expression(x=lng_8, Expression="if (x = 0,0,1)")
expression_18 = Expression(x=lng_8, Expression="if (x = 0,0,1)")
swatch_42 = ColourSwatch(SwatchColor=RGB(255, 255, 255))
swatch_43 = ColourSwatch(SwatchColor=RGB(0, 0, 0))
swatch_44 = ColourSwatch(SwatchColor=RGBA(255, 255, 255, 0))
swatch_45 = ColourSwatch(SwatchColor=RGB(222, 199, 27))
weave_17 = Weave(Pattern=expression_17, Stream0=swatch_42, Stream1=swatch_43, NullGaps=False)
weave_18 = Weave(Pattern=expression_18, Stream0=swatch_44, Stream1=swatch_45, NullGaps=False)
adjustelem_10 = AdjustElementAppearance(ElementsToAdjust=create_button_25, Foreground=weave_17, Background=weave_18)

# ---- group: fx | SCRIPT | COLOR INDICATOR / F || COLOR INDICATOR (CLEAR GEO)
expression_19 = Expression(x=lng_8, Expression="if (x = 0,0,1)")
expression_20 = Expression(x=lng_8, Expression="if (x = 0,0,1)")
swatch_46 = ColourSwatch(SwatchColor=RGB(255, 255, 255))
swatch_47 = ColourSwatch(SwatchColor=RGB(0, 0, 0))
swatch_48 = ColourSwatch(SwatchColor=RGBA(255, 255, 255, 0))
swatch_49 = ColourSwatch(SwatchColor=RGB(222, 199, 27))
weave_19 = Weave(Pattern=expression_19, Stream0=swatch_47, Stream1=swatch_46, NullGaps=False)
weave_20 = Weave(Pattern=expression_20, Stream0=swatch_49, Stream1=swatch_48, NullGaps=False)
adjustelem_11 = AdjustElementAppearance(ElementsToAdjust=create_button_37, Foreground=weave_19, Background=weave_20)

# ---- group: Fx | R A I L I N G / fx | INPUT | RAILING
boolean_toggle_10 = BooleanToggle(True)  # disabled
boolean_toggle_11 = BooleanToggle(True)  # disabled
select_geo_7 = SelectGeo(
    run=value_listener_143.Values,
    allowMultiple=boolean_toggle_10,
    allowNone=boolean_toggle_11,
    msg="Pick object(s)",
    clear=value_listener_167.Values)  # -> pickedGeometry; inputs run: Boolean, allowMultiple: Boolean, allowNone: Boolean, msg: String, clear: Boolean; disabled
# ---------- select_geo_7: C# ----------
    if(run) getNewGeometry(msg, allowMultiple, allowNone);
    pickedGeometry = objIDs;
    if(clear) objIDs.Clear();
# ---------- select_geo_7: C# additional code ----------
  static List<Guid> objIDs = new List<Guid>();


  void getNewGeometry(string msg, bool allowMultiple, bool allowNone){
    ObjectType filter = ObjectType.AnyObject;

    ObjRef[] rhObjects = new ObjRef[1];


    try{
      Rhino.Commands.Result result = Rhino.Commands.Result.Cancel;
      if(!allowMultiple) {
        ObjRef rhObject;
        result = Rhino.Input.RhinoGet.GetOneObject(msg, allowNone, filter, out rhObject);
        rhObjects[0] = rhObject;

      } else {
        result = Rhino.Input.RhinoGet.GetMultipleObjects(msg, allowNone, filter, out rhObjects);
      }

      if(result == Rhino.Commands.Result.Cancel){

      } else if(result == Rhino.Commands.Result.Success){
        objIDs = rhObjects.Select(o => o.ObjectId).ToList();
        return;
      }
    } catch {

    }
  }
# ---------- end select_geo_7 ----------
objfromgroup_7 = GetObjectsInGroup()

# ---- group: fx | SCRIPT | COLOR INDICATOR / F || COLOR INDICATOR (SEL GEO)
lng_9 = ListLength(List=flatten(select_geo_7))
expression_21 = Expression(x=lng_9, Expression="if (x = 0,0,1)")
expression_22 = Expression(x=lng_9, Expression="if (x = 0,0,1)")
swatch_50 = ColourSwatch(SwatchColor=RGB(255, 255, 255))
swatch_51 = ColourSwatch(SwatchColor=RGB(0, 0, 0))
swatch_52 = ColourSwatch(SwatchColor=RGBA(255, 255, 255, 0))
swatch_53 = ColourSwatch(SwatchColor=RGB(222, 199, 27))
weave_21 = Weave(Pattern=expression_21, Stream0=swatch_50, Stream1=swatch_51, NullGaps=False)
weave_22 = Weave(Pattern=expression_22, Stream0=swatch_52, Stream1=swatch_53, NullGaps=False)
adjustelem_12 = AdjustElementAppearance(ElementsToAdjust=create_button_21, Foreground=weave_21, Background=weave_22)

# ---- group: fx | SCRIPT | COLOR INDICATOR / F || COLOR INDICATOR (CLEAR GEO)
expression_23 = Expression(x=lng_9, Expression="if (x = 0,0,1)")
expression_24 = Expression(x=lng_9, Expression="if (x = 0,0,1)")
swatch_54 = ColourSwatch(SwatchColor=RGB(255, 255, 255))
swatch_55 = ColourSwatch(SwatchColor=RGB(0, 0, 0))
swatch_56 = ColourSwatch(SwatchColor=RGBA(255, 255, 255, 0))
swatch_57 = ColourSwatch(SwatchColor=RGB(222, 199, 27))
weave_23 = Weave(Pattern=expression_23, Stream0=swatch_55, Stream1=swatch_54, NullGaps=False)
weave_24 = Weave(Pattern=expression_24, Stream0=swatch_57, Stream1=swatch_56, NullGaps=False)
adjustelem_13 = AdjustElementAppearance(ElementsToAdjust=create_button_31, Foreground=weave_23, Background=weave_24)

# ---- group: Fx | F L O O R / fx | INPUT | F L O O R
boolean_toggle_12 = BooleanToggle(True)  # disabled
boolean_toggle_13 = BooleanToggle(True)  # disabled
select_geo_8 = SelectGeo(
    run=value_listener_147.Values,
    allowMultiple=boolean_toggle_12,
    allowNone=boolean_toggle_13,
    msg="Pick object(s)",
    clear=value_listener_160.Values)  # -> pickedGeometry; inputs run: Boolean, allowMultiple: Boolean, allowNone: Boolean, msg: String, clear: Boolean; disabled; same code as select_geo
geo_2 = Geometry(select_geo_8)  # disabled
objfromgroup_8 = GetObjectsInGroup()
input_geo_main = StreamGate(Stream=geo_2, Gate=panel_214)  # -> Target0, Target1, Target2; disabled

# ---- group: fx | SCRIPT | COLOR INDICATOR / F || COLOR INDICATOR (SEL GEO)
lng_10 = ListLength(List=flatten(geo_2))
expression_25 = Expression(x=lng_10, Expression="if (x = 0,0,1)")
expression_26 = Expression(x=lng_10, Expression="if (x = 0,0,1)")
swatch_58 = ColourSwatch(SwatchColor=RGB(255, 255, 255))
swatch_59 = ColourSwatch(SwatchColor=RGB(0, 0, 0))
swatch_60 = ColourSwatch(SwatchColor=RGBA(255, 255, 255, 0))
swatch_61 = ColourSwatch(SwatchColor=RGB(222, 199, 27))
weave_25 = Weave(Pattern=expression_25, Stream0=swatch_58, Stream1=swatch_59, NullGaps=False)
weave_26 = Weave(Pattern=expression_26, Stream0=swatch_60, Stream1=swatch_61, NullGaps=False)
adjustelem_14 = AdjustElementAppearance(ElementsToAdjust=create_button_23, Foreground=weave_25, Background=weave_26)

# ---- group: fx | SCRIPT | COLOR INDICATOR / F || COLOR INDICATOR (CLEAR GEO)
expression_27 = Expression(x=lng_10, Expression="if (x = 0,0,1)")
expression_28 = Expression(x=lng_10, Expression="if (x = 0,0,1)")
swatch_62 = ColourSwatch(SwatchColor=RGB(255, 255, 255))
swatch_63 = ColourSwatch(SwatchColor=RGB(0, 0, 0))
swatch_64 = ColourSwatch(SwatchColor=RGBA(255, 255, 255, 0))
swatch_65 = ColourSwatch(SwatchColor=RGB(222, 199, 27))
weave_27 = Weave(Pattern=expression_27, Stream0=swatch_63, Stream1=swatch_62, NullGaps=False)
weave_28 = Weave(Pattern=expression_28, Stream0=swatch_65, Stream1=swatch_64, NullGaps=False)
adjustelem_15 = AdjustElementAppearance(ElementsToAdjust=create_button_34, Foreground=weave_27, Background=weave_28)

# ---- group: Fx | P I P E / F || CREATE BASE PIPES
fillet = Fillet(Curve=flatten(crv), Radius=value_listener_123.Values)
null = NullItem(Item=fillet)  # -> NullFlags, InvalidFlags, Description
dispatch = Dispatch(List=fillet, DispatchPattern=null.InvalidFlags)  # -> ListA, ListB
dispatch_2 = Dispatch(List=crv, DispatchPattern=null.InvalidFlags)  # -> ListA, ListB
merge_4 = Merge(Data1=dispatch.ListB, Data2=dispatch_2.ListA)  # -> simplify(Result)
clean = CleanTree(RemoveNulls=True, RemoveInvalid=True, RemoveEmpty=True, Tree=merge_4)
pipe = Pipe(Curve=clean, Radius=value_listener_124.Values, Caps=0)

# ---- group: Fx | R A I L I N G / fx | INPUT | Sort InputCrv (Single / Double) / F || DOUBLE CRV
dispatch_3 = Dispatch(List=select_geo_7, DispatchPattern=[True, False])  # -> ListA, ListB
curvepoint = PointOnCurve(dispatch_3.ListA, parameter=0.5)
curvepoint_2 = PointOnCurve(dispatch_3.ListB, parameter=0.5)
pdecon = Deconstruct(Point=curvepoint)  # -> XComponent, YComponent, ZComponent
pdecon_2 = Deconstruct(Point=curvepoint_2)  # -> XComponent, YComponent, ZComponent
unit_z = Merge(Data1=graft(pdecon.ZComponent), Data2=graft(pdecon_2.ZComponent))
crvs = Merge(Data1=graft(dispatch_3.ListA), Data2=graft(dispatch_3.ListB))
sort = SortList(Keys=unit_z, ValuesA=crvs)  # -> Keys, ValuesA
pshift = ShiftPaths(Data=sort.ValuesA, Offset=-1)

# ---- group: Fx | F L O O R / fx | SCRIPT | Create Slab
addition = Addition(A=value_listener_89.Values, B=value_listener_110.Values)
addition_2 = Addition(A=value_listener_90.Values, B=value_listener_110.Values)

# ---- group: Fx | F L O O R / fx | SCRIPT | Create Slab / F || BREP
xy = XYPlane(Origin=Point(0, 0, 0))
series = Series(Start=addition, Step=addition_2, Count=value_listener_91.Values)
Z = UnitZ(Factor=series)
move = Move(Geometry=xy, Motion=Z)  # -> Geometry, Transform
sec = BrepPlane(Brep=graft(input_geo_main.Target2), Plane=move.Geometry)  # -> Curves, Points
boundary = BoundarySurfaces(Edges=sec.Curves)

# ---- group: Fx | F L O O R / fx | SCRIPT | Create Slab / F || SINGLE CRV
toggle_30 = BooleanToggle(False)
toggle_31 = BooleanToggle(True)
toggle_32 = BooleanToggle(False)
division = Division(A=value_listener_110.Values, B=2)
neg = Negative(Value=value_listener_110.Values)
weave_29 = Weave(Pattern=panel_213, Stream0=value_listener_110.Values, Stream1=division, Stream2=neg, NullGaps=False)
weave_30 = Weave(Pattern=panel_213, Stream0=toggle_30, Stream1=toggle_31, Stream2=toggle_32, NullGaps=False)
offsrf = OffsetSurface(Surface=input_geo_main.Target0, Distance=weave_29, BothSides=weave_30, CreateSolid=True)

# ---- group: Fx | P I P E / F || SORT PIPES AND JOINTS
debrep = DeconstructBrep(Brep=pipe)  # -> Faces, Edges, Vertices
# P I P E   F U N C T I O N
dispatch_4 = Dispatch(List=debrep.Faces, DispatchPattern=[True, False])  # -> ListA, ListB
pipes = Surface(dispatch_4.ListA)
joints = Surface(dispatch_4.ListB)

# ---- group: Fx | P I P E
edges = BrepEdges(Brep=joints)  # -> Naked, Interior, NonManifold
md_slider = MDSlider(SliderMode=0, slider_value=Point(0.5, 0.5, 0.5), x_domain=Domain(0, 1), y_domain=Domain(0, 1), z_domain=Domain(0, 1))
boundary_2 = BoundarySurfaces(Edges=edges.Naked)
evalsrf = EvaluateSurface(Surface=reparameterize(boundary_2), Point=md_slider)  # -> Point, Normal, UDirection, VDirection, Frame
amp = Amplitude(Vector=evalsrf.Normal, Amplitude=expr("-x", value_listener_127.Values))
amp_2 = Amplitude(Vector=evalsrf.Normal, Amplitude=value_listener_127.Values)
extr = Extrude(Base=edges.Naked, Direction=amp_2)
extr_2 = Extrude(Base=edges.Naked, Direction=amp)
merge_5 = Merge(Data1=extr, Data2=extr_2)
join = BrepJoin(Breps=merge_5)  # -> Breps, Closed

# ---- group: UI | ELEMENT ADJUSTMENTS / STACK | FULL SUB EXPANDER
panel_335 = Panel("0,0,0,0")
full_sub_expanders = AdjustElementPositioning(
    ElementsToAdjust=[sub_expanders, tile_expander, sticks_expander_2, brick_expander, sticks_expander, glass_expander],
    Margin=panel_335,
    AbsolutePositioning=False,
    Width=expr("9.4*x/10", width_2),
    HorizontalAlignment=0,
    VerticalAlignment=2)

# ---- group: Fx | P I P E / F || OFFSET DIST
max = Maximum(A=value_listener_125.Values, B=value_listener_126.Values)

# ---- group: Fx | WA L L / fx | SCRIPT | GLASS / F || OFFSET AND SORT CRVS / F ||
division_2 = Division(A=value_listener_77.Values, B=2)  # disabled
neg_2 = Negative(Value=value_listener_77.Values)  # disabled
width_5 = Weave(Pattern=value_listener_82.Indices, Stream0=value_listener_77.Values, Stream1=division_2, Stream2=neg_2, NullGaps=False)  # disabled

# ---- group: Fx | P I P E / F || OFFSET SRF
offsrf_2 = OffsetSurface(Surface=pipes, Distance=expr("x/2", value_listener_125.Values), BothSides=True, CreateSolid=True)  # -> simplify(Offset)
offsrf_3 = OffsetSurface(Surface=joints, Distance=expr("x/2", max), BothSides=True, CreateSolid=True)  # -> simplify(Offset)
rings = OffsetSurface(Surface=join.Breps, Distance=expr("x/2", value_listener_128.Values), BothSides=True, CreateSolid=True)  # -> simplify(Offset)

# ---- group: Fx | F L O O R / fx | SCRIPT | Create Slab / F || OFFSET SRF
toggle_33 = BooleanToggle(False)
toggle_34 = BooleanToggle(True)
toggle_35 = BooleanToggle(False)
division_3 = Division(A=value_listener_110.Values, B=2)
neg_3 = Negative(Value=value_listener_110.Values)
weave_31 = Weave(Pattern=panel_213, Stream0=value_listener_110.Values, Stream1=division_3, Stream2=neg_3, NullGaps=False)
weave_32 = Weave(Pattern=panel_213, Stream0=toggle_33, Stream1=toggle_34, Stream2=toggle_35, NullGaps=False)
offsrf_4 = OffsetSurface(Surface=boundary, Distance=weave_31, BothSides=weave_32, CreateSolid=True)

# ----
dispatch_5 = Dispatch(List=offsrf_2, DispatchPattern=null.InvalidFlags)  # -> ListA, ListB

# ---- group: Fx | WA L L / fx | SCRIPT | T Y P E: S O L I D / F || WALL FROM SINGLE CRV(s) / Base Geo For Extrusion / Offset Settings
division_4 = Division(A=value_listener_77.Values, B=2)
neg_4 = Negative(Value=value_listener_77.Values)
width_6 = Weave(Pattern=value_listener_82.Indices, Stream0=value_listener_77.Values, Stream1=division_4, Stream2=neg_4, NullGaps=False)
width_7 = Weave(Pattern=value_listener_82.Indices, Stream0=False, Stream1=True, Stream2=False, NullGaps=False)

# ---- group: Fx | WA L L / fx | SCRIPT | T Y P E: S O L I D
objfromgroup_9 = GetObjectsInGroup()

# ---- group: Fx | S T A I R / fx | SCRIPT | Create STRINGER GEO
division_5 = Division(A=value_listener_121.Values, B=2)  # disabled
objfromgroup_10 = GetObjectsInGroup()

# ---- group: Fx | WA L L / fx | OUTPUT | W A L L / O | NOAH | W A L L
# EXTRA CODE: OUTPUT
objfromgroup_11 = GetObjectsInGroup()

# ---- group: Fx | R A I L I N G / fx | OUTPUT | R A I L I NG / O | NOAH | R A I L I NG
# EXTRA CODE: OUTPUT
objfromgroup_12 = GetObjectsInGroup()

# ---- group: Fx | F L O O R / fx | SCRIPT | SUPPORT / fx | SCRIPT | WAFFLE / F || WIDTH 2 | Offset Distance Logic
subtraction = Subtraction(A=value_listener_142.Values, B=value_listener_141.Values)  # disabled
max_2 = Maximum(A=subtraction, B=0)  # disabled

# ---- group: Fx | F L O O R / fx | SCRIPT | SUPPORT
objfromgroup_13 = GetObjectsInGroup()

# ---- group: Fx | F L O O R / fx | OUTPUT | W A L L / O | NOAH | F L O O R / Glass
geometry = Geometry()  # disabled
bake = Bake(bake=panel_281, geometry=geometry)  # disabled
# ADDITIONAL CUSTOM G.H. SCRIPT
preview = CustomPreview(
    Geometry=geometry,
    Material={diffuse=RGB(221, 160, 221), emission=RGB(66, 48, 66), shine=0.5, specular=RGB(255, 255, 255), transparency=0})  # disabled

# ---- group: Fx | F L O O R / fx | OUTPUT | W A L L / O | NOAH | F L O O R
# EXTRA CODE: OUTPUT
objfromgroup_14 = GetObjectsInGroup()

# ---- group: Fx | F L O O R / fx | SCRIPT | SWITCHES / STACK | MAIN SWITCHES
toggle_36 = BooleanToggle(False)
toggle_37 = BooleanToggle(True)
toggle_38 = BooleanToggle(False)
toggle_39 = BooleanToggle(True)
toggle_40 = BooleanToggle(True)
toggle_41 = BooleanToggle(True)
toggle_42 = BooleanToggle(False)
toggle_43 = BooleanToggle(True)
toggle_44 = BooleanToggle(True)
toggle_45 = BooleanToggle(True)
solver = StreamFilter(Gate=panel_211, Stream0=toggle_36, Stream1=toggle_37)
tile = StreamFilter(Gate=panel_215, Stream0=toggle_42, Stream1=toggle_43, Stream2=toggle_44, Stream3=toggle_45)
typeindex = StreamFilter(Gate=panel_212, Stream0=toggle_38, Stream1=toggle_39, Stream2=toggle_40, Stream3=toggle_41)
frame = EnableDisableObject(
    Objects=[objfromgroup_8, objfromgroup_14],
    Enabled=solver,
    AllObjects_Object=[boolean_toggle_13, boolean_toggle_12, select_geo_8, input_geo_main, input_geo_main, input_geo_main, input_geo_main, geo_2, geometry_9, panel_281, bake_9, preview_9, preview, geometry, panel_281, bake])

# ---- group: TOOLTIPS | FORM / STACK | INPUTS / cluster | SOLVER
# COLUMN 1 ELEMENT
panel_336 = Panel("""1 | SOLVER | FIREST [TURN ON] [SOLVER] to start this function.
and [TURN OFF] afterwards to avoid [CRASH].""")

# ---- group: TOOLTIPS | FORM / STACK | INPUTS / cluster | OBJECT INPUT
panel_337 = Panel("2 | OBJECT INPUT | Select type of reference [RHINO] geometry [OBJECT] [INPUT] to [ORIENT] onto [TARGET] geometry.")

# ---- group: TOOLTIPS | FORM / STACK | INPUTS / cluster | TARGET INPUT
panel_338 = Panel("3 | TARGET INPUT | Select type of reference [RHINO] geometry [TARGET] [INPUT] to [ORIENT] for [ORIENTATION] base.")

# ---- group: TOOLTIPS | FORM / STACK | INPUTS / cluster | NORMAL
panel_339 = Panel("NORMAL | Select [NORMAL] [DIRECTION] of [TARGET] for [ORIENATION].")

# ---- group: TOOLTIPS | FORM / STACK | INPUTS / cluster | SCATTER
panel_340 = Panel("SCATTER | Select type of [SCATTER]/ [PLACEMENT] of [OBJECT] on [TARGET].")

# ---- group: TOOLTIPS | FORM / STACK | INPUTS / cluster | ATT INPUT
panel_341 = Panel("3.5 | ATTRACTOR INPUT | Select type of reference [RHINO] geometry [ATTRACTOR] [INPUT] to manipulate [OBJECT] geometry.")

# ---- group: TOOLTIPS | FORM / STACK | SWITCHES / cluster | R. RANDOMIZATION
panel_342 = Panel("ROTATION RANDOMIZATION | Switch to [RANDOMIZE] [ORIENTATION] [ANGLE] of individual [OBJECT].")

# ---- group: TOOLTIPS | FORM / STACK | SWITCHES / cluster | SNAP ANGLE
panel_343 = Panel("SNAP ANGLE | Switch to snap [RANDOMIZED] [ANGLE] of [OBJECT] to a set [INCREMENATL VALUE]/ [SNAP ANGLE].")

# ---- group: TOOLTIPS | FORM / STACK | SWITCHES / cluster | SCALE RANDOMIZATION
panel_344 = Panel("SCALE RANDOMIZATION | Switch to [RANDOMIZE] [SCALE] of individual [OBJECT] in 3D at [CENTER] of [OBJECT].")

# ---- group: TOOLTIPS | FORM / STACK | SWITCHES / cluster | FLIP TARGET
panel_345 = Panel("FLIP TARGET | Swtich to flip [NORMAL] [DIRECTION] of [TARGET].")

# ---- group: TOOLTIPS | FORM / cluster | SEL TGT
panel_346 = Panel("5 | SEL TGT | [SELECT] reference [RHINO] geometry [TARGET] [INPUT] for [ORIENTATION] base.")

# ---- group: TOOLTIPS | FORM / cluster | SEL ATT
panel_347 = Panel("5.5 | SEL ATT | [SELECT] reference [RHINO] geometry [ATTRACTOR] [INPUT] to manipulate [OBJECT] geometry.")

# ---- group: ui | T | C O N C E P T U R A L / ui | F | P A T T E R N / ui | C1 | P A T T E R N / SNAP ANGLE
panel_348 = Panel("""CRV
SRF""")
panel_349 = Panel("""TOP
VOLUMETRIC
BOTTOM""")
panel_350 = Panel("""Z+
SRF
Z-""")
panel_351 = Panel("""GRID
RANDOMIZED""")
panel_352 = Panel("OBJECT INPUT")
panel_353 = Panel("CENTER")
panel_354 = Panel("NORMAL")
panel_355 = Panel("SCATTER")
panel_356 = Panel("TARGET INPUT")
panel_357 = Panel("R.RANDOMIZE")
panel_358 = Panel("S.RANDOMIZE")
panel_359 = Panel("FLIP TARGET SRF")
# COLUMN 1 ELEMENT
panel_360 = Panel("Scale and Orient")
_3_create_pulldown_menu_3 = CreatePulldownMenu(Label=panel_356, ListItems=panel_348, showLabel=True)
_4_create_pulldown_menu_4 = CreatePulldownMenu(Label=panel_353, ListItems=panel_349, SelectedIndex=2, showLabel=True)
_5_create_pulldown_menu_3 = CreatePulldownMenu(Label=panel_354, ListItems=panel_350, SelectedIndex=1, showLabel=True)
_6_create_pulldown_menu_2 = CreatePulldownMenu(Label=panel_355, ListItems=panel_351, SelectedIndex=0, showLabel=True)
_1_disaply_toogle_13 = CreateToggle(Default=False, OnLabel=panel_357, OffLabel=panel_357)
_1_disaply_toogle_14 = CreateToggle(Default=False, OnLabel=panel_358, OffLabel=panel_358)
_1_disaply_toogle_15 = CreateToggle(Default=False, OnLabel=panel_359, OffLabel=panel_359)
value_listener_169 = ValueListener(Elements=_1_disaply_toogle_13, SomeProperty=True)  # -> Values, Indices
value_listener_170 = ValueListener(Elements=_1_disaply_toogle_14, SomeProperty=True)  # -> Values, Indices
value_listener_171 = ValueListener(Elements=_1_disaply_toogle_15, SomeProperty=True)  # -> Values, Indices
type_index_2 = ValueListener(Elements=_3_create_pulldown_menu_3, SomeProperty=True)  # -> Values, Indices
value_listener_172 = ValueListener(Elements=_4_create_pulldown_menu_4, SomeProperty=True)  # -> Values, Indices
value_listener_173 = ValueListener(Elements=_5_create_pulldown_menu_3, SomeProperty=True)  # -> Values, Indices
value_listener_174 = ValueListener(Elements=_6_create_pulldown_menu_2, SomeProperty=True)  # -> Values, Indices
# P A T T E R N   E X P A N D E R (human UI)
_0_create_label_16 = CreateLabel(LabelText=panel_360, LabelSize=12, Justification=0)
panel_361 = Panel(value_listener_172.Indices)
panel_362 = Panel(value_listener_174.Indices)
panel_363 = Panel(type_index_2.Indices)

# ---- group: TOOLTIPS | FORM / STACK | INPUTS / cluster | TARGET INPUT (continued)
attach_tooltip_to_element_171 = AttachTooltipToElement(ElementsToAttachTo=_3_create_pulldown_menu_3, TooltipContent=panel_338, ShowDelay=100, Duration=2000)

# ---- group: TOOLTIPS | FORM / STACK | INPUTS / cluster | CENTER
attach_tooltip_to_element_172 = AttachTooltipToElement(
    ElementsToAttachTo=_4_create_pulldown_menu_4,
    TooltipContent="CENTER | [CENTER] of [OBJECT] for [ORIENTATION].",
    ShowDelay=100,
    Duration=2000)

# ---- group: TOOLTIPS | FORM / STACK | INPUTS / cluster | NORMAL (continued)
attach_tooltip_to_element_173 = AttachTooltipToElement(ElementsToAttachTo=_5_create_pulldown_menu_3, TooltipContent=panel_339, ShowDelay=100, Duration=4000)

# ---- group: TOOLTIPS | FORM / STACK | INPUTS / cluster | SCATTER (continued)
attach_tooltip_to_element_174 = AttachTooltipToElement(ElementsToAttachTo=_6_create_pulldown_menu_2, TooltipContent=panel_340, ShowDelay=100, Duration=2000)

# ---- group: TOOLTIPS | FORM / STACK | SWITCHES / cluster | R. RANDOMIZATION (continued)
attach_tooltip_to_element_175 = AttachTooltipToElement(ElementsToAttachTo=_1_disaply_toogle_13, TooltipContent=panel_342, ShowDelay=100, Duration=2000)

# ---- group: TOOLTIPS | FORM / STACK | SWITCHES / cluster | SCALE RANDOMIZATION (continued)
attach_tooltip_to_element_176 = AttachTooltipToElement(ElementsToAttachTo=_1_disaply_toogle_14, TooltipContent=panel_344, ShowDelay=100, Duration=2000)
# ---- group: TOOLTIPS | FORM / STACK | SWITCHES / cluster | FLIP TARGET (continued)
attach_tooltip_to_element_177 = AttachTooltipToElement(ElementsToAttachTo=_1_disaply_toogle_15, TooltipContent=panel_345, ShowDelay=100, Duration=2000)

# ---- group: ui | T | C O N C E P T U R A L
# EXPANDER :: C O N C E P T U R A L
panel_364 = Panel("""NONE
PT(S)
CRV""")
panel_365 = Panel("""CRV
BREP""")
panel_366 = Panel("ATTRACTOR INPUT")
panel_367 = Panel("SNAP ANGLE")
panel_368 = Panel("   SOLVER ON")
panel_369 = Panel("   SOLVER OFF")
_6_create_pulldown_menu_3 = CreatePulldownMenu(Label=panel_366, ListItems=panel_364, SelectedIndex=0, showLabel=True)
_1_disaply_toogle_16 = CreateToggle(Default=False, OnLabel=panel_367, OffLabel=panel_367)
value_listener_175 = ValueListener(Elements=_1_disaply_toogle_16, SomeProperty=True)  # -> Values, Indices
value_listener_176 = ValueListener(Elements=_6_create_pulldown_menu_3, SomeProperty=True)  # -> Values, Indices
panel_370 = Panel(value_listener_173.Indices)
panel_371 = Panel(value_listener_176.Indices)
panel_372 = Panel("SEL TGT")
panel_373 = Panel("SEL ATT")
create_button_42 = CreateButton(ButtonName=panel_372, ButtonStyle=0)
create_button_43 = CreateButton(ButtonName=panel_373, ButtonStyle=0)
value_listener_177 = ValueListener(Elements=create_button_42, SomeProperty=True)  # -> Values, Indices
value_listener_178 = ValueListener(Elements=create_button_43, SomeProperty=True)  # -> Values, Indices

# ---- group: TOOLTIPS | FORM / STACK | INPUTS / cluster | ATT INPUT (continued)
attach_tooltip_to_element_178 = AttachTooltipToElement(ElementsToAttachTo=_6_create_pulldown_menu_3, TooltipContent=panel_341, ShowDelay=100, Duration=2000)

# ---- group: TOOLTIPS | FORM / STACK | SWITCHES / cluster | SNAP ANGLE (continued)
attach_tooltip_to_element_179 = AttachTooltipToElement(ElementsToAttachTo=_1_disaply_toogle_16, TooltipContent=panel_343, ShowDelay=100, Duration=3000)

# ---- group: TOOLTIPS | FORM / cluster | SEL TGT (continued)
attach_tooltip_to_element_180 = AttachTooltipToElement(ElementsToAttachTo=create_button_42, TooltipContent=panel_346, ShowDelay=100, Duration=2000)

# ---- group: TOOLTIPS | FORM / cluster | SEL ATT (continued)
attach_tooltip_to_element_181 = AttachTooltipToElement(ElementsToAttachTo=create_button_43, TooltipContent=panel_347, ShowDelay=100, Duration=2000)

# ---- group: ui | T | C O N C E P T U R A L / ui | F | P A T T E R N / ui | C1 | P A T T E R N / SNAP ANGLE (continued)
_2_create_pulldown_menu_16 = CreatePulldownMenu(Label=panel_352, ListItems=panel_365, SelectedIndex=0, showLabel=True)
toggle_46 = CreateToggle(Default=False, OnLabel=panel_368, OffLabel=panel_369)
value_listener_179 = ValueListener(Elements=toggle_46, SomeProperty=True)  # -> Values, Indices
input_index_16 = ValueListener(Elements=_2_create_pulldown_menu_16, SomeProperty=True)  # -> Values, Indices
panel_374 = Panel(input_index_16.Indices)

# ---- group: TOOLTIPS | FORM / STACK | INPUTS / cluster | SOLVER (continued)
attach_tooltip_to_element_182 = AttachTooltipToElement(ElementsToAttachTo=toggle_46, TooltipContent=panel_336, ShowDelay=100, Duration=2000)

# ---- group: TOOLTIPS | FORM / STACK | INPUTS / cluster | OBJECT INPUT (continued)
attach_tooltip_to_element_183 = AttachTooltipToElement(ElementsToAttachTo=_2_create_pulldown_menu_16, TooltipContent=panel_337, ShowDelay=100, Duration=3000)

# ---- group: ui | T | C O N C E P T U R A L / ui | F | P A T T E R N / ui | E | P A T T E R N / STACK | COLUMANS
merge_6 = Merge(
    Data1=_0_create_label_16,
    Data2=toggle_46,
    Data3=_2_create_pulldown_menu_16,
    Data4=_3_create_pulldown_menu_3,
    Data5=_4_create_pulldown_menu_4,
    Data6=_5_create_pulldown_menu_3,
    Data7=_6_create_pulldown_menu_2,
    Data8=_1_disaply_toogle_13,
    Data9=_1_disaply_toogle_16,
    Data10=_1_disaply_toogle_14,
    Data11=_1_disaply_toogle_15,
    Data12=_10_create_slider_9,
    Data13=_11_create_slider,
    Data14=_12_create_slider,
    Data15=_13_create_slider,
    Data16=create_slider,
    Data17=create_slider_2,
    Data18=create_slider_4,
    Data19=create_slider_3,
    Data20=create_slider_5,
    Data21=create_slider_6,
    Data22=create_slider_7,
    Data23=_6_create_pulldown_menu_3)

# ---- group: ui | T | C O N C E P T U R A L / ui | F | P A T T E R N / ui | E | P A T T E R N / STACK | COLUMANS / cluster
column_1_elements_generator_4 = COLUMN1ELEMENTSGENERATOR_5(
    all_c1_elements=merge_6,
    objinput=panel_374,
    rotationindex=value_listener_169.Values,
    scatterindex=panel_362,
    snapindex=value_listener_175.Values,
    scaleindex=value_listener_170.Values,
    attindex=panel_371)  # -> column_1_elements, number_of_elements_in_column_1

column_2_elements_generator_5 = COLUMN2ELEMENTSGENERATOR_6(
    attindex=panel_371,
    c1length=column_1_elements_generator_4.number_of_elements_in_column_1,
    L=[create_button_18, create_button_19, create_button_11, create_button_42, create_button_12, create_color_picker_2, placeholder_2, create_button_43, create_button_20])

# ---- group: ui | T | C O N C E P T U R A L / ui | F | P A T T E R N / ui | E | P A T T E R N / STACK | MAIN EXPANDER / cluster
create_grid_7 = CreateGrid(column_1=column_1_elements_generator_4.column_1_elements, column_2=column_2_elements_generator_5, height_of_menu=width_2)  # -> elements, width_of_grid, height_2, row_def_2, columan_def, element_row, element_column, total_list_length

# ---- group: ui | T | C O N C E P T U R A L / ui | F | P A T T E R N / ui | E | P A T T E R N / STACK | MAIN EXPANDER
create_grid_8 = CreateGrid(
    UIElements=create_grid_7.elements,
    Width=create_grid_7.width_of_grid,
    Height=create_grid_7.height_2,
    RowDefinitions=create_grid_7.row_def_2,
    ColumnDefinitions=create_grid_7.columan_def,
    ElementRow=create_grid_7.element_row,
    ElementColumn=create_grid_7.element_column,
    ElementRowSpan=1,
    ElementColumnSpan=1)
all_expander_elements_4 = Entwine(Branch00=create_grid_8, FlattenInputs=True)  # -> flatten(Result)
stack_14 = CreateStack(UIElements=all_expander_elements_4, Horizontal=False)

# ---- group: ui | T | C O N C E P T U R A L / ui | F | P A T T E R N / ui | E | P A T T E R N
# EXPANDER MENU
# Columns
# Human UI Elements
savestates_5 = SaveElementStates(
    Elements=[column_1_elements_generator_4.column_1_elements, column_2_elements_generator_5],
    SaveState=value_listener_52.Values,
    StateName="test",
    ClearSavedStates=False,
    stateSetChunk_State0_stateName="test",
    stateSetChunk_State0_stateItem0_ElementIndex=0,
    stateSetChunk_State0_stateItem0_ElementValue="1",
    stateSetChunk_State0_stateItem0_ElementValueType="System.Double",
    stateSetChunk_State0_stateItem1_ElementIndex=0,
    stateSetChunk_State0_stateItem1_ElementValue="11",
    stateSetChunk_State0_stateItem1_ElementValueType="System.Double",
    stateSetChunk_State0_stateItem2_ElementIndex=0,
    stateSetChunk_State0_stateItem2_ElementValue="8.03",
    stateSetChunk_State0_stateItem2_ElementValueType="System.Double",
    stateSetChunk_State0_stateItem3_ElementIndex=0,
    stateSetChunk_State0_stateItem3_ElementValue="7.98",
    stateSetChunk_State0_stateItem3_ElementValueType="System.Double",
    stateSetChunk_State0_stateItem4_ElementIndex=0,
    stateSetChunk_State0_stateItem4_ElementValue="264",
    stateSetChunk_State0_stateItem4_ElementValueType="System.Double",
    stateSetChunk_State0_stateItem5_ElementIndex=0,
    stateSetChunk_State0_stateItem5_ElementValue="157",
    stateSetChunk_State0_stateItem5_ElementValueType="System.Double",
    stateSetChunk_State0_stateItem6_ElementIndex=0,
    stateSetChunk_State0_stateItem6_ElementValue="90",
    stateSetChunk_State0_stateItem6_ElementValueType="System.Double",
    stateSetChunk_State0_stateItem7_ElementIndex=0,
    stateSetChunk_State0_stateItem7_ElementValue="0",
    stateSetChunk_State0_stateItem7_ElementValueType="System.Double",
    stateSetChunk_State0_stateItem8_ElementIndex=0,
    stateSetChunk_State0_stateItem8_ElementValue="1.03",
    stateSetChunk_State0_stateItem8_ElementValueType="System.Double",
    stateSetChunk_State0_stateItem9_ElementIndex=0,
    stateSetChunk_State0_stateItem9_ElementValue="0.32",
    stateSetChunk_State0_stateItem9_ElementValueType="System.Double",
    stateSetChunk_State0_stateItem10_ElementIndex=0,
    stateSetChunk_State0_stateItem10_ElementValue="0",
    stateSetChunk_State0_stateItem10_ElementValueType="System.Double")  # -> SavedStates, SavedStateNames
restore_5 = RestoreElementStates(Restore=value_listener_53.Values, SavedStates=savestates_5.SavedStates, StateNameToRestore=savestates_5.SavedStateNames)

# ---- group: Fx | P A T T E R N / fx | INPUT | TARGET
boolean_toggle_14 = BooleanToggle(True)  # disabled
boolean_toggle_15 = BooleanToggle(True)  # disabled
select_geo_9 = SelectGeo(
    run=value_listener_177.Values,
    allowMultiple=boolean_toggle_14,
    allowNone=boolean_toggle_15,
    msg="Pick object(s)",
    clear=value_listener_54.Values)  # -> pickedGeometry; inputs run: Boolean, allowMultiple: Boolean, allowNone: Boolean, msg: String, clear: Boolean; disabled; same code as select_geo
target_geo = Geometry(graft(select_geo_9))  # disabled
objfromgroup_15 = GetObjectsInGroup()

# ---- group: fx | SCRIPT | COLOR INDICATOR / F || COLOR INDICATOR (SEL GEO)
lng_11 = ListLength(List=flatten(target_geo))
expression_29 = Expression(x=lng_11, Expression="if (x = 0,0,1)")
expression_30 = Expression(x=lng_11, Expression="if (x = 0,0,1)")
swatch_66 = ColourSwatch(SwatchColor=RGB(255, 255, 255))
swatch_67 = ColourSwatch(SwatchColor=RGB(0, 0, 0))
swatch_68 = ColourSwatch(SwatchColor=RGBA(255, 255, 255, 0))
swatch_69 = ColourSwatch(SwatchColor=RGB(222, 199, 27))
weave_33 = Weave(Pattern=expression_29, Stream0=swatch_66, Stream1=swatch_67, NullGaps=False)
weave_34 = Weave(Pattern=expression_30, Stream0=swatch_68, Stream1=swatch_69, NullGaps=False)
adjustelem_16 = AdjustElementAppearance(ElementsToAdjust=create_button_42, Foreground=weave_33, Background=weave_34)

# ---- group: Fx | P A T T E R N / fx | INPUT | ATTRACTOR
boolean_toggle_16 = BooleanToggle(True)  # disabled
boolean_toggle_17 = BooleanToggle(True)  # disabled
select_geo_10 = SelectGeo(
    run=value_listener_178.Values,
    allowMultiple=boolean_toggle_16,
    allowNone=boolean_toggle_17,
    msg="Pick object(s)",
    clear=value_listener_54.Values)  # -> pickedGeometry; inputs run: Boolean, allowMultiple: Boolean, allowNone: Boolean, msg: String, clear: Boolean; disabled; same code as select_geo
objfromgroup_16 = GetObjectsInGroup()
attractor_geo = Geometry(select_geo_10)  # disabled

# ---- group: fx | SCRIPT | COLOR INDICATOR / F || COLOR INDICATOR (CLEAR GEO)
inputgeo_list_2 = Relay([object_geo, target_geo, attractor_geo])
lng_12 = ListLength(List=flatten(inputgeo_list_2))
expression_31 = Expression(x=lng_12, Expression="if (x = 0,0,1)")
expression_32 = Expression(x=lng_12, Expression="if (x = 0,0,1)")
swatch_70 = ColourSwatch(SwatchColor=RGB(255, 255, 255))
swatch_71 = ColourSwatch(SwatchColor=RGB(0, 0, 0))
swatch_72 = ColourSwatch(SwatchColor=RGBA(255, 255, 255, 0))
swatch_73 = ColourSwatch(SwatchColor=RGB(222, 199, 27))
weave_35 = Weave(Pattern=expression_31, Stream0=swatch_71, Stream1=swatch_70, NullGaps=False)
weave_36 = Weave(Pattern=expression_32, Stream0=swatch_73, Stream1=swatch_72, NullGaps=False)
adjustelem_17 = AdjustElementAppearance(ElementsToAdjust=create_button_20, Foreground=weave_35, Background=weave_36)

# ---- group: fx | SCRIPT | COLOR INDICATOR / F || COLOR INDICATOR (SEL GEO)
lng_13 = ListLength(List=flatten(attractor_geo))
expression_33 = Expression(x=lng_13, Expression="if (x = 0,0,1)")
expression_34 = Expression(x=lng_13, Expression="if (x = 0,0,1)")
swatch_74 = ColourSwatch(SwatchColor=RGB(255, 255, 255))
swatch_75 = ColourSwatch(SwatchColor=RGB(0, 0, 0))
swatch_76 = ColourSwatch(SwatchColor=RGBA(255, 255, 255, 0))
swatch_77 = ColourSwatch(SwatchColor=RGB(222, 199, 27))
weave_37 = Weave(Pattern=expression_33, Stream0=swatch_74, Stream1=swatch_75, NullGaps=False)
weave_38 = Weave(Pattern=expression_34, Stream0=swatch_76, Stream1=swatch_77, NullGaps=False)
adjustelem_18 = AdjustElementAppearance(ElementsToAdjust=create_button_43, Foreground=weave_37, Background=weave_38)

# ---- group: Fx | P A T T E R N / fx | SCRIPT | SORT TARGET GEO / F || Sort Geo Type
gate = StreamGate(Stream=target_geo, Gate=panel_363)  # -> Target0, Target1
boundary_3 = BoundarySurfaces(Edges=gate.Target0)
reparamsrf = ReparameterizeSurface(Surface=gate.Target1)  # -> Reparameterized, Original
filter_10 = StreamFilter(Gate=panel_363, Stream0=boundary_3, Stream1=reparamsrf.Reparameterized)

# ---- group: Fx | P A T T E R N / fx | SCRIPT | SORT TARGET GEO / F || Flip Crv
item = ListItem(List=filter_10, Index=0, Wrap=True)
flip = Flip(Surface=filter_10, Guide=item)  # -> Surface, Result
flip_2 = Flip(Surface=flip.Surface)  # -> Surface, Result
weave_39 = Weave(Pattern=value_listener_171.Values, Stream0=filter_10, Stream1=flip_2.Surface, NullGaps=False)

# ---- group: Fx | P A T T E R N / fx | SCRIPT | SORT TARGET GEO / F || OFFSET TARGET AREA
edges_2 = BrepEdges(Brep=weave_39)  # -> Naked, Interior, NonManifold
join_2 = JoinCurves(Curves=edges_2.Naked, Preserve=False)
offsets = OffsetOnSrf(Curve=join_2, Distance=value_listener_30.Values, Surface=graft(weave_39))
graft_9 = GraftTree(Tree=weave_39, IncludeEmptyLists=True, IncludeNullItems=True)
srfsplit = SurfaceSplit(Surface=graft_9, Curves=offsets)
item_2 = ListItem(List=srfsplit, Index=1, Wrap=True)

# ---- group: Fx | P A T T E R N / fx | SCRIPT | TARGET PTS / F || POPULATE (GRID)
sdivide = DivideSurface(Surface=item_2, UCount=value_listener_32.Values, VCount=value_listener_33.Values)  # -> Points, Normals, Parameters
Z_2 = UnitZ(Factor=-1)
xy_2 = XYPlane(Origin=sdivide.Points)
padjust = AdjustPlane(Plane=sdivide.Points, Normal=sdivide.Normals)
padjust_2 = AdjustPlane(Plane=sdivide.Points, Normal=Z_2)
center = Weave(Pattern=panel_370, Stream0=xy_2, Stream1=padjust, Stream2=padjust_2, NullGaps=False)

# ---- group: Fx | P A T T E R N / fx | SCRIPT | TARGET PTS / F || POPULATE (RANDOM)
popgeo = PopulateGeometry(Geometry=item_2, Count=value_listener_31.Values, Seed=1)
brep_cp = BrepClosestPoint(Point=popgeo, Brep=item_2)  # -> Point, Normal, Distance
Z_3 = UnitZ(Factor=-1)
xy_3 = XYPlane(Origin=brep_cp.Point)
padjust_3 = AdjustPlane(Plane=xy_3, Normal=brep_cp.Normal)
padjust_4 = AdjustPlane(Plane=popgeo, Normal=Z_3)
center_2 = Weave(Pattern=panel_370, Stream0=xy_3, Stream1=padjust_3, Stream2=padjust_4, NullGaps=False)

# ---- group: Fx | P A T T E R N / fx | SCRIPT | TARGET PTS
pshift_2 = ShiftPaths(Data=center, Offset=-1)
filter_11 = StreamFilter(Gate=panel_362, Stream0=pshift_2, Stream1=center_2)  # -> simplify(Stream)
clean_2 = CleanTree(RemoveNulls=True, RemoveInvalid=True, RemoveEmpty=False, Tree=filter_11)

# ---- group: Fx | P A T T E R N / F || SCALE FACTORS / F || ROTATION ANGLE
dom = ConstructDomain(DomainStart=value_listener_39.Values, DomainEnd=value_listener_38.Values)
lng_14 = ListLength(List=clean_2)
tstat = TreeStatistics(Tree=lng_14)  # -> Paths, Length, Count
series_2 = Series(Start=value_listener_40.Values, Step=1, Count=tstat.Count)  # -> graft(Series)
random = Random(Range=dom, Number=lng_14, Seed=series_2)
randomize = Weave(Pattern=value_listener_170.Values, Stream0=value_listener_38.Values, Stream1=random, NullGaps=False)

# ---- group: Fx | P A T T E R N / F || OBJ ORIGIN
gate_2 = StreamGate(Stream=object_geo, Gate=panel_374)  # -> Target0, Target1
crv_2 = Curve(gate_2.Target0)
brep = Brep(gate_2.Target1)
brec = BoundingRectangle(Geometry=crv_2, Plane=PlaneXY(0, 0, 0), Axis=0, Slide=0, Union=True)  # -> Bounding, DimensionX, DimensionY
area = Area(Geometry=brec.Bounding)  # -> Area, Centroid

# ---- group: Fx | P A T T E R N / F || OBJ ORIGIN / F || Sort Top and Bottom Srf
group = Group(Objects=flatten(brep))
bbox = BoundingBox(Content=group, Plane=PlaneXY(0, 0, 0))  # -> Box, Box_2
debrep_2 = DeconstructBrep(Brep=bbox.Box)  # -> Faces, Edges, Vertices
md_slider_2 = MDSlider(SliderMode=0, slider_value=Point(0.5, 0.5, 0.5), x_domain=Domain(0, 1), y_domain=Domain(0, 1), z_domain=Domain(0, 1))
evalsrf_2 = EvaluateSurface(Surface=reparameterize(debrep_2.Faces), Point=md_slider_2)  # -> Point, Normal, UDirection, VDirection, Frame
devec = DeconstructVector(Vector=evalsrf_2.Normal)  # -> XComponent, YComponent, ZComponent
equals = Equality(FirstNumber=devec.ZComponent, SecondNumber=1)  # -> Equality, Inequality
equals_2 = Equality(FirstNumber=devec.ZComponent, SecondNumber=-1)  # -> Equality, Inequality
dispatch_6 = Dispatch(List=debrep_2.Faces, DispatchPattern=equals.Equality)  # -> ListA, ListB
dispatch_7 = Dispatch(List=debrep_2.Faces, DispatchPattern=equals_2.Equality)  # -> ListA, ListB
top = Surface(dispatch_6.ListA)
bottom = Surface(dispatch_7.ListA)
volume = Volume(Geometry=bbox.Box)  # -> Volume, Centroid
area_2 = Area(Geometry=top)  # -> Area, Centroid
area_3 = Area(Geometry=bottom)  # -> Area, Centroid
weave_40 = Weave(Pattern=panel_361, Stream0=area_2.Centroid, Stream1=volume.Centroid, Stream2=area_3.Centroid, NullGaps=False)

# ---- group: Fx | P A T T E R N / F || OBJ ORIGIN (continued)
filter_12 = StreamFilter(Gate=panel_374, Stream0=area.Centroid, Stream1=weave_40)

# ---- group: Fx | F O R M / fx | SCRIPT | PRIMARY GEOMETRY
gate_3 = StreamGate(Stream=primary_geometry, Gate=panel_78)  # -> Target0, Target1, Target2, Target3, Target4

# ---- group: Fx | F O R M / fx | SCRIPT | PRIMARY GEOMETRY / fx | SCRIPT | EXTRUDE GEOMETRY / F || Extrusion Base Geo
cls = Closed(Curve=gate_3.Target0)  # -> Closed, Periodic
dispatch_8 = Dispatch(List=gate_3.Target0, DispatchPattern=cls.Closed)  # -> ListA, ListB
extrusion_base = Relay([dispatch_8.ListA, gate_3.Target2])

# ---- group: Fx | F O R M / fx | SCRIPT | PRIMARY GEOMETRY / F || LOFT GEOMETRY
closed = BooleanToggle(False)
adj = BooleanToggle(False)
loft = Loft(C=gate_3.Target1, cls=closed, adj=adj, T=panel_91)

# ---- group: Fx | F O R M / fx | SCRIPT | ADDITIONAL GEOMETRY
gate_4 = StreamGate(Stream=addition_geometry, Gate=panel_30)  # -> Target0, Target1, Target2, Target3, Target4, Target5; disabled
flip_3 = Flip(Surface=gate_4.Target4)  # -> Surface, Result; disabled
weave_41 = Weave(Pattern=value_listener_12.Values, Stream0=gate_4.Target4, Stream1=flip_3.Surface, NullGaps=False)  # disabled
objfromgroup_17 = GetObjectsInGroup()

# ---- group: Fx | F O R M / fx | SCRIPT | ADDITIONAL GEOMETRY / F || DOUBLE CRV | LOFTS
matchdir = MatchDir_2(C=gate_4.Target1)  # disabled
partition = PartitionList(List=flatten(matchdir), Size=2)  # disabled
closed_2 = BooleanToggle(False)  # disabled
adj_2 = BooleanToggle(False)  # disabled
loft_2 = Loft(C=partition, cls=closed_2, adj=adj_2, T=panel_31)  # disabled

# ---- group: Fx | F O R M / fx | SCRIPT | ADDITIONAL GEOMETRY / F || LOFT GEOMETRY
matchdir_2 = MatchDir_2(C=gate_4.Target2)  # disabled
closed_3 = BooleanToggle(False)  # disabled
adj_3 = BooleanToggle(False)  # disabled
loft_3 = Loft(C=matchdir_2, cls=closed_3, adj=adj_3, T=panel_31)  # disabled

# ---- group: Fx | F O R M / fx | SCRIPT | ADDITIONAL GEOMETRY / fx | SCRIPT | EXTRUDE GEOMETRY / F || Extrusion Base Geo
cls_2 = Closed(Curve=gate_4.Target0)  # -> Closed, Periodic; disabled
dispatch_9 = Dispatch(List=gate_4.Target0, DispatchPattern=cls_2.Closed)  # -> ListA, ListB; disabled
extrusion_base_2 = Relay([dispatch_9.ListA, gate_4.Target3])  # disabled

# ---- group: Fx | F O R M / fx | SCRIPT | SUBTRACTION GEOMETRY
gate_5 = StreamGate(Stream=subtraction_geometry, Gate=panel_55)  # -> Target0, Target1, Target2, Target3, Target4, Target5; disabled
flip_4 = Flip(Surface=gate_5.Target4)  # -> Surface, Result; disabled
weave_42 = Weave(Pattern=value_listener_17.Values, Stream0=gate_5.Target4, Stream1=flip_4.Surface, NullGaps=False)  # disabled
objfromgroup_18 = GetObjectsInGroup()

# ---- group: Fx | F O R M / fx | SCRIPT | SUBTRACTION GEOMETRY / F || DOUBLE CRV | LOFTS
matchdir_3 = MatchDir_2(C=gate_5.Target1)  # disabled
partition_2 = PartitionList(List=flatten(matchdir_3), Size=2)  # disabled
closed_4 = BooleanToggle(False)  # disabled
adj_4 = BooleanToggle(False)  # disabled
loft_4 = Loft(C=partition_2, cls=closed_4, adj=adj_4, T=panel_56)  # disabled

# ---- group: Fx | F O R M / fx | SCRIPT | SUBTRACTION GEOMETRY / F || LOFT GEOMETRY
matchdir_4 = MatchDir_2(C=gate_5.Target2)  # disabled
closed_5 = BooleanToggle(False)  # disabled
adj_5 = BooleanToggle(False)  # disabled
loft_5 = Loft(C=matchdir_4, cls=closed_5, adj=adj_5, T=panel_56)  # disabled

# ---- group: Fx | F O R M / fx | SCRIPT | SUBTRACTION GEOMETRY / fx | SCRIPT | EXTRUDE GEOMETRY / F || Extrusion Base Geo
cls_3 = Closed(Curve=gate_5.Target0)  # -> Closed, Periodic; disabled
dispatch_10 = Dispatch(List=gate_5.Target0, DispatchPattern=cls_3.Closed)  # -> ListA, ListB; disabled
extrusion_base_3 = Relay([dispatch_10.ListA, gate_5.Target3])  # disabled

# ---- group: fx | SCRIPT | SWITCHES / STACK | FRAME SWITCHES
toggle_47 = BooleanToggle(False)
toggle_48 = BooleanToggle(True)
toggle_49 = BooleanToggle(False)
toggle_50 = BooleanToggle(False)
add = StreamFilter(Gate=value_listener_15.Values, Stream0=toggle_47, Stream1=toggle_48)
sub = StreamFilter(Gate=value_listener_20.Values, Stream0=toggle_49, Stream1=toggle_50)
frame_2 = EnableDisableObject(
    Objects=objfromgroup_17,
    Enabled=add,
    AllObjects_Object=[addition_geometry, addition_geometry, boolean_toggle_2, select_geo_2, gate_4, gate_4, gate_4, gate_4, gate_4, gate_4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])
frame_3 = EnableDisableObject(
    Objects=objfromgroup_18,
    Enabled=sub,
    AllObjects_Object=[subtraction_geometry, subtraction_geometry, boolean_toggle_3, select_geo_3, gate_5, gate_5, gate_5, gate_5, gate_5, gate_5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])

# ---- group: Fx | F O R M / fx | SCRIPT | PRIMARY GEOMETRY / fx | SCRIPT | EXTRUDE GEOMETRY / F || Extrusion Direction and Height / F || NORMAL
sortbytype = SortObjectsByType(RhinoObjects=extrusion_base)  # -> Points, Curves, Surfaces, Breps, Meshes, TextObjects, HatchObjects, LightObjects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
patch = Patch(Curves=sortbytype.Curves, Spans=20, Flexibility=1, Trim=True)
srf = Surface([patch, sortbytype.Surfaces])
md_slider_3 = MDSlider(SliderMode=0, slider_value=Point(0.5, 0.5, 0.5), x_domain=Domain(0, 1), y_domain=Domain(0, 1), z_domain=Domain(0, 1))

# ---- group: Fx | F O R M / fx | SCRIPT | ADDITIONAL GEOMETRY / fx | SCRIPT | EXTRUDE GEOMETRY / F || Extrusion Direction and Height / F || NORMAL
sortbytype_2 = SortObjectsByType(RhinoObjects=extrusion_base_2)  # -> Points, Curves, Surfaces, Breps, Meshes, TextObjects, HatchObjects, LightObjects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; disabled
patch_2 = Patch(Curves=sortbytype_2.Curves, Spans=20, Flexibility=1, Trim=True)  # disabled
srf_2 = Surface([patch_2, sortbytype_2.Surfaces, sortbytype_2.Breps])  # disabled
clean_3 = CleanTree(RemoveNulls=True, RemoveInvalid=True, RemoveEmpty=False, Tree=srf_2)  # disabled
md_slider_4 = MDSlider(SliderMode=0, slider_value=Point(0.5, 0.5, 0.5), x_domain=Domain(0, 1), y_domain=Domain(0, 1), z_domain=Domain(0, 1))  # disabled

# ---- group: Fx | F O R M / fx | SCRIPT | SUBTRACTION GEOMETRY / fx | SCRIPT | EXTRUDE GEOMETRY / F || Extrusion Direction and Height / F || NORMAL
sortbytype_3 = SortObjectsByType(RhinoObjects=extrusion_base_3)  # -> Points, Curves, Surfaces, Breps, Meshes, TextObjects, HatchObjects, LightObjects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; disabled
patch_3 = Patch(Curves=sortbytype_3.Curves, Spans=20, Flexibility=1, Trim=True)  # disabled
srf_3 = Surface([patch_3, sortbytype_3.Surfaces, sortbytype_3.Breps])  # disabled
clean_4 = CleanTree(RemoveNulls=True, RemoveInvalid=True, RemoveEmpty=False, Tree=srf_3)  # disabled
md_slider_5 = MDSlider(SliderMode=0, slider_value=Point(0.5, 0.5, 0.5), x_domain=Domain(0, 1), y_domain=Domain(0, 1), z_domain=Domain(0, 1))  # disabled

# ---- group: Fx | F O R M / fx | SCRIPT | PRIMARY GEOMETRY / fx | SCRIPT | EXTRUDE GEOMETRY / F || Extrusion Direction and Height
flip_5 = Flip(Surface=srf)  # -> Surface, Result
weave_43 = Weave(Pattern=value_listener_26.Values, Stream0=srf, Stream1=flip_5.Surface, NullGaps=False)
Z_4 = UnitZ(Factor=expr("x-1", value_listener_27.Values))
Z_5 = UnitZ(Factor=value_listener_27.Values)

# ---- group: Fx | F O R M / fx | SCRIPT | PRIMARY GEOMETRY / fx | SCRIPT | EXTRUDE GEOMETRY / F || Extrusion Direction and Height / F || NORMAL (continued)
evalsrf_3 = EvaluateSurface(Surface=reparameterize(weave_43), Point=md_slider_3)  # -> Point, Normal, UDirection, VDirection, Frame
amp_3 = Amplitude(Vector=evalsrf_3.Normal, Amplitude=value_listener_27.Values)

# ---- group: Fx | F O R M / fx | SCRIPT | PRIMARY GEOMETRY / fx | SCRIPT | EXTRUDE GEOMETRY / F || Extrusion Direction and Height (continued)
filter_13 = StreamFilter(Gate=panel_79, Stream0=Z_5, Stream1=amp_3, Stream2=Z_4)

# ---- group: Fx | F O R M / fx | SCRIPT | PRIMARY GEOMETRY / fx | SCRIPT | EXTRUDE GEOMETRY
extr_3 = Extrude(Base=extrusion_base, Direction=filter_13)

# ---- group: Fx | F O R M / fx | SCRIPT | ADDITIONAL GEOMETRY / fx | SCRIPT | EXTRUDE GEOMETRY / F || Extrusion Direction and Height
flip_6 = Flip(Surface=clean_3)  # -> Surface, Result; disabled
weave_44 = Weave(Pattern=value_listener_12.Values, Stream0=clean_3, Stream1=flip_6.Surface, NullGaps=False)  # disabled
Z_6 = UnitZ(Factor=expr("x-1", value_listener_13.Values))  # disabled
Z_7 = UnitZ(Factor=value_listener_13.Values)  # disabled

# ---- group: Fx | F O R M / fx | SCRIPT | ADDITIONAL GEOMETRY / fx | SCRIPT | EXTRUDE GEOMETRY / F || Extrusion Direction and Height / F || NORMAL (continued)
evalsrf_4 = EvaluateSurface(Surface=reparameterize(weave_44), Point=md_slider_4)  # -> Point, Normal, UDirection, VDirection, Frame; disabled
amp_4 = Amplitude(Vector=evalsrf_4.Normal, Amplitude=value_listener_13.Values)  # disabled

# ---- group: Fx | F O R M / fx | SCRIPT | ADDITIONAL GEOMETRY / fx | SCRIPT | EXTRUDE GEOMETRY / F || Extrusion Direction and Height (continued)
filter_14 = StreamFilter(Gate=panel_32, Stream0=Z_7, Stream1=amp_4, Stream2=Z_6)  # disabled

# ---- group: Fx | F O R M / fx | SCRIPT | ADDITIONAL GEOMETRY / fx | SCRIPT | EXTRUDE GEOMETRY
extr_4 = Extrude(Base=extrusion_base_2, Direction=filter_14)  # disabled

# ---- group: Fx | F O R M / fx | SCRIPT | SUBTRACTION GEOMETRY / fx | SCRIPT | EXTRUDE GEOMETRY / F || Extrusion Direction and Height
flip_7 = Flip(Surface=clean_4)  # -> Surface, Result; disabled
weave_45 = Weave(Pattern=value_listener_17.Values, Stream0=clean_4, Stream1=flip_7.Surface, NullGaps=False)  # disabled
Z_8 = UnitZ(Factor=expr("x-1", value_listener_18.Values))  # disabled
Z_9 = UnitZ(Factor=value_listener_18.Values)  # disabled

# ---- group: Fx | F O R M / fx | SCRIPT | SUBTRACTION GEOMETRY / fx | SCRIPT | EXTRUDE GEOMETRY / F || Extrusion Direction and Height / F || NORMAL (continued)
evalsrf_5 = EvaluateSurface(Surface=reparameterize(weave_45), Point=md_slider_5)  # -> Point, Normal, UDirection, VDirection, Frame; disabled
amp_5 = Amplitude(Vector=evalsrf_5.Normal, Amplitude=value_listener_18.Values)  # disabled

# ---- group: Fx | F O R M / fx | SCRIPT | SUBTRACTION GEOMETRY / fx | SCRIPT | EXTRUDE GEOMETRY / F || Extrusion Direction and Height (continued)
filter_15 = StreamFilter(Gate=panel_57, Stream0=Z_9, Stream1=amp_5, Stream2=Z_8)  # disabled

# ---- group: Fx | F O R M / fx | SCRIPT | SUBTRACTION GEOMETRY / fx | SCRIPT | EXTRUDE GEOMETRY
extr_5 = Extrude(Base=extrusion_base_3, Direction=filter_15)  # disabled

# ---- group: Fx | F O R M / fx | SCRIPT | PRIMARY GEOMETRY (continued)
brep_2 = StreamFilter(Gate=panel_78, Stream0=extr_3, Stream1=loft, Stream2=extr_3, Stream3=gate_3.Target3)

# ---- group: Fx | F O R M / fx | SCRIPT | PRIMARY GEOMETRY / fx | SCRIPT | CAP || OFFSET SRF / F || OFFSET SRF
# F O R M    F U N C T I O N
sortbytype_4 = SortObjectsByType(RhinoObjects=brep_2)  # -> Points, Curves, Surfaces, Breps, Meshes, TextObjects, HatchObjects, LightObjects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
mesh = MeshBrep(
    Brep=sortbytype_4.Breps,
    Settings={GridMaxCount=0, GridMinCount=16, JaggedSeams=False, MaxEdgeLength=0, MinEdgeLength=0.0001, MinTolerance=0, Refine=True, RefineAngle=0, RelativeTolerance=0.65, SimplePlanes=True, Tolerance=0})
neg_5 = Negative(Value=value_listener_28.Values)
toggle_51 = BooleanToggle(False)
width_8 = StreamFilter(Gate=panel_80, Stream0=value_listener_28.Values, Stream1=neg_5)
offsrf_5 = OffsetSurface(Surface=sortbytype_4.Surfaces, Distance=width_8, BothSides=toggle_51, CreateSolid=True)
wbthicken = WeaverbirdsMeshThicken(MeshCurves=mesh, Distance=width_8, OffsetType=0)
msh2psrf = MeshToPolysurface(Mesh=wbthicken, Triangles=False, FaceMerge=False)
offset_geo = Merge(Data1=offsrf_5, Data2=msh2psrf)

# ---- group: Fx | F O R M / fx | SCRIPT | PRIMARY GEOMETRY / fx | SCRIPT | CAP || OFFSET SRF / F || CAP GEO
cap = CapHoles(Brep=brep_2)

# ---- group: Fx | F O R M / fx | SCRIPT | PRIMARY GEOMETRY / fx | SCRIPT | CAP || OFFSET SRF
cap_offset = StreamFilter(Gate=value_listener_29.Values, Stream0=offset_geo, Stream1=cap)

# ---- group: Fx | F O R M / fx | SCRIPT | PRIMARY GEOMETRY (continued)
final_brep = StreamFilter(Gate=panel_78, Stream0=cap_offset, Stream1=cap_offset, Stream2=cap_offset, Stream3=cap_offset, Stream4=gate_3.Target4)  # -> flatten(Stream)
item_3 = ListItem(List=final_brep, Index=0, Wrap=True)

# ---- group: Fx | F O R M / fx | SCRIPT | ADDITIONAL GEOMETRY (continued)
brep_3 = StreamFilter(Gate=panel_30, Stream0=extr_4, Stream1=loft_2, Stream2=loft_3, Stream3=extr_4, Stream4=weave_41)  # disabled

# ---- group: Fx | F O R M / fx | SCRIPT | ADDITIONAL GEOMETRY / fx | SCRIPT | CAP || OFFSET SRF / F || OFFSET SRF
sortbytype_5 = SortObjectsByType(RhinoObjects=brep_3)  # -> Points, Curves, Surfaces, Breps, Meshes, TextObjects, HatchObjects, LightObjects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; disabled
mesh_2 = MeshBrep(
    Brep=sortbytype_5.Breps,
    Settings={GridMaxCount=0, GridMinCount=16, JaggedSeams=False, MaxEdgeLength=0, MinEdgeLength=0.0001, MinTolerance=0, Refine=True, RefineAngle=0, RelativeTolerance=0.65, SimplePlanes=True, Tolerance=0})  # disabled
neg_6 = Negative(Value=value_listener_14.Values)  # disabled
toggle_52 = BooleanToggle(False)  # disabled
width_9 = StreamFilter(Gate=panel_33, Stream0=value_listener_14.Values, Stream1=neg_6)  # disabled
offsrf_6 = OffsetSurface(Surface=sortbytype_5.Surfaces, Distance=width_9, BothSides=toggle_52, CreateSolid=True)  # disabled
wbthicken_2 = WeaverbirdsMeshThicken(MeshCurves=mesh_2, Distance=width_9, OffsetType=0)  # disabled
msh2psrf_2 = MeshToPolysurface(Mesh=wbthicken_2, Triangles=False, FaceMerge=False)  # disabled
offset_geo_2 = Merge(Data1=offsrf_6, Data2=msh2psrf_2)  # disabled

# ---- group: Fx | F O R M / fx | SCRIPT | ADDITIONAL GEOMETRY / fx | SCRIPT | CAP || OFFSET SRF / F || CAP GEO
cap_2 = CapHoles(Brep=brep_3)  # disabled

# ---- group: Fx | F O R M / fx | SCRIPT | ADDITIONAL GEOMETRY / fx | SCRIPT | CAP || OFFSET SRF
cap_offset_2 = StreamFilter(Gate=value_listener_16.Values, Stream0=offset_geo_2, Stream1=cap_2)  # disabled

# ---- group: Fx | F O R M / fx | SCRIPT | ADDITIONAL GEOMETRY (continued)
add_final_brep = StreamFilter(
    Gate=panel_30,
    Stream0=cap_offset_2,
    Stream1=cap_offset_2,
    Stream2=cap_offset_2,
    Stream3=cap_offset_2,
    Stream4=cap_offset_2,
    Stream5=gate_4.Target5)  # -> flatten(Stream); disabled

# ---- group: Fx | F O R M / fx | SCRIPT | BOOLEAN OPERATIONS / F || SOLID OPERATIONS / F || ADDITION ( UNION )
merge_7 = Merge(Data1=item_3, Data2=add_final_brep)  # -> flatten(Result)
sunion = SolidUnion(Breps=merge_7)
filter_16 = StreamFilter(Gate=value_listener_15.Values, Stream0=item_3, Stream1=sunion)
final = ListItem(List=filter_16, Index=0, Wrap=True)

# ---- group: Fx | F O R M / fx | SCRIPT | BOOLEAN OPERATIONS / F || MESH OPERATIONS / F || MESH ADDITION (UNION)
smesh = SimpleMesh(Brep=item_3)  # disabled
smesh_2 = SimpleMesh(Brep=add_final_brep)  # disabled
merge_8 = Merge(Data1=flatten(smesh), Data2=flatten(smesh_2))  # disabled
munion = MeshUnion(Meshes=merge_8)  # disabled

# ---- group: Fx | F O R M / fx | SCRIPT | SUBTRACTION GEOMETRY (continued)
brep_4 = StreamFilter(Gate=panel_55, Stream0=extr_5, Stream1=loft_4, Stream2=loft_5, Stream3=extr_5, Stream4=weave_42)  # disabled

# ---- group: Fx | F O R M / fx | SCRIPT | SUBTRACTION GEOMETRY / fx | SCRIPT | CAP || OFFSET SRF / F || OFFSET SRF
sortbytype_6 = SortObjectsByType(RhinoObjects=brep_4)  # -> Points, Curves, Surfaces, Breps, Meshes, TextObjects, HatchObjects, LightObjects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; disabled
mesh_3 = MeshBrep(
    Brep=sortbytype_6.Breps,
    Settings={GridMaxCount=0, GridMinCount=16, JaggedSeams=False, MaxEdgeLength=0, MinEdgeLength=0.0001, MinTolerance=0, Refine=True, RefineAngle=0, RelativeTolerance=0.65, SimplePlanes=True, Tolerance=0})  # disabled
neg_7 = Negative(Value=value_listener_19.Values)  # disabled
toggle_53 = BooleanToggle(False)  # disabled
width_10 = StreamFilter(Gate=panel_58, Stream0=value_listener_19.Values, Stream1=neg_7)  # disabled
offsrf_7 = OffsetSurface(Surface=sortbytype_6.Surfaces, Distance=width_10, BothSides=toggle_53, CreateSolid=True)  # disabled
wbthicken_3 = WeaverbirdsMeshThicken(MeshCurves=mesh_3, Distance=width_10, OffsetType=0)  # disabled
msh2psrf_3 = MeshToPolysurface(Mesh=wbthicken_3, Triangles=False, FaceMerge=False)  # disabled
offset_geo_3 = Merge(Data1=offsrf_7, Data2=msh2psrf_3)  # disabled

# ---- group: Fx | F O R M / fx | SCRIPT | SUBTRACTION GEOMETRY / fx | SCRIPT | CAP || OFFSET SRF / F || CAP GEO
cap_3 = CapHoles(Brep=brep_4)  # disabled

# ---- group: Fx | F O R M / fx | SCRIPT | SUBTRACTION GEOMETRY / fx | SCRIPT | CAP || OFFSET SRF
cap_offset_3 = StreamFilter(Gate=value_listener_21.Values, Stream0=offset_geo_3, Stream1=cap_3)  # disabled

# ---- group: Fx | F O R M / fx | SCRIPT | SUBTRACTION GEOMETRY (continued)
final_brep_2 = StreamFilter(
    Gate=panel_55,
    Stream0=cap_offset_3,
    Stream1=cap_offset_3,
    Stream2=cap_offset_3,
    Stream3=cap_offset_3,
    Stream4=cap_offset_3,
    Stream5=gate_5.Target5)  # -> flatten(Stream); disabled

# ---- group: Fx | F O R M / fx | SCRIPT | BOOLEAN OPERATIONS / F || MESH OPERATIONS / F || MESH SUBTRACTION ( DIFFERENCE )
smesh_3 = SimpleMesh(Brep=final_brep_2)  # disabled
mdif = MeshDifference(MeshesA=munion, MeshesB=smesh_3)  # disabled
filter_17 = StreamFilter(Gate=value_listener_20.Values, Stream0=munion, Stream1=mdif)  # disabled

# ---- group: Fx | F O R M / fx | SCRIPT | BOOLEAN OPERATIONS / F || SOLID OPERATIONS / F || SUBTRACTION ( DIFFERENCE )
sdiff = SolidDifference(BrepsA=final, BrepsB=final_brep_2)
filter_18 = StreamFilter(Gate=value_listener_20.Values, Stream0=final, Stream1=sdiff)

# ---- group: Fx | F O R M / fx | SCRIPT | BOOLEAN OPERATIONS / F || MESH OPERATIONS / F || Sub-D Brep
wbsplitquads = WeaverbirdsConstantQuadsSplitSubdivision(MeshCurves=filter_17, Level=value_listener_23.Values, SmoothNakedEdges=0)  # disabled
wbjoin = WeaverbirdsJoinMeshesAndWeld(Mesh=flatten(wbsplitquads), Weld=True)  # disabled
wbunify = WeaverbirdsUnifyFaceWindings(MeshCurves=wbjoin)  # disabled
wbloop = WeaverbirdsLoopSubdivision(MeshCurves=wbunify, Level=value_listener_22.Values, SmoothNakedEdges=1)  # disabled

# ---- group: Fx | F O R M / fx | SCRIPT | BOOLEAN OPERATIONS / cluster | SUB-D SWITCH
filter_19 = StreamFilter(Gate=value_listener_24.Values, Stream0=filter_18, Stream1=wbloop)

# ---- group: Fx | F O R M / fx | OUTPUT | S C A T T E R / O | NOAH | S C A T T E R
geometry_2 = Geometry(flatten(filter_19))  # disabled
bake_2 = Bake(bake=value_listener_43.Values, geometry=geometry_2, color=value_listener_41.Values)  # disabled
preview_2 = CustomPreview(Geometry=geometry_2, Material=value_listener_41.Values)  # disabled
objfromgroup_19 = GetObjectsInGroup()

# ---- group: fx | SCRIPT | SWITCHES / STACK | MAIN SWITCHES
toggle_54 = BooleanToggle(False)
toggle_55 = BooleanToggle(True)
toggle_56 = BooleanToggle(False)
toggle_57 = BooleanToggle(True)
solver_2 = StreamFilter(Gate=value_listener_25.Values, Stream0=toggle_54, Stream1=toggle_55)
typeindex_2 = StreamFilter(Gate=value_listener_24.Values, Stream0=toggle_56, Stream1=toggle_57)
frame_4 = EnableDisableObject(
    Objects=[objfromgroup, objfromgroup_19],
    Enabled=solver_2,
    AllObjects_Object=[boolean_toggle, select_geo, primary_geometry, primary_geometry, toggle_17, filter_4, toggle_14, toggle_15, toggle_16, preview_2, geometry_2, value_listener_43, bake_2, value_listener_41])

# ---- group: fx | SCRIPT | SWITCHES
frame_5 = EnableDisableObject(
    Objects=objfromgroup_4,
    Enabled=typeindex_2,
    AllObjects_Object=[wbjoin, wbunify, wbloop, smesh, wbsplitquads, munion, merge_8, smesh_2, filter_17, mdif, smesh_3])

# ---- group: Fx | F O R M / fx | OUTPUT | S C A T T E R
# ADDITIONAL CUSTOM G.H. SCRIPT
# EXTRA CODE: OUTPUT
output_geo = Geometry(flatten(geometry_2))

# ---- group: Fx | P A T T E R N / fx | SCRIPT | FINAL TRANSFORMATIONS
group_2 = Group(Objects=object_geo)

# ---- group: Fx | P A T T E R N / F || ROTATION ANGLE / F || ATTRACTOR | REMAP ANGLE
objfromgroup_20 = GetObjectsInGroup()
gate_6 = StreamGate(Stream=attractor_geo, Gate=panel_371)  # -> Target0, Target1, Target2; disabled

# ---- group: Fx | P A T T E R N / STACK | ATTRACTOR
toggle_58 = BooleanToggle(False)
toggle_59 = BooleanToggle(True)
toggle_60 = BooleanToggle(True)
typeindex_3 = StreamFilter(Gate=panel_371, Stream0=toggle_58, Stream1=toggle_59, Stream2=toggle_60)
attrctoir = EnableDisableObject(
    Objects=[objfromgroup_3, objfromgroup_20],
    Enabled=typeindex_3,
    AllObjects_Object=[crv_cp_2, remap_2, area_4, pshift_4, attractor_geo, bbox_2, cp_2, filter_22, gate_7, panel_371, crv_cp, remap, pshift_3, attractor_geo, cp, filter_20, gate_6, panel_371])

# ---- group: Fx | P A T T E R N / fx | SCRIPT | FINAL TRANSFORMATIONS / F || ROTATE
orient = Orient(Geometry=simplify(group_2), Source=simplify(filter_12), Target=clean_2)  # -> Geometry, Transform

# ---- group: Fx | P A T T E R N / F || SCALE FACTORS / F || ATTRACTOR | REMAP SCALE / F || Find Center
bbox_2 = BoundingBox(Content=orient.Geometry, Plane=PlaneXY(0, 0, 0))  # -> simplify(Box), Box_2; disabled
area_4 = Area(Geometry=bbox_2.Box)  # -> Area, Centroid; disabled

# ---- group: Fx | P A T T E R N / F || ROTATION ANGLE / F || ATTRACTOR | REMAP ANGLE (continued)
crv_cp = CurveClosestPoint(Point=area_4.Centroid, Curve=gate_6.Target2)  # -> Point, Parameter, Distance; disabled
cp = ClosestPoint(Point=area_4.Centroid, Cloud=gate_6.Target1)  # -> ClosestPoint, CPIndex, flatten(Distance); disabled
pshift_3 = ShiftPaths(Data=crv_cp.Distance, Offset=-1)  # disabled
filter_20 = StreamFilter(Gate=panel_371, Stream1=cp.Distance, Stream2=pshift_3)  # disabled
remap = Remap(data=filter_20, min=value_listener_35.Values, max=value_listener_34.Values)  # disabled

# ---- group: Fx | P A T T E R N
# P A T T E R N    F U N C T I O N
filter_21 = StreamFilter(Gate=panel_371, Stream0=value_listener_34.Values, Stream1=remap, Stream2=remap)

# ---- group: Fx | P A T T E R N / F || SCALE FACTORS / F || ATTRACTOR | REMAP SCALE / F || REMAP SCALE
gate_7 = StreamGate(Stream=attractor_geo, Gate=panel_371)  # -> Target0, Target1, Target2; disabled
crv_cp_2 = CurveClosestPoint(Point=area_4.Centroid, Curve=gate_7.Target2)  # -> Point, Parameter, Distance; disabled
cp_2 = ClosestPoint(Point=area_4.Centroid, Cloud=gate_7.Target1)  # -> ClosestPoint, CPIndex, flatten(Distance); disabled
pshift_4 = ShiftPaths(Data=crv_cp_2.Distance, Offset=-1)  # disabled
filter_22 = StreamFilter(Gate=panel_371, Stream1=cp_2.Distance, Stream2=pshift_4)  # disabled
remap_2 = Remap(data=filter_22, min=value_listener_39.Values, max=value_listener_38.Values)  # disabled

# ---- group: Fx | P A T T E R N / F || SCALE FACTORS
scale_factor = StreamFilter(Gate=panel_371, Stream0=randomize, Stream1=remap_2, Stream2=remap_2)

# ---- group: Fx | P A T T E R N / F || ROTATION ANGLE / F || RANDOMIOZED SNAP
subtraction_2 = Subtraction(A=value_listener_34.Values, B=value_listener_35.Values)
division_6 = Division(A=subtraction_2, B=value_listener_37.Values)

# ---- group: Fx | P A T T E R N / F || ROTATION ANGLE
dom_2 = ConstructDomain(DomainStart=value_listener_35.Values, DomainEnd=value_listener_34.Values)
lng_15 = ListLength(List=clean_2)
tstat_2 = TreeStatistics(Tree=lng_15)  # -> Paths, Length, Count
series_3 = Series(Start=value_listener_36.Values, Step=1, Count=tstat_2.Count)  # -> graft(Series)
random_2 = Random(Range=dom_2, Number=lng_15, Seed=series_3)

# ---- group: Fx | P A T T E R N / F || ROTATION ANGLE / F || RANDOMIOZED SNAP (continued)
range = Range(Domain=dom_2, Steps=division_6)
lng_16 = ListLength(List=range)
dom_3 = ConstructDomain(DomainStart=0, DomainEnd=expr("x-1", lng_16))
random_3 = Random(Range=dom_3, Number=lng_15, Seed=series_3)
int = Integer(random_3)
item_4 = ListItem(List=range, Index=int, Wrap=True)

# ---- group: Fx | P A T T E R N / F || ROTATION ANGLE (continued)
snap_random = Weave(Pattern=value_listener_175.Values, Stream0=random_2, Stream1=item_4, NullGaps=False)
randomize_2 = Weave(Pattern=value_listener_169.Values, Stream0=filter_21, Stream1=snap_random, NullGaps=False)

# ---- group: Fx | P A T T E R N / fx | SCRIPT | FINAL TRANSFORMATIONS / F || ROTATE (continued)
rotate = Rotate(Geometry=orient.Geometry, Angle=degrees(randomize_2), Plane=clean_2)  # -> simplify(Geometry), Transform

# ---- group: Fx | P A T T E R N / fx | SCRIPT | FINAL TRANSFORMATIONS (continued)
scale = Scale(Geometry=flatten(rotate.Geometry), Center=flatten(clean_2), Factor=flatten(scale_factor))  # -> Geometry, Transform

# ---- group: Fx | P A T T E R N / fx | OUTPUT | S C A T T E R / O | NOAH | S C A T T E R
geometry_3 = Geometry(flatten(scale.Geometry))  # disabled
bake_3 = Bake(bake=value_listener_45.Values, geometry=geometry_3, color=value_listener_46.Values)  # disabled
preview_3 = CustomPreview(Geometry=geometry_3, Material=value_listener_46.Values)  # disabled
objfromgroup_21 = GetObjectsInGroup()

# ---- group: Fx | P A T T E R N / STACK | MAIN SWITCHES
toggle_61 = BooleanToggle(False)
toggle_62 = BooleanToggle(True)
solver_3 = StreamFilter(Gate=value_listener_179.Values, Stream0=toggle_61, Stream1=toggle_62)
frame_6 = EnableDisableObject(
    Objects=[objfromgroup_2, objfromgroup_15, objfromgroup_16, objfromgroup_21],
    Enabled=solver_3,
    AllObjects_Object=[boolean_toggle_5, boolean_toggle_4, select_geo_4, object_geo, object_geo, boolean_toggle_15, boolean_toggle_14, select_geo_9, target_geo, boolean_toggle_17, boolean_toggle_16, select_geo_10, attractor_geo, preview_3, geometry_3, value_listener_45, bake_3, value_listener_46])

# ---- group: Fx | P A T T E R N / fx | OUTPUT | S C A T T E R
# EXTRA CODE: OUTPUT
output_geo_2 = Geometry(flatten(geometry_3))

# ---- group: TOOL TIPS | RAILING / cluster | SOLVER
# COLUMN 1 ELEMENT
panel_375 = Panel("""1 | SOLVER | FIREST [TURN ON] [SOLVER] to start this function.
and [TURN OFF] afterwards to avoid [CRASH].""")

# ---- group: TOOL TIPS | RAILING / cluster | INPUT
panel_376 = Panel("2 | INPUT | Select type of reference [RHINO] geometry [INPUT] for the function.")

# ---- group: TOOL TIPS | RAILING / cluster | TYPE
panel_377 = Panel("TYPE | Select [TYPE] of [RAILING].")

# ---- group: TOOL TIPS | RAILING / cluster | DIVISION
panel_378 = Panel("""DIVISION | Division system for [RAILING].
COUNT | Divide [INPUT] by a fixed [COUNT] of [SEGMENT]s.
LENGTH | Divide [INPUT] by a fixed [LENGTH] of a [SEGMENTS].""")

# ---- group: TOOL TIPS | STAIRS / cluster | SOLVER
# COLUMN 1 ELEMENT
panel_379 = Panel("""1 | SOLVER | FIREST [TURN ON] [SOLVER] to start this function.
and [TURN OFF] afterwards to avoid [CRASH].""")

# ---- group: TOOL TIPS | STAIRS / cluster | INPUT
panel_380 = Panel("2 | INPUT | Select type of reference [RHINO] geometry [INPUT] for the function.")

# ---- group: TOOL TIPS | STAIRS / cluster | RISE DIM
panel_381 = Panel("""RISE DIMENSION | Select [RISE DIMENSION] System of the Stair(s).
STEP HEIGHT | Create [STAIR] by defining individual [STEP HEIGHT].
TOTAL HEIGHT | Create [STAIR] by defining floor to ceiling [TOTAL HEIGHT].""")

# ---- group: TOOL TIPS | STAIRS / cluster | RUN DIM
panel_382 = Panel("""RUN DIMENSION | Select [RUN DIMENSION] System of the Stair(s).
STEP TREAD | Create [STAIR] by defining individual lengths of [STEP TREAD].
STEP COUNT | Create [STAIR] by defining the total number of [STEP COUNT].""")

# ---- group: TOOL TIPS | STAIRS / cluster | T. Geo
panel_383 = Panel("TREAD GEOMETRY | Select type of [TREAD GEOMETRY].")

# ---- group: TOOL TIPS | STAIRS / cluster | O. DIRECTION
panel_384 = Panel("OFFSET DIRECTION | Select [STAIR] [OFFSET DIRECTION] from base [SINGLE CRV].")

# ---- group: TOOL TIPS | STAIRS / cluster | F. DIR
panel_385 = Panel("FLIP DIRECTION | Flip Direction from [START] to [LANDING] along [INPUT].")

# ---- group: TOOL TIPS | STAIRS / cluster | STRINGER
panel_386 = Panel("""STRINGER GEOMETRY | Switch type of [STRINGER] geometry of [STAIR].
CLOSED | SOLID [STAIR]
OPEN | OPEN RISER [STAIR]""")

# ---- group: TOOL TIPS | STAIRS / cluster | RISE
panel_387 = Panel("""RISE GEOMETRY | Switch type of [RISER] geometry of [STAIR].
CLOSED | WITH [STAIR] RISER 
OPEN | NO [STAIR] RISER """)

# ---- group: TOOL TIPS | STAIRS / cluster | WIDTH
panel_388 = Panel("WIDTH | [WIDTH] of [STAIR].")

# ---- group: TOOL TIPS | STAIRS / cluster | STEP HEIGHT
panel_389 = Panel("STEP HEIGHT | [HEIGHT] of individual [STEP] of [STAIR].")

# ---- group: TOOL TIPS | STAIRS / cluster | TOTAL HEIGHT
panel_390 = Panel("TOTAL HEIGHT | Total [HEIGHT] of [STAIR].")

# ---- group: TOOL TIPS | STAIRS / cluster | R. THICKNESS
panel_391 = Panel("RISER THICKNESS | [THICKNESS] 0f [RISER].")

# ---- group: TOOL TIPS | WALL / cluster | SAVE
# COLUMN 2 ELEMENT
panel_392 = Panel("SAVE | [SAVE] the values of the [PARAMETERS] of the function to avoid resetting.")

# ---- group: TOOL TIPS | WALL / cluster | LOAD
panel_393 = Panel("LOAD | [LOAD] the value(s) of the [PARAMETERS] of the functions.")

# ---- group: TOOL TIPS | WALL / cluster | SEL GEO
panel_394 = Panel("3 | SEL GEO | [SELECT] reference [RHINO] geometry [INPUT] for the function.")

# ---- group: TOOL TIPS | WALL / cluster | BAKE GEO
panel_395 = Panel("BAKE GEO | [BAKE]/ [CREATE] function [OUTPUT] geometry into rhino selected layer.")

# ---- group: TOOL TIPS | WALL / cluster | COLOR PICKER
panel_396 = Panel("COLOR PICKER | Select [DISPLAY COLOR] of [OUTPUT] geometry.")

# ---- group: TOOL TIPS | WALL / cluster | COLOR PICKER 2
panel_397 = Panel("COLOR PICKER | Select [DISPLAY COLOR] of [GLASS] geometry.")

# ---- group: ui | T | A R C H I T E C T U R A L / ui | F | W A L L
# S T A I R   E X P A N D E R (human UI)
panel_398 = Panel("0")
panel_399 = Panel("1")
panel_400 = Panel("""+
0
-""")
panel_401 = Panel("""SINGLE CRV (OPEN)
DOUBLE CRV (OPEN)""")
total_height = Slider(10, range=0.01..50)
panel_402 = Panel("FLIP DIR. (-)")
panel_403 = Panel("STRINGER | CLOSED")
_17_create_slider_9 = CreateSlider(
    Slider=r_thickness,
    SnapValue=0.001,
    ShowBounds=False,
    ShowTicks=False,
    ShowTooltip=False,
    ShowValLabel=True,
    showLabel=True)
value_listener_180 = ValueListener(Elements=_17_create_slider_9, SomeProperty=True)  # -> Values, Indices

# ---- group: TOOL TIPS | STAIRS / cluster | R. THICKNESS (continued)
attach_tooltip_to_element_184 = AttachTooltipToElement(ElementsToAttachTo=_17_create_slider_9, TooltipContent=panel_391, ShowDelay=100, Duration=2000)

# ---- group: ui | T | A R C H I T E C T U R A L / ui | F | W A L L / ui | C1 | W A L L / STACK | RISE ITEMS
step_height = Slider(0.583, range=0.01..1)
_13_create_slider_6 = CreateSlider(
    Slider=step_height,
    SnapValue=0.001,
    ShowBounds=False,
    ShowTicks=False,
    ShowTooltip=False,
    ShowValLabel=True,
    showLabel=True)
_14_create_slider_2 = CreateSlider(
    Slider=total_height,
    SnapValue=0.001,
    ShowBounds=False,
    ShowTicks=False,
    ShowTooltip=False,
    ShowValLabel=True,
    showLabel=True)
value_listener_181 = ValueListener(Elements=_13_create_slider_6, SomeProperty=True)  # -> Values, Indices
value_listener_182 = ValueListener(Elements=_14_create_slider_2, SomeProperty=True)  # -> Values, Indices

# ---- group: TOOL TIPS | STAIRS / cluster | STEP HEIGHT (continued)
attach_tooltip_to_element_185 = AttachTooltipToElement(ElementsToAttachTo=_13_create_slider_6, TooltipContent=panel_389, ShowDelay=100, Duration=2000)

# ---- group: TOOL TIPS | STAIRS / cluster | TOTAL HEIGHT (continued)
attach_tooltip_to_element_186 = AttachTooltipToElement(ElementsToAttachTo=_14_create_slider_2, TooltipContent=panel_390, ShowDelay=100, Duration=2000)

# ---- group: ui | T | A R C H I T E C T U R A L / ui | F | W A L L / ui | C1 | W A L L / STACK | DEFAULT ITEMS
panel_404 = Panel("""COVER
NONE""")
panel_405 = Panel("COVER")
panel_406 = Panel("""STEP HEIGHT
TOTAL HEIGHT""")
panel_407 = Panel("""STEP TREAD
STEP COUNT""")
width_11 = Slider(4, range=0.01..10)
panel_408 = Panel("O. DIRECTION")
panel_409 = Panel("RUN DIM.")
panel_410 = Panel("INPUT")
panel_411 = Panel("RISE DIM.")
panel_412 = Panel("TREAD GEO")
panel_413 = Panel("STRINGER | OPEN")
panel_414 = Panel("FLIP DIR.(+)")
panel_415 = Panel("RISE | CLOSED")
panel_416 = Panel("RISE | OPEN")
# COLUMN 1 ELEMENT
panel_417 = Panel("Stair Creation")
panel_418 = Panel("   SOLVER ON")
panel_419 = Panel("   SOLVER OFF")
_2_create_pulldown_menu_17 = CreatePulldownMenu(Label=panel_410, ListItems=panel_401, SelectedIndex=0, showLabel=True)
_3_create_pulldown_menu_4 = CreatePulldownMenu(Label=panel_411, ListItems=panel_406, SelectedIndex=0, showLabel=True)
_4_create_pulldown_menu_5 = CreatePulldownMenu(Label=panel_409, ListItems=panel_407, SelectedIndex=0, showLabel=True)
_7_disaply_toogle = CreateToggle(Default=False, OnLabel=panel_414, OffLabel=panel_402)
_9_disaply_toogle = CreateToggle(Default=False, OnLabel=panel_415, OffLabel=panel_416)
_1_toggle_3 = CreateToggle(Default=False, OnLabel=panel_418, OffLabel=panel_419)
_10_create_slider_14 = CreateSlider(
    Slider=width_11,
    SnapValue=0.001,
    ShowBounds=False,
    ShowTicks=False,
    ShowTooltip=False,
    ShowValLabel=True,
    showLabel=True)
type_index_3 = ValueListener(Elements=_3_create_pulldown_menu_4, SomeProperty=True)  # -> Values, Indices
value_listener_183 = ValueListener(Elements=_4_create_pulldown_menu_5, SomeProperty=True)  # -> Values, Indices
value_listener_184 = ValueListener(Elements=_7_disaply_toogle, SomeProperty=True)  # -> Values, Indices
value_listener_185 = ValueListener(Elements=_9_disaply_toogle, SomeProperty=True)  # -> Values, Indices
value_listener_186 = ValueListener(Elements=_1_toggle_3, SomeProperty=True)  # -> Values, Indices
input_index_17 = ValueListener(Elements=_2_create_pulldown_menu_17, SomeProperty=True)  # -> Values, Indices
_0_create_label_17 = CreateLabel(LabelText=panel_417, LabelSize=12, Justification=0)
value_listener_187 = ValueListener(Elements=_10_create_slider_14, SomeProperty=True)  # -> Values, Indices
panel_420 = Panel(value_listener_183.Indices)
panel_421 = Panel(input_index_17.Indices)
panel_422 = Panel(type_index_3.Indices)

# ---- group: TOOL TIPS | STAIRS / cluster | SOLVER (continued)
attach_tooltip_to_element_187 = AttachTooltipToElement(ElementsToAttachTo=_1_toggle_3, TooltipContent=panel_379, ShowDelay=100, Duration=2000)

# ---- group: TOOL TIPS | STAIRS / cluster | INPUT (continued)
attach_tooltip_to_element_188 = AttachTooltipToElement(ElementsToAttachTo=_2_create_pulldown_menu_17, TooltipContent=panel_380, ShowDelay=100, Duration=3000)

# ---- group: TOOL TIPS | STAIRS / cluster | RISE DIM (continued)
attach_tooltip_to_element_189 = AttachTooltipToElement(ElementsToAttachTo=_3_create_pulldown_menu_4, TooltipContent=panel_381, ShowDelay=100, Duration=2000)

# ---- group: TOOL TIPS | STAIRS / cluster | RUN DIM (continued)
attach_tooltip_to_element_190 = AttachTooltipToElement(ElementsToAttachTo=_4_create_pulldown_menu_5, TooltipContent=panel_382, ShowDelay=100, Duration=4000)

# ---- group: TOOL TIPS | STAIRS / cluster | F. DIR (continued)
attach_tooltip_to_element_191 = AttachTooltipToElement(ElementsToAttachTo=_7_disaply_toogle, TooltipContent=panel_385, ShowDelay=100, Duration=2000)

# ---- group: TOOL TIPS | STAIRS / cluster | RISE (continued)
attach_tooltip_to_element_192 = AttachTooltipToElement(ElementsToAttachTo=_9_disaply_toogle, TooltipContent=panel_387, ShowDelay=100, Duration=4000)

# ---- group: TOOL TIPS | STAIRS / cluster | WIDTH (continued)
attach_tooltip_to_element_193 = AttachTooltipToElement(ElementsToAttachTo=_10_create_slider_14, TooltipContent=panel_388, ShowDelay=100, Duration=2000)

# ---- group: Fx | S T A I R / fx | SCRIPT | SORT INPUT CRVS / F || FLIP CRVS
gate_8 = StreamGate(Stream=geo, Gate=panel_421)  # -> Target0, Target1
partition_3 = PartitionList(List=gate_8.Target1, Size=2)
item_5 = ListItem(List=partition_3, Index=0, Wrap=True)
flip_8 = FlipCurve(Curve=partition_3, Guide=item_5)  # -> Curve, Flag
flip_9 = FlipCurve(Curve=gate_8.Target0)  # -> Curve, Flag
flip_10 = FlipCurve(Curve=flip_8.Curve)  # -> Curve, Flag
single = StreamFilter(Gate=value_listener_184.Values, Stream0=gate_8.Target0, Stream1=flip_9.Curve)
double = StreamFilter(Gate=value_listener_184.Values, Stream0=flip_8.Curve, Stream1=flip_10.Curve)
filter_23 = StreamFilter(Gate=panel_421, Stream0=single, Stream1=double)

# ---- group: ui | T | A R C H I T E C T U R A L / ui | F | R A I L I N G / ui | C1 | R A I L I N G / STACK | DEFAULT
panel_423 = Panel("""SINGLE CRV (OPEN)
DOUBLE CRV (OPEN)""")
panel_424 = Panel("""SOLID
STEEL
GLASS
GLASS2
CABLE""")
panel_425 = Panel("""COUNT
LENGTH""")
panel_426 = Panel("INPUT")
panel_427 = Panel("TYPE")
panel_428 = Panel("DIVISION")
panel_429 = Panel("Railing Creation")
panel_430 = Panel("   SOLVER ON")
panel_431 = Panel("   SOLVER OFF")
_2_create_pulldown_menu_18 = CreatePulldownMenu(Label=panel_426, ListItems=panel_423, showLabel=True)
_3_create_pulldown_menu_5 = CreatePulldownMenu(Label=panel_427, ListItems=panel_424, SelectedIndex=0, showLabel=True)
_4_create_pulldown_menu_6 = CreatePulldownMenu(Label=panel_428, ListItems=panel_425, SelectedIndex=0, showLabel=True)
_1_toggle_4 = CreateToggle(Default=False, OnLabel=panel_430, OffLabel=panel_431)
value_listener_188 = ValueListener(Elements=_1_toggle_4, SomeProperty=True)  # -> Values, Indices
type_index_4 = ValueListener(Elements=_2_create_pulldown_menu_18, SomeProperty=True)  # -> Values, Indices
value_listener_189 = ValueListener(Elements=_3_create_pulldown_menu_5, SomeProperty=True)  # -> Values, Indices
value_listener_190 = ValueListener(Elements=_4_create_pulldown_menu_6, SomeProperty=True)  # -> Values, Indices
_0_create_label_18 = CreateLabel(LabelText=panel_429, LabelSize=12, Justification=0)
panel_432 = Panel(value_listener_189.Indices)
panel_433 = Panel(value_listener_190.Indices)
panel_434 = Panel(type_index_4.Indices)

# ---- group: TOOL TIPS | RAILING / cluster | SOLVER (continued)
attach_tooltip_to_element_194 = AttachTooltipToElement(ElementsToAttachTo=_1_toggle_4, TooltipContent=panel_375, ShowDelay=100, Duration=2000)

# ---- group: TOOL TIPS | RAILING / cluster | INPUT (continued)
attach_tooltip_to_element_195 = AttachTooltipToElement(ElementsToAttachTo=_2_create_pulldown_menu_18, TooltipContent=panel_376, ShowDelay=100, Duration=3000)

# ---- group: TOOL TIPS | RAILING / cluster | TYPE (continued)
attach_tooltip_to_element_196 = AttachTooltipToElement(ElementsToAttachTo=_3_create_pulldown_menu_5, TooltipContent=panel_377, ShowDelay=100, Duration=2000)

# ---- group: TOOL TIPS | RAILING / cluster | DIVISION (continued)
attach_tooltip_to_element_197 = AttachTooltipToElement(ElementsToAttachTo=_4_create_pulldown_menu_6, TooltipContent=panel_378, ShowDelay=100, Duration=4000)

# ---- group: ui | T | A R C H I T E C T U R A L / ui | F | R A I L I N G / ui | C1 | R A I L I N G
# COLUMN 1 ELEMENT
# DROP DOWN MENUS
# SLIDERS
weave_46 = Weave(
    Pattern=panel_432,
    Stream0=str2img_4,
    Stream1=str2img_5,
    Stream2=str2img_6,
    Stream3=str2img_7,
    Stream4=str2img_8,
    NullGaps=False)

# ---- group: ui | T | A R C H I T E C T U R A L / ui | F | R A I L I N G / ui | C1 | R A I L I N G / STACK | DEFAULT (continued)
create_image_6 = CreateImage(ImageSource=weave_46, ImageWidth=expr(".95*x", expression_12), ImageHeight=expr(".95*x", expression_12))

# ---- group: Fx | R A I L I N G / F || VERTICAL ELEMENTS / fx | SCRIPT | Create Vertical
typeindex_4 = StreamFilter(
    Gate=panel_432,
    Stream0=value_listener_62.Values,
    Stream1=value_listener_62.Values,
    Stream2=value_listener_63.Values,
    Stream3=value_listener_62.Values,
    Stream4=value_listener_62.Values)

# ---- group: Fx | R A I L I N G / F || VERTICAL ELEMENTS / fx | SCRIPT | Create Vertical / F || Section Index
panel_435 = Panel("""8
9
6
7""")
panel_436 = Panel("""0
1
6
7""")
panel_437 = Panel("""0
1""")
typeindex_5 = StreamFilter(Gate=panel_432, Stream0=panel_437, Stream1=panel_437, Stream2=panel_437, Stream3=panel_435, Stream4=panel_436)

# ---- group: fx | SCRIPT | SWITCHES / STACK | MAIN SWITCHES
toggle_63 = BooleanToggle(False)
toggle_64 = BooleanToggle(True)
typeindex_6 = StreamFilter(Gate=value_listener_188.Values, Stream0=toggle_63, Stream1=toggle_64)
solver_4 = EnableDisableObject(
    Objects=[objfromgroup_7, objfromgroup_12],
    Enabled=typeindex_6,
    AllObjects_Object=[boolean_toggle_11, boolean_toggle_10, select_geo_7, geometry_7, panel_470, panel_275, panel_473, bake_7, type_4, panel_471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])

# ---- group: ui | T | A R C H I T E C T U R A L / ui | F | W A L L (continued)
_6_create_pulldown_menu_4 = CreatePulldownMenu(Label=panel_408, ListItems=panel_400, SelectedIndex=1, showLabel=True)
_8_disaply_toogle = CreateToggle(Default=True, OnLabel=panel_403, OffLabel=panel_413)
value_listener_191 = ValueListener(Elements=_6_create_pulldown_menu_4, SomeProperty=True)  # -> Values, Indices
value_listener_192 = ValueListener(Elements=_8_disaply_toogle, SomeProperty=True)  # -> Values, Indices
weave_47 = Weave(Pattern=value_listener_192.Values, Stream0=panel_398, Stream1=panel_399, NullGaps=False)
panel_438 = Panel(value_listener_191.Indices)

# ---- group: TOOL TIPS | STAIRS / cluster | O. DIRECTION (continued)
attach_tooltip_to_element_198 = AttachTooltipToElement(ElementsToAttachTo=_6_create_pulldown_menu_4, TooltipContent=panel_384, ShowDelay=100, Duration=2000)

# ---- group: TOOL TIPS | STAIRS / cluster | STRINGER (continued)
attach_tooltip_to_element_199 = AttachTooltipToElement(ElementsToAttachTo=_8_disaply_toogle, TooltipContent=panel_386, ShowDelay=100, Duration=4000)

# ---- group: ui | T | A R C H I T E C T U R A L / ui | F | W A L L / ui | C1 | W A L L / STACK | DEFAULT ITEMS (continued)
weave_48 = Weave(Pattern=value_listener_192.Values, Stream0=panel_405, Stream1=panel_404, NullGaps=False)
_5_create_pulldown_menu_4 = CreatePulldownMenu(Label=panel_412, ListItems=weave_48, SelectedIndex=weave_47, showLabel=True)
value_listener_193 = ValueListener(Elements=_5_create_pulldown_menu_4, SomeProperty=True)  # -> Values, Indices

# ---- group: TOOL TIPS | STAIRS / cluster | T. Geo (continued)
attach_tooltip_to_element_200 = AttachTooltipToElement(ElementsToAttachTo=_5_create_pulldown_menu_4, TooltipContent=panel_383, ShowDelay=100, Duration=2000)

# ---- group: ui | T | A R C H I T E C T U R A L / ui | F | W A L L (continued)
panel_439 = Panel(value_listener_193.Indices)

# ---- group: ui | T | A R C H I T E C T U R A L / ui | F | W A L L / ui | E | W A L L / STACK | COLUMANS
merge_9 = Merge(
    Data1=_0_create_label_17,
    Data2=_1_toggle_3,
    Data3=_2_create_pulldown_menu_17,
    Data4=_3_create_pulldown_menu_4,
    Data5=_4_create_pulldown_menu_5,
    Data6=_5_create_pulldown_menu_4,
    Data7=_6_create_pulldown_menu_4,
    Data8=_7_disaply_toogle,
    Data9=_8_disaply_toogle,
    Data10=_9_disaply_toogle,
    Data11=_10_create_slider_14,
    Data12=_11_create_slider_5,
    Data13=_12_create_slider_5,
    Data14=_13_create_slider_6,
    Data15=_14_create_slider_2,
    Data16=_15_create_slider,
    Data17=_16_create_slider,
    Data18=_17_create_slider,
    Data19=_17_create_slider_2,
    Data20=_17_create_slider_3,
    Data21=_17_create_slider_9)

# ---- group: ui | T | A R C H I T E C T U R A L / ui | F | W A L L / ui | E | W A L L / STACK | COLUMANS / cluster
column_1_elements_generator_5 = COLUMN1ELEMENTSGENERATOR_3(
    all_c1_elements=merge_9,
    inputindex=panel_421,
    riseindex=panel_422,
    runindex=panel_420,
    treadindex=panel_439,
    offsetindex=panel_438,
    stringergeoindex=value_listener_192.Values,
    risegeoindex=value_listener_185.Values)  # -> column_1_elements, number_of_elements_in_column_1

column_2_elements_generator_6 = COLUMN2ELEMENTSGENERATOR_4(
    c1length=column_1_elements_generator_5.number_of_elements_in_column_1,
    L=[create_button_35, create_button_36, create_button_25, create_button_26, create_color_picker_6, placeholder_5, create_button_37])

# ---- group: ui | T | A R C H I T E C T U R A L / ui | F | W A L L / ui | E | W A L L / STACK | MAIN EXPANDER / cluster
create_grid_9 = CreateGrid(column_1=column_1_elements_generator_5.column_1_elements, column_2=column_2_elements_generator_6, height_of_menu=width_2)  # -> elements, width_of_grid, height_2, row_def_2, columan_def, element_row, element_column, total_list_length

# ---- group: ui | T | A R C H I T E C T U R A L / ui | F | W A L L / ui | E | W A L L / STACK | MAIN EXPANDER
create_grid_10 = CreateGrid(
    UIElements=create_grid_9.elements,
    Width=create_grid_9.width_of_grid,
    Height=create_grid_9.height_2,
    RowDefinitions=create_grid_9.row_def_2,
    ColumnDefinitions=create_grid_9.columan_def,
    ElementRow=create_grid_9.element_row,
    ElementColumn=create_grid_9.element_column,
    ElementRowSpan=1,
    ElementColumnSpan=1)
all_expander_elements_5 = Entwine(Branch00=create_grid_10, FlattenInputs=True)  # -> flatten(Result)
stack_15 = CreateStack(UIElements=all_expander_elements_5, Horizontal=False)

# ---- group: ui | T | A R C H I T E C T U R A L / ui | F | W A L L / ui | E | W A L L
# EXPANDER MENU
# Columns
# Human UI Elements
savestates_6 = SaveElementStates(
    Elements=[column_1_elements_generator_5.column_1_elements, column_2_elements_generator_6],
    SaveState=value_listener_161.Values,
    StateName="test",
    ClearSavedStates=False,
    stateSetChunk_State0_stateName="test",
    stateSetChunk_State0_stateItem0_ElementIndex=0,
    stateSetChunk_State0_stateItem0_ElementValue="1",
    stateSetChunk_State0_stateItem0_ElementValueType="System.Double",
    stateSetChunk_State0_stateItem1_ElementIndex=0,
    stateSetChunk_State0_stateItem1_ElementValue="11",
    stateSetChunk_State0_stateItem1_ElementValueType="System.Double",
    stateSetChunk_State0_stateItem2_ElementIndex=0,
    stateSetChunk_State0_stateItem2_ElementValue="8.03",
    stateSetChunk_State0_stateItem2_ElementValueType="System.Double",
    stateSetChunk_State0_stateItem3_ElementIndex=0,
    stateSetChunk_State0_stateItem3_ElementValue="7.98",
    stateSetChunk_State0_stateItem3_ElementValueType="System.Double",
    stateSetChunk_State0_stateItem4_ElementIndex=0,
    stateSetChunk_State0_stateItem4_ElementValue="264",
    stateSetChunk_State0_stateItem4_ElementValueType="System.Double",
    stateSetChunk_State0_stateItem5_ElementIndex=0,
    stateSetChunk_State0_stateItem5_ElementValue="157",
    stateSetChunk_State0_stateItem5_ElementValueType="System.Double",
    stateSetChunk_State0_stateItem6_ElementIndex=0,
    stateSetChunk_State0_stateItem6_ElementValue="90",
    stateSetChunk_State0_stateItem6_ElementValueType="System.Double",
    stateSetChunk_State0_stateItem7_ElementIndex=0,
    stateSetChunk_State0_stateItem7_ElementValue="0",
    stateSetChunk_State0_stateItem7_ElementValueType="System.Double",
    stateSetChunk_State0_stateItem8_ElementIndex=0,
    stateSetChunk_State0_stateItem8_ElementValue="1.03",
    stateSetChunk_State0_stateItem8_ElementValueType="System.Double",
    stateSetChunk_State0_stateItem9_ElementIndex=0,
    stateSetChunk_State0_stateItem9_ElementValue="0.32",
    stateSetChunk_State0_stateItem9_ElementValueType="System.Double",
    stateSetChunk_State0_stateItem10_ElementIndex=0,
    stateSetChunk_State0_stateItem10_ElementValue="0",
    stateSetChunk_State0_stateItem10_ElementValueType="System.Double")  # -> SavedStates, SavedStateNames
restore_6 = RestoreElementStates(Restore=value_listener_162.Values, SavedStates=savestates_6.SavedStates, StateNameToRestore=savestates_6.SavedStateNames)

# ---- group: ui | T | A R C H I T E C T U R A L / ui | F | W A L L / ui | C2 | W A L L
# COLUMN 2 ELEMENT
# BUTTONS & COLOR
colour_8 = ColourPicker(PickedColour=RGB(71, 71, 71))
panel_440 = Panel("SEL GEO")
panel_441 = Panel("BAKE GEO")
create_button_44 = CreateButton(ButtonName=panel_440, ButtonStyle=0)
create_button_45 = CreateButton(ButtonName=panel_441, ButtonStyle=0)
colour_9 = ColourPicker(PickedColour=RGBA(161, 221, 240, 160))
create_color_picker_8 = CreateColorPicker(DefaultColor=colour_9)
value_listener_194 = ValueListener(Elements=create_button_44, SomeProperty=True)  # -> Values, Indices
value_listener_195 = ValueListener(Elements=create_button_45, SomeProperty=True)  # -> Values, Indices
value_listener_196 = ValueListener(Elements=create_color_picker_8, SomeProperty=True)  # -> Values, Indices
placeholder_7 = Placeholder()
panel_442 = Panel(value_listener_195.Values)

# ---- group: TOOL TIPS | WALL / cluster | SEL GEO (continued)
attach_tooltip_to_element_201 = AttachTooltipToElement(ElementsToAttachTo=create_button_44, TooltipContent=panel_394, ShowDelay=100, Duration=2000)

# ---- group: TOOL TIPS | WALL / cluster | BAKE GEO (continued)
attach_tooltip_to_element_202 = AttachTooltipToElement(ElementsToAttachTo=create_button_45, TooltipContent=panel_395, ShowDelay=100, Duration=2000)

# ---- group: TOOL TIPS | WALL / cluster | COLOR PICKER 2 (continued)
attach_tooltip_to_element_203 = AttachTooltipToElement(ElementsToAttachTo=create_color_picker_8, TooltipContent=panel_397, ShowDelay=100, Duration=2000)

# ---- group: ui | T | A R C H I T E C T U R A L / ui | F | W A L L / ui | C2 | W A L L / STACK | MAIN COLUMAN 2
colour_10 = ColourPicker(PickedColour=RGB(235, 217, 211))
panel_443 = Panel("SAVE")
panel_444 = Panel("LOAD")
type = Weave(Pattern=panel_163, Stream0=colour_8, Stream1=colour_10, Stream2=colour_8, Stream3=colour_9, NullGaps=False)
create_button_46 = CreateButton(ButtonName=panel_443, ButtonStyle=0)
create_button_47 = CreateButton(ButtonName=panel_444, ButtonStyle=0)
value_listener_197 = ValueListener(Elements=create_button_46, SomeProperty=True)  # -> Values, Indices
value_listener_198 = ValueListener(Elements=create_button_47, SomeProperty=True)  # -> Values, Indices

# ---- group: TOOL TIPS | WALL / cluster | SAVE (continued)
attach_tooltip_to_element_204 = AttachTooltipToElement(ElementsToAttachTo=create_button_46, TooltipContent=panel_392, ShowDelay=100, Duration=2000)

# ---- group: TOOL TIPS | WALL / cluster | LOAD (continued)
attach_tooltip_to_element_205 = AttachTooltipToElement(ElementsToAttachTo=create_button_47, TooltipContent=panel_393, ShowDelay=100, Duration=2000)

# ---- group: ui | T | A R C H I T E C T U R A L / ui | F | W A L L / ui | C2 | W A L L (continued)
create_color_picker_9 = CreateColorPicker(DefaultColor=type)
value_listener_199 = ValueListener(Elements=create_color_picker_9, SomeProperty=True)  # -> Values, Indices

# ---- group: TOOL TIPS | WALL / cluster | COLOR PICKER (continued)
attach_tooltip_to_element_206 = AttachTooltipToElement(ElementsToAttachTo=create_color_picker_9, TooltipContent=panel_396, ShowDelay=100, Duration=2000)

# ---- group: ui | T | A R C H I T E C T U R A L / ui | F | W A L L / ui | E | W A L L / STACK | COLUMANS
basic_elements_2 = Merge(
    Data1=_0_create_label_8,
    Data2=toggle_28,
    Data3=_2_create_pulldown_menu_13,
    Data4=_3_create_pulldown_menu,
    Data5=_4_create_pulldown_menu,
    Data6=_5_create_pulldown_menu,
    Data7=_6_create_pulldown_menu,
    Data8=_7_create_slider_2,
    Data9=_8_create_slider_5,
    Data10=_9_create_slider_2,
    Data11=_10_create_slider_12,
    Data12=placeholder_7)

# ---- group: ui | T | A R C H I T E C T U R A L / ui | F | W A L L / ui | E | W A L L / STACK | COLUMANS / cluster
column_1_elements_generator_6 = COLUMN1ELEMENTSGENERATOR_2(
    all_c1_elements=basic_elements_2,
    objinput=panel_164,
    rotationindex=panel_163,
    scatterindex=panel_161,
    snapindex=panel_162)  # -> column_1_elements, number_of_elements_in_column_1

column_2_elements_generator_7 = COLUMN2ELEMENTSGENERATOR_3(
    typeindex=panel_163,
    inputindex=panel_164,
    heightindex=panel_161,
    frameindex=panel_162,
    c1length=column_1_elements_generator_6.number_of_elements_in_column_1,
    L=[placeholder_7, create_button_46, create_button_47, create_button_44, create_button_45, create_color_picker_9, create_color_picker_8, create_button_41])

# ----
elements_5 = Merge(
    Data1=column_1_elements_generator_6.column_1_elements,
    Data2=column_2_elements_generator_7,
    Data3=elements_4,
    Data4=elements_2,
    Data5=merge_2)  # -> flatten(Result)

# ---- group: ui | T | A R C H I T E C T U R A L / ui | F | W A L L / ui | E | W A L L / STACK | MAIN EXPANDER / cluster
create_grid_11 = CreateGrid(column_1=column_1_elements_generator_6.column_1_elements, column_2=column_2_elements_generator_7, height_of_menu=width_2)  # -> elements, width_of_grid, height_2, row_def_2, columan_def, element_row, element_column, total_list_length

# ---- group: ui | T | A R C H I T E C T U R A L / ui | F | W A L L / ui | E | W A L L
# EXPANDER MENU
# Columns
# Human UI Elements
savestates_7 = SaveElementStates(
    Elements=elements_5,
    SaveState=value_listener_197.Values,
    StateName="test",
    ClearSavedStates=False,
    stateSetChunk_State0_stateName="test",
    stateSetChunk_State0_stateItem0_ElementIndex=0,
    stateSetChunk_State0_stateItem0_ElementValue="1",
    stateSetChunk_State0_stateItem0_ElementValueType="System.Double",
    stateSetChunk_State0_stateItem1_ElementIndex=0,
    stateSetChunk_State0_stateItem1_ElementValue="1",
    stateSetChunk_State0_stateItem1_ElementValueType="System.Double",
    stateSetChunk_State0_stateItem2_ElementIndex=0,
    stateSetChunk_State0_stateItem2_ElementValue="0.5",
    stateSetChunk_State0_stateItem2_ElementValueType="System.Double",
    stateSetChunk_State0_stateItem3_ElementIndex=0,
    stateSetChunk_State0_stateItem3_ElementValue="16",
    stateSetChunk_State0_stateItem3_ElementValueType="System.Double",
    stateSetChunk_State0_stateItem4_ElementIndex=0,
    stateSetChunk_State0_stateItem4_ElementValue="4",
    stateSetChunk_State0_stateItem4_ElementValueType="System.Double",
    stateSetChunk_State0_stateItem5_ElementIndex=0,
    stateSetChunk_State0_stateItem5_ElementValue="0",
    stateSetChunk_State0_stateItem5_ElementValueType="System.Double",
    stateSetChunk_State0_stateItem6_ElementIndex=0,
    stateSetChunk_State0_stateItem6_ElementValue="50",
    stateSetChunk_State0_stateItem6_ElementValueType="System.Double",
    stateSetChunk_State0_stateItem7_ElementIndex=0,
    stateSetChunk_State0_stateItem7_ElementValue="0.67",
    stateSetChunk_State0_stateItem7_ElementValueType="System.Double",
    stateSetChunk_State0_stateItem8_ElementIndex=0,
    stateSetChunk_State0_stateItem8_ElementValue="0.3",
    stateSetChunk_State0_stateItem8_ElementValueType="System.Double",
    stateSetChunk_State0_stateItem9_ElementIndex=0,
    stateSetChunk_State0_stateItem9_ElementValue="0.18"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)  # -> SavedStates, SavedStateNames
restore_7 = RestoreElementStates(Restore=value_listener_198.Values, SavedStates=savestates_7.SavedStates, StateNameToRestore=savestates_7.SavedStateNames)

# ---- group: ui | T | A R C H I T E C T U R A L / ui | F | W A L L / ui | E | W A L L / STACK | MAIN EXPANDER
create_grid_12 = CreateGrid(
    UIElements=create_grid_11.elements,
    Width=create_grid_11.width_of_grid,
    Height=create_grid_11.height_2,
    RowDefinitions=create_grid_11.row_def_2,
    ColumnDefinitions=create_grid_11.columan_def,
    ElementRow=create_grid_11.element_row,
    ElementColumn=create_grid_11.element_column,
    ElementRowSpan=1,
    ElementColumnSpan=1)
all_expander_elements_6 = Entwine(Branch00=create_grid_12, Branch01=sub_expanders, FlattenInputs=True)  # -> flatten(Result)
stack_16 = CreateStack(UIElements=all_expander_elements_6, Horizontal=False)

# ---- group: Fx | WA L L / fx | INPUT | W A L L
boolean_toggle_18 = BooleanToggle(True)  # disabled
boolean_toggle_19 = BooleanToggle(True)  # disabled
select_geo_11 = SelectGeo(
    run=value_listener_194.Values,
    allowMultiple=boolean_toggle_18,
    allowNone=boolean_toggle_19,
    msg="Pick object(s)",
    clear=value_listener_168.Values)  # -> pickedGeometry; inputs run: Boolean, allowMultiple: Boolean, allowNone: Boolean, msg: String, clear: Boolean; disabled; same code as select_geo_7
sort_flip_geo = SortFlipGeo(input_geometry=select_geo_11, input_index=panel_164)  # disabled
# W A L L   F U N C T I O N
objfromgroup_22 = GetObjectsInGroup()
input_geo_main_2 = StreamGate(Stream=sort_flip_geo, Gate=panel_164)  # -> Target0, Target1, Target2, Target3, Target4; disabled
srf_4 = Surface(input_geo_main_2.Target2)  # disabled

# ---- group: fx | SCRIPT | COLOR INDICATOR / F || COLOR INDICATOR (SEL GEO)
lng_17 = ListLength(List=flatten(select_geo_11))
expression_35 = Expression(x=lng_17, Expression="if (x = 0,0,1)")
expression_36 = Expression(x=lng_17, Expression="if (x = 0,0,1)")
swatch_78 = ColourSwatch(SwatchColor=RGB(255, 255, 255))
swatch_79 = ColourSwatch(SwatchColor=RGB(0, 0, 0))
swatch_80 = ColourSwatch(SwatchColor=RGBA(255, 255, 255, 0))
swatch_81 = ColourSwatch(SwatchColor=RGB(222, 199, 27))
weave_49 = Weave(Pattern=expression_35, Stream0=swatch_78, Stream1=swatch_79, NullGaps=False)
weave_50 = Weave(Pattern=expression_36, Stream0=swatch_80, Stream1=swatch_81, NullGaps=False)
adjustelem_19 = AdjustElementAppearance(ElementsToAdjust=create_button_44, Foreground=weave_49, Background=weave_50)

# ---- group: fx | SCRIPT | COLOR INDICATOR / F || COLOR INDICATOR (CLEAR GEO)
expression_37 = Expression(x=lng_17, Expression="if (x = 0,0,1)")
expression_38 = Expression(x=lng_17, Expression="if (x = 0,0,1)")
swatch_82 = ColourSwatch(SwatchColor=RGB(255, 255, 255))
swatch_83 = ColourSwatch(SwatchColor=RGB(0, 0, 0))
swatch_84 = ColourSwatch(SwatchColor=RGBA(255, 255, 255, 0))
swatch_85 = ColourSwatch(SwatchColor=RGB(222, 199, 27))
weave_51 = Weave(Pattern=expression_37, Stream0=swatch_83, Stream1=swatch_82, NullGaps=False)
weave_52 = Weave(Pattern=expression_38, Stream0=swatch_85, Stream1=swatch_84, NullGaps=False)
adjustelem_20 = AdjustElementAppearance(ElementsToAdjust=create_button_41, Foreground=weave_51, Background=weave_52)

# ---- group: Fx | WA L L / fx | SCRIPT | GLASS / F || GLASS | SORT INPUT / F || SINGLE CRV
graft_10 = GraftTree(Tree=input_geo_main_2.Target0, IncludeEmptyLists=True, IncludeNullItems=True)  # disabled
Z_10 = UnitZ(Factor=value_listener_78.Values)  # disabled
move_2 = Move(Geometry=graft_10, Motion=Z_10)  # -> Geometry, Transform; disabled
crv_3 = Merge(Data1=graft_10, Data2=move_2.Geometry)  # disabled
pshift_5 = ShiftPaths(Data=crv_3, Offset=-1)  # disabled

# ---- group: Fx | WA L L / fx | SCRIPT | GLASS / F || GLASS | SORT INPUT / F || DOUBLE CRV
dispatch_11 = Dispatch(List=input_geo_main_2.Target1, DispatchPattern=[True, False])  # -> ListA, ListB; disabled
curvepoint_3 = PointOnCurve(dispatch_11.ListA, parameter=0.5)  # disabled
curvepoint_4 = PointOnCurve(dispatch_11.ListB, parameter=0.5)  # disabled
pdecon_3 = Deconstruct(Point=curvepoint_3)  # -> XComponent, YComponent, ZComponent; disabled
pdecon_4 = Deconstruct(Point=curvepoint_4)  # -> XComponent, YComponent, ZComponent; disabled
unit_z_2 = Merge(Data1=graft(pdecon_3.ZComponent), Data2=graft(pdecon_4.ZComponent))  # disabled
crvs_2 = Merge(Data1=graft(dispatch_11.ListA), Data2=graft(dispatch_11.ListB))  # disabled
sort_2 = SortList(Keys=unit_z_2, ValuesA=crvs_2)  # -> Keys, ValuesA; disabled
pshift_6 = ShiftPaths(Data=sort_2.ValuesA, Offset=-1)  # disabled

# ---- group: Fx | WA L L / fx | INPUT | CURTAIN WALL / Loft Double Crvs
dispatch_12 = Dispatch(List=input_geo_main_2.Target1, DispatchPattern=[True, False])  # -> graft(ListA), graft(ListB); disabled
merge_10 = Merge(Data1=dispatch_12.ListA, Data2=dispatch_12.ListB)  # disabled
double_2 = Loft(Curves=merge_10, Options={Adjust=False, Closed=False, LoftEnds=0, LoftSimp=0, LoftType=0, Rebuild=10, Refit=0.01})  # disabled

# ---- group: Fx | WA L L / fx | SCRIPT | GLASS / F || GLASS | SORT INPUT
input_crv = StreamFilter(Gate=panel_164, Stream0=pshift_5, Stream1=pshift_6)  # -> flatten(Stream); disabled

# ---- group: Fx | WA L L / fx | SCRIPT | GLASS / fx | SCRIPT | Sort Top and Bottom Crv (Exterior)
dispatch_13 = Dispatch(List=input_crv, DispatchPattern=[True, False])  # -> graft(ListA), graft(ListB); disabled

# ---- group: Fx | WA L L / F || Random Heights
lng_18 = ListLength(List=flatten([input_geo_main_2.Target0, input_geo_main_2.Target3]))
dom_4 = ConstructDomain(DomainStart=value_listener_78.Values, DomainEnd=value_listener_79.Values)
random_4 = Random(Range=dom_4, Number=flatten(lng_18), Seed=value_listener_80.Values)  # -> graft(Random)
heights = Weave(Pattern=panel_161, Stream0=value_listener_78.Values, Stream1=random_4, NullGaps=False)

# ---- group: Fx | WA L L / fx | INPUT | CURTAIN WALL / Extrude Single Crv
Z_11 = UnitZ(Factor=heights)  # disabled
single_2 = Extrude(Base=graft(input_geo_main_2.Target0), Direction=Z_11)  # disabled

# ---- group: Fx | WA L L / fx | INPUT | CURTAIN WALL
geo_input_srf_for_curtain = StreamFilter(Gate=panel_164, Stream0=single_2, Stream1=double_2, Stream2=srf_4)  # disabled
flip_11 = Flip(Surface=geo_input_srf_for_curtain)  # -> Surface, Result; disabled
objfromgroup_23 = GetObjectsInGroup()
weave_53 = Weave(Pattern=value_listener_112.Values, Stream0=geo_input_srf_for_curtain, Stream1=flip_11.Surface, NullGaps=False)  # -> simplify(Weave); disabled
debrep_3 = DeconstructBrep(Brep=weave_53)  # -> simplify(Faces), Edges, Vertices; disabled
panel_445 = Panel(debrep_3.Faces)  # disabled

# ---- group: Fx | WA L L / fx | SCRIPT | GLASS / F || OFFSET AND SORT CRVS
merge_11 = Merge(Data1=dispatch_13.ListA, Data2=dispatch_13.ListB)  # disabled
offcrv = OffsetCurve(Curve=merge_11, Plane=PlaneXY(0, 0, 0), Distance=width_5, BothSides=True, Kinks=0, CapType=0)  # disabled
dispatch_14 = Dispatch(List=offcrv, DispatchPattern=[True, False])  # -> ListA, ListB; disabled

# ---- group: Fx | WA L L / fx | SCRIPT | GLASS / F || DIVIDE CRV
pshift_7 = ShiftPaths(Data=dispatch_14.ListA, Offset=-1)  # disabled
pshift_8 = ShiftPaths(Data=dispatch_14.ListB, Offset=-1)  # disabled
dispatch_15 = Dispatch(List=pshift_7, DispatchPattern=[True, False])  # -> ListA, ListB; disabled
dispatch_16 = Dispatch(List=pshift_8, DispatchPattern=[True, False])  # -> ListA, ListB; disabled
dividecrv = DivideCrv_2(crvinput=dispatch_15.ListA, divindex=panel_177, scount=value_listener_85.Values, slength=value_listener_86.Values)  # -> points, perframe, polyline, tanvec_t, value_t; disabled
crv_cp_3 = CurveClosestPoint(Point=dividecrv.points, Curve=dispatch_15.ListB)  # -> Point, Parameter, Distance; disabled
crv_cp_4 = CurveClosestPoint(Point=dividecrv.points, Curve=dispatch_16.ListA)  # -> Point, Parameter, Distance; disabled
crv_cp_5 = CurveClosestPoint(Point=crv_cp_4.Point, Curve=dispatch_16.ListB)  # -> Point, Parameter, Distance; disabled
ln = Line(StartPoint=dividecrv.points, EndPoint=crv_cp_3.Point)  # disabled
ln_2 = Line(StartPoint=crv_cp_4.Point, EndPoint=crv_cp_5.Point)  # disabled

# ---- group: Fx | WA L L / fx | SCRIPT | T Y P E: S O L I D / F || WALL FROM DOUBLE CRV(s) / Base Geo For Extrusion
dispatch_17 = Dispatch(List=input_geo_main_2.Target1, DispatchPattern=[True, False])  # -> ListA, ListB
top_crv = OffsetCurve(Curve=dispatch_17.ListA, Plane=PlaneXY(0, 0, 0), Distance=width_6, BothSides=width_7, Kinks=0, CapType=1)
bottom_crv = OffsetCurve(Curve=dispatch_17.ListB, Plane=PlaneXY(0, 0, 0), Distance=width_6, BothSides=width_7, Kinks=0, CapType=1)
open_crvs = Merge(Data1=top_crv, Data2=bottom_crv)

# ---- group: Fx | WA L L / fx | SCRIPT | T Y P E: B R I C K / F || Loft Surface
dispatch_18 = Dispatch(List=input_geo_main_2.Target1, DispatchPattern=[True, False])  # -> graft(ListA), graft(ListB); disabled
merge_12 = Merge(Data1=dispatch_18.ListA, Data2=dispatch_18.ListB)  # disabled
double_3 = Loft(Curves=merge_12, Options={Adjust=False, Closed=False, LoftEnds=0, LoftSimp=0, LoftType=0, Rebuild=10, Refit=0.01})  # disabled

# ---- group: Fx | WA L L / fx | SCRIPT | T Y P E: B R I C K / F || Extrude Srf
Z_12 = UnitZ(Factor=heights)  # disabled
single_3 = Extrude(Base=graft(input_geo_main_2.Target0), Direction=Z_12)  # disabled

# ---- group: Fx | WA L L / fx | SCRIPT | T Y P E: S O L I D / F || WALL FROM SINGLE CRV(s) / Base Geo For Extrusion
offset_single_crv_open = OffsetCurve(Curve=input_geo_main_2.Target0, Plane=PlaneXY(0, 0, 0), Distance=width_6, BothSides=width_7, Kinks=0, CapType=1)

# ---- group: Fx | WA L L / fx | SCRIPT | T Y P E: S O L I D / F || Offset Surface
xy_4 = XYPlane(Origin=Point(0, 0, 0))
flip_12 = Flip(Surface=srf_4, Guide=xy_4)  # -> Surface, Result
offsrf_8 = OffsetSurface(Surface=flip_12.Surface, Distance=width_6, BothSides=width_7, CreateSolid=True)

# ---- group: Fx | WA L L / fx | SCRIPT | GLASS / F || LOFT
merge_13 = Merge(Data1=graft(dispatch_15.ListA), Data2=graft(dispatch_15.ListB))  # disabled
merge_14 = Merge(Data1=graft(dispatch_16.ListA), Data2=graft(dispatch_16.ListB))  # disabled
merge_15 = Merge(Data1=graft(ln), Data2=graft(ln_2))  # disabled
closed_6 = BooleanToggle(False)  # disabled
adj_6 = BooleanToggle(False)  # disabled
list = ValueList({"Normal": 0, "Loose": 1, "Tight": 2, "Straight": 3, "Unifrom": 4}, selected="Straight")  # disabled
loft_opt = LoftOptions(Closed=False, Adjust=False, Rebuild=closed_6, Refit=adj_6, Type=list)  # disabled
loft_6 = Loft(Curves=merge_13, Options=loft_opt)  # disabled
loft_7 = Loft(Curves=merge_14, Options=loft_opt)  # disabled
loft_8 = Loft(Curves=merge_15, Options=loft_opt)  # disabled
pshift_9 = ShiftPaths(Data=loft_8, Offset=-1)  # disabled
merge_16 = Merge(Data1=simplify(loft_6), Data2=simplify(loft_7), Data3=simplify(pshift_9))  # disabled

# ---- group: Fx | WA L L / fx | SCRIPT | T Y P E: B R I C K
base_geo_input = StreamFilter(Gate=panel_164, Stream0=single_3, Stream1=double_3, Stream2=srf_4)  # -> flatten(Stream); disabled
brick_wall = BrickWall(
    surface_input=base_geo_input,
    count=value_listener_104.Values,
    brick_length=value_listener_105.Values,
    brick_width=value_listener_106.Values,
    brick_height=value_listener_107.Values)  # disabled
objfromgroup_24 = GetObjectsInGroup()

# ---- group: Fx | WA L L / fx | SCRIPT | T Y P E: S O L I D / F || WALL FROM SINGLE CRV(s)
solid_wall_i = SolidWallI(base_crv=[input_geo_main_2.Target3, offset_single_crv_open], height=heights)

# ---- group: Fx | WA L L / fx | SCRIPT | T Y P E: S O L I D / F || WALL FROM DOUBLE CRV(s)
solid_wall_ii = SolidWallII(L=[open_crvs, input_geo_main_2.Target4])

# ---- group: Fx | WA L L / fx | SCRIPT | T Y P E: S O L I D / O | GEO | SOLID
final_geo_solid = StreamFilter(
    Gate=panel_164,
    Stream0=solid_wall_i,
    Stream1=solid_wall_ii,
    Stream2=offsrf_8,
    Stream3=solid_wall_i,
    Stream4=solid_wall_ii)

# ---- group: Fx | WA L L / fx | SCRIPT | GLASS
offsrf_9 = OffsetSurface(Surface=merge_16, Distance=expr("x/2", value_listener_87.Values), BothSides=True, CreateSolid=True)  # disabled
objfromgroup_25 = GetObjectsInGroup()

# ---- group: fx | SCRIPT | SWITCHES / STACK | MAIN SWITCHES
toggle_65 = BooleanToggle(False)
toggle_66 = BooleanToggle(True)
typeindex_7 = StreamFilter(Gate=value_listener_84.Values, Stream0=toggle_65, Stream1=toggle_66)
solver_5 = EnableDisableObject(
    Objects=[objfromgroup_22, objfromgroup_23, objfromgroup_11],
    Enabled=typeindex_7,
    AllObjects_Object=[boolean_toggle_19, boolean_toggle_18, select_geo_11, input_geo_main_2, input_geo_main_2, input_geo_main_2, input_geo_main_2, input_geo_main_2, input_geo_main_2, sort_flip_geo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])

# ---- group: ui | T | A R C H I T E C T U R A L / ui | F | R A I L I N G / ui | E | R A I L I N G
# EXPANDER MENU
# Columns
# Human UI Elements
ph = Merge(Data1=placeholder_3, Data2=placeholder_3)
div_index = StreamFilter(
    Gate=panel_432,
    Stream1=_4_create_pulldown_menu_6,
    Stream2=_4_create_pulldown_menu_6,
    Stream3=_4_create_pulldown_menu_6,
    Stream4=_4_create_pulldown_menu_6)
color_2 = StreamFilter(Gate=panel_432, Stream2=create_color_picker_4, Stream3=create_color_picker_4)

# ----
placeholders = StreamFilter(Gate=panel_432, Stream0=ph, Stream1=placeholder_3, Stream2=ph, Stream3=ph, Stream4=placeholder_3)

# ---- group: ui | T | A R C H I T E C T U R A L / ui | F | R A I L I N G / ui | E | R A I L I N G / STACK | COLUMANS
basic_elements_3 = Merge(
    Data1=_0_create_label_18,
    Data2=_1_toggle_4,
    Data3=_2_create_pulldown_menu_18,
    Data4=_3_create_pulldown_menu_5,
    Data5=div_index,
    Data6=placeholders)
basic_elements_4 = Merge(
    Data1=create_button_29,
    Data2=create_button_30,
    Data3=create_button_21,
    Data4=create_button_31,
    Data5=create_button_22,
    Data6=create_color_picker_3,
    Data7=color_2)

# ---- group: ui | T | A R C H I T E C T U R A L / ui | F | R A I L I N G / ui | E | R A I L I N G / STACK | MAIN EXPANDER / cluster
create_grid_13 = CreateGrid(column_1=basic_elements_3, column_2=basic_elements_4, height_of_menu=width_2)  # -> elements, width_of_grid, height_2, row_def_2, columan_def, element_row, element_column, total_list_length

# ---- group: ui | T | A R C H I T E C T U R A L / ui | F | R A I L I N G / ui | E | R A I L I N G / STACK | MAIN EXPANDER
railing_elements = RailingELEMENTS(inputindex=panel_434, typeindex=panel_432, divindex=panel_433, L=relay)
create_grid_14 = CreateGrid(
    UIElements=create_grid_13.elements,
    Width=create_grid_13.width_of_grid,
    Height=create_grid_13.height_2,
    RowDefinitions=create_grid_13.row_def_2,
    ColumnDefinitions=create_grid_13.columan_def,
    ElementRow=create_grid_13.element_row,
    ElementColumn=create_grid_13.element_column,
    ElementRowSpan=1,
    ElementColumnSpan=1)
stack_17 = CreateStack(UIElements=railing_elements, Horizontal=False)
all_expander_elements_7 = Entwine(Branch00=create_grid_14, Branch01=create_image_6, Branch02=stack_17, FlattenInputs=True)  # -> flatten(Result)
stack_18 = CreateStack(UIElements=all_expander_elements_7, Horizontal=False)

# ---- group: ui | T | A R C H I T E C T U R A L / ui | F | R A I L I N G / ui | E | R A I L I N G (continued)
savestates_8 = SaveElementStates(
    Elements=[basic_elements_3, basic_elements_4],
    SaveState=value_listener_156.Values,
    StateName="test",
    ClearSavedStates=False,
    stateSetChunk_State0_stateName="test",
    stateSetChunk_State0_stateItem0_ElementIndex=0,
    stateSetChunk_State0_stateItem0_ElementValue="3",
    stateSetChunk_State0_stateItem0_ElementValueType="System.Double",
    stateSetChunk_State0_stateItem1_ElementIndex=0,
    stateSetChunk_State0_stateItem1_ElementValue="3",
    stateSetChunk_State0_stateItem1_ElementValueType="System.Double",
    stateSetChunk_State0_stateItem2_ElementIndex=0,
    stateSetChunk_State0_stateItem2_ElementValue="3",
    stateSetChunk_State0_stateItem2_ElementValueType="System.Double",
    stateSetChunk_State0_stateItem3_ElementIndex=0,
    stateSetChunk_State0_stateItem3_ElementValue="0.5",
    stateSetChunk_State0_stateItem3_ElementValueType="System.Double",
    stateSetChunk_State0_stateItem4_ElementIndex=0,
    stateSetChunk_State0_stateItem4_ElementValue="4",
    stateSetChunk_State0_stateItem4_ElementValueType="System.Double",
    stateSetChunk_State0_stateItem5_ElementIndex=0,
    stateSetChunk_State0_stateItem5_ElementValue="0.29",
    stateSetChunk_State0_stateItem5_ElementValueType="System.Double",
    stateSetChunk_State0_stateItem6_ElementIndex=0,
    stateSetChunk_State0_stateItem6_ElementValue="0.5",
    stateSetChunk_State0_stateItem6_ElementValueType="System.Double",
    stateSetChunk_State0_stateItem7_ElementIndex=0,
    stateSetChunk_State0_stateItem7_ElementValue="0.055",
    stateSetChunk_State0_stateItem7_ElementValueType="System.Double",
    stateSetChunk_State0_stateItem8_ElementIndex=0,
    stateSetChunk_State0_stateItem8_ElementValue="0.04",
    stateSetChunk_State0_stateItem8_ElementValueType="System.Double",
    stateSetChunk_State0_stateItem9_ElementIndex=0,
    stateSetChunk_State0_stateItem9_ElementValue="0.05"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)  # -> SavedStates, SavedStateNames
restore_8 = RestoreElementStates(Restore=value_listener_157.Values, SavedStates=savestates_8.SavedStates, StateNameToRestore=savestates_8.SavedStateNames)

# ---- group: UI | MAIN WINDOW
# UI | MAIN MENU
number_slider_5 = Slider(20, range=1..100)
boolean_toggle_20 = BooleanToggle(True)
launchxpwin = LaunchTransparentWindow(
    Show=boolean_toggle_20,
    Name="P R O J E C T   N O A H (beta)",
    Width=width_2,
    Height=height_2,
    ChildStatus=1,
    EnableHorizScroll=False)
attach_tooltip_to_element_207 = AttachTooltipToElement(ElementsToAttachTo=pulldown, TooltipContent="Match [UNIT] System of [RHINO].", ShowDelay=100, Duration=2000)
attach_tooltip_to_element_208 = AttachTooltipToElement(ElementsToAttachTo=button, TooltipContent="POWER OFF [NOAH]", ShowDelay=100, Duration=2000)
mininimize_window = CSharpScript(x=boolean_toggle_20)  # inputs x: Boolean
# ---------- mininimize_window: C# usings ----------
using System.Windows.Forms;
# ---------- mininimize_window: C# ----------
    if (x)
    {
      Grasshopper.Instances.DocumentEditor.WindowState = FormWindowState.Minimized;
    }
# ---------- end mininimize_window ----------

# ---- group: UI | MAIN WINDOW / UI || ARCHITECTURAL | TAB ELEMNTS
panel_446 = Panel("""FORM
PATTERN""")
tabs = TabbedView(TabNames=panel_446, TabTextSize=number_slider_5, Tab0=flatten(stack_4), Tab1=flatten(stack_14))
tab_index = TabIndex_2(_0_0=value_listener_25.Values, _0_1=value_listener_179.Values)
panel_447 = Panel("0,5,0,0")
adjust_element_positioning_2 = AdjustElementPositioning(ElementsToAdjust=tabs, Margin=panel_447, AbsolutePositioning=False, Width=width_2, HorizontalAlignment=3)
settab = SetTabbedView(TabbedView=tabs, SetTabIndex=tab_index)

# ---- group: UI | MAIN WINDOW / UI || CONCEPTURAL | TAB ELEMNTS
panel_448 = Panel("""FLOOR
WALL
RAIL
STAIR
PIPE""")
tabs_2 = TabbedView(
    TabNames=panel_448,
    TabTextSize=number_slider_5,
    Tab0=flatten(stack_11),
    Tab1=flatten(stack_16),
    Tab2=flatten(stack_18),
    Tab3=flatten(stack_15),
    Tab4=flatten(stack_12))
tab_index_2 = TabIndex(
    _0_0=value_listener_84.Values,
    _0_1=panel_211,
    _0_2=value_listener_188.Values,
    _0_3=value_listener_186.Values,
    _0_4=value_listener_122.Values)
panel_449 = Panel("0,5,0,0")
adjust_element_positioning_3 = AdjustElementPositioning(ElementsToAdjust=tabs_2, Margin=panel_449, AbsolutePositioning=False, Width=width_2, HorizontalAlignment=3)
settab_2 = SetTabbedView(TabbedView=tabs_2, SetTabIndex=tab_index_2)

panel_450 = Panel("""CREDIT
UI
HELP""")
tabs_3 = TabbedView(TabNames=panel_450, TabTextSize=number_slider_5, Tab0=flatten(stack_7), Tab1=flatten(stack), Tab2=flatten(stack_3))
panel_451 = Panel("0,5,0,0")
adjust_element_positioning_4 = AdjustElementPositioning(ElementsToAdjust=tabs_3, Margin=panel_451, AbsolutePositioning=False, Width=width_2, HorizontalAlignment=3)
settab_3 = SetTabbedView(TabbedView=tabs_3)

# ---- group: UI | MAIN WINDOW / STACK | MAIN EXAPNDERS
panel_452 = Panel("C O N C E P T U R A L")
panel_453 = Panel("A R C H I T E C T U R A L")
panel_454 = Panel("I N F O")
con = CreateExpander(UIElements=tabs, Header=panel_452, Open=False)
arc = CreateExpander(UIElements=tabs_2, Header=panel_453, Open=False)
info = CreateExpander(UIElements=tabs_3, Header=panel_454, Open=False)
tabswitches = GateOr(
    A=value_listener_84.Values,
    B=panel_211,
    C=value_listener_188.Values,
    D=value_listener_186.Values,
    E=value_listener_122.Values)
or = GateOr(A=value_listener_179.Values, B=value_listener_25.Values)
setexp_4 = SetExpander(Expander=con, ExpandedOpen=or)
setexp_5 = SetExpander(Expander=arc, ExpandedOpen=tabswitches)
setexp_6 = SetExpander(Expander=info)

# ---- group: UI | MAIN WINDOW (continued)
all_elemnts = Entwine(Branch00=create_image_5, Branch01=stack_13, Branch02=con, Branch03=arc, Branch04=info, FlattenInputs=True)  # -> flatten(Result)
merge_17 = Merge(Data1=con, Data2=arc, Data3=info)
addelems = AddElements(Window=launchxpwin, Elements=flatten(all_elemnts), DoVLChecking=True)  # -> AddedElements, ElementNames

number_slider_6 = Slider(0.9, range=0..2)
accent_colors = ValueList({"Amber", "Blue", "Brown", "Cobalt", "Crimson", "Cyan", "Emerald", "Green", "Indigo", "Lime", "Magenta", "Mauve", "Olive", "Orange", "Pink", "Purple", "Red", "Sienna", "Steel", "Taupe", "Teal", "Violet", "Yellow"}, selected="Yellow")
boolean_toggle_21 = BooleanToggle(True)
colour_picker = ColourPicker(PickedColour=RGBA(0, 0, 0, 100))
panel_455 = Panel("75,220")
winprops = SetWindowProperties(
    Window=launchxpwin,
    StartingLocation=panel_455,
    Theme=1,
    AccentColor=accent_colors,
    ShowTitleBar=boolean_toggle_21,
    BackgroundColor=colour_picker,
    ScaleFactor=number_slider_6)

# ---- group: UI | ELEMENT ADJUSTMENTS
number_slider_7 = Slider(14, range=0..100)
number_slider_8 = Slider(12, range=0..100)
number_slider_9 = Slider(16, range=0..100)
number_slider_10 = Slider(10, range=0..100)
swatch_86 = ColourSwatch(SwatchColor=RGBA(212, 161, 59, 95))
swatch_87 = ColourSwatch(SwatchColor=RGB(0, 0, 0))
adjustelem_credits_font = AdjustElementAppearance(ElementsToAdjust=entwine_2, FontSize=number_slider_9)
adjustelem_main_expander = AdjustElementAppearance(ElementsToAdjust=merge_17, Foreground=swatch_87, FontSize=number_slider_7)
adjustelem_sub_expander = AdjustElementAppearance(
    ElementsToAdjust=[brick_expander, sticks_expander, glass_expander, tile_expander, sticks_expander_2],
    Background=swatch_86,
    FontSize=number_slider_8)
column_widths = ListItem(List=create_grid_11.columan_def, Index=0, Wrap=True)  # -> Item, Item1
row_height = ListItem(List=create_grid_11.row_def_2, Index=0, Wrap=True)
item_width = Subtraction(A=column_widths.Item, B=row_height)
panel_456 = Panel("4,0,0,10")
main_buttons = AdjustElementPositioning(
    ElementsToAdjust=pulldown,
    Margin=panel_456,
    AbsolutePositioning=True,
    Width=expr("7*x/10", width_2),
    Height=row_height,
    HorizontalAlignment=3,
    VerticalAlignment=2)
panel_457 = Panel("-10,0,0,0")
panel_458 = Panel("-5,0,0,0")
main_buttons_2 = AdjustElementPositioning(
    ElementsToAdjust=button,
    Margin=panel_456,
    AbsolutePositioning=True,
    Width=expr("3*x/10", width_2),
    Height=expr("4*x/5", row_height),
    HorizontalAlignment=3,
    VerticalAlignment=1)
_1_3_buttons = AdjustElementPositioning(
    ElementsToAdjust=l_buttons_2,
    AbsolutePositioning=False,
    Width=expr("0.29*x", width_2),
    Height=row_height,
    HorizontalAlignment=1,
    VerticalAlignment=1)
expire = ExpireObject(
    Expire=True,
    AllObjects_Object=[value_listener_194, value_listener_195, value_listener_147, value_listener_148, value_listener_143, value_listener_144, value_listener_197, value_listener_198, value_listener_158, value_listener_159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])
full_buttons = AdjustElementPositioning(
    ElementsToAdjust=[l_buttons_3, l_buttons],
    Margin=panel_457,
    AbsolutePositioning=False,
    Width=expr("8.7*x/10", width_2),
    Height=row_height,
    HorizontalAlignment=1,
    VerticalAlignment=1)
center_element = AdjustElementPositioning(
    ElementsToAdjust=[_0_create_label_14, create_image, stack_5],
    Margin=panel_458,
    AbsolutePositioning=False,
    HorizontalAlignment=1,
    VerticalAlignment=1)

# ---- group: UI | ELEMENT ADJUSTMENTS / STACK | C1 DROPDOWN MENU
c_spattern = Merge(Data1=[_2_create_pulldown_menu_16, _3_create_pulldown_menu_3, _4_create_pulldown_menu_4, _5_create_pulldown_menu_3, _6_create_pulldown_menu_2, _6_create_pulldown_menu_3])
c_form = Merge(Data1=[_2_create_pulldown_menu_9, _2_create_pulldown_menu_10, _2_create_pulldown_menu_11, _2_create_pulldown_menu_12, _2_create_pulldown_menu, _2_create_pulldown_menu_2, _2_create_pulldown_menu_3, _2_create_pulldown_menu_4, _2_create_pulldown_menu_5, _2_create_pulldown_menu_6, _2_create_pulldown_menu_7, _2_create_pulldown_menu_8])
b_wall = Merge(Data1=[_3_create_pulldown_menu, _2_create_pulldown_menu_13, _5_create_pulldown_menu, _4_create_pulldown_menu, _6_create_pulldown_menu])
b_floor = Merge(Data1=[_2_create_pulldown_menu_14, _3_create_pulldown_menu_2, _4_create_pulldown_menu_3, _5_create_pulldown_menu_2])
b_railing = Merge(Data1=[_2_create_pulldown_menu_18, _3_create_pulldown_menu_5, _4_create_pulldown_menu_6])
b_stair = Merge(Data1=[_2_create_pulldown_menu_17, _3_create_pulldown_menu_4, _4_create_pulldown_menu_5, _5_create_pulldown_menu_4, _6_create_pulldown_menu_4])
b_pipe = Merge(Data1=_2_create_pulldown_menu_15)
panel_459 = Panel("5,0,0,0")
c1_dropdown_menu = AdjustElementPositioning(
    ElementsToAdjust=[b_wall, b_floor, b_railing, c_spattern, b_stair, c_form, b_pipe],
    Margin=panel_459,
    AbsolutePositioning=True,
    Width=item_width,
    Height=expr("(9*x)/10", row_height),
    HorizontalAlignment=0,
    VerticalAlignment=1)

# ---- group: UI | ELEMENT ADJUSTMENTS / STACK | C1 SLIDER
c_spattern_2 = Merge(Data1=[_10_create_slider_9, _11_create_slider, _12_create_slider, _13_create_slider, create_slider, create_slider_2, create_slider_4, create_slider_3, create_slider_5, create_slider_6, create_slider_7])
c_form_2 = Merge(Data1=[_10_create_slider_7, _10_create_slider_8, _10_create_slider, _10_create_slider_2, _10_create_slider_3, _10_create_slider_4, _10_create_slider_5, _10_create_slider_6])
b_pipe_2 = Merge(Data1=[_16_create_slider_2, _17_create_slider_4, _17_create_slider_5, _17_create_slider_6, _17_create_slider_7, _17_create_slider_8])
b_stair_2 = Merge(Data1=[_10_create_slider_14, _11_create_slider_5, _12_create_slider_5, _13_create_slider_6, _14_create_slider_2, _15_create_slider, _16_create_slider, _17_create_slider, _17_create_slider_9, _17_create_slider_2, _17_create_slider_3])
b_wall_2 = Merge(Data1=[_7_create_slider_2, _8_create_slider_5, _9_create_slider_2, _10_create_slider_12])
b_floor_2 = Merge(Data1=[_6_create_slider_3, _7_create_slider_3, _8_create_slider_6, _8_create_slider_7])
panel_460 = Panel("5,0,0,0")
c1_slider = AdjustElementPositioning(
    ElementsToAdjust=[b_wall_2, b_floor_2, c_spattern_2, c_form_2, b_pipe_2, b_stair_2],
    Margin=panel_460,
    AbsolutePositioning=True,
    Width=item_width,
    Height=expr("(8.5*x)/10", row_height),
    HorizontalAlignment=0,
    VerticalAlignment=1)
# ---- group: UI | ELEMENT ADJUSTMENTS / STACK | C1 SLIDER (full)
b_floor_3 = Merge(Data1=[_10_create_slider_11, _11_create_slider_3, _12_create_slider_3, _13_create_slider_3, _13_create_slider_4, create_slider_23, create_slider_24, create_slider_39, create_slider_40, create_slider_25, create_slider_15, create_slider_16, create_slider_17, create_slider_18, create_slider_19, create_slider_20, create_slider_21, create_slider_22])
b_wall_3 = Merge(Data1=[_10_create_slider_13, _11_create_slider_4, _12_create_slider_4, _13_create_slider_5, create_slider_26, create_slider_27, create_slider_28, create_slider_29, create_slider_30, create_slider_31, create_slider_32, create_slider_33, create_slider_34, create_slider_35, create_slider_36, create_slider_37, create_slider_38, _5_create_slider_2, _6_create_slider_2, create_slider_14])
b_railing_2 = Merge(Data1=[_5_create_slider, _6_create_slider, _7_create_slider, _8_create_slider_4, _9_create_slider, _10_create_slider_10, _11_create_slider_2, _12_create_slider_2, _13_create_slider_2, _14_create_slider, create_slider_8, create_slider_9, create_slider_10, create_slider_11, create_slider_12, create_slider_13])
merge_18 = Merge(Data1=[_8_create_slider_2, _8_create_slider_3])  # "I::UI"
panel_461 = Panel("5,0,0,0")
c1_slider_full = AdjustElementPositioning(
    ElementsToAdjust=[b_wall_3, b_floor_3, b_railing_2, merge_18],
    Margin=panel_461,
    AbsolutePositioning=True,
    Width=expr("9*x/10", width_2),
    Height=expr("(8.5*x)/10", row_height),
    HorizontalAlignment=0,
    VerticalAlignment=1)

# ---- group: UI | ELEMENT ADJUSTMENTS / STACK | C1 SLIDER TOOGLES
c_scatter = Merge(Data1=[_1_disaply_toogle_13, _1_disaply_toogle_16, _1_disaply_toogle_14, _1_disaply_toogle_15])
c_form_3 = Merge(Data1=[_1_disaply_toogle_9, _1_disaply_toogle_8, _1_disaply_toogle_2, _1_disaply_toogle_3, _1_disaply_toogle, _1_disaply_toogle_5, _1_disaply_toogle_6, _1_disaply_toogle_4, _1_disaply_toogle_7])
b_wall_4 = Merge(Data1=[_7_create_slider_2, _8_create_slider_5, _9_create_slider_2, _10_create_slider_12])
b_stair_3 = Merge(Data1=[_7_disaply_toogle, _8_disaply_toogle, _9_disaply_toogle])
b_pipe_3 = Merge(Data1=_1_toggle_2)
panel_462 = Panel("5,0,0,0")
c1_slider_toogles = AdjustElementPositioning(
    ElementsToAdjust=[b_wall_4, c_form_3, b_stair_3, c_scatter, b_pipe_3],
    Margin=panel_462,
    AbsolutePositioning=False,
    Width=item_width,
    Height=row_height,
    HorizontalAlignment=0,
    VerticalAlignment=2)

# ---- group: UI | ELEMENT ADJUSTMENTS / STACK | C2 BUTTONS
c_pattern = Merge(Data1=[create_button_18, create_button_19, create_button_11, create_button_42, create_button_43, create_button_12, create_button_20])
c_form_4 = Merge(Data1=[create_button_16, create_button_17, create_button_9, create_button_13, create_button_14, create_button_10, create_button_15])
b_wall_5 = Merge(Data1=[create_button_44, create_button_45, create_button_46, create_button_47, create_button_41])
b_floor_4 = Merge(Data1=[create_button_24, create_button_23, create_button_32, create_button_33, create_button_34])
b_railing_3 = Merge(Data1=[create_button_21, create_button_22, create_button_29, create_button_30, create_button_31])
b_stair_4 = Merge(Data1=[create_button_35, create_button_36, create_button_25, create_button_26, create_button_37])
b_pipe_4 = Merge(Data1=[create_button_38, create_button_39, create_button_27, create_button_28, create_button_40])
number_slider_11 = Slider(31, range=0..100)
panel_463 = Panel("0,0,0,0")
c2_buttons = AdjustElementPositioning(
    ElementsToAdjust=[b_wall_5, b_floor_4, b_railing_3, b_stair_4, c_pattern, c_form_4, b_pipe_4],
    Margin=panel_463,
    AbsolutePositioning=False,
    Width=expr("(3.7*x)/10", item_width),
    Height=number_slider_11,
    HorizontalAlignment=0,
    VerticalAlignment=1)

# ---- group: UI | ELEMENT ADJUSTMENTS (continued)
adjustelem_buttons_font = AdjustElementAppearance(ElementsToAdjust=[c_pattern, c_form_4, b_wall_5, b_floor_4, b_railing_3, b_stair_4, b_pipe_4], FontSize=number_slider_10)
adjustelem_default_font = AdjustElementAppearance(
    ElementsToAdjust=[c_spattern, c_form, b_wall, b_floor, b_railing, b_stair, b_pipe, c_spattern_2, c_form_2, b_pipe_2, b_stair_2, b_wall_2, b_floor_3, b_wall_3, b_railing_2],
    FontSize=value_listener_3.Values)

# ---- group: UI | ELEMENT ADJUSTMENTS / STACK | C2 COLOR PICKER
c_pattern_2 = Merge(Data1=create_color_picker_2)
c_form_5 = Merge(Data1=create_color_picker)
b_wall_6 = Merge(Data1=[create_color_picker_9, create_color_picker_8])
b_floor_5 = Merge(Data1=create_color_picker_5)
b_railing_4 = Merge(Data1=[create_color_picker_3, create_color_picker_4])
b_stair_5 = Merge(Data1=[create_color_picker_6, _3_create_pulldown_menu_4])
b_pipe_5 = Merge(Data1=create_color_picker_7)
panel_464 = Panel("0,0,0,0")
c2_color_picker = AdjustElementPositioning(
    ElementsToAdjust=[b_wall_6, b_railing_4, b_floor_5, c_pattern_2, b_stair_5, c_form_5, b_pipe_5],
    Margin=panel_464,
    AbsolutePositioning=True,
    Width=expr("(3.7*x)/10", item_width),
    Height=expr("1.2*x/2", row_height),
    HorizontalAlignment=0,
    VerticalAlignment=1)

# ---- group: UI | ELEMENT ADJUSTMENTS / STACK | FULL SLIDER TOOGLE
panel_465 = Panel("0,0,0,0")
full_slider_toogle = AdjustElementPositioning(
    ElementsToAdjust=[_1_disaply_toogle_12, _4_create_pulldown_menu_2, _1_disaply_toogle_10, _1_disaply_toogle_11],
    Margin=panel_465,
    AbsolutePositioning=False,
    Width=expr("8.8*x/10", width_2),
    Height=row_height,
    HorizontalAlignment=1,
    VerticalAlignment=1)

# ---- group: Fx | WA L L / fx | SCRIPT | T Y P E: S P I D E R S
quads = QuadPanels(Surface=debrep_3.Faces, UDivisions=value_listener_113.Values, VDivisions=value_listener_114.Values)  # disabled
edges_3 = BrepEdges(Brep=debrep_3.Faces)  # -> Naked, Interior, NonManifold; disabled
divide = DivideCurve(Curve=edges_3.Naked, Count=20, Kinks=False)  # -> Points, Tangents, Parameters; disabled
pdecon_5 = Deconstruct(Point=divide.Points)  # -> XComponent, YComponent, ZComponent; disabled
ma = MassAddition(Input=pdecon_5.ZComponent)  # -> Result, PartialResults; disabled
pshift_10 = ShiftPaths(Data=ma.Result, Offset=-1)  # disabled
sort_3 = SortList(Keys=pshift_10, ValuesA=edges_3.Naked)  # -> Keys, simplify(ValuesA); disabled
lng_19 = ListLength(List=flatten(debrep_3.Faces))  # disabled
item_6 = ListItem(List=sort_3.ValuesA, Index=0, Wrap=True)  # -> Item, Item1, Item2, Item3; disabled
expression_39 = Expression(x=lng_19, Expression="If(x = 1, 0, 1)")  # disabled
objfromgroup_26 = GetObjectsInGroup()

# ---- group: Fx | WA L L / fx | SCRIPT | T Y P E: S P I D E R S / F || ARM PLACEMENT
divide_2 = DivideDomain²(Domain=debrep_3.Faces, UCount=value_listener_113.Values, VCount=value_listener_114.Values)  # disabled
subsrf = Isotrim(Surface=debrep_3.Faces, Domain=divide_2)  # disabled
edges_4 = BrepEdges(Brep=quads)  # -> Naked, Interior, NonManifold; disabled
join_3 = JoinCurves(Curves=edges_4.Naked, Preserve=False)  # disabled
offsets_2 = OffsetOnSrf(Curve=join_3, Distance=expr("x/2", value_listener_138.Values), Surface=graft(quads))  # disabled
explode = Explode(Curve=offsets_2, Recursive=True)  # -> Segments, simplify(Vertices); disabled
end = EndPoints(Curve=explode.Segments)  # -> Start, simplify(End); disabled

# ---- group: Fx | WA L L / fx | SCRIPT | T Y P E: S P I D E R S / F || SPIDER ARM | MAIN
join_4 = BrepJoin(Breps=quads)  # -> Breps, Closed; disabled
debrep_4 = DeconstructBrep(Brep=join_4.Breps)  # -> Faces, Edges, simplify(Vertices); disabled
lng_20 = ListLength(List=debrep_4.Vertices)  # disabled
repeat = RepeatData(Data=debrep_3.Faces, Length=lng_20)  # disabled
srf_cp = SurfaceClosestPoint(Point=debrep_4.Vertices, Surface=repeat)  # -> Point, UVPoint, Distance; disabled
evalsrf_6 = EvaluateSurface(Surface=simplify(repeat), Point=srf_cp.UVPoint)  # -> Point, Normal, UDirection, VDirection, Frame; disabled
placement = Panel("""2/10
3/10
4/10
4/10
5/10
5/10
4/6
5/6
11/12
1""")  # disabled
line = LineSDL(Start=evalsrf_6.Point, Direction=evalsrf_6.Normal, Length=value_listener_136.Values)  # disabled
pframe = PerpFrame(Curve=reparameterize(graft(line)), Parameter=placement)  # disabled
radius = CSharpScript(x=value_listener_138.Values)  # -> r; inputs x: Double; disabled
# ---------- radius: C# ----------
    //LIST CREATION
    List<double> radius = new List<double>();
    radius.Clear();

    double pri = x / 6;
    double sec = (x * 3) / 24;

    radius.Add(pri);
    radius.Add(pri);
    radius.Add(pri);
    radius.Add(sec);
    radius.Add(sec);
    radius.Add(pri);
    radius.Add(pri);
    radius.Add(pri);
    radius.Add(pri);
    radius.Add(sec);

    r = radius;
# ---------- end radius ----------
radius_2 = Panel(radius)  # disabled
cir = Circle(Plane=pframe, Radius=radius)  # disabled
loft_opt_2 = LoftOptions(Closed=False, Adjust=True, Rebuild=0, Refit=0, Type=3)  # disabled
loft_9 = Loft(Curves=cir, Options=loft_opt_2)  # disabled
cap_4 = CapHoles(Brep=loft_9)  # disabled

# ---- group: Fx | WA L L / fx | SCRIPT | T Y P E: S P I D E R S / F || ARM GEO | LINE
srf_cp_2 = SurfaceClosestPoint(Point=end.End, Surface=graft(quads))  # -> Point, UVPoint, Distance; disabled
expression_40 = Expression(x=value_listener_136.Values, Expression="(-x)/10")  # disabled
expression_41 = Expression(x=value_listener_136.Values, Expression="(3*x)/10")  # disabled
evalsrf_7 = EvaluateSurface(Surface=graft(quads), Point=srf_cp_2.UVPoint)  # -> Point, Normal, UDirection, VDirection, Frame; disabled
line_2 = LineSDL(Start=end.End, Direction=evalsrf_7.Frame, Length=expression_41)  # -> simplify(Line); disabled
line_3 = LineSDL(Start=end.End, Direction=evalsrf_7.Frame, Length=expression_40)  # -> simplify(Line); disabled
join_5 = JoinCurves(Curves=[line_2, line_3], Preserve=False)  # -> simplify(graft(Curves)); disabled

# ---- group: Fx | WA L L / fx | SCRIPT | T Y P E: S P I D E R S / F || GLASS / Glass
debrep_5 = DeconstructBrep(Brep=quads)  # -> Faces, Edges, Vertices; disabled
join_6 = JoinCurves(Curves=debrep_5.Edges, Preserve=False)  # -> simplify(Curves); disabled
graft_11 = GraftTree(Tree=quads, IncludeEmptyLists=True, IncludeNullItems=True)  # -> simplify(Tree); disabled
offsets_3 = OffsetOnSrf(Curve=join_6, Distance=value_listener_139.Values, Surface=graft_11)  # disabled

# ---- group: Fx | WA L L / fx | SCRIPT | T Y P E: S P I D E R S / F || GLASS
srfsplit_2 = SurfaceSplit(Surface=graft(quads), Curves=offsets_3)  # disabled
area_5 = Area(Geometry=srfsplit_2)  # -> Area, Centroid; disabled
sort_4 = SortList(Keys=area_5.Area, ValuesA=srfsplit_2)  # -> Keys, ValuesA; disabled
item_7 = ListItem(List=sort_4.ValuesA, Index=0, Wrap=True)  # -> Item, Item1; disabled
glass_3 = OffsetSurface(Surface=item_7.Item1, Distance=value_listener_135.Values, BothSides=True, CreateSolid=True)  # disabled

# ---- group: Fx | WA L L / fx | SCRIPT | T Y P E: S P I D E R S / F || ARM GEO | SOLID
sort_crvs = SortCrvs(relay=join_5)  # disabled
panel_466 = Panel("""1
2.7/10
2.7/10
2.5/10
2.5/10
1.5/10
.5/10
0""")  # disabled
pframe_2 = PerpFrame(Curve=reparameterize(sort_crvs), Parameter=panel_466)  # disabled
radius_3 = CSharpScript(x=value_listener_138.Values)  # -> r; inputs x: Double; disabled
# ---------- radius_3: C# ----------
    //LIST CREATION
    List<double> radius = new List<double>();
    radius.Clear();

    double pri = x / 12;
    double sec = (2 * x) / 36;

    radius.Add(pri);
    radius.Add(pri);
    radius.Add(sec);
    radius.Add(sec);
    radius.Add(pri);
    radius.Add(pri);
    radius.Add(pri);
    radius.Add(sec);
    r = radius;
# ---------- end radius_3 ----------
cir_2 = Circle(Plane=pframe_2, Radius=radius_3)  # disabled
loft_opt_3 = LoftOptions(Closed=False, Adjust=True, Rebuild=0, Refit=0, Type=3)  # disabled
panel_467 = Panel(radius_3)  # disabled
loft_10 = Loft(Curves=cir_2, Options=loft_opt_3)  # disabled
cap_5 = CapHoles(Brep=loft_10)  # disabled

# ---- group: Fx | WA L L / fx | SCRIPT | T Y P E: S P I D E R S / F ||
number_slider_12 = Slider(5, range=0..10)  # disabled
number_slider_13 = Slider(1, range=0..10)  # disabled
item_8 = ListItem(List=cir_2, Index=number_slider_12, Wrap=True)  # disabled
item_9 = ListItem(List=cir, Index=number_slider_13, Wrap=True)  # disabled
area_6 = Area(Geometry=item_9)  # -> Area, Centroid; disabled
cps = ClosestPoints(Point=item_8, Cloud=flatten(area_6.Centroid), Count=1)  # -> ClosestPoint, CPIndex, Distance; disabled
ln_3 = Line(StartPoint=item_8, EndPoint=cps.ClosestPoint)  # disabled
expression_42 = Expression(x=value_listener_136.Values, Expression="(.5*x)/20")  # disabled
expression_43 = Expression(x=value_listener_136.Values, Expression="(.5*x)/10")  # disabled
panel_468 = Panel("""0
1""")  # disabled
merge_19 = Merge(Data1=expression_42, Data2=expression_43)  # disabled
vpipe = PipeVariable(Curve=ln_3, Parameters=panel_468, Radii=merge_19, Caps=2)  # disabled

# ---- group: Fx | WA L L / fx | SCRIPT | T Y P E: S T A C K S
input_srf = Surface(reparameterize(debrep_3.Faces))  # disabled
neg_8 = Negative(Value=value_listener_134.Values)  # disabled
f_thickness = Merge(Data1=value_listener_133.Values, Data2=neg_8)  # disabled
graft_12 = GraftTree(Tree=flatten(input_srf), IncludeEmptyLists=True, IncludeNullItems=True)  # disabled
objfromgroup_27 = GetObjectsInGroup()

# ---- group: Fx | WA L L / fx | SCRIPT | T Y P E: S T A C K S / Surface Borders
reparamsrf_2 = ReparameterizeSurface(Surface=input_srf)  # -> Reparameterized, Original; disabled
edges_5 = BrepEdges(Brep=input_srf)  # -> Naked, Interior, NonManifold; disabled

# ---- group: Fx | WA L L / fx | SCRIPT | T Y P E: S T A C K S / Divide Surface (U)
divide_3 = DivideDomain²(Domain=input_srf, UCount=value_listener_114.Values, VCount=1)  # disabled
subsrf_2 = Isotrim(Surface=graft(input_srf), Domain=divide_3)  # disabled
join_7 = BrepJoin(Breps=subsrf_2)  # -> Breps, Closed; disabled
edges_6 = BrepEdges(Brep=join_7.Breps)  # -> Naked, Interior, NonManifold; disabled

# ---- group: Fx | WA L L / fx | SCRIPT | T Y P E: S T A C K S / Divide Surface (V)
divide_4 = DivideDomain²(Domain=input_srf, UCount=1, VCount=value_listener_113.Values)  # disabled
subsrf_3 = Isotrim(Surface=graft(input_srf), Domain=divide_4)  # disabled
join_8 = BrepJoin(Breps=subsrf_3)  # -> Breps, Closed; disabled
edges_7 = BrepEdges(Brep=join_8.Breps)  # -> Naked, Interior, NonManifold; disabled

# ---- group: Fx | WA L L / fx | SCRIPT | T Y P E: S T A C K S / F ||Exterior Frame + Glas
gate_9 = StreamGate(Stream=input_srf, Gate=panel_164)  # -> Target0, Target1, Target2, Target3; disabled
simplify = SimplifyTree(Tree=gate_9.Target2, Front=False)  # -> graft(Tree); disabled
path_mapper = PathMapper(simplify, source="{0;x}", target="{x}")  # disabled
filter_24 = StreamFilter(Gate=panel_164, Stream0=gate_9.Target0, Stream1=gate_9.Target1, Stream2=path_mapper)  # disabled

# ---- group: Fx | WA L L / fx | SCRIPT | T Y P E: S T A C K S / Join Crvs
match_dir = MatchDir(crvs=edges_6.Interior)  # disabled
join_9 = JoinCurves(Curves=simplify(match_dir), Preserve=False)  # -> graft(Curves); disabled

match_dir_2 = MatchDir(crvs=edges_7.Interior)  # disabled
join_10 = JoinCurves(Curves=simplify(match_dir_2), Preserve=False)  # -> graft(Curves); disabled

# ---- group: Fx | WA L L / fx | SCRIPT | T Y P E: S T A C K S
pshift_11 = ShiftPaths(Data=join_9, Offset=-1)  # disabled
neg_9 = Negative(Value=value_listener_130.Values)  # disabled
offsets_4 = OffsetOnSrf(Curve=pshift_11, Distance=value_listener_130.Values, Surface=graft(input_srf))  # disabled
offsets_5 = OffsetOnSrf(Curve=pshift_11, Distance=neg_9, Surface=graft(input_srf))  # disabled
loft_11 = Loft(
    Curves=[offsets_4, offsets_5],
    Options={Adjust=False, Closed=False, LoftEnds=0, LoftSimp=0, LoftType=0, Rebuild=10, Refit=0.01})  # -> simplify(Loft); disabled

pshift_12 = ShiftPaths(Data=join_10, Offset=-1)  # disabled
neg_10 = Negative(Value=value_listener_130.Values)  # disabled
offsets_6 = OffsetOnSrf(Curve=pshift_12, Distance=value_listener_130.Values, Surface=graft(input_srf))  # disabled
offsets_7 = OffsetOnSrf(Curve=pshift_12, Distance=neg_10, Surface=graft(input_srf))  # disabled
loft_12 = Loft(
    Curves=[offsets_6, offsets_7],
    Options={Adjust=False, Closed=False, LoftEnds=0, LoftSimp=0, LoftType=0, Rebuild=10, Refit=0.01})  # -> simplify(Loft); disabled

cluster = Cluster(L=loft_11)  # disabled
filter_25 = StreamFilter(Gate=cluster, Stream0=loft_11, Stream1=loft_11)  # disabled
lng_21 = ListLength(List=filter_25)  # disabled
repeat_2 = RepeatData(Data=input_srf, Length=lng_21)  # -> simplify(graft(Data)); disabled

cluster_2 = Cluster(L=loft_12)  # disabled
filter_26 = StreamFilter(Gate=cluster_2, Stream0=loft_12, Stream1=loft_12)  # disabled
lng_22 = ListLength(List=filter_26)  # disabled
repeat_3 = RepeatData(Data=input_srf, Length=lng_22)  # -> simplify(graft(Data)); disabled

# ---- group: Fx | WA L L / fx | SCRIPT | T Y P E: S T A C K S / Offset Srf
flip_13 = Flip(Surface=loft_11, Guide=repeat_2)  # -> Surface, Result; disabled
offsrf_10 = OffsetSurface(Surface=flip_13.Surface, Distance=f_thickness, BothSides=False, CreateSolid=True)  # disabled
pshift_13 = ShiftPaths(Data=offsrf_10, Offset=-1)  # disabled

flip_14 = Flip(Surface=loft_12, Guide=repeat_3)  # -> Surface, Result; disabled
offsrf_11 = OffsetSurface(Surface=flip_14.Surface, Distance=f_thickness, BothSides=False, CreateSolid=True)  # disabled
pshift_14 = ShiftPaths(Data=offsrf_11, Offset=-1)  # disabled

# ---- group: fx | SCRIPT | SWITCHES / STACK | FRAME SWITCHES
toggle_67 = BooleanToggle(True)
toggle_68 = BooleanToggle(False)
toggle_69 = BooleanToggle(False)
toggle_70 = BooleanToggle(False)
toggle_71 = BooleanToggle(False)
toggle_72 = BooleanToggle(True)
toggle_73 = BooleanToggle(False)
toggle_74 = BooleanToggle(False)
toggle_75 = BooleanToggle(False)
toggle_76 = BooleanToggle(False)
toggle_77 = BooleanToggle(True)
toggle_78 = BooleanToggle(False)
toggle_79 = BooleanToggle(False)
toggle_80 = BooleanToggle(False)
toggle_81 = BooleanToggle(False)
toggle_82 = BooleanToggle(True)
solid_2 = StreamFilter(Gate=panel_163, Stream0=toggle_67, Stream1=toggle_68, Stream2=toggle_69, Stream3=toggle_70)
brick = StreamFilter(Gate=panel_163, Stream0=toggle_71, Stream1=toggle_72, Stream2=toggle_73, Stream3=toggle_74)
curtain = StreamFilter(Gate=panel_163, Stream0=toggle_75, Stream1=toggle_76, Stream2=toggle_77, Stream3=toggle_78)
glass_4 = StreamFilter(Gate=panel_163, Stream0=toggle_79, Stream1=toggle_80, Stream2=toggle_81, Stream3=toggle_82)
frame_7 = EnableDisableObject(
    Objects=objfromgroup_9,
    Enabled=solid_2,
    AllObjects_Object=[offset_single_crv_open, solid_wall_i, solid_wall_ii, final_geo_solid, top_crv, dispatch_17, bottom_crv, open_crvs, input_geo_main_2, width_7, width_6, value_listener_82, value_listener_77, division_4, neg_4, input_geo_main_2, panel_164, offsrf_8, flip_12, xy_4, final_geo_solid])
frame_8 = EnableDisableObject(
    Objects=objfromgroup_24,
    Enabled=brick,
    AllObjects_Object=[brick_wall, dispatch_18, double_3, merge_12, single_3, Z_12, base_geo_input, brick_wall])
frame_9 = EnableDisableObject(
    Objects=[objfromgroup_27, objfromgroup_26],
    Enabled=curtain,
    AllObjects_Object=[edges_5, join_11, reparamsrf_2, value_listener_129, offsets_8, pshift_16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])
frame_10 = EnableDisableObject(
    Objects=objfromgroup_25,
    Enabled=glass_4,
    AllObjects_Object=[move_2, Z_10, crv_3, graft_10, input_crv, pshift_5, curvepoint_3, curvepoint_4, dispatch_11, pdecon_3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])

# ---- group: fx | SCRIPT | SWITCHES / STACK | CURTAIN WALL SWITCHES
toggle_83 = BooleanToggle(True)
toggle_84 = BooleanToggle(False)
toggle_85 = BooleanToggle(False)
toggle_86 = BooleanToggle(True)
sticks_2 = StreamFilter(Gate=panel_162, Stream0=toggle_83, Stream1=toggle_84)
spiders_2 = StreamFilter(Gate=panel_162, Stream0=toggle_85, Stream1=toggle_86)
frame_11 = EnableDisableObject(
    Objects=objfromgroup_27,
    Enabled=sticks_2,
    AllObjects_Object=[edges_5, join_11, reparamsrf_2, value_listener_129, offsets_8, pshift_16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])
frame_12 = EnableDisableObject(
    Objects=objfromgroup_26,
    Enabled=spiders_2,
    AllObjects_Object=[subsrf, divide_2, offsets_3, edges_4, join_3, offsets_2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])

# ---- group: Fx | R A I L I N G / fx | INPUT | Sort InputCrv (Single / Double)
expression_44 = Expression(x=value_listener_59.Values, y=value_listener_64.Values, Expression="x-y")

# ---- group: Fx | R A I L I N G / fx | INPUT | Sort InputCrv (Single / Double) / F || SINGLE CRV
graft_13 = GraftTree(Tree=select_geo_7, IncludeEmptyLists=True, IncludeNullItems=True)
Z_13 = UnitZ(Factor=expression_44)
move_3 = Move(Geometry=graft_13, Motion=Z_13)  # -> Geometry, Transform
crv_4 = Merge(Data1=graft_13, Data2=move_3.Geometry)
pshift_15 = ShiftPaths(Data=crv_4, Offset=-1)

# ---- group: Fx | R A I L I N G / fx | SCRIPT | Create & Sort Top and Bottom Crv (Interior) / F || RATIOS
item_10 = ListItem(List=expression_44, Index=0, Wrap=True)
division_7 = Division(A=value_listener_61.Values, B=item_10)
division_8 = Division(A=value_listener_60.Values, B=item_10)
subtraction_3 = Subtraction(A=1, B=division_8)
ratios = Merge(Data1=division_7, Data2=subtraction_3)
dispatch_19 = Dispatch(List=ratios, DispatchPattern=[True, False])  # -> ListA, ListB

# ---- group: Fx | R A I L I N G / fx | INPUT | Sort InputCrv (Single / Double) (continued)
# R A I L I N G   F U N C T I O N
input_crv_2 = StreamFilter(Gate=panel_434, Stream0=pshift_15, Stream1=pshift)  # -> flatten(Stream)

# ---- group: Fx | R A I L I N G / fx | SCRIPT | Sort Top and Bottom Crv (Exterior)
dispatch_20 = Dispatch(List=input_crv_2, DispatchPattern=[True, False])  # -> ListA, ListB

# ---- group: Fx | R A I L I N G / fx | SCRIPT | Create & Sort Top and Bottom Crv (Interior)
tweencrv = TweenCurve(CurveA=graft(dispatch_20.ListA), CurveB=graft(dispatch_20.ListB), Factor=ratios, BlendType=0)
dispatch_21 = Dispatch(List=tweencrv, DispatchPattern=[True, False])  # -> simplify(ListA), simplify(ListB)

# ---- group: Fx | R A I L I N G / fx | SCRIPT | Create & Sort Top and Bottom Crv (Interior) / F || Sort inputCrv (Regular / Polyline)
dividecrv_2 = DivideCrv_2(crvinput=dispatch_21.ListA, divindex=panel_433, scount=value_listener_55.Values, slength=value_listener_56.Values)  # -> points, perframe, polyline, tanvec_t, value_t
crv_type = StreamFilter(
    Gate=panel_432,
    Stream0=dispatch_21.ListA,
    Stream1=dispatch_21.ListA,
    Stream2=dispatch_21.ListA,
    Stream3=dividecrv_2.polyline,
    Stream4=dividecrv_2.polyline)

dividecrv_3 = DivideCrv_2(crvinput=dispatch_21.ListB, divindex=panel_433, scount=value_listener_55.Values, slength=value_listener_56.Values)  # -> points, perframe, polyline, tanvec_t, value_t
crv_type_2 = StreamFilter(
    Gate=panel_432,
    Stream0=dispatch_21.ListB,
    Stream1=dispatch_21.ListB,
    Stream2=dispatch_21.ListB,
    Stream3=dividecrv_3.polyline,
    Stream4=dividecrv_3.polyline)

# ---- group: Fx | R A I L I N G / fx | SCRIPT | Sort Top and Bottom Crv (Exterior) / F || Sort inputCrv (Regular / Polyline)
dividecrv_4 = DivideCrv(crvinput=dispatch_20.ListA, divindex=panel_433, scount=value_listener_55.Values, slength=value_listener_56.Values)  # -> points, perframe, polyline, tanvec_t, value_t
crv_type_3 = StreamFilter(
    Gate=panel_432,
    Stream0=dispatch_20.ListA,
    Stream1=dispatch_20.ListA,
    Stream2=dispatch_20.ListA,
    Stream3=dividecrv_4.polyline,
    Stream4=dividecrv_4.polyline)

dividecrv_5 = DivideCrv_2(crvinput=dispatch_20.ListB, divindex=panel_433, scount=value_listener_55.Values, slength=value_listener_56.Values)  # -> points, perframe, polyline, tanvec_t, value_t
crv_type_4 = StreamFilter(
    Gate=panel_432,
    Stream0=dispatch_20.ListB,
    Stream1=dispatch_20.ListB,
    Stream2=dispatch_20.ListB,
    Stream3=dividecrv_5.polyline,
    Stream4=dividecrv_5.polyline)

# ---- group: Fx | R A I L I N G / F || VERTICAL ELEMENTS / fx | SCRIPT | VERTICAL BASE LINE / F || Crv PARAM
panel_469 = Panel("""0
1""")
dispatch_22 = Dispatch(List=panel_469, DispatchPattern=[True, False])  # -> ListA, ListB
merge_20 = Merge(Data1=dispatch_22.ListA, Data2=dispatch_19.ListB, Data3=dispatch_19.ListB, Data4=dispatch_22.ListB)
typeindex_8 = StreamFilter(Gate=panel_432, Stream0=panel_469, Stream1=panel_469, Stream2=panel_469, Stream3=merge_20, Stream4=merge_20)

# ---- group: Fx | R A I L I N G / F || VERTICAL ELEMENTS / fx | SCRIPT | VERTICAL BASE LINE
bottompt = Point(dividecrv_4.points)
toppt = Point(dividecrv_5.points)
ln_4 = Line(StartPoint=bottompt, EndPoint=toppt)  # -> flatten(Line)
typeindex_9 = StreamFilter(Gate=panel_432, Stream0=ln_4, Stream1=ln_4, Stream2=ln_4, Stream3=ln_4, Stream4=ln_4)
graft_14 = GraftTree(Tree=typeindex_9, IncludeEmptyLists=True, IncludeNullItems=True)
eval = EvaluateCurve(Curve=reparameterize(graft_14), Parameter=typeindex_8)  # -> Point, Tangent, Angle
xy_5 = XYPlane(Origin=eval.Point)  # -> simplify(Plane)
align = AlignPlane(Plane=xy_5, Direction=graft(dividecrv_4.tanvec_t))  # -> simplify(Plane), Angle

# ---- group: Fx | R A I L I N G / F || VERTICAL ELEMENTS / fx | SCRIPT | INTERIOR BEAMS
shatter = Shatter(Curve=reparameterize(crv_type_2), Parameters=dividecrv_3.value_t)  # -> graft(Segments); disabled
shatter_2 = Shatter(Curve=reparameterize(crv_type), Parameters=dividecrv_2.value_t)  # -> graft(Segments); disabled
addition_3 = Addition(A=value_listener_57.Values, B=1)  # disabled
addition_4 = Addition(A=value_listener_57.Values, B=1)  # disabled
dividecrv_i_bottom = DivideCrv_2(crvinput=shatter, divindex=panel_433, scount=addition_3, slength=value_listener_58.Values)  # -> points, perframe, polyline, tanvec_t, value_t; disabled
dividecrv_e_top = DivideCrv_2(crvinput=shatter_2, divindex=panel_433, scount=addition_4, slength=value_listener_58.Values)  # -> points, perframe, polyline, tanvec_t, value_t; disabled
cullends = CullEnds_2(L=dividecrv_i_bottom.points)  # disabled
cullends_2 = CullEnds_2(L=dividecrv_i_bottom.tanvec_t)  # disabled
cullends_3 = CullEnds_2(L=dividecrv_e_top.points)  # disabled
weave_54 = Weave(Pattern=panel_433, Stream0=cullends, Stream1=dividecrv_i_bottom.points, NullGaps=False)  # disabled
weave_55 = Weave(Pattern=panel_433, Stream0=cullends_2, Stream1=dividecrv_i_bottom.tanvec_t, NullGaps=False)  # disabled
weave_56 = Weave(Pattern=panel_433, Stream0=cullends_3, Stream1=dividecrv_e_top.points, NullGaps=False)  # disabled
ln_5 = Line(StartPoint=weave_54, EndPoint=weave_56)  # disabled
beamrec = BeamRec(C=ln_5, rotational_angle=0, T=weave_55, L=value_listener_63.Values, W=value_listener_63.Values)  # disabled
objfromgroup_28 = GetObjectsInGroup()

# ---- group: Fx | R A I L I N G / F || VERTICAL ELEMENTS / fx | SCRIPT | Create Vertical / F || crossSection Crv
cir_3 = Circle(Plane=align.Plane, Radius=expr("x/4", value_listener_62.Values))
cir_4 = Circle(Plane=align.Plane, Radius=expr("x/2", value_listener_62.Values))
rectangle = Rectangle(plane=align.Plane, length=typeindex_4, width=typeindex_4, radius=0)  # -> rectangle_2, length_2
merge_21 = Merge(Data1=rectangle.rectangle_2, Data2=cir_3, Data3=cir_4)

# ---- group: Fx | R A I L I N G / F || HORIZONTAL ELEMENTS / fx | SCRIPT | Create Cables
objfromgroup_29 = GetObjectsInGroup()
div = DivideDomain(Domain=Domain(0, 1), Count=value_listener_65.Values)  # disabled
dedomain = DeconstructDomain(Domain=div)  # -> Start, End; disabled
cullends_4 = CullEnds(L=dedomain.End)  # disabled
ins = InsertItems(List=cullends_4, Item=0, Indices=0, Wrap=True)  # disabled
tweencrv_2 = TweenCurve(CurveA=crv_type, CurveB=crv_type_2, Factor=ins, BlendType=0)  # disabled
pipe_2 = Pipe(Curve=tweencrv_2, Radius=value_listener_66.Values, Caps=2)  # disabled

# ---- group: Fx | R A I L I N G / F || VERTICAL ELEMENTS / fx | SCRIPT | Create Vertical / F || Select Crv
item_11 = ListItem(List=merge_21, Index=typeindex_5, Wrap=True)
matchdir_5 = MatchDir_2(C=item_11)

# ---- group: Fx | R A I L I N G / F || HORIZONTAL ELEMENTS / fx | SCRIPT | Create Rail Handle
steel_2 = Relay([crv_type, crv_type_2])
rail = StreamFilter(
    Gate=panel_432,
    Stream0=crv_type_3,
    Stream1=graft(steel_2),
    Stream2=graft(crv_type_4),
    Stream3=graft(crv_type_4),
    Stream4=graft(crv_type_4))
pframe_3 = PerpFrame(Curve=reparameterize(rail), Parameter=0)
rectangle_2 = Rectangle(plane=pframe_3, length=value_listener_64.Values, width=value_listener_64.Values, radius=0)  # -> rectangle_2, length_2
cir_5 = Circle(Plane=pframe_3, Radius=value_listener_64.Values)
crosssection = StreamFilter(
    Gate=panel_432,
    Stream0=rectangle_2.rectangle_2,
    Stream1=rectangle_2.rectangle_2,
    Stream2=rectangle_2.rectangle_2,
    Stream3=cir_5,
    Stream4=cir_5)
swp1 = Sweep1(Rail=rail, Sections=crosssection, Miter=1)
cap_6 = CapHoles(Brep=swp1)  # -> flatten(Brep)

# ---- group: Fx | R A I L I N G / F || VERTICAL ELEMENTS / fx | SCRIPT | Create Vertical / F || Loft Solid
closed_7 = BooleanToggle(False)
adj_7 = BooleanToggle(False)
list_2 = ValueList({"Normal": 0, "Loose": 1, "Tight": 2, "Straight": 3, "Unifrom": 4}, selected="Straight")
loft_13 = Loft(C=matchdir_5, cls=closed_7, adj=adj_7, T=list_2)
cap_7 = CapHoles(Brep=loft_13)

# ---- group: Fx | WA L L / fx | SCRIPT | T Y P E: S T A C K S / F ||Exterior Frame + Glas / Base Srf
join_11 = JoinCurves(Curves=edges_5.Naked, Preserve=False)  # -> reparameterize(simplify(Curves)); disabled
matchdir_6 = MatchDir_2(C=join_11)  # disabled
expression_45 = Expression(x=value_listener_129.Values, Expression="-x")  # disabled

# ---- group: Fx | WA L L / fx | SCRIPT | T Y P E: S T A C K S (continued)
graft_15 = GraftTree(Tree=flatten(matchdir_6), IncludeEmptyLists=True, IncludeNullItems=True)  # disabled
group_3 = Group(Objects=pshift_14)  # disabled
group_4 = Group(Objects=pshift_13)  # disabled
ei_frame = Group(Objects=flatten(group_4))  # disabled
ei_frame_2 = Group(Objects=flatten(group_3))  # disabled

# ---- group: Fx | WA L L / fx | SCRIPT | T Y P E: S T A C K S / F ||Exterior Frame + Glas / Base Srf (continued)
offsets_8 = OffsetOnSrf(Curve=graft_15, Distance=value_listener_129.Values, Surface=graft_12)  # disabled
offsets_9 = OffsetOnSrf(Curve=graft_15, Distance=expression_45, Surface=graft_12)  # disabled
clean_5 = CleanTree(RemoveNulls=True, RemoveInvalid=True, RemoveEmpty=False, Tree=offsets_8)  # disabled
pshift_16 = ShiftPaths(Data=clean_5, Offset=-1)  # disabled
clean_6 = CleanTree(RemoveNulls=True, RemoveInvalid=True, RemoveEmpty=False, Tree=offsets_9)  # disabled
pshift_17 = ShiftPaths(Data=clean_6, Offset=-1)  # disabled
merge_22 = Merge(Data1=pshift_16, Data2=pshift_17)  # disabled
srfsplit_3 = SurfaceSplit(Surface=graft(input_srf), Curves=merge_22)  # disabled
area_7 = Area(Geometry=srfsplit_3)  # -> Area, Centroid; disabled
sort_5 = SortList(Keys=area_7.Area, ValuesA=srfsplit_3)  # -> Keys, ValuesA; disabled
item_12 = ListItem(List=sort_5.ValuesA, Index=0, Wrap=True)  # -> Item, Item1; disabled

# ---- group: Fx | WA L L / fx | SCRIPT | T Y P E: S T A C K S / F ||Exterior Frame + Glas / Exterior Frame Geo
max_3 = Maximum(A=value_listener_131.Values, B=value_listener_134.Values)  # disabled
max_4 = Maximum(A=value_listener_132.Values, B=value_listener_133.Values)  # disabled
offsrf_12 = OffsetSurface(Surface=item_12.Item, Distance=expr("-x", max_4), BothSides=False, CreateSolid=True)  # -> simplify(Offset); disabled
offsrf_13 = OffsetSurface(Surface=item_12.Item, Distance=max_3, BothSides=False, CreateSolid=True)  # -> simplify(Offset); disabled
sunion_2 = SolidUnion(Breps=[offsrf_13, offsrf_12])  # disabled
ex_frame = Group(Objects=sunion_2)  # disabled

# ---- group: Fx | WA L L / fx | SCRIPT | T Y P E: S T A C K S / F ||Exterior Frame + Glas / Glass Geo
glass_5 = OffsetSurface(Surface=item_12.Item1, Distance=value_listener_135.Values, BothSides=True, CreateSolid=True)  # disabled

# ---- group: Fx | WA L L / fx | SCRIPT | T Y P E: S T A C K S / O | GEO | STICKS
all_frame_geo = Merge(Data1=flatten(ex_frame), Data2=ei_frame, Data3=ei_frame_2)  # disabled

# ---- group: Fx | F L O O R / fx | SCRIPT | Create Slab / F || DOUBLE CRV
partition_4 = PartitionList(List=simplify(input_geo_main.Target1), Size=2)
closed_8 = BooleanToggle(False)
adj_8 = BooleanToggle(True)
list_3 = ValueList({"Normal": 0, "Loose": 1, "Tight": 2, "Straight": 3, "Unifrom": 4}, selected="Normal")

# ---- group: Fx | F L O O R
# F L O O R   F U N C T I O N
matchdir_7 = MatchDir_3(C=partition_4)

# ---- group: Fx | F L O O R / fx | SCRIPT | Create Slab / F || DOUBLE CRV (continued)
loft_14 = Loft(C=matchdir_7, cls=closed_8, adj=adj_8, T=list_3)
cap_8 = CapHoles(Brep=loft_14)

# ---- group: Fx | F L O O R / fx | SCRIPT | Create Slab / O | GEO | SLAB
filter_27 = StreamFilter(Gate=panel_214, Stream0=flatten(offsrf), Stream1=flatten(cap_8), Stream2=flatten(offsrf_4))  # -> graft(Stream)

# ---- group: Fx | F L O O R / F || Sort Top and Bottom Srf
debrep_6 = DeconstructBrep(Brep=filter_27)  # -> Faces, Edges, Vertices
md_slider_6 = MDSlider(SliderMode=0, slider_value=Point(0.5, 0.5, 0.5), x_domain=Domain(0, 1), y_domain=Domain(0, 1), z_domain=Domain(0, 1))
evalsrf_8 = EvaluateSurface(Surface=reparameterize(debrep_6.Faces), Point=md_slider_6)  # -> Point, Normal, UDirection, VDirection, Frame
devec_2 = DeconstructVector(Vector=evalsrf_8.Normal)  # -> XComponent, YComponent, ZComponent
equals_3 = Equality(FirstNumber=devec_2.ZComponent, SecondNumber=1)  # -> Equality, Inequality
equals_4 = Equality(FirstNumber=devec_2.ZComponent, SecondNumber=-1)  # -> Equality, Inequality
dispatch_23 = Dispatch(List=debrep_6.Faces, DispatchPattern=equals_3.Equality)  # -> ListA, ListB
dispatch_24 = Dispatch(List=debrep_6.Faces, DispatchPattern=equals_4.Equality)  # -> ListA, ListB
top_2 = Surface(simplify(dispatch_23.ListA))
bottom_2 = Surface(simplify(dispatch_24.ListA))

# ---- group: Fx | F L O O R / fx | SCRIPT | SUPPORT / fx | SCRIPT | CREATE FRAME GEO
srf_5 = Surface(bottom_2)  # disabled
type_2 = StreamGate(Stream=srf_5, Gate=panel_212)  # -> Target0, Target1, Target2, Target3; disabled

# ---- group: Fx | F L O O R / fx | SCRIPT | SUPPORT / F || Offset FOUNDATION
edges_8 = BrepEdges(Brep=type_2.Target1)  # -> Naked, Interior, NonManifold; disabled
join_12 = JoinCurves(Curves=edges_8.Naked, Preserve=False)  # disabled
offset_2 = OffsetCurve(Curve=join_12, Distance=expr("-x/2", value_listener_142.Values), Plane=PlaneXY(0, 0, 0), Corners=1)  # disabled
offset_3 = OffsetCurve(Curve=join_12, Distance=expr("x/2", value_listener_142.Values), Plane=PlaneXY(0, 0, 0), Corners=1)  # disabled
len = Length(Curve=offset_2)  # disabled
len_2 = Length(Curve=offset_3)  # disabled
merge_23 = Merge(Data1=offset_2, Data2=offset_3)  # disabled
merge_24 = Merge(Data1=len, Data2=len_2)  # disabled
sort_6 = SortList(Keys=merge_24, ValuesA=merge_23)  # -> Keys, ValuesA; disabled
item_13 = ListItem(List=sort_6.ValuesA, Index=0, Wrap=True)  # -> simplify(Item); disabled
pshift_18 = ShiftPaths(Data=item_13, Offset=-1)  # disabled
fillet_2 = Fillet(Curve=pshift_18, Radius=value_listener_103.Values)  # disabled
merge_25 = Merge(Data1=simplify(join_12), Data2=simplify(fillet_2))  # disabled
boundary_4 = BoundarySurfaces(Edges=merge_25)  # disabled
extrude_z = ExtrudeZ(B=boundary_4, height=expr("-x", value_listener_140.Values), closed_cap=1)  # disabled
objfromgroup_30 = GetObjectsInGroup()

# ---- group: Fx | S T A I R / fx | SCRIPT | SORT INPUT CRVS
gate_10 = StreamGate(Stream=flatten(filter_23), Gate=panel_421)  # -> Target0, Target1

# ---- group: Fx | S T A I R / fx | SCRIPT | SORT INPUT CRVS / F || SINGLE CRV / F || Offset SINGLE CRV
toggle_87 = BooleanToggle(False)
toggle_88 = BooleanToggle(True)
toggle_89 = BooleanToggle(False)
division_9 = Division(A=value_listener_187.Values, B=2)
neg_11 = Negative(Value=value_listener_187.Values)
width_12 = StreamFilter(Gate=panel_438, Stream0=value_listener_187.Values, Stream1=division_9, Stream2=neg_11)
weave_57 = Weave(Pattern=panel_438, Stream0=toggle_87, Stream1=toggle_88, Stream2=toggle_89, NullGaps=False)
offcrv_2 = OffsetCurve(Curve=gate_10.Target0, Plane=PlaneXY(0, 0, 0), Distance=width_12, BothSides=weave_57, Kinks=0, CapType=0)

# ---- group: Fx | S T A I R / fx | SCRIPT | SORT INPUT CRVS / F || SINGLE CRV
join_13 = JoinCurves(Curves=offcrv_2, Preserve=False)  # -> simplify(Curves)
merge_26 = Merge(Data1=simplify(graft(gate_10.Target0)), Data2=join_13)
o_direction = StreamFilter(Gate=panel_438, Stream0=merge_26, Stream1=offcrv_2, Stream2=merge_26)

# ---- group: Fx | S T A I R / fx | SCRIPT | SORT INPUT CRVS (continued)
input_crv_3 = StreamFilter(Gate=panel_421, Stream0=o_direction, Stream1=gate_10.Target1)  # -> flatten(Stream)

# ---- group: Fx | S T A I R / fx | SCRIPT | CREATE BASE CRV GEO / F || SORT LENGTHS
partition_5 = PartitionList(List=input_crv_3, Size=2)
len_3 = Length(Curve=partition_5)
sort_7 = SortList(Keys=len_3, ValuesA=partition_5)  # -> Keys, ValuesA
item_14 = ListItem(List=sort_7.ValuesA, Index=0, Wrap=True)  # -> Item, Item1
long = Curve(reparameterize(simplify(item_14.Item1)))
short = Curve(reparameterize(simplify(item_14.Item)))

# ---- group: Fx | S T A I R / fx | SCRIPT | Create STRINGER GEO / F || OFFSET AND SORT STRINGER Border Crvs / F || OFFSET CRVS
expression_46 = Expression(x=value_listener_115.Values, Expression="if (x = 0, 0, 1)")  # disabled
filter_28 = StreamFilter(Gate=expression_46, Stream0=division_5, Stream1=value_listener_115.Values)  # disabled
merge_27 = Merge(Data1=short, Data2=long)  # disabled
matchdir_8 = MatchDir_2(C=merge_27)  # disabled
neg_12 = Negative(Value=filter_28)  # disabled
offset_4 = OffsetCurve(Curve=matchdir_8, Distance=filter_28, Plane=PlaneXY(0, 0, 0), Corners=1)  # disabled
offset_5 = OffsetCurve(Curve=matchdir_8, Distance=neg_12, Plane=PlaneXY(0, 0, 0), Corners=1)  # disabled

# ---- group: Fx | S T A I R / fx | SCRIPT | CREATE BASE CRV GEO / F || DIVIDE STEPS
dividecrv_6 = DivideCrv_3(crvinput=short, divindex=panel_420, scount=value_listener_117.Values, slength=value_listener_118.Values)  # -> points, perframe, polyline, tanvec_t, value_t
crv_cp_6 = CurveClosestPoint(Point=dividecrv_6.points, Curve=long)  # -> Point, Parameter, Distance

# ---- group: Fx | S T A I R / fx | SCRIPT | Create STRINGER GEO / F || OFFSET AND SORT STRINGER Border Crvs / F || BOUNDARY BREP
end_2 = EndPoints(Curve=short)  # -> Start, End; disabled
end_3 = EndPoints(Curve=long)  # -> Start, End; disabled
ln_6 = Line(StartPoint=end_2.Start, EndPoint=end_3.Start)  # disabled
ln_7 = Line(StartPoint=end_2.End, EndPoint=end_3.End)  # disabled
merge_28 = Merge(Data1=short, Data2=ln_6, Data3=long, Data4=ln_7)  # disabled
boundary_5 = BoundarySurfaces(Edges=merge_28)  # disabled
offsrf_14 = OffsetSurface(Surface=boundary_5, Distance=1, BothSides=True, CreateSolid=True)  # disabled

# ---- group: Fx | S T A I R / fx | SCRIPT | Create STRINGER GEO / F || OFFSET AND SORT STRINGER Border Crvs
curvepoint_5 = PointOnCurve(offset_4, parameter=0.5)  # disabled
curvepoint_6 = PointOnCurve(offset_5, parameter=0.5)  # disabled
merge_29 = Merge(Data1=curvepoint_5, Data2=curvepoint_6)  # disabled
merge_30 = Merge(Data1=offset_4, Data2=offset_5)  # disabled
pshift_19 = ShiftPaths(Data=merge_29, Offset=-1)  # disabled
pshift_20 = ShiftPaths(Data=merge_30, Offset=-1)  # disabled
brepinc = PointInBrep(Brep=offsrf_14, Point=pshift_19, Strict=False)  # disabled
dispatch_25 = Dispatch(List=pshift_20, DispatchPattern=brepinc)  # -> ListA, ListB; disabled

# ---- group: Fx | S T A I R / fx | SCRIPT | Create STRINGER GEO / F || Create Interior Stringer Geo
expression_47 = Expression(x=value_listener_116.Values, Expression="if (x = 1, 0, 1)")  # disabled
range_2 = Range(Domain=Domain(0, 1), Steps=expr("x-1", value_listener_116.Values))  # disabled
dispatch_26 = Dispatch(List=dispatch_25.ListA, DispatchPattern=[True, False])  # -> ListA, ListB; disabled
filter_29 = StreamFilter(Gate=expression_47, Stream0=0.5, Stream1=range_2)  # disabled
twn2crvs = TweenTwoCurves(CurveA=simplify(dispatch_26.ListA), CurveB=simplify(dispatch_26.ListB), Factor=filter_29, Refit=1, PointSample=0)  # -> simplify(Tween); disabled

# ---- group: Fx | P I P E / F || MANAGE DATA BRANCH AND GROUP
pshift_21 = ShiftPaths(Data=offsrf_2, Offset=-1)
expression_48 = Expression(x=lng_7, Expression="if (x = 1,1,0)")
expression_49 = Expression(x=lng_7, Expression="if (x = 1,1,0)")
expression_50 = Expression(x=lng_7, Expression="if (x = 1,1,0)")
pshift_22 = ShiftPaths(Data=rings, Offset=-1)
joints_2 = StreamFilter(Gate=expression_49, Stream0=offsrf_3, Stream1=flatten(offsrf_3))
rings_2 = StreamFilter(Gate=expression_50, Stream0=pshift_22, Stream1=flatten(rings))

# ----
merge_31 = Merge(Data1=dispatch_5.ListA, Data2=pshift_21)

# ---- group: Fx | P I P E / F || MANAGE DATA BRANCH AND GROUP (continued)
pipe_3 = StreamFilter(Gate=expression_48, Stream0=merge_31, Stream1=flatten(offsrf_2))
merge_32 = Merge(Data1=pipe_3, Data2=joints_2, Data3=rings_2)

# ----
clean_7 = CleanTree(RemoveNulls=True, RemoveInvalid=True, RemoveEmpty=True, Tree=merge_32)

# ---- group: Fx | P I P E / F || MANAGE DATA BRANCH AND GROUP (continued)
group_5 = Group(Objects=clean_7)  # -> flatten(Group)
group_6 = Group(Objects=group_5)

# ---- group: Fx | P I P E / fx | OUTPUT | P I P E / O | NOAH | P I P E
geometry_4 = Geometry(flatten(group_6))  # disabled
bake_4 = Bake(bake=panel_294, geometry=geometry_4, color=value_listener_155.Values)  # disabled
preview_4 = CustomPreview(Geometry=geometry_4, Material=value_listener_155.Values)  # disabled
objfromgroup_31 = GetObjectsInGroup()

# ---- group: Fx | P I P E / fx | SCRIPT | SWITCHES / STACK | MAIN SWITCHES
toggle_90 = BooleanToggle(False)
toggle_91 = BooleanToggle(True)
typeindex_10 = StreamFilter(Gate=value_listener_122.Values, Stream0=toggle_90, Stream1=toggle_91)
solver_6 = EnableDisableObject(
    Objects=[objfromgroup_31, objfromgroup_5],
    Enabled=typeindex_10,
    AllObjects_Object=[preview_4, geometry_4, panel_294, bake_4, value_listener_155, boolean_toggle_7, boolean_toggle_6, select_geo_5, crv])

# ---- group: Fx | P I P E / fx | OUTPUT | P I P E
# EXTRA CODE: OUTPUT
output_geo_3 = Geometry(flatten(geometry_4))

# ---- group: Fx | F L O O R / fx | SCRIPT | TILE
expression_51 = Expression(x=value_listener_71.Values, Expression="If(x = False, 0, 3)")  # disabled
revsrf = ReverseSurfaceDirection(Surface=top_2, ReverseOption=expression_51)  # disabled
objfromgroup_32 = GetObjectsInGroup()

# ---- group: Fx | F L O O R / fx | SCRIPT | TILE / F || Sort Pattern Type
gate_11 = StreamGate(Stream=revsrf, Gate=panel_215)  # -> Target0, Target1, Target2, Target3; disabled
quads_2 = QuadPanels(Surface=gate_11.Target1, UDivisions=value_listener_72.Values, VDivisions=value_listener_73.Values)  # disabled
quadstag = StaggeredQuadPanels(Surface=gate_11.Target2, UDivisions=value_listener_72.Values, VDivisions=value_listener_73.Values)  # disabled
quadrand = RandomQuadPanels(
    Surface=gate_11.Target3,
    UDivisions=value_listener_72.Values,
    VDivisions=value_listener_73.Values,
    RandomSeed=value_listener_74.Values)  # disabled
filter_30 = StreamFilter(Gate=panel_215, Stream1=quads_2, Stream2=quadstag, Stream3=quadrand)  # disabled

# ---- group: Fx | F L O O R / fx | SCRIPT | SWITCHES
frame_13 = EnableDisableObject(
    Objects=objfromgroup_32,
    Enabled=tile,
    AllObjects_Object=[quadrand, brepinc_3, extrude_z_4, move_8, Z_18, dispatch_31, srfsplit_5, edges_14, gate_11, quads_2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])
frame_14 = EnableDisableObject(
    Objects=objfromgroup_13,
    Enabled=typeindex,
    AllObjects_Object=[value_listener_142, quads_3, edges_8, bottom_2, merge_25, boundary_4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])

# ---- group: Fx | WA L L / fx | SCRIPT | T Y P E: S P I D E R S / F || CABLES
divide_5 = DivideDomain²(Domain=debrep_3.Faces, UCount=value_listener_113.Values, VCount=1)  # disabled
divide_6 = DivideDomain²(Domain=debrep_3.Faces, UCount=1, VCount=value_listener_114.Values)  # disabled
subsrf_4 = Isotrim(Surface=debrep_3.Faces, Domain=divide_5)  # disabled
subsrf_5 = Isotrim(Surface=debrep_3.Faces, Domain=divide_6)  # disabled
join_14 = BrepJoin(Breps=subsrf_4)  # -> Breps, Closed; disabled
join_15 = BrepJoin(Breps=subsrf_5)  # -> Breps, Closed; disabled
edges_9 = BrepEdges(Brep=join_14.Breps)  # -> Naked, Interior, NonManifold; disabled
edges_10 = BrepEdges(Brep=join_15.Breps)  # -> Naked, Interior, NonManifold; disabled
lng_23 = ListLength(List=flatten(debrep_3.Faces))  # disabled
expression_52 = Expression(x=lng_23, Expression="If(x = 1, 0, 1)")  # disabled
number_slider_14 = Slider(7, range=0..10)  # disabled
number_slider_15 = Slider(6, range=0..10)  # disabled
item_15 = ListItem(List=cir, Index=number_slider_14, Wrap=True)  # disabled
item_16 = ListItem(List=cir, Index=number_slider_15, Wrap=True)  # disabled
area_8 = Area(Geometry=item_15)  # -> Area, flatten(Centroid); disabled
area_9 = Area(Geometry=item_16)  # -> Area, flatten(Centroid); disabled

# ---- group: Fx | WA L L / fx | SCRIPT | T Y P E: S P I D E R S (continued)
merge_33 = Merge(Data1=simplify(item_6.Item), Data2=simplify(edges_9.Interior), Data3=simplify(item_6.Item3))  # -> simplify(Result); disabled
merge_34 = Merge(Data1=simplify(item_6.Item1), Data2=simplify(edges_10.Interior), Data3=simplify(item_6.Item2))  # -> simplify(Result); disabled
flatten = FlattenTree(Tree=merge_34, Path="{0}")  # disabled
filter_31 = StreamFilter(Gate=expression_39, Stream0=flatten, Stream1=merge_34)  # disabled

# ---- group: Fx | WA L L / fx | SCRIPT | T Y P E: S P I D E R S / F || CABLES (continued)
flatten_2 = FlattenTree(Tree=merge_33, Path="{0}")  # disabled
filter_32 = StreamFilter(Gate=expression_52, Stream0=flatten_2, Stream1=merge_33)  # disabled
crv_5 = Curve(simplify(graft(filter_32)))  # disabled
crv_6 = Curve(simplify(graft(filter_31)))  # disabled
divide_7 = DivideCurve(Curve=crv_5, Count=value_listener_114.Values, Kinks=False)  # -> simplify(Points), Tangents, Parameters; disabled
divide_8 = DivideCurve(Curve=crv_6, Count=value_listener_113.Values, Kinks=False)  # -> simplify(Points), Tangents, Parameters; disabled
cps_2 = ClosestPoints(Point=divide_7.Points, Cloud=area_8.Centroid, Count=1)  # -> simplify(ClosestPoint), CPIndex, Distance; disabled
cps_3 = ClosestPoints(Point=divide_8.Points, Cloud=area_9.Centroid, Count=1)  # -> ClosestPoint, CPIndex, Distance; disabled
pshift_23 = ShiftPaths(Data=cps_2.ClosestPoint, Offset=-1)  # disabled
pshift_24 = ShiftPaths(Data=cps_3.ClosestPoint, Offset=-1)  # disabled
pline = PolyLine(Vertices=pshift_23, Closed=False)  # disabled
pline_2 = PolyLine(Vertices=pshift_24, Closed=False)  # disabled
pipe_4 = Pipe(Curve=pline, Radius=value_listener_137.Values, Caps=2)  # disabled
pipe_5 = Pipe(Curve=pline_2, Radius=value_listener_137.Values, Caps=2)  # disabled

# ---- group: Fx | WA L L / fx | SCRIPT | T Y P E: S P I D E R S / O | GEO | FRAME
frame_15 = Merge(Data1=cap_4, Data2=pipe_4, Data3=pipe_5, Data4=cap_5, Data5=vpipe)  # disabled

# ---- group: Fx | WA L L / fx | OUTPUT | W A L L / O | GEO | W A L L
g_l_a_s_s = StreamFilter(Gate=panel_162, Stream0=glass_5, Stream1=glass_3)
c_u_r_t_a_i_n_f_r_a_m_e = StreamFilter(Gate=panel_162, Stream0=all_frame_geo, Stream1=frame_15)
w_a_l_l_g_e_o = StreamFilter(Gate=panel_163, Stream0=final_geo_solid, Stream1=brick_wall, Stream2=c_u_r_t_a_i_n_f_r_a_m_e, Stream3=offsrf_9)

# ---- group: Fx | WA L L / fx | OUTPUT | W A L L / O | NOAH | W A L L / SOLID GEO
geometry_5 = Geometry(flatten(w_a_l_l_g_e_o))  # disabled
preview_5 = CustomPreview(Geometry=geometry_5, Material=value_listener_199.Values)  # disabled
bake_5 = Bake(bake=panel_442, geometry=geometry_5, color=value_listener_199.Values)  # disabled

# ---- group: Fx | WA L L / fx | OUTPUT | W A L L / O | NOAH | W A L L / Glass
geometry_6 = Geometry(flatten(g_l_a_s_s))  # disabled
type_3 = Weave(Pattern=panel_163, Stream0=False, Stream1=False, Stream2=True, Stream3=False, NullGaps=False)  # disabled
and = GateAnd(A=value_listener_84.Values, B=type_3)  # disabled
bake_6 = Bake(bake=panel_442, geometry=geometry_6, color=value_listener_196.Values)  # disabled
onoff_3 = EnableDisableObject(Enabled=and, AllObjects_Object=preview_6)
preview_6 = CustomPreview(Geometry=geometry_6, Material=value_listener_196.Values)  # disabled

# ---- group: Fx | R A I L I N G / F || HORIZONTAL ELEMENTS / fx | SCRIPT | Create Glass Extrusion/ Panels
typeindex_11 = StreamFilter(Gate=panel_432, Stream2=crv_type_4, Stream3=crv_type_2)  # disabled
typeindex_12 = StreamFilter(Gate=panel_432, Stream2=crv_type, Stream3=crv_type)  # disabled
graft_16 = GraftTree(Tree=flatten(typeindex_11), IncludeEmptyLists=True, IncludeNullItems=True)  # disabled
graft_17 = GraftTree(Tree=flatten(typeindex_12), IncludeEmptyLists=True, IncludeNullItems=True)  # disabled
crv_cp_7 = CurveClosestPoint(Point=dividecrv_3.points, Curve=reparameterize(crv_type_2))  # -> Point, Parameter, Distance; disabled
merge_35 = Merge(Data1=graft_16, Data2=graft_17)  # disabled
divindex = DivIndex(typeindex=panel_432, divindex=panel_433, ptlist=dividecrv_3.points)  # disabled
shatter_3 = Shatter(Curve=reparameterize(merge_35), Parameters=crv_cp_7.Parameter)  # disabled
trim = TrimTree(Tree=shatter_3, Depth=1)  # disabled
closed_9 = BooleanToggle(False)  # disabled
adj_9 = BooleanToggle(False)  # disabled
list_4 = ValueList({"Normal": 0, "Loose": 1, "Tight": 2, "Straight": 3, "Unifrom": 4}, selected="Straight")  # disabled
closed_10 = BooleanToggle(False)  # disabled
adj_10 = BooleanToggle(False)  # disabled
list_5 = ValueList({"Normal": 0, "Loose": 1, "Tight": 2, "Straight": 3, "Unifrom": 4}, selected="Straight")  # disabled
objfromgroup_33 = GetObjectsInGroup()

# ---- group: Fx | R A I L I N G / F || HORIZONTAL ELEMENTS / fx | SCRIPT | Create Glass Extrusion/ Panels / F || Sort Crvs
series_4 = Series(Start=0, Step=1, Count=divindex)  # disabled
series_5 = Series(Start=divindex, Step=1, Count=divindex)  # disabled
weave_58 = Weave(Pattern=[0, 1], Stream0=series_4, Stream1=series_5, NullGaps=False)  # disabled
item_17 = ListItem(List=trim, Index=weave_58, Wrap=True)  # disabled
dispatch_27 = Dispatch(List=item_17, DispatchPattern=[True, False])  # -> ListA, ListB; disabled

# ---- group: Fx | R A I L I N G / F || HORIZONTAL ELEMENTS / fx | SCRIPT | Create Glass Extrusion/ Panels / F || Create Panels
merge_36 = Merge(Data1=graft(dispatch_27.ListA), Data2=graft(dispatch_27.ListB))  # -> simplify(Result); disabled
closed_11 = BooleanToggle(False)  # disabled
adj_11 = BooleanToggle(False)  # disabled
list_6 = ValueList({"Normal": 0, "Loose": 1, "Tight": 2, "Straight": 3, "Unifrom": 4}, selected="Straight")  # disabled
matchdir_9 = MatchDir_2(C=merge_36)  # disabled
loft_15 = Loft(C=matchdir_9, cls=closed_11, adj=adj_11, T=list_6)  # disabled
debrep_7 = DeconstructBrep(Brep=loft_15)  # -> Faces, Edges, Vertices; disabled
debrep_8 = DeconstructBrep(Brep=graft(debrep_7.Faces))  # -> Faces, simplify(Edges), Vertices; disabled
join_16 = JoinCurves(Curves=debrep_8.Edges, Preserve=False)  # disabled
offsets_10 = OffsetOnSrf(Curve=join_16, Distance=expr("x/2", value_listener_62.Values), Surface=debrep_8.Faces)  # disabled
offsets_11 = OffsetOnSrf(Curve=offsets_10, Distance=value_listener_69.Values, Surface=debrep_8.Faces)  # disabled
explode_2 = Explode(Curve=simplify(offsets_11), Recursive=True)  # -> Segments, Vertices; disabled
autoedgsrf = AutomaticEdgeSurface(Edges=explode_2.Segments)  # disabled
offsrf_15 = OffsetSurface(Surface=autoedgsrf, Distance=expr("x/2", value_listener_70.Values), BothSides=True, CreateSolid=True)  # disabled
objfromgroup_34 = GetObjectsInGroup()

# ---- group: Fx | R A I L I N G / F || HORIZONTAL ELEMENTS / fx | SCRIPT | Create Glass Extrusion/ Panels (continued)
offcrv_3 = OffsetCurve(
    Curve=dispatch_27.ListA,
    Plane=PlaneXY(0, 0, 0),
    Distance=expr("x/2", value_listener_70.Values),
    BothSides=True,
    Kinks=0,
    CapType=1)  # disabled
offcrv_4 = OffsetCurve(
    Curve=dispatch_27.ListB,
    Plane=PlaneXY(0, 0, 0),
    Distance=expr("x/2", value_listener_70.Values),
    BothSides=True,
    Kinks=0,
    CapType=1)  # disabled
offcrv_5 = OffsetCurve(
    Curve=dispatch_27.ListA,
    Plane=PlaneXY(0, 0, 0),
    Distance=expr("x/2", value_listener_70.Values),
    BothSides=True,
    Kinks=0,
    CapType=0)  # disabled
offcrv_6 = OffsetCurve(
    Curve=dispatch_27.ListB,
    Plane=PlaneXY(0, 0, 0),
    Distance=expr("x/2", value_listener_70.Values),
    BothSides=True,
    Kinks=0,
    CapType=0)  # disabled
merge_37 = Merge(Data1=offcrv_3, Data2=offcrv_4)  # disabled
merge_38 = Merge(Data1=offcrv_5, Data2=offcrv_6)  # disabled
loft_16 = Loft(C=merge_37, cls=closed_10, adj=adj_10, T=list_5)  # disabled
loft_17 = Loft(C=merge_38, cls=closed_9, adj=adj_9, T=list_4)  # disabled
merge_39 = Merge(Data1=simplify(loft_16), Data2=simplify(loft_17))  # disabled
join_17 = BrepJoin(Breps=merge_39)  # -> Breps, Closed; disabled
typeindex_13 = StreamFilter(Gate=panel_432, Stream2=join_17.Breps, Stream3=offsrf_15)  # -> flatten(Stream); disabled

# ---- group: Fx | R A I L I N G / F || HORIZONTAL ELEMENTS / fx | SCRIPT | Create Clip GEO
number_slider_16 = Slider(0.1, range=0.01..1)  # disabled
explode_3 = Explode(Curve=simplify(offsets_11), Recursive=True)  # -> Segments, Vertices; disabled
subtraction_4 = Subtraction(A=1, B=number_slider_16)  # disabled
dom²num = ConstructDomain²(UMin=number_slider_16, UMax=subtraction_4, VMin=subtraction_4, VMax=number_slider_16)  # disabled
autoedgsrf_2 = AutomaticEdgeSurface(Edges=explode_3.Segments)  # disabled
subsrf_6 = Isotrim(Surface=reparameterize(autoedgsrf_2), Domain=dom²num)  # disabled
debrep_9 = DeconstructBrep(Brep=subsrf_6)  # -> Faces, Edges, simplify(Vertices); disabled
number_slider_17 = Slider(0, range=0..360)  # disabled
max_5 = Maximum(A=value_listener_70.Values, B=value_listener_67.Values)  # disabled
min = Minimum(A=value_listener_62.Values, B=max_5)  # disabled
objfromgroup_35 = GetObjectsInGroup()

cir_6 = Circle(Plane=debrep_9.Vertices, Radius=expr("5* x", value_listener_69.Values))  # -> graft(Circle); disabled
crv_7 = Curve(flatten(join_16))  # disabled
srf_6 = Surface(cir_6)  # disabled
bcx = BrepCurve(Brep=srf_6, Curve=crv_7)  # -> Curves, simplify(Points); disabled
trim_2 = TrimTree(Tree=bcx.Points, Depth=1)  # disabled
item_18 = ListItem(List=reverse(trim_2), Index=0, Wrap=True)  # disabled
trim_3 = TrimTree(Tree=item_18, Depth=1)  # disabled

ln_8 = Line(StartPoint=debrep_9.Vertices, EndPoint=trim_3)  # disabled
clip = CLIP(C=ln_8, L=value_listener_68.Values, W=min, rotational_angle=number_slider_17)  # -> simplify(beam_brep); disabled
pshift_25 = ShiftPaths(Data=clip, Offset=-1)  # disabled
sdiff_2 = SolidDifference(BrepsA=pshift_25, BrepsB=flatten(offsrf_15))  # disabled

# ---- group: fx | SCRIPT | SWITCHES / STACK | FRAME SWITCHES
toggle_92 = BooleanToggle(False)
toggle_93 = BooleanToggle(True)
toggle_94 = BooleanToggle(False)
toggle_95 = BooleanToggle(False)
toggle_96 = BooleanToggle(False)
toggle_97 = BooleanToggle(False)
toggle_98 = BooleanToggle(False)
toggle_99 = BooleanToggle(True)
toggle_100 = BooleanToggle(True)
toggle_101 = BooleanToggle(False)
toggle_102 = BooleanToggle(False)
toggle_103 = BooleanToggle(False)
toggle_104 = BooleanToggle(False)
toggle_105 = BooleanToggle(True)
toggle_106 = BooleanToggle(False)
toggle_107 = BooleanToggle(False)
toggle_108 = BooleanToggle(False)
toggle_109 = BooleanToggle(False)
toggle_110 = BooleanToggle(False)
toggle_111 = BooleanToggle(True)
steel_3 = StreamFilter(Gate=panel_432, Stream0=toggle_92, Stream1=toggle_93, Stream2=toggle_94, Stream3=toggle_95, Stream4=toggle_96)
glass_2_2 = StreamFilter(Gate=panel_432, Stream0=toggle_97, Stream1=toggle_98, Stream2=toggle_99, Stream3=toggle_100, Stream4=toggle_101)
glass2 = StreamFilter(Gate=panel_432, Stream0=toggle_102, Stream1=toggle_103, Stream2=toggle_104, Stream3=toggle_105, Stream4=toggle_106)
cable_2 = StreamFilter(Gate=panel_432, Stream0=toggle_107, Stream1=toggle_108, Stream2=toggle_109, Stream3=toggle_110, Stream4=toggle_111)
frame_16 = EnableDisableObject(
    Objects=objfromgroup_28,
    Enabled=steel_3,
    AllObjects_Object=[ln_5, cullends, beamrec, value_listener_63, cullends_3, shatter, shatter_2, dividecrv_i_bottom, dividecrv_e_top, addition_4, addition_3, crv_type, crv_type_2, dividecrv_3, dividecrv_2, weave_54, weave_56, panel_433, cullends_2, weave_55])
frame_17 = EnableDisableObject(
    Objects=objfromgroup_33,
    Enabled=glass_2_2,
    AllObjects_Object=[typeindex_11, crv_type_4, crv_type_2, panel_432, graft_16, graft_17, merge_35, loft_15, closed_11, adj_11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])
frame_18 = EnableDisableObject(
    Objects=[objfromgroup_35, objfromgroup_34],
    Enabled=glass2,
    AllObjects_Object=[subsrf_6, dom²num, debrep_9, ln_8, clip, subtraction_4, min, max_5, sdiff_2, pshift_25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])
frame_19 = EnableDisableObject(Objects=objfromgroup_29, Enabled=cable_2, AllObjects_Object=[pipe_2, tweencrv_2, div, cullends_4, dedomain, ins, pipe_2])

# ---- group: Fx | F L O O R / fx | SCRIPT | SUPPORT / F || Split IRREGULARinto PATTERN Shape RESPONSIVELY
relay_2 = Relay([type_2.Target2, type_2.Target3])  # disabled
edges_11 = BrepEdges(Brep=relay_2)  # -> Naked, Interior, NonManifold; disabled
quads_3 = QuadPanels(Surface=relay_2, UDivisions=value_listener_101.Values, VDivisions=value_listener_102.Values)  # disabled
join_18 = JoinCurves(Curves=edges_11.Naked, Preserve=False)  # disabled
srfsplit_4 = SurfaceSplit(Surface=quads_3, Curves=join_18)  # disabled
pshift_26 = ShiftPaths(Data=srfsplit_4, Offset=-1)  # -> simplify(Data); disabled
extrude_z_2 = ExtrudeZ(B=relay_2, height=1, closed_cap=1)  # -> simplify(extruded_brep); disabled
Z_14 = UnitZ(Factor=expr("x/2", 1))  # disabled
lng_24 = ListLength(List=flatten(top_2))  # disabled
expression_53 = Expression(x=lng_24, Expression="if (x = 1,1,0)")  # disabled

# ---- group: Fx | F L O O R / fx | SCRIPT | SUPPORT / F || Split IRREGULARinto PATTERN Shape RESPONSIVELY / F || Offset and Extrude (FOR INCLUSION TESTING)
offset_6 = OffsetCurve(Curve=pshift_26, Distance=expr("-x/2", value_listener_76.Values), Plane=PlaneXY(0, 0, 0), Corners=1)  # disabled
offset_7 = OffsetCurve(Curve=pshift_26, Distance=expr("x/2", value_listener_76.Values), Plane=PlaneXY(0, 0, 0), Corners=1)  # disabled
len_4 = Length(Curve=offset_6)  # disabled
len_5 = Length(Curve=offset_7)  # disabled
merge_40 = Merge(Data1=offset_6, Data2=offset_7)  # disabled
merge_41 = Merge(Data1=len_4, Data2=len_5)  # disabled
lng_25 = ListLength(List=flatten(top_2))  # disabled
sort_8 = SortList(Keys=merge_41, ValuesA=merge_40)  # -> Keys, ValuesA; disabled
item_19 = ListItem(List=sort_8.ValuesA, Index=0, Wrap=True)  # -> simplify(Item); disabled
expression_54 = Expression(x=lng_25, Expression="If(x = 1, 0, 1)")  # disabled
explode_4 = Explode(Curve=item_19, Recursive=True)  # -> Segments, Vertices; disabled
item_20 = ListItem(List=explode_4.Vertices, Index=0, Wrap=True)  # -> simplify(Item); disabled
pshift_27 = ShiftPaths(Data=item_20, Offset=-1)  # disabled
filter_33 = StreamFilter(Gate=expression_54, Stream0=item_20, Stream1=pshift_27)  # disabled

# ---- group: Fx | F L O O R / fx | SCRIPT | SUPPORT / F || Split IRREGULARinto PATTERN Shape RESPONSIVELY (continued)
move_4 = Move(Geometry=filter_33, Motion=Z_14)  # -> simplify(Geometry), Transform; disabled
brepinc_2 = PointInBrep(Brep=extrude_z_2, Point=move_4.Geometry, Strict=True)  # disabled
branch = StreamFilter(Gate=expression_53, Stream0=brepinc_2, Stream1=flatten(brepinc_2))  # disabled
dispatch_28 = Dispatch(List=simplify(pshift_26), DispatchPattern=simplify(branch))  # -> ListA, ListB; disabled

# ---- group: Fx | F L O O R / fx | SCRIPT | SUPPORT / fx | SCRIPT | WAFFLE / F || BORDER EDGE CRV
edges_12 = BrepEdges(Brep=dispatch_28.ListA)  # -> Naked, Interior, NonManifold; disabled
join_19 = JoinCurves(Curves=edges_12.Naked, Preserve=False)  # disabled
pshift_28 = ShiftPaths(Data=join_19, Offset=-2)  # disabled

# ---- group: Fx | F L O O R / fx | SCRIPT | SUPPORT / fx | SCRIPT | JOIST
join_20 = BrepJoin(Breps=flatten(dispatch_28.ListA))  # -> Breps, Closed; disabled
edges_13 = BrepEdges(Brep=join_20.Breps)  # -> Naked, Interior, NonManifold; disabled
objfromgroup_36 = GetObjectsInGroup()

# ---- group: Fx | F L O O R / fx | SCRIPT | SUPPORT / fx | SCRIPT | WAFFLE / F || WIDTH 1 | Offset and Fillet WIDTH 1
offset_8 = OffsetCurve(Curve=dispatch_28.ListA, Distance=expr("-x/2", value_listener_142.Values), Plane=PlaneXY(0, 0, 0), Corners=1)  # disabled
offset_9 = OffsetCurve(Curve=dispatch_28.ListA, Distance=expr("x/2", value_listener_142.Values), Plane=PlaneXY(0, 0, 0), Corners=1)  # disabled
len_6 = Length(Curve=offset_8)  # disabled
len_7 = Length(Curve=offset_9)  # disabled
merge_42 = Merge(Data1=offset_8, Data2=offset_9)  # disabled
merge_43 = Merge(Data1=len_6, Data2=len_7)  # disabled
sort_9 = SortList(Keys=merge_43, ValuesA=merge_42)  # -> Keys, ValuesA; disabled
item_21 = ListItem(List=sort_9.ValuesA, Index=0, Wrap=True)  # -> simplify(Item); disabled

# ---- group: Fx | F L O O R / fx | SCRIPT | SUPPORT / fx | SCRIPT | JOIST / F || Sort Line Directions
end_4 = EndPoints(Curve=edges_13.Interior)  # -> Start, End; disabled
vec2pt = Vector2Pt(PointA=end_4.Start, PointB=end_4.End, Unitize=True)  # -> Vector, Length; disabled
item_22 = ListItem(List=vec2pt.Vector, Index=0, Wrap=True)  # disabled
X = UnitX(Factor=1)  # disabled
angle = Angle(VectorA=vec2pt.Vector, VectorB=X)  # -> Angle, Reflex; disabled
angle_2 = Angle(VectorA=item_22, VectorB=X)  # -> Angle, Reflex; disabled
similar = Similarity(FirstNumber=angle.Angle, SecondNumber=angle_2.Angle, Threshold=0.1)  # -> Similarity, AbsoluteDifference; disabled
dispatch_29 = Dispatch(List=edges_13.Interior, DispatchPattern=similar.Similarity)  # -> ListA, ListB; disabled

# ---- group: Fx | F L O O R / fx | SCRIPT | SUPPORT / fx | SCRIPT | WAFFLE
fillet_3 = Fillet(Curve=item_21, Radius=value_listener_103.Values)  # disabled
objfromgroup_37 = GetObjectsInGroup()

# ---- group: Fx | F L O O R / fx | SCRIPT | SUPPORT / fx | SCRIPT | WAFFLE / F || WIDTH 2 | Offset WIDTH 2
offset_10 = OffsetCurve(Curve=fillet_3, Distance=expr("-x/2", max_2), Plane=PlaneXY(0, 0, 0), Corners=1)  # disabled
offset_11 = OffsetCurve(Curve=fillet_3, Distance=expr("x/2", max_2), Plane=PlaneXY(0, 0, 0), Corners=1)  # disabled
len_8 = Length(Curve=offset_10)  # disabled
len_9 = Length(Curve=offset_11)  # disabled
merge_44 = Merge(Data1=offset_10, Data2=offset_11)  # disabled
merge_45 = Merge(Data1=len_8, Data2=len_9)  # disabled
sort_10 = SortList(Keys=merge_45, ValuesA=merge_44)  # -> Keys, reverse(ValuesA); disabled
item_23 = ListItem(List=sort_10.ValuesA, Index=0, Wrap=True)  # -> simplify(Item); disabled

# ---- group: Fx | F L O O R / fx | SCRIPT | SUPPORT / fx | SCRIPT | JOIST / F || Create Beams
join_21 = JoinCurves(Curves=dispatch_29.ListA, Preserve=False)  # disabled
join_22 = JoinCurves(Curves=dispatch_29.ListB, Preserve=False)  # disabled
depth_4 = Weave(Pattern=value_listener_92.Values, Stream0=value_listener_98.Values, Stream1=value_listener_94.Values, NullGaps=False)  # disabled
width_13 = Weave(Pattern=value_listener_92.Values, Stream0=value_listener_97.Values, Stream1=value_listener_93.Values, NullGaps=False)  # disabled
tw = Weave(Pattern=value_listener_92.Values, Stream0=value_listener_99.Values, Stream1=value_listener_95.Values, NullGaps=False)  # disabled
tf = Weave(Pattern=value_listener_92.Values, Stream0=value_listener_100.Values, Stream1=value_listener_96.Values, NullGaps=False)  # disabled
beam3d = Beam3D(
    C=join_21,
    W=value_listener_94.Values,
    D=value_listener_93.Values,
    wt=value_listener_95.Values,
    ft=value_listener_96.Values)  # disabled
beam3d_2 = Beam3D(C=join_22, W=depth_4, D=width_13, wt=tw, ft=tf)  # disabled
Z_15 = UnitZ(Factor=expr("-x/2", value_listener_93.Values))  # disabled
move_5 = Move(Geometry=beam3d, Motion=Z_15)  # -> Geometry, Transform; disabled
Z_16 = UnitZ(Factor=expr("-x/2", width_13))  # disabled
move_6 = Move(Geometry=beam3d_2, Motion=Z_16)  # -> Geometry, Transform; disabled
merge_46 = Merge(Data1=move_5.Geometry, Data2=move_6.Geometry)  # disabled

# ---- group: Fx | F L O O R / fx | SCRIPT | SUPPORT / fx | SCRIPT | WAFFLE / F || Move F-
Z_17 = UnitZ(Factor=expr("-x", value_listener_140.Values))  # disabled
move_7 = Move(Geometry=item_23, Motion=Z_17)  # -> Geometry, Transform; disabled

# ---- group: Fx | F L O O R / fx | SCRIPT | SUPPORT / fx | SCRIPT | WAFFLE / F || WAFFLE SOLID / F || INTERIOR VOID (subtraction)
merge_47 = Merge(Data1=simplify(fillet_3), Data2=simplify(move_7.Geometry))  # disabled
closed_12 = BooleanToggle(False)  # disabled
adj_12 = BooleanToggle(False)  # disabled
list_7 = ValueList({"Normal": 0, "Loose": 1, "Tight": 2, "Straight": 3, "Unifrom": 4}, selected="Straight")  # disabled
loft_18 = Loft(C=merge_47, cls=closed_12, adj=adj_12, T=list_7)  # disabled
cap_9 = CapHoles(Brep=loft_18)  # disabled

# ---- group: Fx | F L O O R / fx | SCRIPT | SUPPORT / fx | SCRIPT | WAFFLE / F || WAFFLE SOLID / F || PANEL SOLID
extrude_z_3 = ExtrudeZ(B=simplify(join_19), height=expr("-x", value_listener_140.Values), closed_cap=1)  # disabled

# ---- group: Fx | F L O O R / fx | SCRIPT | SUPPORT / fx | SCRIPT | WAFFLE / F || WAFFLE SOLID
sdiff_3 = SolidDifference(BrepsA=simplify(extrude_z_3), BrepsB=simplify(cap_9))  # disabled

# ---- group: Fx | F L O O R / fx | SCRIPT | SUPPORT / O | GEO | FRAME SUPPORT
frame_20 = StreamFilter(Gate=panel_212, Stream1=extrude_z, Stream2=sdiff_3, Stream3=merge_46)  # disabled

# ---- group: Fx | F L O O R / O | GEO | Final Geo Selection / F || FOUNDATION GEO SELECTION
expression_55 = Expression(x=panel_212, Expression="If(x = 0, 0, 1)")
merge_48 = Merge(Data1=filter_27, Data2=frame_20)
support = StreamFilter(Gate=expression_55, Stream0=filter_27, Stream1=merge_48)

# ---- group: Fx | F L O O R / fx | SCRIPT | SWITCHES / STACK | FRAME SWITCHES
toggle_112 = BooleanToggle(False)
toggle_113 = BooleanToggle(True)
toggle_114 = BooleanToggle(False)
toggle_115 = BooleanToggle(False)
toggle_116 = BooleanToggle(False)
toggle_117 = BooleanToggle(False)
toggle_118 = BooleanToggle(True)
toggle_119 = BooleanToggle(False)
toggle_120 = BooleanToggle(False)
toggle_121 = BooleanToggle(False)
toggle_122 = BooleanToggle(False)
toggle_123 = BooleanToggle(True)
foundation_2 = StreamFilter(Gate=panel_212, Stream0=toggle_112, Stream1=toggle_113, Stream2=toggle_114, Stream3=toggle_115)
waffle_2 = StreamFilter(Gate=panel_212, Stream0=toggle_116, Stream1=toggle_117, Stream2=toggle_118, Stream3=toggle_119)
joist_2 = StreamFilter(Gate=panel_212, Stream0=toggle_120, Stream1=toggle_121, Stream2=toggle_122, Stream3=toggle_123)
frame_21 = EnableDisableObject(
    Objects=objfromgroup_30,
    Enabled=foundation_2,
    AllObjects_Object=[edges_8, merge_25, pshift_18, join_12, type_2, merge_25, value_listener_142, offset_2, offset_3, len, len_2, sort_6, merge_24, merge_23, item_13, join_12, value_listener_142, join_12, fillet_2, fillet_2, boundary_4, value_listener_140, extrude_z, extrude_z])
frame_22 = EnableDisableObject(
    Objects=objfromgroup_37,
    Enabled=waffle_2,
    AllObjects_Object=[fillet_3, offset_8, offset_9, len_6, len_7, sort_9, merge_43, merge_42, item_21, dispatch_28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])
frame_23 = EnableDisableObject(
    Objects=objfromgroup_36,
    Enabled=joist_2,
    AllObjects_Object=[edges_13, join_20, end_4, vec2pt, similar, item_22, dispatch_29, angle_2, X, angle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])

# ---- group: Fx | F L O O R / fx | SCRIPT | TILE / F || Split IRREGULARinto PATTERN Shape RESPONSIVELY
edges_14 = BrepEdges(Brep=top_2)  # -> Naked, Interior, NonManifold; disabled
extrude_z_4 = ExtrudeZ(B=top_2, height=value_listener_75.Values, closed_cap=1)  # -> simplify(extruded_brep); disabled
Z_18 = UnitZ(Factor=expr("x/2", value_listener_75.Values))  # disabled
lng_26 = ListLength(List=flatten(top_2))  # disabled
expression_56 = Expression(x=lng_26, Expression="if (x = 1,1,0)")  # disabled

# ---- group: Fx | F L O O R / fx | SCRIPT | TILE (continued)
join_23 = JoinCurves(Curves=edges_14.Naked, Preserve=False)  # disabled

# ---- group: Fx | R A I L I N G / F || HORIZONTAL ELEMENTS / fx | SCRIPT | Create Extrusion
typeindex_14 = StreamFilter(Gate=panel_432, Stream0=crv_type_4, Stream2=crv_type, Stream3=crv_type_4, Stream4=crv_type_4)
graft_18 = GraftTree(Tree=flatten(typeindex_14), IncludeEmptyLists=True, IncludeNullItems=True)
graft_19 = GraftTree(Tree=flatten(crv_type_3), IncludeEmptyLists=True, IncludeNullItems=True)
offcrv_7 = OffsetCurve(
    Curve=graft_18,
    Plane=PlaneXY(0, 0, 0),
    Distance=expr("x/2", value_listener_62.Values),
    BothSides=True,
    Kinks=0,
    CapType=1)
offcrv_8 = OffsetCurve(
    Curve=graft_19,
    Plane=PlaneXY(0, 0, 0),
    Distance=expr("x/2", value_listener_62.Values),
    BothSides=True,
    Kinks=0,
    CapType=1)
merge_49 = Merge(Data1=offcrv_7, Data2=offcrv_8)
closed_13 = BooleanToggle(False)
adj_13 = BooleanToggle(True)
list_8 = ValueList({"Normal": 0, "Loose": 1, "Tight": 2, "Straight": 3, "Unifrom": 4}, selected="Straight")
closed_14 = BooleanToggle(False)
adj_14 = BooleanToggle(True)
list_9 = ValueList({"Normal": 0, "Loose": 1, "Tight": 2, "Straight": 3, "Unifrom": 4}, selected="Straight")
loft_19 = Loft(C=merge_49, cls=closed_14, adj=adj_14, T=list_9)

# ----
offcrv_9 = OffsetCurve(
    Curve=graft_18,
    Plane=PlaneXY(0, 0, 0),
    Distance=expr("x/2", value_listener_62.Values),
    BothSides=True,
    Kinks=0,
    CapType=0)
offcrv_10 = OffsetCurve(
    Curve=graft_19,
    Plane=PlaneXY(0, 0, 0),
    Distance=expr("x/2", value_listener_62.Values),
    BothSides=True,
    Kinks=0,
    CapType=0)
merge_50 = Merge(Data1=offcrv_9, Data2=offcrv_10)
dispatch_30 = Dispatch(List=merge_50, DispatchPattern=[True, False])  # -> ListA, ListB

# ---- group: Fx | R A I L I N G / F || HORIZONTAL ELEMENTS / fx | SCRIPT | Create Extrusion (continued)
partition_6 = PartitionList(List=merge_50, Size=2)
loft_20 = Loft(C=partition_6, cls=closed_13, adj=adj_13, T=list_8)
merge_51 = Merge(Data1=simplify(loft_19), Data2=simplify(loft_20))
join_24 = BrepJoin(Breps=merge_51)  # -> Breps, Closed

# ---- group: Fx | R A I L I N G / fx | OUTPUT | R A I L I NG / O | GEO | R A I L I NG
glass_6 = Merge(Data1=cap_6, Data2=join_24.Breps, Data3=cap_7)  # -> flatten(Result)
solid_3 = Merge(Data1=join_24.Breps)  # -> flatten(Result)
steel_4 = Merge(Data1=cap_6, Data2=cap_7, Data3=beamrec)  # -> flatten(Result)
glass2_2 = Merge(Data1=cap_6, Data2=sdiff_2, Data3=cap_7)  # -> flatten(Result)
cable_3 = Merge(Data1=cap_6, Data2=pipe_2, Data3=cap_7)  # -> flatten(Result)
typeindex_15 = StreamFilter(Gate=panel_432, Stream0=solid_3, Stream1=steel_4, Stream2=glass_6, Stream3=glass2_2, Stream4=cable_3)
glass_7 = Group(Objects=flatten(typeindex_13))
rail_2 = Group(Objects=flatten(typeindex_15))

# ---- group: Fx | R A I L I N G / fx | OUTPUT | R A I L I NG / O | NOAH | R A I L I NG / GEO | RAIL
geometry_7 = Geometry(flatten(rail_2))  # disabled
panel_470 = Panel("SOLID")  # disabled
panel_471 = Panel("BRICK")  # disabled
panel_472 = Panel("CURTAIN")  # disabled
type_4 = Weave(Pattern=panel_163, Stream0=panel_470, Stream1=panel_471, Stream2=panel_472, NullGaps=False)  # disabled
panel_473 = Panel("WALL:: ")  # disabled
panel_474 = Panel(" WALL")  # disabled
layer = Merge(Data1=panel_473, Data2=type_4, Data3=panel_474)  # disabled
object = Merge(Data1=type_4, Data2=panel_474)  # disabled
join_25 = TextJoin(Text=layer)  # disabled
join_26 = TextJoin(Text=object)  # disabled
bake_7 = Bake(bake=panel_275, geometry=geometry_7, color=value_listener_199.Values)  # disabled
preview_7 = CustomPreview(Geometry=geometry_7, Material=value_listener_145.Values)  # disabled

# ---- group: Fx | R A I L I N G / fx | OUTPUT | R A I L I NG / O | NOAH | R A I L I NG / GEO | GLASS
panel_475 = Panel("GLASS")  # disabled
geometry_8 = Geometry(flatten(glass_7))  # disabled
toggle_124 = BooleanToggle(False)  # disabled
toggle_125 = BooleanToggle(False)  # disabled
toggle_126 = BooleanToggle(True)  # disabled
toggle_127 = BooleanToggle(True)  # disabled
toggle_128 = BooleanToggle(False)  # disabled
panel_476 = Panel("WALL:: ")  # disabled
panel_477 = Panel(" WALL")  # disabled
layer_2 = Merge(Data1=panel_476, Data2=panel_475, Data3=panel_477)  # disabled
object_2 = Merge(Data1=panel_475, Data2=panel_477)  # disabled
rail_3 = StreamFilter(Gate=panel_432, Stream0=toggle_124, Stream1=toggle_125, Stream2=toggle_126, Stream3=toggle_127, Stream4=toggle_128)  # disabled
join_27 = TextJoin(Text=layer_2)  # disabled
join_28 = TextJoin(Text=object_2)  # disabled
and_2 = GateAnd(A=value_listener_188.Values, B=rail_3)  # disabled
bake_8 = Bake(bake=panel_275, geometry=geometry_8, color=value_listener_196.Values)  # disabled
onoff_4 = EnableDisableObject(Enabled=and_2, AllObjects_Object=preview_8)
preview_8 = CustomPreview(Geometry=geometry_8, Material=value_listener_146.Values)  # disabled

# ---- group: Fx | F L O O R / fx | SCRIPT | TILE / F || Split IRREGULARinto PATTERN Shape RESPONSIVELY (continued)
srfsplit_5 = SurfaceSplit(Surface=filter_30, Curves=join_23)  # disabled
pshift_29 = ShiftPaths(Data=srfsplit_5, Offset=-1)  # -> simplify(Data); disabled

# ---- group: Fx | F L O O R / fx | SCRIPT | TILE / F || Split IRREGULARinto PATTERN Shape RESPONSIVELY / F || Offset and Extrude (FOR INCLUSION TESTING)
offset_12 = OffsetCurve(Curve=pshift_29, Distance=expr("-x/2", value_listener_76.Values), Plane=PlaneXY(0, 0, 0), Corners=1)  # disabled
offset_13 = OffsetCurve(Curve=pshift_29, Distance=expr("x/2", value_listener_76.Values), Plane=PlaneXY(0, 0, 0), Corners=1)  # disabled
len_10 = Length(Curve=offset_12)  # disabled
len_11 = Length(Curve=offset_13)  # disabled
merge_52 = Merge(Data1=offset_12, Data2=offset_13)  # disabled
merge_53 = Merge(Data1=len_10, Data2=len_11)  # disabled
lng_27 = ListLength(List=flatten(top_2))  # disabled
sort_11 = SortList(Keys=merge_53, ValuesA=merge_52)  # -> Keys, ValuesA; disabled
item_24 = ListItem(List=sort_11.ValuesA, Index=0, Wrap=True)  # -> simplify(Item); disabled
expression_57 = Expression(x=lng_27, Expression="If(x = 1, 0, 1)")  # disabled
explode_5 = Explode(Curve=item_24, Recursive=True)  # -> Segments, Vertices; disabled
item_25 = ListItem(List=explode_5.Vertices, Index=0, Wrap=True)  # -> simplify(Item); disabled
pshift_30 = ShiftPaths(Data=item_25, Offset=-1)  # disabled
filter_34 = StreamFilter(Gate=expression_57, Stream0=item_25, Stream1=pshift_30)  # disabled

# ---- group: Fx | F L O O R / fx | SCRIPT | TILE / F || Split IRREGULARinto PATTERN Shape RESPONSIVELY (continued)
move_8 = Move(Geometry=filter_34, Motion=Z_18)  # -> simplify(Geometry), Transform; disabled
brepinc_3 = PointInBrep(Brep=extrude_z_4, Point=move_8.Geometry, Strict=False)  # disabled
branch_2 = StreamFilter(Gate=expression_56, Stream0=brepinc_3, Stream1=flatten(brepinc_3))  # disabled
dispatch_31 = Dispatch(List=simplify(pshift_29), DispatchPattern=simplify(branch_2))  # -> ListA, ListB; disabled

# ---- group: Fx | F L O O R / fx | SCRIPT | TILE / F || Offset and Extrude
offset_14 = OffsetCurve(Curve=dispatch_31.ListA, Distance=expr("-x/2", value_listener_75.Values), Plane=PlaneXY(0, 0, 0), Corners=1)  # disabled
offset_15 = OffsetCurve(Curve=dispatch_31.ListA, Distance=expr("x/2", value_listener_75.Values), Plane=PlaneXY(0, 0, 0), Corners=1)  # disabled
len_12 = Length(Curve=offset_14)  # disabled
len_13 = Length(Curve=offset_15)  # disabled
merge_54 = Merge(Data1=offset_14, Data2=offset_15)  # disabled
merge_55 = Merge(Data1=len_12, Data2=len_13)  # disabled
sort_12 = SortList(Keys=merge_55, ValuesA=merge_54)  # -> Keys, ValuesA; disabled
expression_58 = Expression(x=value_listener_75.Values, Expression="If(x = 0, 0, 1)")  # disabled
item_26 = ListItem(List=sort_12.ValuesA, Index=0, Wrap=True)  # -> simplify(Item); disabled
filter_35 = StreamFilter(Gate=expression_58, Stream0=dispatch_31.ListB, Stream1=item_26)  # disabled
boundary_6 = BoundarySurfaces(Edges=filter_35)  # disabled

# ---- group: Fx | F L O O R / fx | SCRIPT | TILE / O | GEO | TILE
offsrf_16 = OffsetSurface(Surface=boundary_6, Distance=value_listener_75.Values, BothSides=True, CreateSolid=True)  # -> flatten(Offset); disabled
expression_59 = Expression(x=value_listener_75.Values, Expression="If(x = 0, 0, 1)")  # disabled
filter_36 = StreamFilter(Gate=expression_59, Stream0=flatten(boundary_6), Stream1=offsrf_16)  # disabled
group_7 = Group(Objects=filter_36)  # disabled

# ---- group: Fx | F L O O R / O | GEO | Final Geo Selection / F || SOLID/ SRF SELECTION
expression_60 = Expression(x=value_listener_75.Values, Expression="If(x = 0, 0, 1)")
merge_56 = Merge(Data1=support, Data2=group_7)
pattern = StreamFilter(Gate=expression_60, Stream0=filter_30, Stream1=merge_56)

# ---- group: Fx | F L O O R / fx | OUTPUT | W A L L / O | NOAH | F L O O R / SOLID GEO
geometry_9 = Geometry(flatten(pattern))  # disabled
preview_9 = CustomPreview(Geometry=geometry_9, Material=value_listener_149.Values)  # disabled
bake_9 = Bake(bake=panel_281, geometry=geometry_9, color=value_listener_149.Values)  # disabled

# ---- group: Fx | S T A I R
replace = ReplaceItems(List=crv_cp_6.Parameter, Item=0, Indices=0, Wrap=False)

# ---- group: Fx | S T A I R / fx | SCRIPT | CREATE BASE CRV GEO / F || Long / F || PARAMETER (t) LONG
lng_28 = ListLength(List=replace)
item_27 = ListItem(List=dividecrv_6.value_t, Index=expr("x-1", lng_28), Wrap=True)
ins_2 = InsertItems(List=replace, Item=1, Indices=lng_28, Wrap=True)  # -> simplify(List)
expression_61 = Expression(x=item_27, Expression="if (x = 1, 1, 0)")
filter_37 = StreamFilter(Gate=expression_61, Stream0=ins_2, Stream1=ins_2)

# ---- group: Fx | S T A I R (continued)
replace_2 = ReplaceItems(List=replace, Item=1, Indices=expr("x-1", lng_28), Wrap=False)
filter_38 = StreamFilter(Gate=expression_61, Stream0=replace, Stream1=replace_2)

# ---- group: Fx | S T A I R / fx | SCRIPT | CREATE BASE CRV GEO / F || Short / F || PARAMETER (t) SHORT
lng_29 = ListLength(List=dividecrv_6.value_t)
ins_3 = InsertItems(List=dividecrv_6.value_t, Item=1, Indices=lng_29, Wrap=True)  # -> simplify(List)
item_28 = ListItem(List=dividecrv_6.value_t, Index=expr("x-1", lng_28), Wrap=True)
expression_62 = Expression(x=item_28, Expression="if (x = 1, 0, 1)")
filter_39 = StreamFilter(Gate=expression_62, Stream0=dividecrv_6.value_t, Stream1=ins_3)
filter_40 = StreamFilter(Gate=panel_420, Stream0=filter_39, Stream1=dividecrv_6.value_t)  # -> simplify(Stream)

# ---- group: Fx | S T A I R / fx | SCRIPT | CREATE BASE CRV GEO / F || Long / F || PARAMETER (t) LONG (continued)
filter_41 = StreamFilter(Gate=panel_420, Stream0=filter_37, Stream1=filter_38)  # -> simplify(Stream)

# ---- group: Fx | S T A I R / fx | SCRIPT | CREATE BASE CRV GEO / F || Short
shatter_4 = Shatter(Curve=short, Parameters=filter_40)
eval_2 = EvaluateCurve(Curve=short, Parameter=filter_40)  # -> Point, Tangent, Angle
segments = Curve(shatter_4)

# ---- group: Fx | S T A I R / fx | SCRIPT | CREATE BASE CRV GEO / F || Long
shatter_5 = Shatter(Curve=long, Parameters=filter_41)
eval_3 = EvaluateCurve(Curve=long, Parameter=filter_41)  # -> Point, Tangent, Angle
segments_2 = Curve(shatter_5)

# ---- group: Fx | S T A I R / fx | SCRIPT | CREATE BASE CRV GEO / F || LINE
ln_9 = Line(StartPoint=eval_2.Point, EndPoint=eval_3.Point)
line_4 = Curve(ln_9)

# ---- group: Fx | S T A I R / fx | SCRIPT | CREATE BASE CRV GEO / F || EXTENDED LINE
number_slider_18 = Slider(100, range=0..100)
ext = ExtendCurve(Curve=line_4, Type=0, Start=number_slider_18, End=number_slider_18)
cull_i = CullIndex(List=ext, Indices=0, Wrap=True)

# ---- group: Fx | S T A I R / fx | SCRIPT | MOVE STEPS IN Z DIRECTION / F || MOVE LONG / F || TRANSFORMATION VECTOR
pshift_31 = ShiftPaths(Data=segments_2, Offset=-1)
tstat_3 = TreeStatistics(Tree=segments_2)  # -> Paths, Length, Count
lng_30 = ListLength(List=pshift_31)
repeat_4 = RepeatData(Data=value_listener_181.Values, Length=tstat_3.Count)  # -> graft(Data)
division_10 = Division(A=value_listener_182.Values, B=lng_30)
filter_42 = StreamFilter(Gate=panel_422, Stream0=repeat_4, Stream1=division_10)
series_6 = Series(Start=filter_42, Step=filter_42, Count=lng_30)
Z_19 = UnitZ(Factor=series_6)

# ---- group: Fx | S T A I R / fx | SCRIPT | MOVE STEPS IN Z DIRECTION / F || MOVE SHORT / F || TRANSFORMATION VECTOR
pshift_32 = ShiftPaths(Data=segments, Offset=-1)
tstat_4 = TreeStatistics(Tree=segments)  # -> Paths, Length, Count
lng_31 = ListLength(List=pshift_32)
repeat_5 = RepeatData(Data=value_listener_181.Values, Length=tstat_4.Count)  # -> graft(Data)
division_11 = Division(A=value_listener_182.Values, B=lng_31)
filter_43 = StreamFilter(Gate=panel_422, Stream0=repeat_5, Stream1=division_11)
series_7 = Series(Start=filter_43, Step=filter_43, Count=lng_31)
Z_20 = UnitZ(Factor=series_7)

# ---- group: Fx | S T A I R / fx | SCRIPT | MOVE STEPS IN Z DIRECTION / F || MOVE EXTENED LINES / F || TRANSFORMATION VECTOR
pshift_33 = ShiftPaths(Data=cull_i, Offset=-1)
tstat_5 = TreeStatistics(Tree=cull_i)  # -> Paths, Length, Count
lng_32 = ListLength(List=pshift_33)
repeat_6 = RepeatData(Data=value_listener_181.Values, Length=tstat_5.Count)  # -> graft(Data)
division_12 = Division(A=value_listener_182.Values, B=lng_32)
filter_44 = StreamFilter(Gate=panel_422, Stream0=repeat_6, Stream1=division_12)
series_8 = Series(Start=0, Step=filter_44, Count=lng_32)
Z_21 = UnitZ(Factor=series_8)

# ---- group: Fx | S T A I R / fx | SCRIPT | MOVE STEPS IN Z DIRECTION / F || MOVE LINES / F || TRANSFORMATION VECTOR
tstat_6 = TreeStatistics(Tree=line_4)  # -> Paths, Length, Count
repeat_7 = RepeatData(Data=value_listener_181.Values, Length=tstat_6.Count)  # -> graft(Data)
division_13 = Division(A=value_listener_182.Values, B=lng_32)
lng_33 = ListLength(List=line_4)
filter_45 = StreamFilter(Gate=panel_422, Stream0=repeat_7, Stream1=division_13)
series_9 = Series(Start=filter_45, Step=filter_45, Count=lng_33)
lng_34 = ListLength(List=series_9)
item_29 = ListItem(List=series_9, Index=expr("x-2", lng_34), Wrap=True)
replace_3 = ReplaceItems(List=series_9, Item=item_29, Indices=expr("x-1", lng_34), Wrap=False)
Z_22 = UnitZ(Factor=replace_3)

# ---- group: Fx | S T A I R / fx | SCRIPT | MOVE STEPS IN Z DIRECTION / F || MOVE LONG
simplify_2 = SimplifyTree(Tree=segments_2, Front=False)
simplify_3 = SimplifyTree(Tree=Z_19, Front=False)
move_9 = Move(Geometry=simplify_2, Motion=simplify_3)  # -> Geometry, Transform

# ---- group: Fx | S T A I R / fx | SCRIPT | MOVE STEPS IN Z DIRECTION / F || MOVE SHORT
simplify_4 = SimplifyTree(Tree=segments, Front=False)
simplify_5 = SimplifyTree(Tree=Z_20, Front=False)
move_10 = Move(Geometry=simplify_4, Motion=simplify_5)  # -> Geometry, Transform

# ---- group: Fx | S T A I R / fx | SCRIPT | MOVE STEPS IN Z DIRECTION / F || MOVE EXTENED LINES
simplify_6 = SimplifyTree(Tree=cull_i, Front=False)
simplify_7 = SimplifyTree(Tree=Z_21, Front=False)
move_11 = Move(Geometry=simplify_6, Motion=simplify_7)  # -> Geometry, Transform

# ---- group: Fx | S T A I R / fx | SCRIPT | MOVE STEPS IN Z DIRECTION / F || MOVE LINES
simplify_8 = SimplifyTree(Tree=line_4, Front=False)
simplify_9 = SimplifyTree(Tree=Z_22, Front=False)
move_12 = Move(Geometry=simplify_8, Motion=simplify_9)  # -> Geometry, Transform

# ---- group: Fx | S T A I R / fx | SCRIPT | Create STRINGER GEO / F || Extrude and Split Stringer Geo / F || Extrusion
sort_13 = SortList(Keys=replace_3)  # -> reverse(Keys), ValuesA; disabled
Z_23 = UnitZ(Factor=expr("-x", sort_13.Keys))  # disabled
item_30 = ListItem(List=sort_13.Keys, Index=0, Wrap=True)  # disabled
move_13 = Move(Geometry=twn2crvs, Motion=Z_23)  # -> Geometry, Transform; disabled
extrude_z_5 = ExtrudeZ(B=move_13.Geometry, height=expr("3*x", item_30), closed_cap=0)  # -> simplify(extruded_brep); disabled

# ---- group: Fx | S T A I R / fx | SCRIPT | SOLID STAIR / F || Create Belly Geo / F || BELLY FIRST STEP GEO
item_31 = ListItem(List=segments, Index=0, Wrap=True)
item_32 = ListItem(List=segments_2, Index=0, Wrap=True)
rulesrf = RuledSurface(CurveA=item_31, CurveB=item_32)  # -> simplify(flatten(Surface))

# ---- group: Fx | S T A I R / fx | SCRIPT | SOLID STAIR / F || Create Belly Geo
closed_15 = BooleanToggle(False)
adj_15 = BooleanToggle(False)
list_10 = ValueList({"Normal": 0, "Loose": 1, "Tight": 2, "Straight": 3, "Unifrom": 4}, selected="Loose")
loft_21 = Loft(C=move_11.Geometry, cls=closed_15, adj=adj_15, T=list_10)  # -> simplify(flatten(L))
graft_20 = GraftTree(Tree=loft_21, IncludeEmptyLists=True, IncludeNullItems=True)
graft_21 = GraftTree(Tree=rulesrf, IncludeEmptyLists=True, IncludeNullItems=True)
merge_57 = Merge(Data1=simplify(graft_20), Data2=simplify(graft_21))
join_29 = BrepJoin(Breps=merge_57)  # -> Breps, Closed

# ---- group: Fx | S T A I R / fx | SCRIPT | SOLID STAIR / F || CREATE RISE GEO
extrude_z_6 = ExtrudeZ(B=move_12.Geometry, height=expr("-x", filter_45), closed_cap=0)
offsrf_17 = OffsetSurface(Surface=extrude_z_6, Distance=expr("x/2", value_listener_180.Values), BothSides=True, CreateSolid=True)

# ---- group: Fx | S T A I R / F || TREAD COVER GEO
panel_478 = Panel("0")  # disabled
ext_2 = ExtendCurve(Curve=move_10.Geometry, Type=2, Start=value_listener_119.Values, End=panel_478)  # disabled
ext_3 = ExtendCurve(Curve=move_9.Geometry, Type=2, Start=value_listener_119.Values, End=panel_478)  # disabled
rulesrf_2 = RuledSurface(CurveA=ext_2, CurveB=ext_3)  # disabled
objfromgroup_38 = GetObjectsInGroup()
extrude_z_7 = ExtrudeZ(B=rulesrf_2, height=value_listener_120.Values, closed_cap=1)  # disabled

# ---- group: fx | SCRIPT | SWITCHES / STACK | FRAME SWITCHES
toggle_129 = BooleanToggle(True)
toggle_130 = BooleanToggle(False)
toggle_131 = BooleanToggle(True)
toggle_132 = BooleanToggle(False)
tread = StreamFilter(Gate=panel_439, Stream0=toggle_129, Stream1=toggle_130)
stringer = StreamFilter(Gate=value_listener_192.Values, Stream0=toggle_131, Stream1=toggle_132)
frame_24 = EnableDisableObject(
    Objects=objfromgroup_38,
    Enabled=tread,
    AllObjects_Object=[ext_2, ext_3, value_listener_119, rulesrf_2, extrude_z_7, panel_478])
frame_25 = EnableDisableObject(
    Objects=objfromgroup_10,
    Enabled=stringer,
    AllObjects_Object=[value_listener_115, dispatch_26, twn2crvs, range_2, offsrf_18, extrude_z_5, merge_27, short, long, neg_12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])

# ---- group: Fx | S T A I R / fx | SCRIPT | Create STRINGER GEO / F || Extrude and Split Stringer Geo / F || Cutter Geo / F || Branch Management
lng_35 = ListLength(List=geo)  # disabled
lng_36 = ListLength(List=geo)  # disabled
expression_63 = Expression(x=lng_35, Expression="if (x ≤ 2,0,1)")  # disabled
expression_64 = Expression(x=lng_36, Expression="if (x ≤ 4,0,1)")  # disabled

# ---- group: Fx | S T A I R / fx | SCRIPT | SOLID STAIR / F || STRINGER BASE GEO / F || STRINGER BASE SIDE | SHORT
extrude_z_8 = ExtrudeZ(B=move_10.Geometry, height=expr("-2.6*x", filter_43), closed_cap=0)
join_30 = BrepJoin(Breps=extrude_z_8)  # -> simplify(flatten(Breps)), Closed

# ---- group: Fx | S T A I R / fx | SCRIPT | SOLID STAIR / F || STRINGER BASE GEO / F || STRINGER BASE SIDE | LONG
extrude_z_9 = ExtrudeZ(B=move_9.Geometry, height=expr("-2.6*x", filter_42), closed_cap=0)
join_31 = BrepJoin(Breps=extrude_z_9)  # -> simplify(flatten(Breps)), Closed

# ---- group: Fx | S T A I R / fx | SCRIPT | SOLID STAIR / F || STRINGER BASE GEO
graft_22 = GraftTree(Tree=join_30.Breps, IncludeEmptyLists=True, IncludeNullItems=True)
graft_23 = GraftTree(Tree=join_31.Breps, IncludeEmptyLists=True, IncludeNullItems=True)

# ---- group: Fx | S T A I R / fx | SCRIPT | SOLID STAIR / F || Create Belly Geo / F || TRIM GEO
merge_58 = Merge(Data1=graft_22, Data2=graft_23)  # -> flatten(Result)
splitmul = SplitBrepMultiple(Brep=join_29.Breps, Cutters=merge_58)
area_10 = Area(Geometry=splitmul)  # -> Area, Centroid
sort_14 = SortList(Keys=area_10.Area, ValuesA=splitmul)  # -> Keys, ValuesA
item_33 = ListItem(List=sort_14.ValuesA, Index=0, Wrap=True)

# ---- group: Fx | S T A I R / fx | SCRIPT | SOLID STAIR / F || STRINGER BASE GEO / F || STRINGER BASE SIDE | SHORT (continued)
split = SplitBrep(Brep=graft_22, Cutter=join_29.Breps)
area_11 = Area(Geometry=split)  # -> Area, Centroid
pdecon_6 = Deconstruct(Point=area_11.Centroid)  # -> XComponent, YComponent, ZComponent
sort_15 = SortList(Keys=pdecon_6.ZComponent, ValuesA=split)  # -> Keys, reverse(ValuesA)
item_34 = ListItem(List=sort_15.ValuesA, Index=0, Wrap=True)

# ---- group: Fx | S T A I R / fx | SCRIPT | SOLID STAIR / F || STRINGER BASE GEO / F || STRINGER BASE SIDE | LONG (continued)
split_2 = SplitBrep(Brep=graft_23, Cutter=join_29.Breps)
area_12 = Area(Geometry=split_2)  # -> Area, Centroid

# ---- group: Fx | S T A I R / fx | SCRIPT | SOLID STAIR / F || STRINGER BASE GEO / F || STRINGER BASE SIDE | SHORT (continued)
pdecon_7 = Deconstruct(Point=area_12.Centroid)  # -> XComponent, YComponent, ZComponent

# ---- group: Fx | S T A I R / fx | SCRIPT | SOLID STAIR / F || STRINGER BASE GEO / F || STRINGER BASE SIDE | LONG (continued)
sort_16 = SortList(Keys=pdecon_7.ZComponent, ValuesA=split_2)  # -> Keys, reverse(ValuesA)
item_35 = ListItem(List=sort_16.ValuesA, Index=0, Wrap=True)

# ---- group: Fx | S T A I R / O | GEO | SOLID
rulesrf_3 = RuledSurface(CurveA=move_10.Geometry, CurveB=move_9.Geometry)
merge_59 = Merge(Data1=rulesrf_3, Data2=item_34, Data3=item_35, Data4=item_33, Data5=extrude_z_6)
join_32 = BrepJoin(Breps=flatten(merge_59))  # -> Breps, Closed

# ---- group: Fx | S T A I R / fx | SCRIPT | Create STRINGER GEO / F || Extrude and Split Stringer Geo / F || Cutter Geo
merge_60 = Merge(Data1=simplify(item_33), Data2=simplify(rulesrf_3), Data3=simplify(extrude_z_6))  # disabled

# ---- group: Fx | S T A I R / fx | SCRIPT | Create STRINGER GEO / F || Extrude and Split Stringer Geo / F || Cutter Geo / F || Branch Management (continued)
flatten_3 = FlattenTree(Tree=merge_60, Path="{0}")  # disabled
flatten_4 = FlattenTree(Tree=merge_60, Path="{0}")  # disabled
single_multiple = StreamFilter(Gate=expression_63, Stream0=flatten_3, Stream1=merge_60)  # disabled
single_multiple_2 = StreamFilter(Gate=expression_64, Stream0=flatten_4, Stream1=merge_60)  # disabled
single_double_crv = StreamFilter(Gate=panel_421, Stream0=flatten_3, Stream1=single_multiple_2)  # disabled

# ---- group: Fx | S T A I R / fx | SCRIPT | Create STRINGER GEO / F || Extrude and Split Stringer Geo / F || Cutter Geo (continued)
join_33 = BrepJoin(Breps=single_double_crv)  # -> simplify(Breps), Closed; disabled

# ---- group: Fx | S T A I R / fx | SCRIPT | Create STRINGER GEO / F || Extrude and Split Stringer Geo
splitmul_2 = SplitBrepMultiple(Brep=extrude_z_5, Cutters=join_33.Breps)  # disabled

# ---- group: Fx | S T A I R / fx | SCRIPT | Create STRINGER GEO / F || Extrude and Split Stringer Geo / F || Sort And Offset Stringer Geo
area_13 = Area(Geometry=splitmul_2)  # -> Area, Centroid; disabled
extrude_z_10 = ExtrudeZ(B=dispatch_25.ListA, height=expr("2*x", item_30), closed_cap=0)  # -> simplify(extruded_brep); disabled
sort_17 = SortList(Keys=area_13.Area, ValuesA=splitmul_2)  # -> Keys, ValuesA; disabled
Z_24 = UnitZ(Factor=expr("3*x", filter_45))  # disabled
bbx = BrepBrep(BrepA=extrude_z_10, BrepB=item_33)  # -> Curves, Points; disabled
expression_65 = Expression(x=value_listener_115.Values, Expression="if (x = 0, 0, 1)")  # disabled
item_36 = ListItem(List=sort_17.ValuesA, Index=0, Wrap=True)  # disabled
extr_6 = Extrude(Base=bbx.Curves, Direction=Z_24)  # disabled
filter_46 = StreamFilter(Gate=expression_65, Stream0=extr_6, Stream1=item_36)  # disabled
offsrf_18 = OffsetSurface(Surface=filter_46, Distance=division_5, BothSides=True, CreateSolid=True)  # disabled

# ---- group: Fx | S T A I R / O | GEO | FINAL GEO
stringergeoindex = StreamFilter(Gate=value_listener_192.Values, Stream0=offsrf_18, Stream1=join_32.Breps)
treadindex = StreamFilter(Gate=panel_439, Stream0=extrude_z_7)
treadindex_2 = StreamFilter(Gate=value_listener_185.Values, Stream1=offsrf_17)
group_8 = Group(Objects=flatten(stringergeoindex))
group_9 = Group(Objects=flatten(treadindex))
group_10 = Group(Objects=flatten(treadindex_2))
all_geo = Merge(Data1=group_8, Data2=group_9, Data3=group_10)

# ---- group: Fx | S T A I R / fx | OUTPUT | S T A I R S / O | NOAH | S T A I R S
geometry_10 = Geometry(flatten(all_geo))  # disabled
bake_10 = Bake(bake=panel_287, geometry=geometry_10, color=value_listener_152.Values)  # disabled
objfromgroup_39 = GetObjectsInGroup()
preview_10 = CustomPreview(Geometry=geometry_10, Material=value_listener_152.Values)  # disabled

# ---- group: fx | SCRIPT | SWITCHES / STACK | MAIN SWITCHES
toggle_133 = BooleanToggle(False)
toggle_134 = BooleanToggle(True)
typeindex_16 = StreamFilter(Gate=value_listener_186.Values, Stream0=toggle_133, Stream1=toggle_134)
solver_7 = EnableDisableObject(
    Objects=[objfromgroup_39, objfromgroup_6],
    Enabled=typeindex_16,
    AllObjects_Object=[preview_10, geometry_10, panel_287, bake_10, value_listener_152, boolean_toggle_9, boolean_toggle_8, select_geo_6, geo])

# ---- group: Fx | S T A I R / fx | OUTPUT | S T A I R S
# EXTRA CODE: OUTPUT
output_geo_4 = Geometry(flatten(geometry_10))

# ==== cluster Placeholder
label = CreateLabel(LabelSize=12, Justification=0)
L = ClusterOutput(label)

# ==== cluster CreateGrid
column_1 = ClusterInput()  # Column 1
column_2 = ClusterInput()  # Column 2
height_of_menu = ClusterInput()  # Height of Menu
lng = ListLength(List=column_1)
lng_2 = ListLength(List=column_2)
series = Series(Start=0, Step=1, Count=lng)
series_2 = Series(Start=0, Step=1, Count=lng_2)
expression = Expression(x=height_of_menu, Expression="(0.35*x)/3")
expression_2 = Expression(x=height_of_menu, Expression="(2.1*x)/3")
expression_3 = Expression(x=height_of_menu, Expression="(0.8*x)/3")
element = Weave(Pattern=[0, 1], Stream0=column_1, Stream1=column_2, NullGaps=False)
row = Weave(Pattern=[0, 1], Stream0=series, Stream1=series_2, NullGaps=False)
addition = Addition(A=lng, B=lng_2)
max = Maximum(A=lng, B=lng_2)
expression_4 = Expression(x=height_of_menu, Expression="(2.96*x)/3")
series_3 = Series(Start=0, Step=1, Count=2)
row_def = RepeatData(Data=expression, Length=addition)
column_def = Merge(Data1=expression_2, Data2=expression_3)
height = Multiplication(A=max, B=expression)
column = RepeatData(Data=series_3, Length=addition)
elements = ClusterOutput(element)  # Elements of UI
width_of_grid = ClusterOutput(expression_4)  # Width of Grid
height_2 = ClusterOutput(height)  # Height
row_def_2 = ClusterOutput(row_def)  # Row Def
columan_def = ClusterOutput(column_def)  # Columan Def
element_row = ClusterOutput(row)  # Element Row
element_column = ClusterOutput(column)  # Element Column
total_list_length = ClusterOutput(addition)  # Total List Length of the Elements

# ==== cluster SolidWallI
height = ClusterInput()  # Height of Wall
base_crv = ClusterInput()  # Base Crv for Extrusion
Z = UnitZ(Factor=height)
extr = Extrude(Base=simplify(base_crv), Direction=simplify(Z))
panel = Panel(extr)
panel_2 = Panel(base_crv)
cap = CapHoles(Brep=extr)
wall = ClusterOutput(cap)  # Result Brep of Walls
panel_3 = Panel(cap)

# ==== cluster BrickWall
surface_input = ClusterInput()  # Input Surface
count = ClusterInput()  # Count of Brick Per Line
brick_length = ClusterInput()  # Brick Length (x)
brick_width = ClusterInput()  # Brick Width (y)
brick_height = ClusterInput()  # Brick Height (z)

# ---- group: Find Buttom Point
bbox = BoundingBox(Content=surface_input, Plane=PlaneXY(0, 0, 0))  # -> Box, Box_2
box = EvaluateBox(Box=bbox.Box, UParameter=0, VParameter=0, WParameter=0)  # -> Plane, Point, Include

# ----
unit_z = UnitZ(Factor=1)
contour = Contour(Shape=surface_input, Point=box.Plane, Direction=unit_z, Distance=brick_height)  # -> flatten(Contours)

# ---- group: Create Target Planes
dispatch = Dispatch(List=contour, DispatchPattern=[True, False])  # -> ListA, ListB
horizontal_frames = HorizontalFrames(Curve=dispatch.ListA, Count=count)  # -> Frames, Parameters
horizontal_frames_2 = HorizontalFrames(Curve=dispatch.ListB, Count=count)  # -> Frames, Parameters
dispatch_2 = Dispatch(List=horizontal_frames.Frames, DispatchPattern=[True, False])  # -> ListA, ListB
dispatch_3 = Dispatch(List=horizontal_frames_2.Frames, DispatchPattern=[True, False])  # -> ListA, ListB
merge = Merge(Data1=dispatch_2.ListA, Data2=dispatch_3.ListB)

# ---- group: Create Brick Geo
domain_box = DomainBox(Base=PlaneXY(0, 0, 0), X=brick_length, Y=brick_width, Z=brick_height)
deconstruct_brep = DeconstructBrep(Brep=domain_box)  # -> Faces, Edges, Vertices
list_item = ListItem(List=deconstruct_brep.Faces, Index=4, Wrap=True)
area = Area(Geometry=list_item)  # -> Area, Centroid
xy_plane = XYPlane(Origin=area.Centroid)

# ----
orient = Orient(Geometry=domain_box, Source=xy_plane, Target=merge)  # -> Geometry, Transform
geometry = ClusterOutput(orient.Geometry)

# ==== cluster SolidWallII
L = ClusterInput()
panel = Panel(L)
dispatch = Dispatch(List=L, DispatchPattern=[True, False])  # -> graft(ListA), graft(ListB)
merge = Merge(Data1=dispatch.ListA, Data2=dispatch.ListB)
panel_2 = Panel(dispatch.ListA)
loft = Loft(Curves=merge, Options={Adjust=False, Closed=False, LoftEnds=0, LoftSimp=0, LoftType=0, Rebuild=10, Refit=0.01})
cap = CapHoles(Brep=loft)
panel_3 = Panel(merge)
B = ClusterOutput(cap)

# ==== cluster Bake: Cluster of Elefont Bake Options.
bake = ClusterInput()
geometry = ClusterInput()
o_name = ClusterInput()
l_name = ClusterInput()
color = ClusterInput()
define_layer = DefineLayer(Name=l_name, Color=color)
define_object_attributes = DefineObjectAttributes(Name=o_name, Layer=define_layer, Color=color)
bake_objects = BakeObjects(Geometry=geometry, Attributes=define_object_attributes, BakeName=l_name, Bake=bake)

# ==== cluster SortFlipGeo
input_index = ClusterInput()  # Input Geo type Index
input_geometry = ClusterInput()  # Input Geometry from Human UI
geo = Geometry(input_geometry)
input_geo_main = StreamGate(Stream=geo, Gate=input_index)  # -> Target0, Target1, Target2, Target3, Target4
filter_co = FilterCO(curves=input_geo_main.Target0)  # -> closed_curves, open_curves
filter_co_2 = FilterCO(curves=input_geo_main.Target1)  # -> closed_curves, open_curves
sort_geo_types = SortGeoTypes(rhobj=input_geo_main.Target2)
filter_co_3 = FilterCO(curves=input_geo_main.Target3)  # -> closed_curves, open_curves
filter_co_4 = FilterCO(curves=input_geo_main.Target4)  # -> closed_curves, open_curves
graft = GraftTree(Tree=[filter_co_3.closed_curves, filter_co.open_curves], IncludeEmptyLists=True, IncludeNullItems=True)
partition = PartitionList(List=[filter_co_4.closed_curves, filter_co_2.open_curves], Size=2)
match_crvs = MatchCrvs(crv=[partition, graft])
pshift = ShiftPaths(Data=match_crvs, Offset=-2)
final_input = Merge(Data1=pshift, Data2=sort_geo_types)
O = ClusterOutput(final_input)
panel = Panel(final_input)

# ==== cluster MatchDir
crvs = ClusterInput()
item = ListItem(List=flatten(crvs), Index=0, Wrap=True)
flip = FlipCurve(Curve=crvs, Guide=item)  # -> Curve, Flag
flipped_curves = ClusterOutput(flip.Curve)  # Curves Flipped to one direction
# ==== cluster Cluster
L = ClusterInput()
lng = ListLength(List=L)
expression = Expression(x=lng, Expression="If (x = 1, 0, 1)")
item = ListItem(List=flatten(expression), Index=0, Wrap=True)
i = ClusterOutput(item)

# ==== cluster SortCrvs
relay = ClusterInput()
item = ListItem(List=flatten(relay), Index=1, Wrap=True)
flip = FlipCurve(Curve=reparameterize(relay), Guide=item)  # -> Curve, Flag
C = ClusterOutput(flip.Curve)

# ==== cluster FindGroups
relay = ClusterInput()
T = ClusterInput()
len = TextLength(Text=relay)
fragment = TextFragment(Text=T, Start=0, Count=len)
L = ClusterInput()
tmatch = MatchText(Text=fragment, Pattern=relay, Case=True)
dispatch = Dispatch(List=L, DispatchPattern=tmatch)  # -> ListA, ListB
components = ClusterOutput(dispatch.ListA)

# ==== cluster CURTAINELEMENTS
L = ClusterInput()
typeindex = ClusterInput()
frameindex = ClusterInput()
curtain_element = ListItem(List=L, Index=0, Wrap=True)  # -> Item, Item1, Item2, Item3, Item4, Item5, Item6, Item7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
curtain_element_index = CSharpScript(typeIndex=typeindex, frameIndex=frameindex)  # -> out, i; inputs typeIndex: Int32, frameIndex: Int32
# ---------- curtain_element_index: C# ----------
    index.Clear();

    //STICKS ELEMENTS
    if (typeIndex == 2 && frameIndex == 0)
    {
      index.Add(0);
      index.Add(2);
      index.Add(3);
      index.Add(4);
      index.Add(5);
      index.Add(6);
      index.Add(8);
      index.Add(7);
      index.Add(9);
      index.Add(10);
      index.Add(11);
    }

    if (typeIndex == 2 && frameIndex == 1)
    {
      index.Add(1);
      index.Add(2);
      index.Add(3);
      index.Add(4);
      index.Add(12);
      index.Add(14);
      index.Add(13);
      index.Add(15);
      index.Add(11);
    }

    //FIANL RESULTANT DATA
    i = index;
# ---------- curtain_element_index: C# additional code ----------
  //Declare Value
  List<int> index = new List<int>();
# ---------- end curtain_element_index ----------
sorted_curtain_elements = Weave(
    Pattern=curtain_element_index.i,
    Stream0=curtain_element.Item,
    Stream1=curtain_element.Item1,
    Stream2=curtain_element.Item2,
    Stream3=curtain_element.Item3,
    Stream4=curtain_element.Item4,
    Stream5=curtain_element.Item5,
    Stream6=curtain_element.Item6,
    Stream7=curtain_element.Item7,
    Stream8=curtain_element.Item8,
    Stream9=curtain_element.Item9,
    Stream10=curtain_element.Item10,
    Stream11=curtain_element.Item11,
    Stream12=curtain_element.Item12,
    Stream13=curtain_element.Item13,
    Stream14=curtain_element.Item14,
    Stream15=curtain_element.Item15,
    NullGaps=False)
stack = CreateStack(UIElements=sorted_curtain_elements, Horizontal=False)
S = ClusterOutput(stack)

# ==== cluster COLUMN2ELEMENTSGENERATOR
inputindex = ClusterInput()
frameinput = ClusterInput()
c1length = ClusterInput()
L = ClusterInput()
element_index = CSharpScript(inputIndex=inputindex, frameInput=frameinput, c1Length=c1length)  # -> i, a, l; inputs inputIndex: Int32, frameInput: Int32, c1Length: Int32
# ---------- element_index: C# ----------
    index.Clear();

    //ALL TIME ELEMENTS
    index.Add(0);
    index.Add(1);
    index.Add(2);
    index.Add(6);
    index.Add(3);
    index.Add(4);


    //ADDITIONAL PLACEHOLDERS

    addPh = c1Length - index.Count;
    if (addPh <= 0)
    {
      addPh = 0;
    }
    else
    {
      addPh -= 1;
    }

    //FINAL RESULTANT DATA

    i = index;
    a = addPh;
    l = index.Count;
# ---------- element_index: C# additional code ----------
  //Declare Value
  List<int> index = new List<int>();
  int addPh;
# ---------- end element_index ----------
panel = Panel(element_index.i)
panel_2 = Panel(element_index.a)
item = ListItem(List=L, Index=0, Wrap=True)  # -> Item, Item1, Item2, Item3, Item4, Item5, Item6
column_1_all_elements = Weave(
    Pattern=element_index.i,
    Stream0=item.Item,
    Stream1=item.Item1,
    Stream2=item.Item2,
    Stream3=item.Item3,
    Stream4=item.Item4,
    Stream5=item.Item5,
    Stream6=item.Item6,
    NullGaps=False)
placeholders = RepeatData(Data=item.Item5, Length=element_index.a)
column_1_all_elements_final = Merge(Data1=column_1_all_elements, Data2=placeholders)
panel_3 = Panel(column_1_all_elements_final)
panel_4 = Panel(c1length)
panel_5 = Panel(element_index.l)
R = ClusterOutput(column_1_all_elements_final)

# ==== cluster COLUMN1ELEMENTSGENERATOR
all_c1_elements = ClusterInput()  # All Elements for Column 1 as list
inputindex = ClusterInput()
frameinput = ClusterInput()
element_index = CSharpScript(inputIndex=inputindex, frameInput=frameinput)  # -> i, a, l; inputs inputIndex: Int32, frameInput: Int32
# ---------- element_index: C# ----------
    index.Clear();

    //ALL TIME ELEMENTS
    index.Add(0);
    index.Add(1);
    index.Add(2);
    index.Add(3);
    index.Add(4);



    if (inputIndex == 0)
    {
      index.Add(5);
      index.Add(6);
    }


    if (inputIndex == 1)
    {
      index.Add(10);
    }


    if (inputIndex == 2)
    {
      index.Add(5);
      index.Add(6);
      index.Add(7);
      index.Add(8);
      index.Add(9);
    }


    //FIANL RESULTANT DATA
    l = index.Count;
    i = index;
# ---------- element_index: C# additional code ----------
  //Declare Value
  List<int> index = new List<int>();
# ---------- end element_index ----------
item = ListItem(List=all_c1_elements, Index=0, Wrap=True)  # -> Item, Item1, Item2, Item3, Item4, Item5, Item6, Item7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
selected_element_indexies = Panel(element_index.i)
column_1_all_elements = Weave(
    Pattern=element_index.i,
    Stream0=item.Item,
    Stream1=item.Item1,
    Stream2=item.Item2,
    Stream3=item.Item3,
    Stream4=item.Item4,
    Stream5=item.Item5,
    Stream6=item.Item6,
    Stream7=item.Item7,
    Stream8=item.Item8,
    Stream9=item.Item9,
    Stream10=item.Item10,
    NullGaps=False)
panel = Panel(column_1_all_elements)
column_1_elements = ClusterOutput(column_1_all_elements)
number_of_elements_in_column_1 = ClusterOutput(element_index.l)

# ==== cluster FRAMEELEMENTS
uvindex = ClusterInput()
frameindex = ClusterInput()
L = ClusterInput()
curtain_element = ListItem(List=L, Index=0, Wrap=True)  # -> Item, Item1, Item2, Item3, Item4, Item5, Item6, Item7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
curtain_element_index = CSharpScript(uvIndex=uvindex, frameIndex=frameindex)  # -> out, i; inputs uvIndex: Int32, frameIndex: Int32
# ---------- curtain_element_index: C# ----------
    index.Clear();

    //IMG
    index.Add(2);

    //DIVISION PARAMS
    if (frameIndex == 2)
    {
      index.Add(0);
      index.Add(1);
    }


    //FOUNDATION & WAFFLE
    if (frameIndex == 1 || frameIndex == 2)
    {
      index.Add(3);
      index.Add(4);
      if (frameIndex == 2)
      {
        index.Add(16);
      }
      index.Add(5);
    }

    //JOIST
    if (frameIndex == 3)
    {
      index.Add(6);

      index.Add(0);
      index.Add(1);

      index.Add(7);
      index.Add(8);
      index.Add(9);
      index.Add(10);

      if (uvIndex == 0)
      {
        index.Add(11);
        index.Add(12);
        index.Add(13);
        index.Add(15);

      }
    }

    //FIANL RESULTANT DATA
    i = index;
# ---------- curtain_element_index: C# additional code ----------
  //Declare Value
  List<int> index = new List<int>();
# ---------- end curtain_element_index ----------
sorted_curtain_elements = Weave(
    Pattern=curtain_element_index.i,
    Stream0=curtain_element.Item,
    Stream1=curtain_element.Item1,
    Stream2=curtain_element.Item2,
    Stream3=curtain_element.Item3,
    Stream4=curtain_element.Item4,
    Stream5=curtain_element.Item5,
    Stream6=curtain_element.Item6,
    Stream7=curtain_element.Item7,
    Stream8=curtain_element.Item8,
    Stream9=curtain_element.Item9,
    Stream10=curtain_element.Item10,
    Stream11=curtain_element.Item11,
    Stream12=curtain_element.Item12,
    Stream13=curtain_element.Item13,
    Stream14=curtain_element.Item14,
    Stream15=curtain_element.Item15,
    Stream16=curtain_element.Item16,
    NullGaps=False)  # -> flatten(Weave)
panel = Panel(curtain_element_index.i)
clean = CleanTree(RemoveNulls=True, RemoveInvalid=True, RemoveEmpty=True, Tree=sorted_curtain_elements)
panel_2 = Panel(clean)
stack = CreateStack(UIElements=clean, Horizontal=False)
W = ClusterOutput(sorted_curtain_elements)

# ==== cluster UNITS
relay = ClusterInput()
dom = ConstructDomain(DomainStart=Slider(0.1, range=0.1..5), DomainEnd=Slider(60, range=0.1..60))
dom_2 = ConstructDomain(DomainStart=Slider(0.1, range=0.1..5), DomainEnd=Slider(5, range=0.1..5))
dom_3 = ConstructDomain(DomainStart=Slider(0.1, range=0.1..5), DomainEnd=Slider(5, range=0.1..5))
set_value = Weave(Pattern=relay, Stream0="6", Stream1="0.5", Stream2="0.45", NullGaps=False)
range = Weave(Pattern=relay, Stream0=dom, Stream1=dom_2, Stream2=dom_3, NullGaps=False)
W = ClusterOutput(set_value)
W_2 = ClusterOutput(range)

# ==== cluster UNITS_2
relay = ClusterInput()
dom = ConstructDomain(DomainStart=Slider(0.1, range=0.1..5), DomainEnd=Slider(250, range=0.1..250))
dom_2 = ConstructDomain(DomainStart=Slider(0.1, range=0.1..5), DomainEnd=Slider(30, range=0.1..30))
dom_3 = ConstructDomain(DomainStart=Slider(0.1, range=0.1..5), DomainEnd=Slider(10, range=0.1..10))
set_value = Weave(Pattern=relay, Stream0="48", Stream1="4", Stream2="1.2", NullGaps=False)
range = Weave(Pattern=relay, Stream0=dom, Stream1=dom_2, Stream2=dom_3, NullGaps=False)
W = ClusterOutput(set_value)
W_2 = ClusterOutput(range)

# ==== cluster UNITS_3
relay = ClusterInput()
dom = ConstructDomain(DomainStart=Slider(0.1, range=0.1..5), DomainEnd=Slider(250, range=0.1..250))
dom_2 = ConstructDomain(DomainStart=Slider(0.1, range=0.1..5), DomainEnd=Slider(30, range=0.1..30))
dom_3 = ConstructDomain(DomainStart=Slider(0.1, range=0.1..5), DomainEnd=Slider(10, range=0.1..10))
set_value = Weave(Pattern=relay, Stream0="96", Stream1="8", Stream2="2.4", NullGaps=False)
range = Weave(Pattern=relay, Stream0=dom, Stream1=dom_2, Stream2=dom_3, NullGaps=False)
W = ClusterOutput(set_value)
W_2 = ClusterOutput(range)

# ==== cluster UNITS_4
relay = ClusterInput()
dom = ConstructDomain(DomainStart=Slider(0.1, range=0.1..5), DomainEnd=Slider(60, range=0.1..60))
dom_2 = ConstructDomain(DomainStart=Slider(0.1, range=0.1..5), DomainEnd=Slider(5, range=0.1..5))
dom_3 = ConstructDomain(DomainStart=Slider(0.1, range=0.1..5), DomainEnd=Slider(3, range=0.1..10))
set_value = Weave(Pattern=relay, Stream0="8", Stream1="0.67", Stream2="0.2", NullGaps=False)
range = Weave(Pattern=relay, Stream0=dom, Stream1=dom_2, Stream2=dom_3, NullGaps=False)
W = ClusterOutput(set_value)
W_2 = ClusterOutput(range)

# ==== cluster UNITS_5
relay = ClusterInput()
dom = ConstructDomain(DomainStart=Slider(0.1, range=0.1..5), DomainEnd=Slider(60, range=0.1..250))
dom_2 = ConstructDomain(DomainStart=Slider(0.01, range=0.01..5), DomainEnd=Slider(5, range=0.1..30))
dom_3 = ConstructDomain(DomainStart=Slider(0.1, range=0.1..5), DomainEnd=Slider(3, range=0.1..10))
set_value = Weave(Pattern=relay, Stream0="3.6", Stream1="0.3", Stream2="0.09", NullGaps=False)
range = Weave(Pattern=relay, Stream0=dom, Stream1=dom_2, Stream2=dom_3, NullGaps=False)
W = ClusterOutput(set_value)
W_2 = ClusterOutput(range)

# ==== cluster UNITS_6
relay = ClusterInput()
dom = ConstructDomain(DomainStart=Slider(0.1, range=0.1..5), DomainEnd=Slider(60, range=0.1..250))
dom_2 = ConstructDomain(DomainStart=Slider(0.01, range=0.01..5), DomainEnd=Slider(5, range=0.1..30))
dom_3 = ConstructDomain(DomainStart=Slider(0.1, range=0.1..5), DomainEnd=Slider(3, range=0.1..10))
set_value = Weave(Pattern=relay, Stream0="2.25", Stream1="0.18", Stream2="0.05", NullGaps=False)
range = Weave(Pattern=relay, Stream0=dom, Stream1=dom_2, Stream2=dom_3, NullGaps=False)
W = ClusterOutput(set_value)
W_2 = ClusterOutput(range)

# ==== cluster UNITS_7
relay = ClusterInput()
dom = ConstructDomain(DomainStart=Slider(0.1, range=0.1..5), DomainEnd=Slider(24, range=0.1..250))
dom_2 = ConstructDomain(DomainStart=Slider(0.01, range=0.01..1), DomainEnd=Slider(2, range=0.1..30))
dom_3 = ConstructDomain(DomainStart=Slider(0.01, range=0.01..5), DomainEnd=Slider(1, range=0.1..10))
set_value = Weave(Pattern=relay, Stream0="3", Stream1="0.25", Stream2="0.07", NullGaps=False)
range = Weave(Pattern=relay, Stream0=dom, Stream1=dom_2, Stream2=dom_3, NullGaps=False)
W = ClusterOutput(set_value)
W_2 = ClusterOutput(range)

# ==== cluster UNITS_8
relay = ClusterInput()
dom = ConstructDomain(DomainStart=Slider(0.1, range=0.1..5), DomainEnd=Slider(24, range=0.1..250))
dom_2 = ConstructDomain(DomainStart=Slider(0.01, range=0.01..5), DomainEnd=Slider(2, range=0.1..30))
dom_3 = ConstructDomain(DomainStart=Slider(0.01, range=0.01..5), DomainEnd=Slider(1, range=0.1..10))
set_value = Weave(Pattern=relay, Stream0="2", Stream1="0.1", Stream2="0.05", NullGaps=False)
range = Weave(Pattern=relay, Stream0=dom, Stream1=dom_2, Stream2=dom_3, NullGaps=False)
W = ClusterOutput(set_value)
W_2 = ClusterOutput(range)

# ==== cluster UNITS_9
relay = ClusterInput()
dom = ConstructDomain(DomainStart=Slider(0.1, range=0.1..5), DomainEnd=Slider(24, range=0.1..250))
dom_2 = ConstructDomain(DomainStart=Slider(0.01, range=0.01..5), DomainEnd=Slider(2, range=0.1..30))
dom_3 = ConstructDomain(DomainStart=Slider(0.01, range=0.01..5), DomainEnd=Slider(1, range=0.1..10))
set_value = Weave(Pattern=relay, Stream0="3", Stream1="0.25", Stream2="0.07", NullGaps=False)
range = Weave(Pattern=relay, Stream0=dom, Stream1=dom_2, Stream2=dom_3, NullGaps=False)
W = ClusterOutput(set_value)
W_2 = ClusterOutput(range)

# ==== cluster UNITS_10
relay = ClusterInput()
dom = ConstructDomain(DomainStart=Slider(0.01, range=0.01..6), DomainEnd=Slider(2, range=0.1..250))
dom_2 = ConstructDomain(DomainStart=Slider(0.001, range=0.001..5), DomainEnd=Slider(0.2, range=0.1..30))
dom_3 = ConstructDomain(DomainStart=Slider(0.001, range=0.001..5), DomainEnd=Slider(0.1, range=0.1..10))
set_value = Weave(Pattern=relay, Stream0="0.09", Stream1="0.010", Stream2="0.002", NullGaps=False)
range = Weave(Pattern=relay, Stream0=dom, Stream1=dom_2, Stream2=dom_3, NullGaps=False)
W = ClusterOutput(set_value)
W_2 = ClusterOutput(range)

# ==== cluster UNITS_11
relay = ClusterInput()
dom = ConstructDomain(DomainStart=Slider(0.1, range=0.1..5), DomainEnd=Slider(48, range=0.1..250))
dom_2 = ConstructDomain(DomainStart=Slider(0.1, range=0.1..5), DomainEnd=Slider(3, range=0.1..30))
dom_3 = ConstructDomain(DomainStart=Slider(0.1, range=0.1..5), DomainEnd=Slider(1, range=0.1..10))
set_value = Weave(Pattern=relay, Stream0="9", Stream1="0.75", Stream2="0.2", NullGaps=False)
range = Weave(Pattern=relay, Stream0=dom, Stream1=dom_2, Stream2=dom_3, NullGaps=False)
W = ClusterOutput(set_value)
W_2 = ClusterOutput(range)

# ==== cluster UNITS_12
relay = ClusterInput()
dom = ConstructDomain(DomainStart=Slider(0.01, range=0.01..5), DomainEnd=Slider(6, range=0.1..250))
dom_2 = ConstructDomain(DomainStart=Slider(0.001, range=0.001..5), DomainEnd=Slider(0.5, range=0.1..30))
dom_3 = ConstructDomain(DomainStart=Slider(0.0001, range=0.0001..5), DomainEnd=Slider(0.01, range=0.01..10))
set_value = Weave(Pattern=relay, Stream0="0.24", Stream1="0.02", Stream2="0.006", NullGaps=False)
range = Weave(Pattern=relay, Stream0=dom, Stream1=dom_2, Stream2=dom_3, NullGaps=False)
W = ClusterOutput(set_value)
W_2 = ClusterOutput(range)

# ==== cluster UNITS_13
relay = ClusterInput()
dom = ConstructDomain(DomainStart=Slider(0.1, range=0.1..5), DomainEnd=Slider(48, range=0.1..250))
dom_2 = ConstructDomain(DomainStart=Slider(0.1, range=0.1..5), DomainEnd=Slider(3, range=0.1..30))
dom_3 = ConstructDomain(DomainStart=Slider(0.01, range=0.01..5), DomainEnd=Slider(1, range=0.1..10))
set_value = Weave(Pattern=relay, Stream0="6", Stream1="0.5", Stream2="0.15", NullGaps=False)
range = Weave(Pattern=relay, Stream0=dom, Stream1=dom_2, Stream2=dom_3, NullGaps=False)
W = ClusterOutput(set_value)
W_2 = ClusterOutput(range)

# ==== cluster UNITS_14
relay = ClusterInput()
dom = ConstructDomain(DomainStart=Slider(0.001, range=0.001..5), DomainEnd=Slider(6, range=0.1..250))
dom_2 = ConstructDomain(DomainStart=Slider(0.001, range=0.001..5), DomainEnd=Slider(0.1, range=0.1..30))
dom_3 = ConstructDomain(DomainStart=Slider(0.001, range=0.001..5), DomainEnd=Slider(0.1, range=0.1..10))
set_value = Weave(Pattern=relay, Stream0="0.1", Stream1="0.008", Stream2="0.002", NullGaps=False)
range = Weave(Pattern=relay, Stream0=dom, Stream1=dom_2, Stream2=dom_3, NullGaps=False)
W = ClusterOutput(set_value)
W_2 = ClusterOutput(range)

# ==== cluster UNITS_15
relay = ClusterInput()
inch = Panel("8")
feet = Panel("0.67")
meter = Panel("0.3")
inch_2 = ConstructDomain(DomainStart=Slider(0.01, range=0.01..5), DomainEnd=Slider(48, range=0.1..250))
feet_2 = ConstructDomain(DomainStart=Slider(0.01, range=0.01..5), DomainEnd=Slider(5, range=0.1..30))
meter_2 = ConstructDomain(DomainStart=Slider(0.01, range=0.001..5), DomainEnd=Slider(3, range=0.1..10))
set_value = Weave(Pattern=relay, Stream0=inch, Stream1=feet, Stream2=meter, NullGaps=False)
range = Weave(Pattern=relay, Stream0=inch_2, Stream1=feet_2, Stream2=meter_2, NullGaps=False)
W = ClusterOutput(set_value)
W_2 = ClusterOutput(range)

# ==== cluster UNITS_16
relay = ClusterInput()
inch = Panel("96")
feet = Panel("15")
meter = Panel("2")
inch_2 = ConstructDomain(DomainStart=Slider(0.01, range=0.01..5), DomainEnd=Slider(250, range=0.1..250))
feet_2 = ConstructDomain(DomainStart=Slider(0.01, range=0.01..5), DomainEnd=Slider(50, range=0.1..50))
meter_2 = ConstructDomain(DomainStart=Slider(0.01, range=0.001..5), DomainEnd=Slider(10, range=0.1..10))
set_value = Weave(Pattern=relay, Stream0=inch, Stream1=feet, Stream2=meter, NullGaps=False)
range = Weave(Pattern=relay, Stream0=inch_2, Stream1=feet_2, Stream2=meter_2, NullGaps=False)
W = ClusterOutput(set_value)
W_2 = ClusterOutput(range)

# ==== cluster DivideCrv
divindex = ClusterInput()  # Type of Division (0=count, 1=length)
scount = ClusterInput()  # Count of Segments to be divided.
slength = ClusterInput()  # Length of Individual segments.
crvinput = ClusterInput()  # Input Curve(s) to be divided.
divide = DivideCurve(Curve=reparameterize(crvinput), Count=scount, Kinks=False)  # -> Points, Tangents, Parameters
divlength = DivideLength(Curve=reparameterize(crvinput), Length=slength)  # -> Points, Tangents, Parameters
div_p = StreamFilter(Gate=divindex, Stream0=divide.Points, Stream1=divlength.Points)
div_t = StreamFilter(Gate=divindex, Stream0=divide.Tangents, Stream1=divlength.Tangents)
panel = Panel(div_t)
div_t_2 = StreamFilter(Gate=divindex, Stream0=divide.Parameters, Stream1=divlength.Parameters)
pline = PolyLine(Vertices=div_p, Closed=False)
frames = AlignPlane(Plane=div_p, Direction=div_t)  # -> Plane, Angle

# ---- group: Normal Vec
xy = XYPlane(Origin=div_p)
align = AlignPlane(Plane=xy, Direction=div_t)  # -> Plane, Angle
deplane = DeconstructPlane(Plane=align.Plane)  # -> Origin, XAxis, YAxis, ZAxis
vdis = VectorDisplay(Anchor=div_p, Vector=div_t)

# ----
points = ClusterOutput(div_p)
perframe = ClusterOutput(frames.Plane)
polyline = ClusterOutput(pline)
tanvec_t = ClusterOutput(deplane.YAxis)
value_t = ClusterOutput(div_t_2)

# ==== cluster Rectangle: Create Rectangle at Origin with Length and Width.
length = ClusterInput()  # Length of Rectangle.
width = ClusterInput()  # Width of Rectangle.
radius = ClusterInput()  # Fillet Radius of Rectangle Corner.
plane = ClusterInput()  # Origin of Rectangle.
dom = ConstructDomain(DomainStart=expr("x/2", length), DomainEnd=expr("-x/2", length))
dom_2 = ConstructDomain(DomainStart=expr("x/2", width), DomainEnd=expr("-x/2", width))
rectangle = Rectangle(Plane=plane, XSize=dom, YSize=dom_2, Radius=radius)  # -> Rectangle, Length
rectangle_2 = ClusterOutput(rectangle.Rectangle)
length_2 = ClusterOutput(rectangle.Length)  # Length of Rectangle Curve.

# ==== cluster Loft
C = ClusterInput()
cls = ClusterInput()
adj = ClusterInput()
T = ClusterInput()
loft_opt = LoftOptions(Closed=cls, Adjust=adj, Rebuild=0, Refit=0, Type=T)
loft = Loft(Curves=C, Options=loft_opt)
L = ClusterOutput(loft)

# ==== cluster CLIP
C = ClusterInput()
pframe = PerpFrame(Curve=reparameterize(graft(C)), Parameter=[0, 1])
rotational_angle = ClusterInput()  # Angle of Rotation
prot = RotatePlane(Plane=pframe, Angle=degrees(rotational_angle))
L = ClusterInput()
W = ClusterInput()
rectangle = Rectangle(plane=pframe, length=L, width=W, radius=0)  # -> rectangle_2, length_2
item = ListItem(List=rectangle.rectangle_2, Index=0, Wrap=True)
swp1 = Sweep1(Rail=graft(C), Sections=item, Miter=1)
cap = CapHoles(Brep=swp1)
trim = TrimTree(Tree=cap, Depth=1)
beam_brep = ClusterOutput(trim)

# ==== cluster CullEnds: Cull the items at start and end
L = ClusterInput()
lng = ListLength(List=L)
subtraction = Subtraction(A=lng, B=1)
panel = Panel(L)
cull_i = CullIndex(List=L, Indices=subtraction, Wrap=True)
L_2 = ClusterOutput(cull_i)

# ==== cluster MatchDir_2
C = ClusterInput()
item = ListItem(List=flatten(C), Index=0, Wrap=True)
flip = FlipCurve(Curve=C, Guide=item)  # -> Curve, Flag
C_2 = ClusterOutput(flip.Curve)

# ==== cluster CullEnds_2: Cull the items at start and end
L = ClusterInput()
lng = ListLength(List=L)
subtraction = Subtraction(A=lng, B=1)
pt = Point(L)
panel = Panel(subtraction)
panel_2 = Panel(L)
ins = InsertItems(List=subtraction, Item="0", Indices=0, Wrap=True)
cull_i = CullIndex(List=L, Indices=ins, Wrap=True)
L_2 = ClusterOutput(cull_i)
panel_3 = Panel(ins)

# ==== cluster BeamRec: Create Rectangular Beam from Curve.
C = ClusterInput()
rotational_angle = ClusterInput()  # Angle of Rotation
T = ClusterInput()
L = ClusterInput()
W = ClusterInput()
matchdir = MatchDir_2(C=C)
simplify = SimplifyTree(Tree=T, Front=False)
flatten = FlattenTree(Tree=matchdir, Path="{0}")
pframe = PerpFrame(Curve=reparameterize(graft(flatten)), Parameter=[0, 1])  # -> simplify(Frame)
item = ListItem(List=pframe, Index=1, Wrap=True)
unflatten = UnflattenTree(Tree=item, Guide=matchdir)  # -> simplify(Tree)
align = AlignPlane(Plane=unflatten, Direction=simplify)  # -> Plane, Angle
panel = Panel(unflatten)
crv = Curve(simplify(matchdir))
rectangle = Rectangle(plane=align.Plane, length=L, width=W, radius=rotational_angle)  # -> rectangle_2, length_2
panel_2 = Panel(simplify)
swp1 = Sweep1(Rail=graft(crv), Sections=graft(rectangle.rectangle_2), Miter=1)
cap = CapHoles(Brep=swp1)
panel_3 = Panel(crv)
trim = TrimTree(Tree=cap, Depth=2)  # -> simplify(Tree)
beam_brep = ClusterOutput(trim)
panel_4 = Panel(trim)

# ==== cluster DivideCrv_2
divindex = ClusterInput()  # Type of Division (0=count, 1=length)
scount = ClusterInput()  # Count of Segments to be divided.
slength = ClusterInput()  # Length of Individual segments.
crvinput = ClusterInput()  # Input Curve(s) to be divided.
divide = DivideCurve(Curve=reparameterize(crvinput), Count=scount, Kinks=False)  # -> Points, Tangents, Parameters
divlength = DivideLength(Curve=reparameterize(crvinput), Length=slength)  # -> Points, Tangents, Parameters
div_p = StreamFilter(Gate=divindex, Stream0=divide.Points, Stream1=divlength.Points)
div_t = StreamFilter(Gate=divindex, Stream0=divide.Tangents, Stream1=divlength.Tangents)
panel = Panel(div_t)
div_t_2 = StreamFilter(Gate=divindex, Stream0=divide.Parameters, Stream1=divlength.Parameters)
pline = PolyLine(Vertices=div_p, Closed=False)
frames = AlignPlane(Plane=div_p, Direction=div_t)  # -> Plane, Angle

# ---- group: Normal Vec
xy = XYPlane(Origin=div_p)
align = AlignPlane(Plane=xy, Direction=div_t)  # -> Plane, Angle
deplane = DeconstructPlane(Plane=align.Plane)  # -> Origin, XAxis, YAxis, ZAxis
vdis = VectorDisplay(Anchor=div_p, Vector=deplane.YAxis)

# ----
points = ClusterOutput(div_p)
perframe = ClusterOutput(frames.Plane)
polyline = ClusterOutput(pline)
tanvec_t = ClusterOutput(deplane.YAxis)
value_t = ClusterOutput(div_t_2)

# ==== cluster UNITS_17
relay = ClusterInput()
dom = ConstructDomain(DomainStart=Slider(0.1, range=0.1..5), DomainEnd=Slider(60, range=0.1..60))
dom_2 = ConstructDomain(DomainStart=Slider(0.01, range=0.01..5), DomainEnd=Slider(10, range=0.1..10))
dom_3 = ConstructDomain(DomainStart=Slider(0.01, range=0.01..5), DomainEnd=Slider(5, range=0.1..5))
set_value = Weave(Pattern=relay, Stream0="36", Stream1="3", Stream2="1", NullGaps=False)
range = Weave(Pattern=relay, Stream0=dom, Stream1=dom_2, Stream2=dom_3, NullGaps=False)
W = ClusterOutput(set_value)
W_2 = ClusterOutput(range)

# ==== cluster UNITS_18
relay = ClusterInput()
dom = ConstructDomain(DomainStart=Slider(0, range=0..5), DomainEnd=Slider(60, range=0.1..60))
dom_2 = ConstructDomain(DomainStart=Slider(0, range=0..5), DomainEnd=Slider(5, range=0.1..5))
dom_3 = ConstructDomain(DomainStart=Slider(0, range=0..5), DomainEnd=Slider(3, range=0.1..5))
set_value = Weave(Pattern=relay, Stream0="6", Stream1="0.5", Stream2="0.1", NullGaps=False)
range = Weave(Pattern=relay, Stream0=dom, Stream1=dom_2, Stream2=dom_3, NullGaps=False)
W = ClusterOutput(set_value)
W_2 = ClusterOutput(range)

# ==== cluster UNITS_19
relay = ClusterInput()
dom = ConstructDomain(DomainStart=Slider(0.1, range=0.1..5), DomainEnd=Slider(144, range=0.1..144))
dom_2 = ConstructDomain(DomainStart=Slider(0.01, range=0.01..5), DomainEnd=Slider(10, range=0.1..10))
dom_3 = ConstructDomain(DomainStart=Slider(0.01, range=0.01..5), DomainEnd=Slider(5, range=0.1..5))
set_value = Weave(Pattern=relay, Stream0="48", Stream1="4", Stream2="1.2", NullGaps=False)
range = Weave(Pattern=relay, Stream0=dom, Stream1=dom_2, Stream2=dom_3, NullGaps=False)
W = ClusterOutput(set_value)
W_2 = ClusterOutput(range)

# ==== cluster UNITS_20
relay = ClusterInput()
dom = ConstructDomain(DomainStart=Slider(0.1, range=0.1..5), DomainEnd=Slider(144, range=0.1..144))
dom_2 = ConstructDomain(DomainStart=Slider(0.01, range=0.01..5), DomainEnd=Slider(5, range=0.1..5))
dom_3 = ConstructDomain(DomainStart=Slider(0.01, range=0.01..5), DomainEnd=Slider(5, range=0.1..5))
set_value = Weave(Pattern=relay, Stream0="3.42", Stream1="0.285", Stream2="0.012", NullGaps=False)
range = Weave(Pattern=relay, Stream0=dom, Stream1=dom_2, Stream2=dom_3, NullGaps=False)
W = ClusterOutput(set_value)
W_2 = ClusterOutput(range)

# ==== cluster UNITS_21
relay = ClusterInput()
dom = ConstructDomain(DomainStart=Slider(0.1, range=0.1..5), DomainEnd=Slider(144, range=0.1..144))
dom_2 = ConstructDomain(DomainStart=Slider(0.01, range=0.01..5), DomainEnd=Slider(5, range=0.1..5))
dom_3 = ConstructDomain(DomainStart=Slider(0.01, range=0.01..5), DomainEnd=Slider(5, range=0.1..5))
set_value = Weave(Pattern=relay, Stream0="6", Stream1="0.5", Stream2="0.15", NullGaps=False)
range = Weave(Pattern=relay, Stream0=dom, Stream1=dom_2, Stream2=dom_3, NullGaps=False)
W = ClusterOutput(set_value)
W_2 = ClusterOutput(range)

# ==== cluster UNITS_22
relay = ClusterInput()
dom = ConstructDomain(DomainStart=Slider(0.1, range=0.1..5), DomainEnd=Slider(12, range=0.1..144))
dom_2 = ConstructDomain(DomainStart=Slider(0.001, range=0.001..5), DomainEnd=Slider(2, range=0.1..5))
dom_3 = ConstructDomain(DomainStart=Slider(0.001, range=0.0001..5), DomainEnd=Slider(1, range=0.1..5))
set_value = Weave(Pattern=relay, Stream0="0.66", Stream1="0.055", Stream2="0.015", NullGaps=False)
range = Weave(Pattern=relay, Stream0=dom, Stream1=dom_2, Stream2=dom_3, NullGaps=False)
W = ClusterOutput(set_value)
W_2 = ClusterOutput(range)

# ==== cluster UNITS_23
relay = ClusterInput()
dom = ConstructDomain(DomainStart=Slider(0.1, range=0.1..5), DomainEnd=Slider(12, range=0.1..144))
dom_2 = ConstructDomain(DomainStart=Slider(0.001, range=0.001..5), DomainEnd=Slider(2, range=0.1..5))
dom_3 = ConstructDomain(DomainStart=Slider(0.001, range=0.0001..5), DomainEnd=Slider(1, range=0.1..5))
set_value = Weave(Pattern=relay, Stream0="0.6", Stream1="0.04", Stream2="0.012", NullGaps=False)
range = Weave(Pattern=relay, Stream0=dom, Stream1=dom_2, Stream2=dom_3, NullGaps=False)
W = ClusterOutput(set_value)
W_2 = ClusterOutput(range)

# ==== cluster UNITS_24
relay = ClusterInput()
dom = ConstructDomain(DomainStart=Slider(0.1, range=0.1..5), DomainEnd=Slider(12, range=0.1..144))
dom_2 = ConstructDomain(DomainStart=Slider(0.001, range=0.001..5), DomainEnd=Slider(2, range=0.1..5))
dom_3 = ConstructDomain(DomainStart=Slider(0.001, range=0.0001..5), DomainEnd=Slider(0.5, range=0.1..5))
set_value = Weave(Pattern=relay, Stream0="0.66", Stream1="0.05", Stream2="0.015", NullGaps=False)
range = Weave(Pattern=relay, Stream0=dom, Stream1=dom_2, Stream2=dom_3, NullGaps=False)
W = ClusterOutput(set_value)
W_2 = ClusterOutput(range)

# ==== cluster UNITS_25
relay = ClusterInput()
dom = ConstructDomain(DomainStart=Slider(0.1, range=0.1..5), DomainEnd=Slider(12, range=0.1..144))
dom_2 = ConstructDomain(DomainStart=Slider(0.001, range=0.001..5), DomainEnd=Slider(0.5, range=0.1..5))
dom_3 = ConstructDomain(DomainStart=Slider(0.001, range=0.0001..5), DomainEnd=Slider(0.1, range=0.1..5))
set_value = Weave(Pattern=relay, Stream0="0.18", Stream1="0.015", Stream2="0.004", NullGaps=False)
range = Weave(Pattern=relay, Stream0=dom, Stream1=dom_2, Stream2=dom_3, NullGaps=False)
W = ClusterOutput(set_value)
W_2 = ClusterOutput(range)

# ==== cluster UNITS_26
relay = ClusterInput()
dom = ConstructDomain(DomainStart=Slider(0.1, range=0.1..5), DomainEnd=Slider(12, range=0.1..144))
dom_2 = ConstructDomain(DomainStart=Slider(0.001, range=0.001..5), DomainEnd=Slider(1, range=0.1..5))
dom_3 = ConstructDomain(DomainStart=Slider(0.001, range=0.0001..5), DomainEnd=Slider(0.5, range=0.1..5))
set_value = Weave(Pattern=relay, Stream0="0.36", Stream1="0.03", Stream2="0.009", NullGaps=False)
range = Weave(Pattern=relay, Stream0=dom, Stream1=dom_2, Stream2=dom_3, NullGaps=False)
W = ClusterOutput(set_value)
W_2 = ClusterOutput(range)

# ==== cluster UNITS_27
relay = ClusterInput()
dom = ConstructDomain(DomainStart=Slider(0.1, range=0.1..5), DomainEnd=Slider(36, range=0.1..144))
dom_2 = ConstructDomain(DomainStart=Slider(0.001, range=0.001..5), DomainEnd=Slider(2, range=0.1..5))
dom_3 = ConstructDomain(DomainStart=Slider(0.001, range=0.0001..5), DomainEnd=Slider(1, range=0.1..5))
set_value = Weave(Pattern=relay, Stream0="2", Stream1="0.17", Stream2="0.05", NullGaps=False)
range = Weave(Pattern=relay, Stream0=dom, Stream1=dom_2, Stream2=dom_3, NullGaps=False)
W = ClusterOutput(set_value)
W_2 = ClusterOutput(range)

# ==== cluster RailingELEMENTS
inputindex = ClusterInput()
typeindex = ClusterInput()
divindex = ClusterInput()
L = ClusterInput()
curtain_element = ListItem(List=L, Index=0, Wrap=True)  # -> Item, Item1, Item2, Item3, Item4, Item5, Item6, Item7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
curtain_element_index = CSharpScript(inputIndex=inputindex, typeIndex=typeindex, divIndex=divindex)  # -> out, i; inputs inputIndex: Int32, typeIndex: Int32, divIndex: Int32
# ---------- curtain_element_index: C# ----------
    index.Clear();

    //DIVISION CONTROLS

    if (typeIndex == 0){}
    else
    {

      if (divIndex == 0)
      {
        index.Add(0);

        if (typeIndex == 1)
        {
          index.Add(2);
        }
      }

      if (divIndex == 1)
      {
        index.Add(1);

        if (typeIndex == 1)
        {
          index.Add(3);
        }
      }

    }


    //HEIGHT CONTROLS
    if (inputIndex == 0)
    {
      index.Add(4);
    }
    if (typeIndex == 0){}
    else
    {
      index.Add(5);
      index.Add(6);
    }


    //WIDTH CONTROLS
    index.Add(7);
    if (typeIndex == 1 || typeIndex == 2)
    {
      index.Add(8);
    }
    if (typeIndex == 1 || typeIndex == 2 || typeIndex == 3 || typeIndex == 4)
    {
      index.Add(9);
    }
    


    //CABLE CONTROLS
    if (typeIndex == 4)
    {
      index.Add(10);
      index.Add(11);
    }


    //CLIP CONTROLS
    if (typeIndex == 3)
    {
      index.Add(12);
      index.Add(13);
    }

    //GLASS OFFSET
    if (typeIndex == 3)
    {
      index.Add(14);
    }

    //GLASS THICKESS
    if (typeIndex == 2 || typeIndex == 3)
    {
      index.Add(15);
    }



    //FIANL RESULTANT DATA
    i = index;
# ---------- curtain_element_index: C# additional code ----------
  //Declare Value
  List<int> index = new List<int>();
# ---------- end curtain_element_index ----------
sorted_curtain_elements = Weave(
    Pattern=curtain_element_index.i,
    Stream0=curtain_element.Item,
    Stream1=curtain_element.Item1,
    Stream2=curtain_element.Item2,
    Stream3=curtain_element.Item3,
    Stream4=curtain_element.Item4,
    Stream5=curtain_element.Item5,
    Stream6=curtain_element.Item6,
    Stream7=curtain_element.Item7,
    Stream8=curtain_element.Item8,
    Stream9=curtain_element.Item9,
    Stream10=curtain_element.Item10,
    Stream11=curtain_element.Item11,
    Stream12=curtain_element.Item12,
    Stream13=curtain_element.Item13,
    Stream14=curtain_element.Item14,
    Stream15=curtain_element.Item15,
    NullGaps=False)
stack = CreateStack(UIElements=sorted_curtain_elements, Horizontal=False)
S = ClusterOutput(stack)

# ==== cluster DivIndex
typeindex = ClusterInput()
divindex = ClusterInput()
ptlist = ClusterInput()
lng = ListLength(List=ptlist)  # -> expr("x-1", simplify(Length))
lng_2 = ListLength(List=ptlist)  # -> simplify(Length)
weave = Weave(Pattern=divindex, Stream0=lng, Stream1=lng_2, NullGaps=False)
typeindex_2 = StreamFilter(Gate=typeindex, Stream0=weave, Stream1=weave, Stream2=weave, Stream3=lng, Stream4=weave)
s_0 = ClusterOutput(typeindex_2)

# ==== cluster COLUMN2ELEMENTSGENERATOR_2
patternindex = ClusterInput()
L = ClusterInput()
element_index = CSharpScript(patternIndex=patternindex)  # -> i, l; inputs patternIndex: Int32
# ---------- element_index: C# ----------
    index.Clear();

    //ALL ELEMENTS
    index.Add(0);
    index.Add(1);
    index.Add(2);

    //TILE ELEMENTS
    if (patternIndex == 3)
    {
      index.Add(3);
    }

    index.Add(4);
    index.Add(5);

    //FINAL RESULTANT DATA

    i = index;
    l = index.Count;
# ---------- element_index: C# additional code ----------
  //Declare Value
  List<int> index = new List<int>();
# ---------- end element_index ----------
panel = Panel(element_index.i)
item = ListItem(List=L, Index=0, Wrap=True)  # -> Item, Item1, Item2, Item3, Item4, Item5
column_1_all_elements = Weave(
    Pattern=element_index.i,
    Stream0=item.Item,
    Stream1=item.Item1,
    Stream2=item.Item2,
    Stream3=item.Item3,
    Stream4=item.Item4,
    Stream5=item.Item5,
    NullGaps=False)
column_1_all_elements_final = Merge(Data1=column_1_all_elements)
panel_2 = Panel(column_1_all_elements_final)
panel_3 = Panel(element_index.l)
R = ClusterOutput(column_1_all_elements_final)

# ==== cluster ExtrudeZ: Extrude from Base Crv in Z-Direction.
height = ClusterInput()  # Heigth of Extrusion.
closed_cap = ClusterInput()  # Closed Brep
B = ClusterInput()
Z = UnitZ(Factor=height)
extr = Extrude(Base=B, Direction=Z)
cap = CapHoles(Brep=extr)
filter = StreamFilter(Gate=closed_cap, Stream0=extr, Stream1=cap)
extruded_brep = ClusterOutput(filter)

# ==== cluster COLUMN2ELEMENTSGENERATOR_3
typeindex = ClusterInput()
inputindex = ClusterInput()
heightindex = ClusterInput()
frameindex = ClusterInput()
c1length = ClusterInput()
L = ClusterInput()
element_index = CSharpScript(typeIndex=typeindex, inputIndex=inputindex, heightIndex=heightindex, frameIndex=frameindex, c1Length=c1length)  # -> i, a, l; inputs typeIndex: Double, inputIndex: Int32, heightIndex: Int32, frameIndex: Int32, c1Length: Int32
# ---------- element_index: C# ----------
    index.Clear();

    //ALL TIME ELEMENTS
    index.Add(1);
    index.Add(2);
    index.Add(3);
    index.Add(7);
    index.Add(4);
    index.Add(5);


    //TYPE: SOLID & BRICK
    if (typeIndex == 0 || typeIndex == 1){}
    //TYPE: CURTAIN
    if (typeIndex == 2)
    {
      index.Add(6);
    }


    //ADDITIONAL PLACEHOLDERS

    addPh = c1Length - index.Count;
    if (addPh <= 0)
    {
      addPh = 0;
    }
    if (addPh > 0){}

    //FINAL RESULTANT DATA

    i = index;
    a = addPh;
    l = index.Count;
# ---------- element_index: C# additional code ----------
  //Declare Value
  List<int> index = new List<int>();
  int addPh;
# ---------- end element_index ----------
panel = Panel(element_index.i)
panel_2 = Panel(element_index.a)
item = ListItem(List=L, Index=0, Wrap=True)  # -> Item, Item1, Item2, Item3, Item4, Item5, Item6, Item7
column_1_all_elements = Weave(
    Pattern=element_index.i,
    Stream0=item.Item,
    Stream1=item.Item1,
    Stream2=item.Item2,
    Stream3=item.Item3,
    Stream4=item.Item4,
    Stream5=item.Item5,
    Stream6=item.Item6,
    Stream7=item.Item7,
    NullGaps=False)
panel_3 = Panel(column_1_all_elements)
placeholders = RepeatData(Data=item.Item, Length=element_index.a)
column_1_all_elements_final = Merge(Data1=column_1_all_elements, Data2=placeholders)
R = ClusterOutput(column_1_all_elements_final)

# ==== cluster COLUMN1ELEMENTSGENERATOR_2
all_c1_elements = ClusterInput()  # All Elements for Column 1 as list
objinput = ClusterInput()
rotationindex = ClusterInput()
scatterindex = ClusterInput()
snapindex = ClusterInput()
item = ListItem(List=all_c1_elements, Index=0, Wrap=True)  # -> Item, Item1, Item2, Item3, Item4, Item5, Item6, Item7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
element_index = CSharpScript(typeIndex=rotationindex, inputIndex=objinput, heightIndex=scatterindex, frameIndex=snapindex)  # -> i, a, l; inputs typeIndex: Double, inputIndex: Int32, heightIndex: Int32, frameIndex: Int32
# ---------- element_index: C# ----------
    index.Clear();

    //ALL TIME ELEMENTS
    index.Add(0);
    index.Add(1);
    index.Add(2);
    index.Add(3);


    //FRAME MENU
    if (typeIndex == 2)
    {
      index.Add(6);
    }


    //HEIGHT MENU
    if (inputIndex == 0 || inputIndex == 3)
    {
      index.Add(4);
    }


    //DIRECTION MENU
    if (typeIndex == 0)
    {
      if (inputIndex == 0 || inputIndex == 1 || inputIndex == 2)
      {
        index.Add(5);
      }
    }


    //THICKNESS MENU
    if (typeIndex == 0 || typeIndex == 3)
    {
      if (inputIndex == 0 || inputIndex == 1 || inputIndex == 2)
      {
        index.Add(7);
      }
    }


    //HEIGHT CONTROLS
    if (inputIndex == 0 || inputIndex == 3)
    {
      if (heightIndex == 0)
      {
        index.Add(8);
      }
      else
      {
        index.Add(8);
        index.Add(9);
        index.Add(10);
      }
    }


    //PLACEHOLDER
    //SOLID
    if (typeIndex == 0)
    {
      if (inputIndex == 4)
      {
        addPh = 1;
      }
    }
    //BRICK || CURTAIN
    if (typeIndex == 1 || typeIndex == 2 || typeIndex == 3)
    {
      if (inputIndex == 1 || inputIndex == 2)
      {
        addPh = 2;
      }
    }

    //FINAL RESULTANT DATA

    i = index;
    a = addPh;
    l = index.Count;
# ---------- element_index: C# additional code ----------
  //Declare Value
  List<int> index = new List<int>();
  int addPh;
# ---------- end element_index ----------
selected_element_indexies = Panel(element_index.i)
column_1_all_elements = Weave(
    Pattern=element_index.i,
    Stream0=item.Item,
    Stream1=item.Item1,
    Stream2=item.Item2,
    Stream3=item.Item3,
    Stream4=item.Item4,
    Stream5=item.Item5,
    Stream6=item.Item6,
    Stream7=item.Item7,
    Stream8=item.Item8,
    Stream9=item.Item9,
    Stream10=item.Item10,
    Stream11=item.Item11,
    NullGaps=False)
placeholder = RepeatData(Data=item.Item11, Length=element_index.a)
c_1_elements = Merge(Data1=column_1_all_elements, Data2=placeholder)
panel = Panel(c_1_elements)
column_1_elements = ClusterOutput(c_1_elements)
number_of_elements_in_column_1 = ClusterOutput(element_index.l)

# ==== cluster TabIndex
_0_0 = ClusterInput()
_0_1 = ClusterInput()
_0_2 = ClusterInput()
_0_3 = ClusterInput()
_0_4 = ClusterInput()
entwine = Entwine(Branch00=_0_0, Branch01=_0_1, Branch02=_0_2, Branch03=_0_3, Branch04=_0_4, FlattenInputs=True)
panel = Panel("""1
0
2
3
4""")
pshift = ShiftPaths(Data=entwine, Offset=-1)
sort = SortList(Keys=pshift, ValuesA=panel)  # -> Keys, reverse(ValuesA)
item = ListItem(List=sort.ValuesA, Index=0, Wrap=True)
panel_2 = Panel(item)
panel_3 = Panel(pshift)
i = ClusterOutput(item)

# ==== cluster TabIndex_2
_0_0 = ClusterInput()
_0_1 = ClusterInput()
entwine = Entwine(Branch00=_0_0, Branch01=_0_1, FlattenInputs=True)
panel = Panel("""0
1""")
pshift = ShiftPaths(Data=entwine, Offset=-1)
sort = SortList(Keys=pshift, ValuesA=panel)  # -> Keys, reverse(ValuesA)
item = ListItem(List=sort.ValuesA, Index=0, Wrap=True)
i = ClusterOutput(item)

# ==== cluster UNITS_28
relay = ClusterInput()
inch = Panel("96")
feet = Panel("10")
meter = Panel("2")
inch_2 = ConstructDomain(DomainStart=Slider(0.01, range=0.01..5), DomainEnd=Slider(250, range=0.1..250))
feet_2 = ConstructDomain(DomainStart=Slider(0.01, range=0.01..5), DomainEnd=Slider(50, range=0.1..50))
meter_2 = ConstructDomain(DomainStart=Slider(0.01, range=0.001..5), DomainEnd=Slider(10, range=0.1..10))
set_value = Weave(Pattern=relay, Stream0=inch, Stream1=feet, Stream2=meter, NullGaps=False)
range = Weave(Pattern=relay, Stream0=inch_2, Stream1=feet_2, Stream2=meter_2, NullGaps=False)
W = ClusterOutput(set_value)
W_2 = ClusterOutput(range)

# ==== cluster Remap: Remaps numbers
data = ClusterInput()
min = ClusterInput()
max = ClusterInput()
bnd = Bounds(Numbers=data)
dom = ConstructDomain(DomainStart=min, DomainEnd=max)
remap = RemapNumbers(Value=data, Source=bnd, Target=dom)  # -> Mapped, Clipped
R = ClusterOutput(remap.Mapped)

# ==== cluster UNITS_29
relay = ClusterInput()
inch = Panel("0.12")
feet = Panel("0.01")
meter = Panel("0.003")
inch_2 = ConstructDomain(DomainStart=Slider(0, range=0..5), DomainEnd=Slider(6, range=0.1..250))
feet_2 = ConstructDomain(DomainStart=Slider(0, range=0..0.5), DomainEnd=Slider(0.5, range=0.1..50))
meter_2 = ConstructDomain(DomainStart=Slider(0, range=0..5), DomainEnd=Slider(0.1, range=0.1..10))
set_value = Weave(Pattern=relay, Stream0=inch, Stream1=feet, Stream2=meter, NullGaps=False)
range = Weave(Pattern=relay, Stream0=inch_2, Stream1=feet_2, Stream2=meter_2, NullGaps=False)
W = ClusterOutput(set_value)
W_2 = ClusterOutput(range)

# ==== cluster UNITS_30
relay = ClusterInput()
inch = Panel("1.8")
feet = Panel("0.15")
meter = Panel("0.045")
inch_2 = ConstructDomain(DomainStart=Slider(0, range=0..5), DomainEnd=Slider(6, range=0.1..250))
feet_2 = ConstructDomain(DomainStart=Slider(0, range=0..0.5), DomainEnd=Slider(0.5, range=0.1..50))
meter_2 = ConstructDomain(DomainStart=Slider(0, range=0..5), DomainEnd=Slider(0.1, range=0.1..10))
set_value = Weave(Pattern=relay, Stream0=inch, Stream1=feet, Stream2=meter, NullGaps=False)
range = Weave(Pattern=relay, Stream0=inch_2, Stream1=feet_2, Stream2=meter_2, NullGaps=False)
W = ClusterOutput(set_value)
W_2 = ClusterOutput(range)

# ==== cluster UNITS_31
relay = ClusterInput()
dom = ConstructDomain(DomainStart=Slider(0.1, range=0.1..5), DomainEnd=Slider(144, range=0.1..144))
dom_2 = ConstructDomain(DomainStart=Slider(0.01, range=0.01..5), DomainEnd=Slider(5, range=0.1..5))
dom_3 = ConstructDomain(DomainStart=Slider(0.01, range=0.01..5), DomainEnd=Slider(5, range=0.1..5))
set_value = Weave(Pattern=relay, Stream0="8", Stream1="0.67", Stream2="0.20", NullGaps=False)
range = Weave(Pattern=relay, Stream0=dom, Stream1=dom_2, Stream2=dom_3, NullGaps=False)
W = ClusterOutput(set_value)
W_2 = ClusterOutput(range)

# ==== cluster UNITS_32
relay = ClusterInput()
dom = ConstructDomain(DomainStart=Slider(0.1, range=0.1..5), DomainEnd=Slider(144, range=0.1..144))
dom_2 = ConstructDomain(DomainStart=Slider(0.01, range=0.01..5), DomainEnd=Slider(5, range=0.1..5))
dom_3 = ConstructDomain(DomainStart=Slider(0.01, range=0.01..5), DomainEnd=Slider(5, range=0.1..5))
set_value = Weave(Pattern=relay, Stream0="8", Stream1="0.667", Stream2="0.2", NullGaps=False)
range = Weave(Pattern=relay, Stream0=dom, Stream1=dom_2, Stream2=dom_3, NullGaps=False)
W = ClusterOutput(set_value)
W_2 = ClusterOutput(range)

# ==== cluster UNITS_33
relay = ClusterInput()
dom = ConstructDomain(DomainStart=Slider(0.1, range=0.1..5), DomainEnd=Slider(144, range=0.1..144))
dom_2 = ConstructDomain(DomainStart=Slider(0.01, range=0.01..5), DomainEnd=Slider(5, range=0.1..5))
dom_3 = ConstructDomain(DomainStart=Slider(0.01, range=0.01..5), DomainEnd=Slider(5, range=0.1..5))
set_value = Weave(Pattern=relay, Stream0="7.995", Stream1="0.666", Stream2="0.203", NullGaps=False)
range = Weave(Pattern=relay, Stream0=dom, Stream1=dom_2, Stream2=dom_3, NullGaps=False)
W = ClusterOutput(set_value)
W_2 = ClusterOutput(range)

# ==== cluster UNITS_34
relay = ClusterInput()
dom = ConstructDomain(DomainStart=Slider(0.1, range=0.1..5), DomainEnd=Slider(144, range=0.1..144))
dom_2 = ConstructDomain(DomainStart=Slider(0.01, range=0.01..5), DomainEnd=Slider(5, range=0.1..5))
dom_3 = ConstructDomain(DomainStart=Slider(0.01, range=0.01..5), DomainEnd=Slider(5, range=0.1..5))
set_value = Weave(Pattern=relay, Stream0="0.285", Stream1="0.024", Stream2="0.012", NullGaps=False)
range = Weave(Pattern=relay, Stream0=dom, Stream1=dom_2, Stream2=dom_3, NullGaps=False)
W = ClusterOutput(set_value)
W_2 = ClusterOutput(range)

# ==== cluster UNITS_35
relay = ClusterInput()
dom = ConstructDomain(DomainStart=Slider(0.1, range=0.1..5), DomainEnd=Slider(144, range=0.1..144))
dom_2 = ConstructDomain(DomainStart=Slider(0.01, range=0.01..5), DomainEnd=Slider(5, range=0.1..5))
dom_3 = ConstructDomain(DomainStart=Slider(0.01, range=0.01..5), DomainEnd=Slider(5, range=0.1..5))
set_value = Weave(Pattern=relay, Stream0="0.435", Stream1="0.036", Stream2="0.012", NullGaps=False)
range = Weave(Pattern=relay, Stream0=dom, Stream1=dom_2, Stream2=dom_3, NullGaps=False)
W = ClusterOutput(set_value)
W_2 = ClusterOutput(range)

# ==== cluster COLUMN2ELEMENTSGENERATOR_4
c1length = ClusterInput()
L = ClusterInput()
element_index = CSharpScript(c1Length=c1length)  # -> i, a, l; inputs c1Length: Int32
# ---------- element_index: C# ----------
    index.Clear();

    //ALL TIME ELEMENTS
    index.Add(0);
    index.Add(1);
    index.Add(2);
    index.Add(6);
    index.Add(3);
    index.Add(4);

    //ADDITIONAL PLACEHOLDERS

    addPh = c1Length - index.Count;
    if (addPh <= 0)
    {
      addPh = 0;
    }
    if (addPh > 0){}

    //FINAL RESULTANT DATA

    i = index;
    a = addPh;
    l = index.Count;
# ---------- element_index: C# additional code ----------
  //Declare Value
  List<int> index = new List<int>();
  int addPh;
# ---------- end element_index ----------
panel = Panel(element_index.i)
panel_2 = Panel(element_index.a)
item = ListItem(List=L, Index=0, Wrap=True)  # -> Item, Item1, Item2, Item3, Item4, Item5, Item6
column_1_all_elements = Weave(
    Pattern=element_index.i,
    Stream0=item.Item,
    Stream1=item.Item1,
    Stream2=item.Item2,
    Stream3=item.Item3,
    Stream4=item.Item4,
    Stream5=item.Item5,
    Stream6=item.Item6,
    NullGaps=False)
panel_3 = Panel(column_1_all_elements)
placeholders = RepeatData(Data=item.Item5, Length=element_index.a)
column_1_all_elements_final = Merge(Data1=column_1_all_elements, Data2=placeholders)
R = ClusterOutput(column_1_all_elements_final)

# ==== cluster COLUMN1ELEMENTSGENERATOR_3
all_c1_elements = ClusterInput()  # All Elements for Column 1 as list
item = ListItem(List=all_c1_elements, Index=0, Wrap=True)  # -> Item, Item1, Item2, Item3, Item4, Item5, Item6, Item7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
inputindex = ClusterInput()
riseindex = ClusterInput()
runindex = ClusterInput()
treadindex = ClusterInput()
offsetindex = ClusterInput()
stringergeoindex = ClusterInput()
risegeoindex = ClusterInput()
element_index = CSharpScript(
    inputIndex=inputindex,
    riseIndex=riseindex,
    runIndex=runindex,
    treadIndex=treadindex,
    offsetIndex=offsetindex,
    stringergeoIndex=stringergeoindex,
    risegeoIndex=risegeoindex)  # -> i, a, l; inputs inputIndex: Int32, riseIndex: Int32, runIndex: Int32, treadIndex: Int32, offsetIndex: Int32, stringergeoIndex: Boolean, risegeoIndex: Boolean
# ---------- element_index: C# ----------
    index.Clear();

    //ALL TIME ELEMENTS
    index.Add(0);
    index.Add(1);
    index.Add(2);
    index.Add(3);
    index.Add(4);
    index.Add(5);

    //OFFSET DIRECTION MENU
    if (inputIndex == 0)
    {
      index.Add(6);
    }

    //SLIDER TOOGLES
    index.Add(7);
    index.Add(8);

    if (stringergeoIndex == false)
    {
      index.Add(9);
    }

    //WIDTH PARAM
    if (inputIndex == 0)
    {
      index.Add(10);
    }

    //HEIGHT PARAMS

    if (riseIndex == 0)
    {
      index.Add(13);
    }
    else
    {
      index.Add(14);
    }

    //RUN PARAMS

    if (runIndex == 0)
    {
      index.Add(16);
    }
    else
    {
      index.Add(15);
    }


    //RISE PARAMS
    if (stringergeoIndex == false && risegeoIndex == true)
    {
      index.Add(20);
    }

    //TREAD PARAMS
    if (treadIndex == 0)
    {
      index.Add(17);
      index.Add(18);
    }

    //STRINGER PARAMS
    if (stringergeoIndex == false)
    {
      index.Add(11);
      index.Add(12);
      index.Add(19);
    }



    //FIANL RESULTANT DATA
    l = index.Count;
    i = index;
# ---------- element_index: C# additional code ----------
  //Declare Value
  List<int> index = new List<int>();
# ---------- end element_index ----------
column_1_all_elements = Weave(
    Pattern=element_index.i,
    Stream0=item.Item,
    Stream1=item.Item1,
    Stream2=item.Item2,
    Stream3=item.Item3,
    Stream4=item.Item4,
    Stream5=item.Item5,
    Stream6=item.Item6,
    Stream7=item.Item7,
    Stream8=item.Item8,
    Stream9=item.Item9,
    Stream10=item.Item10,
    Stream11=item.Item11,
    Stream12=item.Item12,
    Stream13=item.Item13,
    Stream14=item.Item14,
    Stream15=item.Item15,
    Stream16=item.Item16,
    Stream17=item.Item17,
    Stream18=item.Item18,
    Stream19=item.Item19,
    Stream20=item.Item20,
    NullGaps=False)
selected_element_indexies = Panel(element_index.i)
c_1_elements = Merge(Data1=column_1_all_elements)
placeholder = RepeatData(Length=element_index.a)
panel = Panel(c_1_elements)
column_1_elements = ClusterOutput(c_1_elements)
number_of_elements_in_column_1 = ClusterOutput(element_index.l)

# ==== cluster DivideCrv_3
divindex = ClusterInput()  # Type of Division (0=count, 1=length)
scount = ClusterInput()  # Count of Segments to be divided.
slength = ClusterInput()  # Length of Individual segments.
crvinput = ClusterInput()  # Input Curve(s) to be divided.
divide = DivideCurve(Curve=reparameterize(crvinput), Count=scount, Kinks=False)  # -> Points, Tangents, Parameters
divlength = DivideLength(Curve=reparameterize(crvinput), Length=slength)  # -> Points, Tangents, Parameters
div_p = StreamFilter(Gate=divindex, Stream0=divlength.Points, Stream1=divide.Points)  # -> simplify(Stream)
div_t = StreamFilter(Gate=divindex, Stream0=divlength.Tangents, Stream1=divide.Tangents)  # -> simplify(Stream)
div_t_2 = StreamFilter(Gate=divindex, Stream0=divlength.Parameters, Stream1=divide.Parameters)  # -> simplify(Stream)
pline = PolyLine(Vertices=div_p, Closed=False)  # -> simplify(Polyline)
frames = AlignPlane(Plane=div_p, Direction=div_t)  # -> simplify(Plane), Angle
points = ClusterOutput(div_p)
perframe = ClusterOutput(frames.Plane)
polyline = ClusterOutput(pline)
tanvec_t = ClusterOutput(div_t)
value_t = ClusterOutput(div_t_2)

# ==== cluster COLUMN2ELEMENTSGENERATOR_5
addindex = ClusterInput()
subindex = ClusterInput()
c1length = ClusterInput()
L = ClusterInput()
item = ListItem(List=L, Index=0, Wrap=True)  # -> Item, Item1, Item2, Item3, Item4, Item5, Item6, Item7, Item8
element_index = CSharpScript(addIndex=addindex, subIndex=subindex, c1Length=c1length)  # -> i, a, l; inputs addIndex: Boolean, subIndex: Boolean, c1Length: Int32
# ---------- element_index: C# ----------
    index.Clear();

    //ALL TIME ELEMENTS
    index.Add(0);
    index.Add(1);
    index.Add(2);

    //ADDITION SELECTION
    if (addIndex == true)
    {
      index.Add(3);
    }

    //SUBTRACTION SELECTION
    if (subIndex == true)
    {
      index.Add(4);
    }

    index.Add(5);
    index.Add(6);
    index.Add(7);

    //ADDITIONAL PLACEHOLDERS

    addPh = c1Length - index.Count;
    if (addPh <= 0)
    {
      addPh = 0;
    }
    if (addPh > 0){}

    //FINAL RESULTANT DATA

    i = index;
    a = addPh;
    l = index.Count;
# ---------- element_index: C# additional code ----------
  //Declare Value
  List<int> index = new List<int>();
  int addPh;
# ---------- end element_index ----------
panel = Panel(element_index.i)
panel_2 = Panel(element_index.a)
column_1_all_elements = Weave(
    Pattern=element_index.i,
    Stream0=item.Item,
    Stream1=item.Item1,
    Stream2=item.Item2,
    Stream3=item.Item3,
    Stream4=item.Item4,
    Stream5=item.Item5,
    Stream6=item.Item6,
    Stream7=item.Item7,
    Stream8=item.Item8,
    NullGaps=False)
panel_3 = Panel(column_1_all_elements)
placeholders = RepeatData(Data=item.Item8, Length=element_index.a)
column_1_all_elements_final = Merge(Data1=column_1_all_elements, Data2=placeholders)
R = ClusterOutput(column_1_all_elements_final)

# ==== cluster COLUMN1ELEMENTSGENERATOR_4
all_c1_elements = ClusterInput()  # All Elements for Column 1 as list
item = ListItem(List=all_c1_elements, Index=0, Wrap=True)  # -> Item, Item1, Item2, Item3, Item4, Item5, Item6, Item7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
inputindex = ClusterInput()
solidindex = ClusterInput()
extruindex = ClusterInput()
addindex = ClusterInput()
ainputindex = ClusterInput()
asolidindex = ClusterInput()
aextruindex = ClusterInput()
subindex = ClusterInput()
sinputindex = ClusterInput()
ssolidindex = ClusterInput()
sextruindex = ClusterInput()
subdindex = ClusterInput()
element_index = CSharpScript(
    inputIndex=inputindex,
    solidIndex=solidindex,
    extruIndex=extruindex,
    addIndex=addindex,
    ainputIndex=ainputindex,
    asolidIndex=asolidindex,
    aextruIndex=aextruindex,
    subIndex=subindex,
    sinputIndex=sinputindex,
    ssolidIndex=ssolidindex,
    sextruIndex=sextruindex,
    subDIndex=subdindex)  # -> i, a, l; inputs inputIndex: Int32, solidIndex: Boolean, extruIndex: Int32, addIndex: Boolean, ainputIndex: Int32, asolidIndex: Boolean, aextruIndex: Int32, subIndex: Boolean, sinputIndex: Int32, ssolidIndex: Boolean, sextruIndex: Int32, subDIndex: Boolean
# ---------- element_index: C# ----------
    index.Clear();

    //ALL TIME ELEMENTS
    index.Add(0);
    index.Add(1);
    index.Add(2);

    //PRIMARTY GEOMETRY ELEMETS


    index.Add(3);
    if (inputIndex == 0 || inputIndex == 1 || inputIndex == 2 || inputIndex == 3)
    {
      //LOFT INDEX
      if (inputIndex == 1)
      {
        index.Add(4);
      }

      //EXTRUSION INDEX
      if (inputIndex == 0 || inputIndex == 2)
      {
        index.Add(5);
      }

      //SOLID OFF | OFFSET DIRECTION
      if (solidIndex == false)
      {
        index.Add(6);
      }

      //TOOGLES
      //SOLID TOOGLE
      if (inputIndex == 0 || inputIndex == 1)
      {
        index.Add(7);
      }
      //FLIP NORMAL TOOGLE
      if (extruIndex == 1)
      {
        index.Add(8);
      }



      //SLIDERS
      //HEIGHT
      if (inputIndex == 0 || inputIndex == 2)
      {
        index.Add(9);
      }

      //WIDTH
      if (solidIndex == false)
      {
        index.Add(10);
      }

    }



    //ADDITIONAL GEOMETRY ELEMETS


    index.Add(11);

    if (addIndex == true)
    {
      index.Add(12);
      index.Add(13);
      if (ainputIndex == 0 || ainputIndex == 1 || ainputIndex == 2 || ainputIndex == 3 || ainputIndex == 4)
      {
        //LOFT INDEX
        if (ainputIndex == 1 || ainputIndex == 2)
        {
          index.Add(14);
        }

        //EXTRUSION INDEX
        if (ainputIndex == 0 || ainputIndex == 3)
        {
          index.Add(15);
        }

        //SOLID OFF | OFFSET DIRECTION
        if (asolidIndex == false)
        {
          index.Add(16);
        }

        //TOOGLES
        //SOLID TOOGLE
        if (ainputIndex == 0 || ainputIndex == 1 || ainputIndex == 2 || ainputIndex == 3)
        {
          index.Add(17);
        }
        //FLIP NORMAL TOOGLE
        if (aextruIndex == 1)
        {
          index.Add(18);
        }



        //SLIDERS
        //HEIGHT
        if (ainputIndex == 0 || ainputIndex == 3)
        {
          index.Add(19);
        }

        //WIDTH
        if (asolidIndex == false)
        {
          index.Add(20);
        }
      }
    }

    //SUBTRACTIONAL GEOMETRY ELEMETS


    index.Add(21);

    if (subIndex == true)
    {
      index.Add(22);
      index.Add(23);
      if (sinputIndex == 0 || sinputIndex == 1 || sinputIndex == 2 || sinputIndex == 3 || sinputIndex == 4)
      {
        //LOFT INDEX
        if (sinputIndex == 1 || sinputIndex == 2)
        {
          index.Add(24);
        }

        //EXTRUSION INDEX
        if (sinputIndex == 0 || sinputIndex == 3)
        {
          index.Add(25);
        }

        //SOLID OFF | OFFSET DIRECTION
        if (ssolidIndex == false)
        {
          index.Add(26);
        }

        //TOOGLES
        //SOLID TOOGLE
        if (sinputIndex == 0 || sinputIndex == 1 || sinputIndex == 2 || sinputIndex == 3)
        {
          index.Add(27);
        }
        //FLIP NORMAL TOOGLE
        if (sextruIndex == 1)
        {
          index.Add(28);
        }



        //SLIDERS
        //HEIGHT
        if (sinputIndex == 0 || sinputIndex == 3)
        {
          index.Add(29);
        }

        //WIDTH
        if (ssolidIndex == false)
        {
          index.Add(30);
        }
      }
    }


    //SUB-D PARAMS
    index.Add(31);

    if (subDIndex == true)
    {
      index.Add(32);
      index.Add(33);
    }

    //FINAL RESULTANT DATA

    i = index;
    l = index.Count;
# ---------- element_index: C# additional code ----------
  //Declare Value
  List<int> index = new List<int>();
# ---------- end element_index ----------
column_1_all_elements = Weave(
    Pattern=element_index.i,
    Stream0=item.Item,
    Stream1=item.Item1,
    Stream2=item.Item2,
    Stream3=item.Item3,
    Stream4=item.Item4,
    Stream5=item.Item5,
    Stream6=item.Item6,
    Stream7=item.Item7,
    Stream8=item.Item8,
    Stream9=item.Item9,
    Stream10=item.Item10,
    Stream11=item.Item11,
    Stream12=item.Item12,
    Stream13=item.Item13,
    Stream14=item.Item14,
    Stream15=item.Item15,
    Stream16=item.Item16,
    Stream17=item.Item17,
    Stream18=item.Item18,
    Stream19=item.Item19,
    Stream20=item.Item20,
    Stream21=item.Item21,
    Stream22=item.Item22,
    Stream23=item.Item23,
    Stream24=item.Item24,
    Stream25=item.Item25,
    Stream26=item.Item26,
    Stream27=item.Item27,
    Stream28=item.Item28,
    Stream29=item.Item29,
    Stream30=item.Item30,
    Stream31=item.Item31,
    Stream32=item.Item32,
    Stream33=item.Item33,
    NullGaps=False)
selected_element_indexies = Panel(element_index.i)
entwine = Entwine(Branch00=column_1_all_elements, FlattenInputs=True)  # -> flatten(Result)
repeat = RepeatData(Data=item.Item9, Length=element_index.a)
panel = Panel(entwine)
column_1_elements = ClusterOutput(entwine)
number_of_elements_in_column_1 = ClusterOutput(element_index.l)

# ==== cluster COLUMN2ELEMENTSGENERATOR_6
attindex = ClusterInput()
c1length = ClusterInput()
L = ClusterInput()
element_index = CSharpScript(attIndex=attindex, c1Length=c1length)  # -> i, a, l; inputs attIndex: Int32, c1Length: Int32
# ---------- element_index: C# ----------
    index.Clear();

    //ALL TIME ELEMENTS
    index.Add(0);
    index.Add(1);
    index.Add(2);
    index.Add(3);

    if (attIndex != 0)
    {
      index.Add(7);
    }

    index.Add(8);
    index.Add(4);
    index.Add(5);

    //ADDITIONAL PLACEHOLDERS

    addPh = c1Length - index.Count;
    if (addPh <= 0)
    {
      addPh = 0;
    }
    if (addPh > 0){}

    //FINAL RESULTANT DATA

    i = index;
    a = addPh;
    l = index.Count;
# ---------- element_index: C# additional code ----------
  //Declare Value
  List<int> index = new List<int>();
  int addPh;
# ---------- end element_index ----------
panel = Panel(element_index.i)
panel_2 = Panel(element_index.a)
item = ListItem(List=L, Index=0, Wrap=True)  # -> Item, Item1, Item2, Item3, Item4, Item5, Item6, Item7, Item8
column_1_all_elements = Weave(
    Pattern=element_index.i,
    Stream0=item.Item,
    Stream1=item.Item1,
    Stream2=item.Item2,
    Stream3=item.Item3,
    Stream4=item.Item4,
    Stream5=item.Item5,
    Stream6=item.Item6,
    Stream7=item.Item7,
    Stream8=item.Item8,
    NullGaps=False)
panel_3 = Panel(column_1_all_elements)
placeholders = RepeatData(Data=item.Item6, Length=element_index.a)
column_1_all_elements_final = Merge(Data1=column_1_all_elements, Data2=placeholders)
R = ClusterOutput(column_1_all_elements_final)

# ==== cluster COLUMN1ELEMENTSGENERATOR_5
all_c1_elements = ClusterInput()  # All Elements for Column 1 as list
item = ListItem(List=all_c1_elements, Index=0, Wrap=True)  # -> Item, Item1, Item2, Item3, Item4, Item5, Item6, Item7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
objinput = ClusterInput()
rotationindex = ClusterInput()
scatterindex = ClusterInput()
snapindex = ClusterInput()
scaleindex = ClusterInput()
attindex = ClusterInput()
element_index = CSharpScript(
    objInput=objinput,
    rotationIndex=rotationindex,
    scatterIndex=scatterindex,
    snapIndex=snapindex,
    scaleIndex=scaleindex,
    attIndex=attindex)  # -> i, a, l; inputs objInput: Int32, rotationIndex: Int32, scatterIndex: Int32, snapIndex: Int32, scaleIndex: Int32, attIndex: Int32
# ---------- element_index: C# ----------
    index.Clear();

    //ALL TIME ELEMENTS
    index.Add(0);
    index.Add(1);
    index.Add(2);

    //MENUS
    index.Add(3);
    index.Add(22);

    //CENTER INDEX
    if (objInput == 1)
    {
      index.Add(4);
    }

    index.Add(5);

    //SCATTER INDEX
    if (attIndex == 0)
    {
      index.Add(6);
    }


    //ROTATION PARAMS
    index.Add(7);
    if (rotationIndex == 1)
    {
      index.Add(8);
    }

    //SCALE PARAM
    if (attIndex == 0)
    {
      index.Add(9);
    }

    //FLIP PARAM
    index.Add(10);

    //OFFSET PARAM
    index.Add(11);

    //SCATTER PARAMS
    if (scatterIndex == 0)
    {
      index.Add(13);
      index.Add(14);
    }
    if (scatterIndex == 1)
    {
      index.Add(12);
    }


    //ANGLE PARAMS
    index.Add(15);
    if (rotationIndex == 1 || attIndex == 1 || attIndex == 2)
    {
      index.Add(16);
      index.Add(18);
    }
    if (snapIndex == 1)
    {
      index.Add(17);
    }


    //SCALE PARAMS
    index.Add(19);
    if (scaleIndex == 1 || attIndex == 1 || attIndex == 2)
    {
      index.Add(20);
      index.Add(21);
    }


    //FIANL RESULTANT DATA
    l = index.Count;
    i = index;
# ---------- element_index: C# additional code ----------
  //Declare Value
  List<int> index = new List<int>();
# ---------- end element_index ----------
column_1_all_elements = Weave(
    Pattern=element_index.i,
    Stream0=item.Item,
    Stream1=item.Item1,
    Stream2=item.Item2,
    Stream3=item.Item3,
    Stream4=item.Item4,
    Stream5=item.Item5,
    Stream6=item.Item6,
    Stream7=item.Item7,
    Stream8=item.Item8,
    Stream9=item.Item9,
    Stream10=item.Item10,
    Stream11=item.Item11,
    Stream12=item.Item12,
    Stream13=item.Item13,
    Stream14=item.Item14,
    Stream15=item.Item15,
    Stream16=item.Item16,
    Stream17=item.Item17,
    Stream18=item.Item18,
    Stream19=item.Item19,
    Stream20=item.Item20,
    Stream21=item.Item21,
    Stream22=item.Item22,
    NullGaps=False)
selected_element_indexies = Panel(element_index.i)
c_1_elements = Merge(Data1=column_1_all_elements)
placeholder = RepeatData(Length=element_index.a)
panel = Panel(c_1_elements)
column_1_elements = ClusterOutput(c_1_elements)
number_of_elements_in_column_1 = ClusterOutput(element_index.l)

# ==== cluster COLUMN1ELEMENTSGENERATOR_6
all_c1_elements = ClusterInput()  # All Elements for Column 1 as list
inputindex = ClusterInput()
item = ListItem(List=all_c1_elements, Index=0, Wrap=True)  # -> Item, Item1, Item2, Item3, Item4, Item5, Item6, Item7, Item8
element_index = CSharpScript(inputIndex=inputindex)  # -> i, a, l; inputs inputIndex: Int32
# ---------- element_index: C# ----------
    index.Clear();

    //ALL TIME ELEMENTS
    index.Add(0);
    index.Add(1);
    index.Add(2);
    index.Add(3);
    index.Add(4);
    index.Add(5);
    index.Add(6);
    index.Add(7);
    index.Add(8);


    //FIANL RESULTANT DATA
    l = index.Count;
    i = index;
# ---------- element_index: C# additional code ----------
  //Declare Value
  List<int> index = new List<int>();
# ---------- end element_index ----------
column_1_all_elements = Weave(
    Pattern=element_index.i,
    Stream0=item.Item,
    Stream1=item.Item1,
    Stream2=item.Item2,
    Stream3=item.Item3,
    Stream4=item.Item4,
    Stream5=item.Item5,
    Stream6=item.Item6,
    Stream7=item.Item7,
    Stream8=item.Item8,
    NullGaps=False)
selected_element_indexies = Panel(element_index.i)
c_1_elements = Merge(Data1=column_1_all_elements)
placeholder = RepeatData(Length=element_index.a)
panel = Panel(c_1_elements)
column_1_elements = ClusterOutput(c_1_elements)
number_of_elements_in_column_1 = ClusterOutput(element_index.l)

# ==== cluster Beam3D
C = ClusterInput()
pframe = PerpFrame(Curve=reparameterize(graft(C)), Parameter=[0, 1])
Z = UnitZ(Factor=1)
W = ClusterInput()
D = ClusterInput()
wt = ClusterInput()
ft = ClusterInput()
align = AlignPlane(Plane=pframe, Direction=Z)  # -> Plane, Angle
prot = RotatePlane(Plane=align.Plane, Angle=degrees(90))
beamsection = BeamSection(origin=prot, flange_width=W, beam_depth=D, web_thickness=wt, flange_thickness=ft)
item = ListItem(List=beamsection, Index=0, Wrap=True)
swp1 = Sweep1(Rail=graft(C), Sections=item, Miter=1)
cap = CapHoles(Brep=swp1)
trim = TrimTree(Tree=cap, Depth=1)
beam_brep = ClusterOutput(trim)

# ==== cluster MatchDir_3: Flip and Match Direction of all Curves.
C = ClusterInput()
item = ListItem(List=C, Index=0, Wrap=True)
flip = FlipCurve(Curve=C, Guide=item)  # -> Curve, Flag
C_2 = ClusterOutput(flip.Curve)

# ==== cluster UNITS_36
relay = ClusterInput()
dom = ConstructDomain(DomainStart=Slider(0, range=0..5), DomainEnd=Slider(60, range=0.1..60))
dom_2 = ConstructDomain(DomainStart=Slider(0, range=0..5), DomainEnd=Slider(5, range=0.1..5))
dom_3 = ConstructDomain(DomainStart=Slider(0, range=0..5), DomainEnd=Slider(3, range=0.1..5))
set_value = Weave(Pattern=relay, Stream0="0", Stream1="0", Stream2="0", NullGaps=False)
range = Weave(Pattern=relay, Stream0=dom, Stream1=dom_2, Stream2=dom_3, NullGaps=False)
W = ClusterOutput(set_value)
W_2 = ClusterOutput(range)

# ==== cluster UNITS_37
relay = ClusterInput()
dom = ConstructDomain(DomainStart=Slider(0.1, range=0..5), DomainEnd=Slider(8.5, range=0.1..60))
dom_2 = ConstructDomain(DomainStart=Slider(0.01, range=0..5), DomainEnd=Slider(1, range=0.1..5))
dom_3 = ConstructDomain(DomainStart=Slider(0.01, range=0..5), DomainEnd=Slider(0.25, range=0.1..5))
set_value = Weave(Pattern=relay, Stream0="7", Stream1="0.583", Stream2="0.178", NullGaps=False)
range = Weave(Pattern=relay, Stream0=dom, Stream1=dom_2, Stream2=dom_3, NullGaps=False)
W = ClusterOutput(set_value)
W_2 = ClusterOutput(range)

# ==== cluster UNITS_38
relay = ClusterInput()
dom = ConstructDomain(DomainStart=Slider(0.1, range=0..5), DomainEnd=Slider(12, range=0.1..60))
dom_2 = ConstructDomain(DomainStart=Slider(0.01, range=0..5), DomainEnd=Slider(1, range=0.1..5))
dom_3 = ConstructDomain(DomainStart=Slider(0.01, range=0..5), DomainEnd=Slider(0.5, range=0.1..5))
set_value = Weave(Pattern=relay, Stream0="11", Stream1="0.917", Stream2="0.279", NullGaps=False)
range = Weave(Pattern=relay, Stream0=dom, Stream1=dom_2, Stream2=dom_3, NullGaps=False)
W = ClusterOutput(set_value)
W_2 = ClusterOutput(range)

# ==== cluster UNITS_39
relay = ClusterInput()
dom = ConstructDomain(DomainStart=Slider(0.01, range=0.01..6), DomainEnd=Slider(2, range=0.1..250))
dom_2 = ConstructDomain(DomainStart=Slider(0.001, range=0.001..5), DomainEnd=Slider(0.2, range=0.1..30))
dom_3 = ConstructDomain(DomainStart=Slider(0.001, range=0.001..5), DomainEnd=Slider(0.1, range=0.1..10))
set_value = Weave(Pattern=relay, Stream0="1", Stream1="0.083", Stream2="0.025", NullGaps=False)
range = Weave(Pattern=relay, Stream0=dom, Stream1=dom_2, Stream2=dom_3, NullGaps=False)
W = ClusterOutput(set_value)
W_2 = ClusterOutput(range)

# ==== cluster UNITS_40
relay = ClusterInput()
dom = ConstructDomain(DomainStart=Slider(0.01, range=0.01..6), DomainEnd=Slider(12, range=0.1..250))
dom_2 = ConstructDomain(DomainStart=Slider(0.001, range=0.001..5), DomainEnd=Slider(1, range=0.1..30))
dom_3 = ConstructDomain(DomainStart=Slider(0.001, range=0.001..5), DomainEnd=Slider(0.5, range=0.1..10))
set_value = Weave(Pattern=relay, Stream0="3", Stream1="0.25", Stream2="0.076", NullGaps=False)
range = Weave(Pattern=relay, Stream0=dom, Stream1=dom_2, Stream2=dom_3, NullGaps=False)
W = ClusterOutput(set_value)
W_2 = ClusterOutput(range)

# ==== cluster UNITS_41
relay = ClusterInput()
dom = ConstructDomain(DomainStart=Slider(0.1, range=0.1..5), DomainEnd=Slider(36, range=0.1..144))
dom_2 = ConstructDomain(DomainStart=Slider(0.01, range=0.01..5), DomainEnd=Slider(3, range=0.1..5))
dom_3 = ConstructDomain(DomainStart=Slider(0.01, range=0.01..5), DomainEnd=Slider(0.5, range=0.1..5))
set_value = Weave(Pattern=relay, Stream0="6", Stream1="0.5", Stream2="0.15", NullGaps=False)
range = Weave(Pattern=relay, Stream0=dom, Stream1=dom_2, Stream2=dom_3, NullGaps=False)
W = ClusterOutput(set_value)
W_2 = ClusterOutput(range)

# ==== cluster UNITS_42
relay = ClusterInput()
dom = ConstructDomain(DomainStart=Slider(0.01, range=0.01..6), DomainEnd=Slider(2, range=0.1..250))
dom_2 = ConstructDomain(DomainStart=Slider(0.001, range=0.001..5), DomainEnd=Slider(0.2, range=0.1..30))
dom_3 = ConstructDomain(DomainStart=Slider(0.001, range=0.001..5), DomainEnd=Slider(0.1, range=0.1..10))
set_value = Weave(Pattern=relay, Stream0="0.36", Stream1="0.030", Stream2="0.009", NullGaps=False)
range = Weave(Pattern=relay, Stream0=dom, Stream1=dom_2, Stream2=dom_3, NullGaps=False)
W = ClusterOutput(set_value)
W_2 = ClusterOutput(range)

# ==== cluster UNITS_43
relay = ClusterInput()
dom = ConstructDomain(DomainStart=Slider(0.01, range=0.01..6), DomainEnd=Slider(2, range=0.1..250))
dom_2 = ConstructDomain(DomainStart=Slider(0.001, range=0.001..5), DomainEnd=Slider(0.2, range=0.1..30))
dom_3 = ConstructDomain(DomainStart=Slider(0.001, range=0.001..5), DomainEnd=Slider(0.1, range=0.1..10))
set_value = Weave(Pattern=relay, Stream0="0.6", Stream1="0.05", Stream2="0.015", NullGaps=False)
range = Weave(Pattern=relay, Stream0=dom, Stream1=dom_2, Stream2=dom_3, NullGaps=False)
W = ClusterOutput(set_value)
W_2 = ClusterOutput(range)

# ==== cluster ImgPath
filename = ClusterInput()
filepath = ClusterInput()
rep = ReplaceText(Text=filename, Find="*", RecursiveReplace=False)
len = TextLength(Text=filepath)
len_2 = TextLength(Text=rep)
subtraction = Subtraction(A=len, B=len_2)
fragment = TextFragment(Text=filepath, Start=0, Count=expr("x-3", subtraction))
merge = Merge(Data1=fragment, Data2="img\")
join = TextJoin(Text=merge)
R = ClusterOutput(join)

# ==== cluster MatchCrvs
crv = ClusterInput()
crv_2 = Curve(crv)
item = ListItem(List=flatten(crv_2), Index=0, Wrap=True)
flip = FlipCurve(Curve=crv_2, Guide=item)  # -> Curve, Flag
C = ClusterOutput(flip.Curve)

# ==== cluster SortGeoTypes
rhobj = ClusterInput()
sortbytype = SortObjectsByType(RhinoObjects=rhobj)  # -> Points, Curves, Surfaces, Breps, Meshes, TextObjects, HatchObjects, LightObjects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

# ---- group: F || Create Srf from Border Crv
cls = Closed(Curve=sortbytype.Curves)  # -> Closed, Periodic
dispatch = Dispatch(List=sortbytype.Curves, DispatchPattern=cls.Closed)  # -> ListA, ListB
crv = Curve(dispatch.ListA)
item = ListItem(List=flatten(crv), Index=0, Wrap=True)
flip = FlipCurve(Curve=crv, Guide=item)  # -> Curve, Flag
explode = Explode(Curve=flip.Curve, Recursive=True)  # -> Segments, Vertices
item_2 = ListItem(List=explode.Segments, Index=0, Wrap=True)  # -> Item, Item1, Item2, Item3
edgesrf = EdgeSurface(CurveA=item_2.Item, CurveB=item_2.Item1, CurveC=item_2.Item2, CurveD=item_2.Item3)

# ----
debrep = DeconstructBrep(Brep=sortbytype.Breps)  # -> Faces, Edges, Vertices
merge = Merge(Data1=edgesrf, Data2=sortbytype.Surfaces, Data3=debrep.Faces)  # -> flatten(Result)
clean = CleanTree(RemoveNulls=True, RemoveInvalid=True, RemoveEmpty=False, Tree=merge)
panel = Panel(clean)
T = ClusterOutput(clean)

# ==== cluster FilterCO
curves = ClusterInput()  # Curves for testing
cls = Closed(Curve=curves)  # -> Closed, Periodic
dispatch = Dispatch(List=curves, DispatchPattern=cls.Closed)  # -> ListA, ListB
closed_curves = ClusterOutput(dispatch.ListA)
open_curves = ClusterOutput(dispatch.ListB)

# ==== cluster BeamSection
origin = ClusterInput()  # Origin of Cross Section
flange_width = ClusterInput()  # Flange Width
beam_depth = ClusterInput()  # Beam Depth
web_thickness = ClusterInput()  # Web Thickness
flange_thickness = ClusterInput()  # Flange Thickness
division = Division(A=beam_depth, B=2)
expression = Expression(x=division, y=web_thickness, Expression="(x)-(0.5*y)")
expression_2 = Expression(x=division, y=web_thickness, Expression="(2*x)-(y)")
rectangle = Rectangle(plane=origin, length=flange_width, width=web_thickness, radius=0)  # -> rectangle_2, length_2
rectangle_2 = Rectangle(plane=origin, length=flange_thickness, width=expression_2, radius=0)  # -> rectangle_2, length_2
deplane = DeconstructPlane(Plane=origin)  # -> Origin, XAxis, YAxis, ZAxis
crv = Curve(rectangle.rectangle_2)
amp = Amplitude(Vector=deplane.YAxis, Amplitude=expression)
neg = Negative(Value=amp)
move = Move(Geometry=crv, Motion=amp)  # -> Geometry, Transform
move_2 = Move(Geometry=crv, Motion=neg)  # -> Geometry, Transform
merge = Merge(Data1=graft(move.Geometry), Data2=graft(move_2.Geometry), Data3=graft(rectangle_2.rectangle_2))
runion = RegionUnion(Curves=merge)
trim = TrimTree(Tree=runion, Depth=2)
merge_2 = Panel(merge)
union = Panel(runion)
trim_tree = Panel(trim)
T = ClusterOutput(trim)
